# Grasshopper definition Area Cals.ghx (Grasshopper 1.0.7)
# plug-ins: Redback, Human

panel = Panel("""0.7
0.8""")
input = DataInput(Destination="C:\Users\b-mbuckley\Documents\Hackathon2018\Curve Method.ghdata")  # -> Roof, Roof_Properties, Full_Mass, Full_Mass_Properties, Facade, Facade_Properties, Floorplates, Floorplate_Properties
panel_2 = Panel("""Resi
Com""")
dpipeline = DynamicGeometryPipeline(
    LayerFilter="Site",
    TypeFilter="Curve",
    NameFilter="*",
    GroupByLayer=False,
    GroupByType=False,
    IncludeHidden=True,
    IncludeLocked=True,
    enableFullPath=False,
    listenToAttributes=True)
json = JSON(Key=panel_2, Value=panel)
cluster = Cluster(
    efficiency_ref_json=json,
    roof=input.Roof,
    roof_properties=input.Roof_Properties,
    floorplates=input.Floorplates,
    floorplate_properties=input.Floorplate_Properties,
    site_curves=dpipeline)  # -> area_json_2, building_info_json_2
path = FilePath("C:\Users\b-mbuckley\Documents\Hackathon2018\")
output = DataOutput(
    Area_Cal=cluster.area_json_2,
    Building_Info_Json=cluster.building_info_json_2,
    Destination="C:\Users\b-mbuckley\Documents\Hackathon2018\Area Cals. Json.ghdata")
write_file = WRITEFILE(content=cluster.area_json_2, filepath=path, filename="Areacal.json", activate=Button())
panel_3 = Panel(path)
target_apartment_size = Panel("""55
75
95""")
target_apartment_mix = Panel("""0.3
0.5
0.2""")
apartment_type = Panel("""1 Bed
2 Bed
3 Bed""")
cluster_2 = Cluster_2(
    apartment_type=apartment_type,
    nsa=Slider(8000, range=0..10000),
    target_apartment_size=target_apartment_size,
    target_apartment_mix=target_apartment_mix)  # -> apartment_type_mix_json_2, remainding_area_2
input_2 = DataInput(Destination="C:\Users\b-mbuckley\Documents\Hackathon2018\Area Cals.ghdata")  # -> Area_Cal, Building_Info_Json
panel_4 = Panel(input_2.Area_Cal)
panel_5 = Panel(cluster_2.remainding_area_2)
panel_6 = Panel(cluster_2.apartment_type_mix_json_2)

# ==== cluster Cluster
efficiency_ref_json = ClusterInput()
roof = ClusterInput()
roof_properties = ClusterInput()
roof_properties_2 = Data(roof_properties)
floorplates = ClusterInput()
floorplate_properties = ClusterInput()
site_curves = ClusterInput()
roof_2 = Data(roof)
floorplate_properties_2 = Data(floorplate_properties)
efficiency_ref_json_2 = Data(efficiency_ref_json)
floorplates_2 = Data(floorplates)
site_curves_2 = Surface(site_curves)
area = Area(Geometry=site_curves_2)  # -> Area, Centroid
area_2 = Area(Geometry=floorplates_2)  # -> Area, Centroid
area_3 = Area(Geometry=floorplates_2)  # -> Area, Centroid
read = ReadJSON(Object=floorplate_properties_2, Key="BuildID")
read_2 = ReadJSON(Object=floorplate_properties_2, Key="SubBuildID")
read_3 = ReadJSON(Object=floorplate_properties_2, Key="RL")
read_4 = ReadJSON(Object=floorplate_properties_2, Key="Typology")
ma = MassAddition(Input=flatten(area_3.Area))  # -> Result, PartialResults
flatten = FlattenTree(Tree=read_4, Path="{0}")
pdecon = Deconstruct(Point=area_2.Centroid)  # -> XComponent, YComponent, ZComponent
data = Data(read)
cset = CreateSet(List=flatten)  # -> Set, Map
flatten_2 = FlattenTree(Tree=data, Path="{0}")
division = Division(A=ma.Result, B=area.Area)
cset_2 = CreateSet(List=flatten_2)  # -> Set, Map
multiplication = Multiplication(A=division, B=100)
python = GhPythonScript(ID=read_2)  # -> StackID
# ---------- python: Python ----------
__author__ = "B-MBuckley"
__version__ = "2018.10.25"

import rhinoscriptsyntax as rs

StackID = []

for i in range(len(ID)-1):
    StackID.append(ID[0:i+1])
# ---------- end python ----------
panel = Panel(read_2)
mindex = MemberIndex(Set=flatten_2, Member=cset_2.Set)  # -> Index, Count
round = Round(Number=multiplication)  # -> Nearest, Floor, Ceiling
sort = SortList(Keys=pdecon.ZComponent, ValuesA=area_2.Area)  # -> Keys, ValuesA
read_5 = ReadJSON(Object=efficiency_ref_json_2, Key=cset.Set)
sort_2 = SortList(Keys=pdecon.ZComponent, ValuesA=read_2)  # -> Keys, ValuesA
sort_3 = SortList(Keys=pdecon.ZComponent, ValuesA=area_2.Centroid)  # -> Keys, ValuesA
sort_4 = SortList(Keys=pdecon.ZComponent, ValuesA=area_2.Centroid)  # -> Keys, ValuesA
sort_5 = SortList(Keys=pdecon.ZComponent, ValuesA=read)  # -> Keys, ValuesA
sort_6 = SortList(Keys=pdecon.ZComponent, ValuesA=read_4)  # -> Keys, ValuesA
sort_7 = SortList(Keys=pdecon.ZComponent, ValuesA=read_3)  # -> Keys, ValuesA
division_2 = Division(A=round.Nearest, B=100)
mindex_2 = MemberIndex(Set=panel, Member=python)  # -> Index, Count
item = ListItem(List=read_2, Index=mindex.Index, Wrap=True)
item_2 = ListItem(List=read, Index=mindex.Index, Wrap=True)
panel_2 = Panel(round.Nearest)
multiplication_2 = Multiplication(A=read_5, B=sort.ValuesA)
long = LongestList(
    ListA=sort.ValuesA,
    ListB=sort_5.ValuesA,
    ListC=sort_2.ValuesA,
    ListD=sort_6.ValuesA,
    ListE=sort_7.ValuesA,
    ListF=sort_3.ValuesA,
    PaddingMode=2)  # -> ListA, ListB, ListC, ListD, ListE, ListF
panel_4 = Panel(long.ListF)
panel_5 = Panel(long.ListC)
panel_6 = Panel(sort.ValuesA)
panel_7 = Panel(long.ListE)
panel_8 = Panel(long.ListB)
panel_9 = Panel(long.ListD)
graft = GraftTree(Tree=panel_7, IncludeEmptyLists=True, IncludeNullItems=True)  # -> simplify(Tree)
trim = TrimTree(Tree=graft, Depth=1)
cset_3 = CreateSet(List=trim)  # -> Set, Map
panel_10 = Panel(graft)
mindex_3 = MemberIndex(Set=trim, Member=cset_3.Set)  # -> Index, Count
lng = ListLength(List=cset_3.Set)
series = Series(Start=0, Step=1, Count=lng)
replace = ReplaceItems(List=series, Item="G", Indices="0", Wrap=False)
graft_2 = GraftTree(Tree=multiplication_2, IncludeEmptyLists=True, IncludeNullItems=True)  # -> simplify(Tree)
graft_3 = GraftTree(Tree=panel_7, IncludeEmptyLists=True, IncludeNullItems=True)  # -> simplify(Tree)
trim_2 = TrimTree(Tree=mindex_3.Index, Depth=1)
graft_4 = GraftTree(Tree=panel_8, IncludeEmptyLists=True, IncludeNullItems=True)  # -> simplify(Tree)
graft_5 = GraftTree(Tree=panel_6, IncludeEmptyLists=True, IncludeNullItems=True)  # -> simplify(Tree)
graft_6 = GraftTree(Tree=panel_5, IncludeEmptyLists=True, IncludeNullItems=True)  # -> simplify(Tree)
graft_7 = GraftTree(Tree=panel_9, IncludeEmptyLists=True, IncludeNullItems=True)  # -> simplify(Tree)
concat = Concatenate(FragmentA="Level ", FragmentB=replace)  # -> simplify(graft(Result))
round_2 = Round(Number=graft_5)  # -> Nearest, Floor, Ceiling
round_3 = Round(Number=graft_2)  # -> Nearest, Floor, Ceiling
viewer = ParamViewer(round_2.Nearest)
long_2 = LongestList(ListA=mindex_3.Index, ListB=concat, PaddingMode=2)  # -> ListA, ListB
trim_3 = TrimTree(Tree=long_2.ListB, Depth=1)
sort_8 = SortList(Keys=trim_2, ValuesA=trim_3)  # -> Keys, graft(ValuesA)
panel_11 = Panel("""BuildID
GBA
SubBuildID
Typology
NSA-NLA
RL
Level Names""")
merge = Merge(
    Data1=graft_4,
    Data2=round_2.Nearest,
    Data3=graft_6,
    Data4=graft_7,
    Data5=round_3.Nearest,
    Data6=graft_3,
    Data7=sort_8.ValuesA)
panel_12 = Panel(long_2.ListB)
data_2 = Data(sort_5.ValuesA)
trim_4 = TrimTree(Tree=long_2.ListB, Depth=1)
panel_13 = Panel("0,0")
data_3 = Data(sort_5.ValuesA)
json = JSON(Key=panel_11, Value=merge)
cset_4 = CreateSet(List=trim_4)  # -> Set, Map
tag = TextTag(Location=graft(sort_4.ValuesA), Text=round_2.Nearest, Colour=ColourSwatch(SwatchColor=RGB(255, 0, 0)))
flatten_3 = FlattenTree(Tree=data_3, Path="{0}")
flatten_4 = FlattenTree(Tree=data_2, Path="{0}")
data_4 = Data(division_2)
lng_2 = ListLength(List=cset_4.Set)
shift = ShiftPaths(Data=json, Offset=-1)
cset_5 = CreateSet(List=flatten_3)  # -> Set, Map
data_5 = Data(lng_2)
mindex_4 = MemberIndex(Set=flatten_3, Member=cset_5.Set)  # -> Index, Count
trim_5 = TrimTree(Tree=data_4, Depth=1)
panel_14 = Panel(data_4)
python_2 = GhPythonScript(List=shift)  # -> JSON; inputs List: list
# ---------- python_2: Python ----------
__author__ = "B-MBuckley"
__version__ = "2018.10.25"

import rhinoscriptsyntax as rs
import json

outob = []
for i in List:
    outob.append(json.loads(i))

JSON = json.dumps(outob)
# ---------- end python_2 ----------
panel_15 = Panel("""Building Number of Levels
Site FSR""")
merge_2 = Merge(Data1=data_5, Data2=trim_5)
item_3 = ListItem(List=python_2, Index=mindex_4.Index, Wrap=True)
item_4 = ListItem(List=flatten_4, Index=mindex_4.Index, Wrap=True)
json_2 = JSON(Key=panel_15, Value=merge_2)
json_3 = JSON(Key=item_4, Value=item_3)
area_json = Data(python_2)
building_info_json = Data(json_2)
panel_16 = Panel(area_json)
building_info_json_2 = ClusterOutput(building_info_json)

# ---- group: Cluster Output
area_json_2 = ClusterOutput(area_json)

# ==== cluster Cluster_2
target_apartment_size = ClusterInput()
target_apartment_mix = ClusterInput()
apartment_type = ClusterInput()
target_apartment_size_2 = Data(target_apartment_size)
target_apartment_mix_2 = Data(target_apartment_mix)
apartment_type_2 = Data(apartment_type)
panel = Panel("""Apartment Type
Target Apartment Size
Target Apartment Mix""")
merge = Merge(Data1=graft(apartment_type_2), Data2=graft(target_apartment_size_2), Data3=graft(target_apartment_mix_2))
json = JSON(Key=panel, Value=merge)
data = Data(json)
read = ReadJSON(Object=data, Key="Apartment Type")
read_2 = ReadJSON(Object=data, Key="Target Apartment Size")
read_3 = ReadJSON(Object=data, Key="Target Apartment Mix")
multiplication = Multiplication(A=read_2, B=read_3)
flip = FlipMatrix(Data=multiplication)
ma = MassAddition(Input=flatten(flip))  # -> Result, PartialResults
nsa = ClusterInput()
division = Division(A=multiplication, B=ma.Result)
multiplication_2 = Multiplication(NSA=nsa, B=division)
division_2 = Division(A=multiplication_2, B=read_2)
mod = Modulus(A=multiplication_2, B=read_2)
panel_2 = Panel("""Apartment Type
Unit Count""")
flip_2 = FlipMatrix(Data=mod)
round = Round(Number=division_2)  # -> Nearest, Floor, Ceiling
ma_2 = MassAddition(Input=flip_2)  # -> Result, PartialResults
merge_2 = Merge(Data1=read, Data2=round.Floor)
json_2 = JSON(Key=panel_2, Value=merge_2)
remainding_area = Data(ma_2.Result)
apartment_type_mix_json = Data(json_2)
remainding_area_2 = ClusterOutput(remainding_area)
apartment_type_mix_json_2 = ClusterOutput(apartment_type_mix_json)

# ==== cluster WRITEFILE: Writes files, also checks for python objects and converts them to text before writing.
activate = ClusterInput()
content = ClusterInput()
filename = ClusterInput()
filepath = ClusterInput()
python = GhPythonScript(CONTENT=content, FILEPATH=filepath, FILENAME=filename, ACTIVATE=activate)  # inputs CONTENT: list
# ---------- python: Python ----------
__author__ = "s-abutler"
__version__ = "2018.09.10"

import rhinoscriptsyntax as rs
from json import dumps
def check(o):
#    print(str(type(o)))
#    return o
    if str(type(o)) == "<type 'dict'>":
        return dumps(o)
    else:
        return o
if ACTIVATE:
    con = list(map(lambda u: check(u), CONTENT))
    conwrite = "\n".join(con)
    dir = FILEPATH+"\\"+FILENAME
    with open(dir,'w') as f:
        f.write(conwrite)
# ---------- end python ----------
