# Grasshopper definition BOX.gh (Grasshopper 1.0.7)
# Copyright: Co-de-iT

geo = Geometry(<brep referenced from the Rhino model>)
rep = ReplaceText(Text="1:500", Find=":", Replace="/", RecursiveReplace=False)
scale = Scale(Geometry=geo, Center=Point(0, 0, 0), Factor=rep)  # -> Geometry, Transform
geo_2 = Geometry([<brep referenced from the Rhino model> x2])
geo_3 = Geometry(<brep referenced from the Rhino model>)
material_thickness = Slider(1, range=0..10)
tab_length = Slider(3.2, range=0..10)
dispatch = Dispatch(List=geo_2, DispatchPattern=[True, False])  # -> ListA, ListB
xy = XYPlane(Origin=Point(0, 0, 0))
debrep = DeconstructBrep(Brep=scale.Geometry)  # -> Faces, Edges, Vertices
item = ListItem(List=debrep.Faces, Index=[-1, -2], Wrap=True)  # -> flatten(Item)
item_2 = ListItem(List=scale.Geometry, Index=2, Wrap=True)
bbx = BrepBrep(BrepA=dispatch.ListA, BrepB=dispatch.ListB)  # -> Curves, Points
rep_2 = ReplaceText(Text="1:200", Find=":", Replace="/", RecursiveReplace=False)
number_slider = Slider(2, range=0..10)
cull_i = CullIndex(List=debrep.Faces, Indices=[-1, -2], Wrap=True)
scale_2 = Scale(Geometry=bbx.Curves, Center=Point(0, 0, 0), Factor=rep)  # -> Geometry, Transform
scale_3 = Scale(Geometry=geo_3, Center=Point(0, 0, 0), Factor=rep_2)  # -> Geometry, Transform
explode = Explode(Curve=scale_2.Geometry, Recursive=True)  # -> flatten(Segments), Vertices
evalsrf = EvaluateSurface(Surface=reparameterize(item), Point=Point(0, 0, 0))  # -> Point, Normal, Frame
dim = Dimensions(Surface=cull_i)  # -> UDimension, VDimension
item_3 = ListItem(List=dim.VDimension, Index=0, Wrap=True)  # -> flatten(Item)
debrep_2 = DeconstructBrep(Brep=scale_3.Geometry)  # -> Faces, Edges, Vertices
geo_4 = Geometry(cull_i)
consec = ConsecutiveDomains(Numbers=item_3, Additive=True)
expression = Expression(x=dim.UDimension, y=number_slider, Expression="x-y")
graft = GraftTree(Tree=geo_4, IncludeEmptyLists=True, IncludeNullItems=True)
eval = EvaluateLength(Curve=explode.Segments, Length=0.5, Normalized=True)  # -> Point, Tangent, Parameter
xy_2 = XYPlane(Origin=Point(0, 0, 0))
geo_5 = Geometry(debrep_2.Faces)
consec_2 = ConsecutiveDomains(Numbers=expression, Additive=True)
neg = Negative(Value=number_slider)
dedomain = DeconstructDomain(Domain=consec)  # -> Start, End
int = Integer(0)
dedomain_2 = DeconstructDomain(Domain=consec_2)  # -> Start, End
orient = Orient(Geometry=item, Source=evalsrf.Frame, Target=xy_2)  # -> Geometry, Transform
bbox = BoundingBox(Content=orient.Geometry, Plane=xy)  # -> Box, Box_2
debox = DeconstructBox(Box=bbox.Box)  # -> Plane, X, Y, Z
dedomain_3 = DeconstructDomain(Domain=debox.X)  # -> Start, End
expression_2 = Expression(x=dedomain_3.Start, y=dedomain_3.End, Expression="y-x")
consec_3 = ConsecutiveDomains(Numbers=expression_2, Additive=True)
dedomain_4 = DeconstructDomain(Domain=consec_3)  # -> Start, End
item_4 = ListItem(List=dedomain_4.Start, Index=0, Wrap=True)
srf_cp = SurfaceClosestPoint(Point=eval.Point, Surface=graft)  # -> Point, UVPoint, Distance
item_5 = ListItem(List=dedomain.Start, Index=0, Wrap=True)
int_2 = Integer(0)
long = LongestList(ListA=int, ListB=item_4, PaddingMode=2)  # -> ListA, ListB
int_3 = Integer(0)
item_6 = ListItem(List=dedomain_2.Start, Index=0, Wrap=True)
expression_3 = Expression(x=srf_cp.Distance, Expression="x<1")
area = Area(Geometry=geo_5)  # -> Area, Centroid
long_2 = LongestList(ListA=int_2, ListB=item_5, PaddingMode=2)  # -> ListA, ListB
merge = Merge(Data1=simplify(long.ListA), Data2=simplify(dedomain_4.Start))
long_3 = LongestList(ListA=int_3, ListB=item_6, PaddingMode=2)  # -> ListA, ListB
dispatch_2 = Dispatch(List=explode.Segments, DispatchPattern=expression_3)  # -> ListA, ListB
merge_2 = Merge(Data1=simplify(long_2.ListA), Data2=simplify(dedomain.Start))  # -> graft(Result)
pt = ConstructPoint(XCoordinate=merge, YCoordinate=0, ZCoordinate=0)
pdecon = Deconstruct(Point=area.Centroid)  # -> XComponent, YComponent, ZComponent
merge_3 = Merge(Data1=simplify(long_3.ListA), Data2=simplify(dedomain_2.Start))
pt_2 = ConstructPoint(XCoordinate=merge_3, YCoordinate=expr("x+450", merge_2), ZCoordinate=0)
crv = Curve(simplify(dispatch_2.ListA))
xy_3 = XYPlane(Origin=pt)
sort = SortList(Keys=pdecon.ZComponent, ValuesA=geo_5, ValuesB=area.Centroid)  # -> Keys, ValuesA, ValuesB
rectangle = Rectangle(Plane=pt_2, XSize=dim.UDimension, YSize=dim.VDimension, Radius=0)  # -> Rectangle, Length
group = Group(Objects=crv)
orient_2 = Orient(Geometry=orient.Geometry, Source=xy_2, Target=xy_3)  # -> Geometry, Transform
group_2 = Group(Objects=rectangle.Rectangle)  # -> flatten(Group)
planesrf = PlaneSurface(Plane=pt_2, XSize=dim.UDimension, YSize=dim.VDimension)
unflatten = UnflattenTree(Tree=group, Guide=geo_4)
crv_2 = Curve(orient_2.Geometry)
item_7 = ListItem(List=sort.ValuesA, Index=[0, -1], Wrap=True)
cull_i_2 = CullIndex(List=sort.ValuesA, Indices=[0, -1], Wrap=True)
evalsrf_2 = EvaluateSurface(Surface=reparameterize(cull_i), Point=Point(0, 0, 0))  # -> Point, Normal, Frame
evalsrf_3 = EvaluateSurface(Surface=reparameterize(planesrf), Point=Point(0, 0, 0))  # -> Point, Normal, Frame
explode_2 = Explode(Curve=crv_2, Recursive=True)  # -> Segments, Vertices
graft_2 = GraftTree(Tree=explode_2.Segments, IncludeEmptyLists=True, IncludeNullItems=True)
len = Length(Curve=graft_2)
item_8 = ListItem(List=group_2, Index=0, Wrap=True)
expression_4 = Expression(x=len, y=Slider(12, range=0..20), Expression="x/y")
int_4 = Integer(expression_4)
item_9 = ListItem(List=item_7, Index=1, Wrap=True)
item_10 = ListItem(List=item_7, Index=0, Wrap=True)
cull_i_3 = CullIndex(List=sort.ValuesB, Indices=[0, -1], Wrap=True)
orient_3 = Orient(Geometry=unflatten, Source=evalsrf_2.Frame, Target=evalsrf_3.Frame)  # -> Geometry, Transform
expression_5 = Expression(x=int_4, Expression="(floor(x/2)*2)+1")
explode_3 = Explode(Curve=item_9, Recursive=True)  # -> Segments, Vertices
crv_cp = CurveClosestPoint(Point=cull_i_3, Curve=item_10)  # -> Point, Parameter, Distance
explode_4 = Explode(Curve=item_10, Recursive=True)  # -> Segments, Vertices
range = Range(Domain=Domain(0, 1), Steps=expression_5)
sort_2 = SortList(Keys=crv_cp.Parameter, ValuesA=cull_i_2)  # -> Keys, ValuesA
eval_2 = EvaluateLength(Curve=reparameterize(explode_4.Segments), Length=0.5, Normalized=True)  # -> Point, Tangent, Parameter
eval_3 = EvaluateLength(Curve=reparameterize(explode_3.Segments), Length=0.5, Normalized=True)  # -> Point, Tangent, Parameter
eval_4 = EvaluateLength(Curve=rectangle.Rectangle, Length=Slider(0.538, range=0..1), Normalized=True)  # -> Point, Tangent, Parameter
cp = ClosestPoint(Point=eval_2.Point, Cloud=eval_3.Point)  # -> ClosestPoint, CPIndex, Distance
P = DispatchPattern([False, True])
shatter = Shatter(Curve=reparameterize(graft_2), Parameters=range)
item_11 = ListItem(List=explode_3.Segments, Index=cp.CPIndex, Wrap=True)
number_slider_2 = Slider(1, range=0..3)
number_slider_3 = Slider(3, range=0..3)
dispatch_3 = Dispatch(List=shatter, DispatchPattern=P)  # -> ListA, ListB
graft_3 = GraftTree(Tree=explode_4.Segments, IncludeEmptyLists=True, IncludeNullItems=True)
graft_4 = GraftTree(Tree=item_11, IncludeEmptyLists=True, IncludeNullItems=True)
explode_5 = Explode(Curve=rectangle.Rectangle, Recursive=True)  # -> Segments, Vertices
panel = Panel(unflatten)
xy_4 = XYPlane(Origin=Point(0, 0, 0))
crv_3 = Curve(dispatch_3.ListB)
eval_5 = EvaluateLength(Curve=graft_3, Length=[0, 1], Normalized=True)  # -> Point, Tangent, Parameter
eval_6 = EvaluateLength(Curve=graft_4, Length=[0, 1], Normalized=True)  # -> Point, Tangent, Parameter
crv_4 = Curve(dispatch_3.ListA)
cull_i_4 = CullIndex(List=explode_5.Segments, Indices=[number_slider_2, number_slider_3], Wrap=True)
item_12 = ListItem(List=explode_5.Segments, Index=[number_slider_2, number_slider_3], Wrap=True)
offset = Offset(Curve=crv_3, Distance=neg, Plane=xy_4, Corners=1)
cp_2 = ClosestPoint(Point=eval_5.Point, Cloud=eval_6.Point)  # -> ClosestPoint, CPIndex, Distance
graft_5 = GraftTree(Tree=item_12, IncludeEmptyLists=True, IncludeNullItems=True)
len_2 = Length(Curve=graft_5)
expression_6 = Expression(x=len_2, y=Slider(12, range=0..20), Expression="x/y")
int_5 = Integer(expression_6)
expression_7 = Expression(x=int_5, Expression="ceiling(x/2)*2")
ln = Line(StartPoint=eval_5.Point, EndPoint=cp_2.ClosestPoint)  # -> simplify(Line)
loft = Loft(Curves=ln, Options={Adjust=False, Closed=False, LoftEnds=0, LoftSimp=0, LoftType=0, Rebuild=10, Refit=0.01})
ultrim = UltraTrim(data=loft)
unflatten_2 = UnflattenTree(Tree=offset, Guide=crv_3)
weave = Weave(Pattern=P, Stream0=unflatten_2, Stream1=crv_4, NullGaps=False)
range_2 = Range(Domain=Domain(0, 1), Steps=expression_7)
graft_6 = GraftTree(Tree=cull_i_4, IncludeEmptyLists=True, IncludeNullItems=True)
len_3 = Length(Curve=graft_6)
merge_4 = Merge(Data1=simplify(ultrim), Data2=simplify(item_7))
P_2 = DispatchPattern([False, True])
shatter_2 = Shatter(Curve=reparameterize(graft_5), Parameters=range_2)
geo_6 = Geometry(merge_4)
expression_8 = Expression(x=len_3, y=Slider(12, range=0..20), Expression="x/y")
int_6 = Integer(expression_8)
expression_9 = Expression(x=int_6, Expression="(floor(x/2)*2)+1")
dispatch_4 = Dispatch(List=shatter_2, DispatchPattern=P_2)  # -> ListA, ListB
connect = ConnectCurves(Curves=weave, Continuity=Slider(0, range=0..2), Close=Toggle(False), Bulge=1)
xy_5 = XYPlane(Origin=Point(0, 0, 0))
end = EndPoints(Curve=shatter_2)  # -> Start, End
xy_6 = XYPlane(Origin=Point(0, 0, 0))
crv_5 = Curve(dispatch_4.ListB)
crv_6 = Curve(dispatch_4.ListA)
panel_2 = Panel(item_8)
item_13 = ListItem(List=geo_6, Index=[-1, -2], Wrap=True)
item_14 = ListItem(List=item_13, Index=0, Wrap=True)
range_3 = Range(Domain=Domain(0, 1), Steps=expression_9)
ext = ExtendCurve(Curve=connect, Type=0, Start=expr("-x", number_slider), End=expr("-x", number_slider))
offset_2 = Offset(Curve=crv_5, Distance=neg, Plane=xy_5, Corners=1)
crv_7 = Curve(item_14)
P_3 = DispatchPattern([True, False])
shatter_3 = Shatter(Curve=reparameterize(graft_6), Parameters=range_3)
unflatten_3 = UnflattenTree(Tree=offset_2, Guide=crv_5)
weave_2 = Weave(Pattern=P_2, Stream0=unflatten_3, Stream1=crv_6, NullGaps=False)
geo_7 = Geometry([<brep referenced from the Rhino model> x2])
flatten = FlattenTree(Tree=item_13, Path="{0}")
explode_6 = Explode(Curve=crv_7, Recursive=True)  # -> Segments, Vertices
offset_l = OffsetLoose(Curve=explode_6.Segments, Distance=1, Plane=xy_6)  # -> simplify(Curve)
item_15 = ListItem(List=offset_l, Index=0, Wrap=True)
eval_7 = EvaluateLength(Curve=item_15, Length=0.5, Normalized=True)  # -> Point, Tangent, Parameter
dispatch_5 = Dispatch(List=geo_7, DispatchPattern=[True, False])  # -> ListA, ListB
incurve = PointInCurve(Point=eval_7.Point, Curve=crv_7)  # -> Relationship, Point
dispatch_6 = Dispatch(List=shatter_3, DispatchPattern=P_3)  # -> ListA, ListB
xy_7 = XYPlane(Origin=Point(0, 0, 0))
crv_8 = Curve([<curve referenced from the Rhino model> x2])
bbx_2 = BrepBrep(BrepA=dispatch_5.ListA, BrepB=dispatch_5.ListB)  # -> Curves, Points
panel_3 = Panel("""-1
1""")
bool = Boolean(incurve.Relationship)
xy_8 = XYPlane(Origin=Point(0, 0, 0))
crv_9 = Curve(dispatch_6.ListB)
item_16 = ListItem(List=panel_3, Index=bool, Wrap=True)
crv_10 = Curve(dispatch_6.ListA)
cull_i_5 = CullIndex(List=geo_6, Indices=[-1, -2], Wrap=True)
scale_4 = Scale(Geometry=[bbx_2.Curves, crv_8], Center=Point(0, 0, 0), Factor=rep_2)  # -> Geometry, Transform
evalsrf_4 = EvaluateSurface(Surface=reparameterize(flatten), Point=Point(0, 0, 0))  # -> Point, Normal, UDirection, VDirection, Frame
expression_10 = Expression(x=material_thickness, y=item_16, Expression="X*Y")
offset_3 = Offset(Curve=crv_9, Distance=neg, Plane=xy_8, Corners=1)
panel_4 = Panel(incurve.Relationship)
dim_2 = Dimensions(Surface=cull_i_5)  # -> UDimension, VDimension
connect_2 = ConnectCurves(Curves=weave_2, Continuity=Slider(0, range=0..2), Close=Toggle(False), Bulge=1)
item_17 = ListItem(List=dim_2.VDimension, Index=0, Wrap=True)  # -> flatten(Item)
explode_7 = Explode(Curve=scale_4.Geometry, Recursive=True)  # -> flatten(Segments), Vertices
geo_8 = Geometry(cull_i_5)
geo_9 = Geometry(item_13)
offset_l_2 = OffsetLoose(Curve=explode_6.Segments, Distance=expression_10, Plane=xy_6)  # -> simplify(Curve)
srf_cp_2 = SurfaceClosestPoint(Point=evalsrf_4.Point, Surface=flatten)  # -> Point, UVPoint, Distance
unflatten_4 = UnflattenTree(Tree=offset_3, Guide=crv_9)
weave_3 = Weave(Pattern=P_3, Stream0=unflatten_4, Stream1=crv_10, NullGaps=False)
graft_7 = GraftTree(Tree=geo_9, IncludeEmptyLists=True, IncludeNullItems=True)
consec_4 = ConsecutiveDomains(Numbers=item_17, Additive=True)
graft_8 = GraftTree(Tree=geo_8, IncludeEmptyLists=True, IncludeNullItems=True)
eval_8 = EvaluateLength(Curve=explode_7.Segments, Length=0.5, Normalized=True)  # -> Point, Tangent, Parameter
ext_2 = ExtendCurve(Curve=offset_l_2, Type=0, Start=500, End=500)  # -> simplify(Curve)
neg_2 = Negative(Value=material_thickness)
vec2pt = Vector2Pt(PointA=evalsrf_4.Point, PointB=srf_cp_2.Point, Unitize=False)  # -> Vector, Length
dedomain_5 = DeconstructDomain(Domain=consec_4)  # -> Start, End
srf_cp_3 = SurfaceClosestPoint(Point=eval_8.Point, Surface=graft_7)  # -> Point, UVPoint, Distance
panel_5 = Panel(weave_2)
srf_cp_4 = SurfaceClosestPoint(Point=eval_8.Point, Surface=graft_8)  # -> Point, UVPoint, Distance
int_7 = Integer(0)
ext_3 = ExtendCurve(Curve=explode_6.Segments, Type=0, Start=500, End=500)  # -> simplify(Curve)
move = Move(Geometry=evalsrf_4.Frame, Motion=vec2pt.Vector)  # -> Geometry, Transform
xy_9 = XYPlane(Origin=Point(0, 0, 0))
item_18 = ListItem(List=dedomain_5.Start, Index=0, Wrap=True)
int_8 = Integer(0)
expression_11 = Expression(x=srf_cp_3.Distance, Expression="x<1")
expression_12 = Expression(x=srf_cp_4.Distance, Expression="x<1")
shift = ShiftList(List=ext_2, Shift=1, Wrap=True)
orient_4 = Orient(Geometry=flatten, Source=move.Geometry, Target=xy_9)  # -> Geometry, Transform
bbox_2 = BoundingBox(Content=orient_4.Geometry, Plane=xy_7)  # -> Box, Box_2
debox_2 = DeconstructBox(Box=bbox_2.Box)  # -> Plane, X, Y, Z
dedomain_6 = DeconstructDomain(Domain=debox_2.X)  # -> Start, End
expression_13 = Expression(x=dedomain_6.Start, y=dedomain_6.End, Expression="y-x")
consec_5 = ConsecutiveDomains(Numbers=expression_13, Additive=True)
dedomain_7 = DeconstructDomain(Domain=consec_5)  # -> Start, End
item_19 = ListItem(List=dedomain_7.Start, Index=0, Wrap=True)
long_4 = LongestList(ListA=int_7, ListB=item_19, PaddingMode=2)  # -> ListA, ListB
shift_2 = ShiftList(List=ext_3, Shift=1, Wrap=True)
shift_3 = ShiftList(List=ext_3, Shift=-1, Wrap=True)
int_9 = Integer(0)
crv_11 = Curve(ext_2)
crv_12 = Curve(ext_2)
long_5 = LongestList(ListA=int_8, ListB=item_18, PaddingMode=2)  # -> ListA, ListB
merge_5 = Merge(Data1=simplify(long_4.ListA), Data2=simplify(dedomain_7.Start))
dispatch_7 = Dispatch(List=explode_7.Segments, DispatchPattern=expression_11)  # -> ListA, ListB
dispatch_8 = Dispatch(List=explode_7.Segments, DispatchPattern=expression_12)  # -> ListA, ListB
ccx = CurveCurve(CurveA=reparameterize(crv_11), CurveB=reparameterize(shift))  # -> Points, ParamsA, ParamsB
ccx_2 = CurveCurve(CurveA=reparameterize(crv_12), CurveB=reparameterize(shift_2))  # -> Points, ParamsA, ParamsB
ccx_3 = CurveCurve(CurveA=reparameterize(crv_12), CurveB=reparameterize(shift_3))  # -> Points, ParamsA, ParamsB
connect_3 = ConnectCurves(Curves=weave_3, Continuity=Slider(0, range=0..2), Close=Toggle(False), Bulge=1)
crv_13 = Curve(connect_3)
ext_4 = ExtendCurve(Curve=crv_13, Type=0, Start=0, End=neg)
merge_6 = Merge(Data1=simplify(long_5.ListA), Data2=simplify(dedomain_5.Start))  # -> graft(Result)
crv_14 = Curve(simplify(dispatch_7.ListA))
pt_3 = ConstructPoint(XCoordinate=merge_5, YCoordinate=0, ZCoordinate=0)
crv_15 = Curve(simplify(dispatch_8.ListA))
ultrim_2 = UltraTrim(data=ccx.ParamsB)
xy_10 = XYPlane(Origin=pt_3)
group_3 = Group(Objects=crv_14)
group_4 = Group(Objects=crv_15)
shift_4 = ShiftList(List=ultrim_2, Shift=-1, Wrap=True)
orient_5 = Orient(Geometry=orient_4.Geometry, Source=xy_9, Target=xy_10)  # -> Geometry, Transform
merge_7 = Merge(Data1=simplify(ccx_3.ParamsA), Data2=simplify(ccx_2.ParamsA))
graft_9 = GraftTree(Tree=crv_12, IncludeEmptyLists=True, IncludeNullItems=True)
flatten_2 = FlattenTree(Tree=group_3, Path="{0}")
unflatten_5 = UnflattenTree(Tree=group_4, Guide=geo_8)
graft_10 = GraftTree(Tree=shift_4, IncludeEmptyLists=True, IncludeNullItems=True)
crv_16 = Curve(orient_5.Geometry)
bnd = Bounds(Numbers=merge_7)
end_2 = EndPoints(Curve=simplify(graft(explode_6.Segments)))  # -> Start, End
evalsrf_5 = EvaluateSurface(Surface=reparameterize(cull_i_5), Point=Point(0, 0, 0))  # -> Point, Normal, Frame
explode_8 = Explode(Curve=crv_16, Recursive=True)  # -> Segments, Vertices
graft_11 = GraftTree(Tree=explode_8.Segments, IncludeEmptyLists=True, IncludeNullItems=True)
merge_8 = Merge(Data1=simplify(graft_10), Data2=simplify(ccx.ParamsA))
graft_12 = GraftTree(Tree=crv_11, IncludeEmptyLists=True, IncludeNullItems=True)
len_4 = Length(Curve=graft_11)
subcrv = SubCurve(BaseCurve=reparameterize(graft_9), Domain=bnd)
orient_6 = Orient(Geometry=flatten_2, Source=move.Geometry, Target=xy_9)  # -> Geometry, Transform
expression_14 = Expression(x=len_4, y=tab_length, Expression="x/y")
bnd_2 = Bounds(Numbers=merge_8)
crv_cp_2 = CurveClosestPoint(Point=[end_2.Start, end_2.End], Curve=reparameterize(subcrv))  # -> Point, Parameter, Distance
int_10 = Integer(expression_14)
orient_7 = Orient(Geometry=orient_6.Geometry, Source=xy_9, Target=xy_10)  # -> simplify(Geometry), Transform
subcrv_2 = SubCurve(BaseCurve=reparameterize(graft_12), Domain=bnd_2)
expression_15 = Expression(x=int_10, Expression="(floor(x/2)*2)+1")
bnd_3 = Bounds(Numbers=crv_cp_2.Parameter)
ungroup = Ungroup(Group=orient_7.Geometry)
subcrv_3 = SubCurve(BaseCurve=reparameterize(subcrv), Domain=bnd_3)  # -> simplify(Curve)
range_4 = Range(Domain=Domain(0, 1), Steps=expression_15)
end_3 = EndPoints(Curve=subcrv_3)  # -> Start, End
ultrim_3 = UltraTrim(data=end_3.End)
ultrim_4 = UltraTrim(data=end_3.Start)
shift_5 = ShiftList(List=ultrim_3, Shift=-1, Wrap=True)  # -> simplify(graft(List))
shift_6 = ShiftList(List=ultrim_4, Shift=1, Wrap=True)  # -> simplify(graft(List))
P_4 = DispatchPattern([False, True])
shatter_4 = Shatter(Curve=reparameterize(graft_11), Parameters=range_4)
crv_cp_3 = CurveClosestPoint(Point=[shift_6, shift_5], Curve=reparameterize(subcrv_2))  # -> Point, Parameter, Distance
number_slider_4 = Slider(1, range=0..3)
number_slider_5 = Slider(3, range=0..3)
bnd_4 = Bounds(Numbers=crv_cp_3.Parameter)
dispatch_9 = Dispatch(List=shatter_4, DispatchPattern=P_4)  # -> ListA, ListB
subcrv_4 = SubCurve(BaseCurve=reparameterize(subcrv_2), Domain=bnd_4)  # -> simplify(Curve)
end_4 = EndPoints(Curve=graft(explode_6.Segments))  # -> Start, End
panel_6 = Panel(unflatten_5)
xy_11 = XYPlane(Origin=Point(0, 0, 0))
ext_5 = ExtendCurve(Curve=subcrv_4, Type=0, Start=500, End=500)
crv_17 = Curve(dispatch_9.ListB)
crv_18 = Curve(dispatch_9.ListA)
end_5 = EndPoints(Curve=subcrv_4)  # -> Start, End
ln_2 = Line(StartPoint=end_3.Start, EndPoint=end_3.End)
crv_cp_4 = CurveClosestPoint(Point=[end_4.Start, end_4.End], Curve=reparameterize(ext_5))  # -> Point, Parameter, Distance
crv_cp_5 = CurveClosestPoint(Point=[end_5.Start, end_5.End, end_3.Start, end_3.End], Curve=reparameterize(ext_5))  # -> Point, Parameter, Distance
xy_12 = XYPlane(Origin=Point(0, 0, 0))
offset_4 = Offset(Curve=crv_17, Distance=neg_2, Plane=xy_11, Corners=1)
bnd_5 = Bounds(Numbers=crv_cp_4.Parameter)
unflatten_6 = UnflattenTree(Tree=offset_4, Guide=crv_17)
bnd_6 = Bounds(Numbers=crv_cp_5.Parameter)
weave_4 = Weave(Pattern=P_4, Stream0=unflatten_6, Stream1=crv_18, NullGaps=False)
ln_3 = Line(StartPoint=end_5.Start, EndPoint=end_3.Start)  # -> simplify(Line)
ln_4 = Line(StartPoint=end_3.End, EndPoint=end_5.End)  # -> simplify(Line)
subcrv_5 = SubCurve(BaseCurve=reparameterize(ext_5), Domain=bnd_5)  # -> simplify(Curve)
subcrv_6 = SubCurve(BaseCurve=reparameterize(ext_5), Domain=bnd_6)  # -> simplify(Curve)
P_5 = DispatchPattern([False, True])
len_5 = Length(Curve=ln_4)  # -> simplify(Length)
len_6 = Length(Curve=ln_3)  # -> simplify(Length)
offset_l_3 = OffsetLoose(Curve=ln_4, Distance=expr("-x", material_thickness), Plane=xy_6)  # -> simplify(Curve)
P_6 = DispatchPattern([False, True])
offset_l_4 = OffsetLoose(Curve=ln_3, Distance=expr("-x", material_thickness), Plane=xy_6)  # -> simplify(Curve)
end_6 = EndPoints(Curve=subcrv_6)  # -> Start, End
len_7 = Length(Curve=subcrv_6)
num = Number(len_7)
ultrim_5 = UltraTrim(data=num)
end_7 = EndPoints(Curve=subcrv_5)  # -> Start, End
merge_9 = Merge(Data1=len_6, Data2=len_5)  # -> simplify(Result)
num_2 = Number(merge_9)
item_20 = ListItem(List=num_2, Index=1, Wrap=True)
ultrim_6 = UltraTrim(data=item_20)
expression_16 = Expression(x=ultrim_5, y=ultrim_6, Expression="x-y")
consec_6 = ConsecutiveDomains(Numbers=expression_16, Additive=True)
dedomain_8 = DeconstructDomain(Domain=consec_6)  # -> Start, End
item_21 = ListItem(List=dedomain_8.Start, Index=0, Wrap=True)
long_6 = LongestList(ListA=int_9, ListB=item_21, PaddingMode=2)  # -> ListA, ListB
merge_10 = Merge(Data1=simplify(long_6.ListA), Data2=simplify(dedomain_8.Start))
pt_4 = ConstructPoint(XCoordinate=merge_10, YCoordinate=expr("x+450", merge_6), ZCoordinate=0)
rectangle_2 = Rectangle(Plane=pt_4, XSize=ultrim_5, YSize=dim_2.VDimension, Radius=0)  # -> Rectangle, Length
planesrf_2 = PlaneSurface(Plane=pt_4, XSize=ultrim_5, YSize=dim_2.VDimension)
group_5 = Group(Objects=rectangle_2.Rectangle)  # -> flatten(Group)
evalsrf_6 = EvaluateSurface(Surface=reparameterize(planesrf_2), Point=Point(0, 0, 0))  # -> Point, Normal, Frame
panel_7 = Panel(item_20)
item_22 = ListItem(List=group_5, Index=0, Wrap=True)
orient_8 = Orient(Geometry=unflatten_5, Source=evalsrf_5.Frame, Target=evalsrf_6.Frame)  # -> Geometry, Transform
explode_9 = Explode(Curve=rectangle_2.Rectangle, Recursive=True)  # -> Segments, Vertices
num_3 = Number(reverse(num_2))
cull_i_6 = CullIndex(List=explode_9.Segments, Indices=[number_slider_4, number_slider_5], Wrap=True)  # -> simplify(List)
crv_19 = Curve(cull_i_6)
item_23 = ListItem(List=explode_9.Segments, Index=[number_slider_4, number_slider_5], Wrap=True)
graft_13 = GraftTree(Tree=num_3, IncludeEmptyLists=True, IncludeNullItems=True)
graft_14 = GraftTree(Tree=item_23, IncludeEmptyLists=True, IncludeNullItems=True)
len_8 = Length(Curve=graft_14)
expression_17 = Expression(x=len_8, y=tab_length, Expression="x/y")
int_11 = Integer(expression_17)
expression_18 = Expression(x=int_11, Expression="ceiling(x/2)*2")
offset_5 = Offset(Curve=graft_14, Distance=expr("-x", graft_13), Plane=xy_12, Corners=1)
range_5 = Range(Domain=Domain(0, 1), Steps=expression_18)
shatter_5 = Shatter(Curve=reparameterize(offset_5), Parameters=range_5)
shatter_6 = Shatter(Curve=reparameterize(graft_14), Parameters=range_5)
dispatch_10 = Dispatch(List=shatter_5, DispatchPattern=P_5)  # -> ListA, ListB
dispatch_11 = Dispatch(List=shatter_6, DispatchPattern=P_6)  # -> ListA, ListB
loft_2 = Loft(
    Curves=[ln_3, offset_l_4],
    Options={Adjust=False, Closed=False, LoftEnds=0, LoftSimp=0, LoftType=0, Rebuild=10, Refit=0.01})
loft_3 = Loft(
    Curves=[ln_4, offset_l_3],
    Options={Adjust=False, Closed=False, LoftEnds=0, LoftSimp=0, LoftType=0, Rebuild=10, Refit=0.01})
connect_4 = ConnectCurves(Curves=weave_4, Continuity=Slider(0, range=0..2), Close=Toggle(False), Bulge=1)
xy_13 = XYPlane(Origin=Point(0, 0, 0))
end_8 = EndPoints(Curve=shatter_6)  # -> Start, End
crv_20 = Curve(simplify(dispatch_10.ListB))
crv_21 = Curve(dispatch_11.ListA)
panel_8 = Panel(item_22)
offset_6 = Offset(Curve=crv_20, Distance=neg_2, Plane=xy_13, Corners=1)
ext_6 = ExtendCurve(Curve=connect_4, Type=0, Start=500, End=500)  # -> simplify(Curve)
crv_cp_6 = CurveClosestPoint(Point=end_7.End, Curve=reparameterize(subcrv_6))  # -> Point, Parameter, Distance
crv_cp_7 = CurveClosestPoint(Point=end_7.Start, Curve=reparameterize(subcrv_6))  # -> Point, Parameter, Distance
P_7 = DispatchPattern([True, False])
trim = TrimTree(Tree=simplify(ext_6), Depth=1)
unflatten_7 = UnflattenTree(Tree=crv_20, Guide=crv_20)
dist = Distance(PointA=end_6.Start, PointB=end_7.Start)
dist_2 = Distance(PointA=end_6.End, PointB=end_7.End)
expression_19 = Expression(x=crv_cp_6.Distance, Expression="x≈0")
expression_20 = Expression(x=crv_cp_7.Distance, Expression="x≈0")
weave_5 = Weave(Pattern=P_6, Stream0=unflatten_7, Stream1=crv_21, NullGaps=False)
shift_7 = ShiftList(List=trim, Shift=1, Wrap=True)
crv_22 = Curve(trim)
weave_6 = Weave(Pattern=expression_19, Stream0="1", Stream1="-1", NullGaps=False)
weave_7 = Weave(Pattern=expression_20, Stream0="1", Stream1="-1", NullGaps=False)
ccx_4 = CurveCurve(CurveA=reparameterize(crv_22), CurveB=reparameterize(shift_7))  # -> Points, ParamsA, ParamsB
xy_14 = XYPlane(Origin=Point(0, 0, 0))
expression_21 = Expression(x=dist_2, y=weave_6, Expression="x*y")
expression_22 = Expression(x=dist, y=weave_7, Expression="x*y")
trim_2 = TrimTree(Tree=simplify(ccx_4.ParamsB), Depth=1)
shift_8 = ShiftList(List=trim_2, Shift=-1, Wrap=True)
merge_11 = Merge(Data1=expression_22, Data2=expression_21)
num_4 = Number(merge_11)
dispatch_12 = Dispatch(List=num_4, DispatchPattern=[True, False])  # -> ListA, ListB
ext_7 = ExtendCurve(Curve=crv_19, Type=0, Start=dispatch_12.ListB, End=dispatch_12.ListA)
graft_15 = GraftTree(Tree=ext_7, IncludeEmptyLists=True, IncludeNullItems=True)  # -> simplify(Tree)
len_9 = Length(Curve=graft_15)
expression_23 = Expression(x=len_9, y=tab_length, Expression="x/y")
int_12 = Integer(expression_23)
expression_24 = Expression(x=int_12, Expression="(floor(x/2)*2)+1")
range_6 = Range(Domain=Domain(0, 1), Steps=expression_24)
shatter_7 = Shatter(Curve=reparameterize(graft_15), Parameters=range_6)
dispatch_13 = Dispatch(List=shatter_7, DispatchPattern=P_7)  # -> ListA, ListB
crv_23 = Curve(dispatch_13.ListB)
crv_24 = Curve(dispatch_13.ListA)
offset_7 = Offset(Curve=crv_23, Distance=neg_2, Plane=xy_14, Corners=1)
connect_5 = ConnectCurves(Curves=weave_5, Continuity=Slider(0, range=0..2), Close=Toggle(False), Bulge=1)  # -> simplify(Curve)
unflatten_8 = UnflattenTree(Tree=offset_7, Guide=crv_23)
weave_8 = Weave(Pattern=P_7, Stream0=unflatten_8, Stream1=crv_24, NullGaps=False)
graft_16 = GraftTree(Tree=shift_8, IncludeEmptyLists=True, IncludeNullItems=True)
trim_3 = TrimTree(Tree=connect_5, Depth=1)
merge_12 = Merge(Data1=graft_16, Data2=ccx_4.ParamsA)
graft_17 = GraftTree(Tree=crv_22, IncludeEmptyLists=True, IncludeNullItems=True)
bnd_7 = Bounds(Numbers=merge_12)
subcrv_7 = SubCurve(BaseCurve=reparameterize(graft_17), Domain=bnd_7)  # -> simplify(Curve)
trim_4 = TrimTree(Tree=subcrv_7, Depth=1)
connect_6 = ConnectCurves(Curves=weave_8, Continuity=Slider(0, range=0..2), Close=Toggle(False), Bulge=1)
crv_25 = Curve(connect_6)
ext_8 = ExtendCurve(Curve=crv_25, Type=0, Start=0, End=neg_2)  # -> simplify(Curve)
trim_5 = TrimTree(Tree=ext_8, Depth=1)
weave_9 = Weave(Pattern=[0, 1], Stream0=trim_3, Stream1=trim_5, NullGaps=False)
ext_9 = ExtendCurve(Curve=weave_9, Type=0, Start=500, End=500)  # -> simplify(Curve)
join = JoinCurves(Curves=trim_4, Preserve=False)  # -> simplify(Curves)
crv_26 = Curve(join)
trim_6 = TrimWithRegion(Curve=ungroup, Region=crv_26)  # -> Inside, Outside
crv_27 = Curve(trim_6.Inside)
crv_28 = Curve(simplify(crv_27))
shift_9 = ShiftList(List=ext_9, Shift=1, Wrap=True)
crv_29 = Curve(ext_9)
ccx_5 = CurveCurve(CurveA=reparameterize(crv_29), CurveB=reparameterize(shift_9))  # -> Points, ParamsA, ParamsB
trim_7 = TrimTree(Tree=simplify(ccx_5.ParamsB), Depth=1)
shift_10 = ShiftList(List=trim_7, Shift=-1, Wrap=True)
graft_18 = GraftTree(Tree=shift_10, IncludeEmptyLists=True, IncludeNullItems=True)
merge_13 = Merge(Data1=graft_18, Data2=ccx_5.ParamsA)
graft_19 = GraftTree(Tree=crv_29, IncludeEmptyLists=True, IncludeNullItems=True)
panel_9 = Panel([crv_28, join])
bnd_8 = Bounds(Numbers=merge_13)
subcrv_8 = SubCurve(BaseCurve=reparameterize(graft_19), Domain=bnd_8)  # -> simplify(Curve)
trim_8 = TrimTree(Tree=subcrv_8, Depth=1)

group_6 = Group(Objects=[join, crv_28])
join_2 = JoinCurves(Curves=trim_8, Preserve=False)

# ==== cluster UltraTrim: Betterer version of Trim
data = ClusterInput()
data_2 = Data(simplify(data))
trim = TrimTree(Tree=data_2, Depth=1)
null = NullItem(Item=trim)  # -> NullFlags, InvalidFlags, Description
ma = MassAddition(Input=flatten(null.NullFlags))  # -> Result, PartialResults
smaller = SmallerThan(FirstNumber=ma.Result, SecondNumber=1)  # -> SmallerThan, OrEqualTo
trim_2 = TrimTree(Tree=data_2, Depth=smaller.SmallerThan)
T = ClusterOutput(trim_2)
