# Grasshopper definition BOX_aka_FingerJoint.gh (Grasshopper 1.0.7)
# Copyright: Co-de-iT
# plug-ins: treesloth01, Anemone, MetaHopper

number_slider = Slider(3500, range=0..10000)  # disabled
pt = Point(Point(233276.6737, -38903.38311, 15600))  # disabled
crv = Curve([<curve referenced from the Rhino model> x2])
Z = UnitZ(Factor=pt)  # disabled
geometrytoprocess = Geometry([<brep referenced from the Rhino model> x2])
contour = Contour(Shape=geometrytoprocess, Point=Point(0, 0, 0), Direction=Z, Distance=number_slider)  # disabled
item = ListItem(List=geometrytoprocess, Index=0, Wrap=True)
topoly = CurveToPolyline(Curve=crv, ToleranceDistance=Slider(400, range=0..1000), ToleranceAngle=0)  # -> Polyline, Segments
material_thickness = Slider(1.8, range=0..10)
surfacecurves = Curve([<curve referenced from the Rhino model> x2])
scale = Panel("1:1")
tab_length = Slider(3.2, range=0..10)
crv_2 = Curve(surfacecurves)
brep = Brep(geometrytoprocess)
null = NullItem(Item=crv_2)  # -> NullFlags, InvalidFlags, Description
null_2 = NullItem(Item=brep)  # -> NullFlags, InvalidFlags, Description
rep = ReplaceText(Text=scale, Find=":", Replace="/", RecursiveReplace=False)
materialthickness = Data(material_thickness)
tablength = Data(tab_length)
cull = CullPattern(List=crv_2, CullPattern=invert(null.NullFlags))
cull_2 = CullPattern(List=brep, CullPattern=invert(null_2.NullFlags))
scale_2 = Scale(Geometry=cull_2, Center=Point(0, 0, 0), Factor=rep)  # -> Geometry, Transform
scale_3 = Scale(Geometry=cull, Center=Point(0, 0, 0), Factor=rep)  # -> Geometry, Transform
geo = Geometry(<brep referenced from the Rhino model>)
rep_2 = ReplaceText(Text="1:500", Find=":", Replace="/", RecursiveReplace=False)
debrep = DeconstructBrep(Brep=scale_2.Geometry)  # -> Faces, Edges, Vertices
xy = XYPlane(Origin=Point(0, 0, 0))
scale_4 = Scale(Geometry=geo, Center=Point(0, 0, 0), Factor=rep_2)  # -> Geometry, Transform
geo_2 = Geometry(debrep.Faces)
geo_3 = Geometry([<brep referenced from the Rhino model> x2])
dispatch = Dispatch(List=geo_3, DispatchPattern=[True, False])  # -> ListA, ListB
xy_2 = XYPlane(Origin=Point(0, 0, 0))
debrep_2 = DeconstructBrep(Brep=scale_4.Geometry)  # -> Faces, Edges, Vertices
item_2 = ListItem(List=debrep_2.Faces, Index=[-1, -2], Wrap=True)  # -> flatten(Item)
item_3 = ListItem(List=scale_4.Geometry, Index=2, Wrap=True)
bbx = BrepBrep(BrepA=dispatch.ListA, BrepB=dispatch.ListB)  # -> Curves, Points
number_slider_2 = Slider(2, range=0..10)
area = Area(Geometry=geo_2)  # -> Area, Centroid
cull_i = CullIndex(List=debrep_2.Faces, Indices=[-1, -2], Wrap=True)
scale_5 = Scale(Geometry=bbx.Curves, Center=Point(0, 0, 0), Factor=rep_2)  # -> Geometry, Transform
explode = Explode(Curve=scale_5.Geometry, Recursive=True)  # -> flatten(Segments), Vertices
evalsrf = EvaluateSurface(Surface=reparameterize(item_2), Point=Point(0, 0, 0))  # -> Point, Normal, Frame
dim = Dimensions(Surface=cull_i)  # -> UDimension, VDimension
item_4 = ListItem(List=dim.VDimension, Index=0, Wrap=True)  # -> flatten(Item)
pdecon = Deconstruct(Point=area.Centroid)  # -> XComponent, YComponent, ZComponent
geo_4 = Geometry(cull_i)
consec = ConsecutiveDomains(Numbers=item_4, Additive=True)
panel = Panel("""-1
1""")
expression = Expression(x=dim.UDimension, y=number_slider_2, Expression="x-y")
materialthickness_2 = Data(materialthickness)
graft = GraftTree(Tree=geo_4, IncludeEmptyLists=True, IncludeNullItems=True)
eval = EvaluateLength(Curve=explode.Segments, Length=0.5, Normalized=True)  # -> Point, Tangent, Parameter
sort = SortList(Keys=pdecon.ZComponent, ValuesA=geo_2, ValuesB=area.Centroid)  # -> Keys, ValuesA, ValuesB
xy_3 = XYPlane(Origin=Point(0, 0, 0))
consec_2 = ConsecutiveDomains(Numbers=expression, Additive=True)
neg = Negative(Value=number_slider_2)
dedomain = DeconstructDomain(Domain=consec)  # -> Start, End
int = Integer(0)
materialthickness_3 = Data(materialthickness)
dedomain_2 = DeconstructDomain(Domain=consec_2)  # -> Start, End
orient = Orient(Geometry=item_2, Source=evalsrf.Frame, Target=xy_3)  # -> Geometry, Transform
bbox = BoundingBox(Content=orient.Geometry, Plane=xy_2)  # -> Box, Box_2
debox = DeconstructBox(Box=bbox.Box)  # -> Plane, X, Y, Z
dedomain_3 = DeconstructDomain(Domain=debox.X)  # -> Start, End
expression_2 = Expression(x=dedomain_3.Start, y=dedomain_3.End, Expression="y-x")
consec_3 = ConsecutiveDomains(Numbers=expression_2, Additive=True)
dedomain_4 = DeconstructDomain(Domain=consec_3)  # -> Start, End
item_5 = ListItem(List=dedomain_4.Start, Index=0, Wrap=True)
srf_cp = SurfaceClosestPoint(Point=eval.Point, Surface=graft)  # -> Point, UVPoint, Distance
item_6 = ListItem(List=sort.ValuesA, Index=[0, -1], Wrap=True)
item_7 = ListItem(List=dedomain.Start, Index=0, Wrap=True)
int_2 = Integer(0)
long = LongestList(ListA=int, ListB=item_5, PaddingMode=2)  # -> ListA, ListB
multiplication = Multiplication(A=materialthickness_3, B="20")
item_8 = ListItem(List=dedomain_2.Start, Index=0, Wrap=True)
int_3 = Integer(0)
expression_3 = Expression(x=srf_cp.Distance, Expression="x<1")
long_2 = LongestList(ListA=int_2, ListB=item_7, PaddingMode=2)  # -> ListA, ListB
merge = Merge(Data1=simplify(long.ListA), Data2=simplify(dedomain_4.Start))
long_3 = LongestList(ListA=int_3, ListB=item_8, PaddingMode=2)  # -> ListA, ListB
item_9 = ListItem(List=item_6, Index=0, Wrap=True)  # -> Item, Item1
dispatch_2 = Dispatch(List=explode.Segments, DispatchPattern=expression_3)  # -> ListA, ListB
merge_2 = Merge(Data1=simplify(long_2.ListA), Data2=simplify(dedomain.Start))  # -> graft(Result)
pt_2 = ConstructPoint(XCoordinate=merge, YCoordinate=0, ZCoordinate=0)
merge_3 = Merge(Data1=simplify(long_3.ListA), Data2=simplify(dedomain_2.Start))
pt_3 = ConstructPoint(XCoordinate=merge_3, YCoordinate=expr("x+450", merge_2), ZCoordinate=0)
crv_3 = Curve(simplify(dispatch_2.ListA))
xy_4 = XYPlane(Origin=pt_2)
materialthickness_4 = Data(materialthickness)
explode_2 = Explode(Curve=item_9.Item1, Recursive=True)  # -> Segments, Vertices
explode_3 = Explode(Curve=item_9.Item, Recursive=True)  # -> Segments, Vertices
rectangle = Rectangle(Plane=pt_3, XSize=dim.UDimension, YSize=dim.VDimension, Radius=0)  # -> Rectangle, Length
group = Group(Objects=crv_3)
orient_2 = Orient(Geometry=orient.Geometry, Source=xy_3, Target=xy_4)  # -> Geometry, Transform
group_2 = Group(Objects=rectangle.Rectangle)  # -> flatten(Group)
eval_2 = EvaluateLength(Curve=reparameterize(explode_3.Segments), Length=0.5, Normalized=True)  # -> Point, Tangent, Parameter
eval_3 = EvaluateLength(Curve=reparameterize(explode_2.Segments), Length=0.5, Normalized=True)  # -> Point, Tangent, Parameter
planesrf = PlaneSurface(Plane=pt_3, XSize=dim.UDimension, YSize=dim.VDimension)
unflatten = UnflattenTree(Tree=group, Guide=geo_4)
crv_4 = Curve(orient_2.Geometry)
evalsrf_2 = EvaluateSurface(Surface=reparameterize(cull_i), Point=Point(0, 0, 0))  # -> Point, Normal, Frame
evalsrf_3 = EvaluateSurface(Surface=reparameterize(planesrf), Point=Point(0, 0, 0))  # -> Point, Normal, Frame
explode_4 = Explode(Curve=crv_4, Recursive=True)  # -> Segments, Vertices
graft_2 = GraftTree(Tree=explode_4.Segments, IncludeEmptyLists=True, IncludeNullItems=True)
len = Length(Curve=graft_2)
cp = ClosestPoint(Point=eval_2.Point, Cloud=eval_3.Point)  # -> ClosestPoint, CPIndex, Distance
item_10 = ListItem(List=group_2, Index=0, Wrap=True)
expression_4 = Expression(x=len, y=Slider(12, range=0..20), Expression="x/y")
item_11 = ListItem(List=explode_2.Segments, Index=cp.CPIndex, Wrap=True)
int_4 = Integer(expression_4)
orient_3 = Orient(Geometry=unflatten, Source=evalsrf_2.Frame, Target=evalsrf_3.Frame)  # -> Geometry, Transform
expression_5 = Expression(x=int_4, Expression="(floor(x/2)*2)+1")
graft_3 = GraftTree(Tree=explode_3.Segments, IncludeEmptyLists=True, IncludeNullItems=True)
graft_4 = GraftTree(Tree=item_11, IncludeEmptyLists=True, IncludeNullItems=True)
eval_4 = EvaluateLength(Curve=graft_4, Length=[0, 1], Normalized=True)  # -> Point, Tangent, Parameter
eval_5 = EvaluateLength(Curve=graft_3, Length=[0, 1], Normalized=True)  # -> Point, Tangent, Parameter
range = Range(Domain=Domain(0, 1), Steps=expression_5)
eval_6 = EvaluateLength(Curve=rectangle.Rectangle, Length=Slider(0.538, range=0..1), Normalized=True)  # -> Point, Tangent, Parameter
cp_2 = ClosestPoint(Point=eval_5.Point, Cloud=eval_4.Point)  # -> ClosestPoint, CPIndex, Distance
P = DispatchPattern([False, True])
shatter = Shatter(Curve=reparameterize(graft_2), Parameters=range)
ln = Line(StartPoint=eval_5.Point, EndPoint=cp_2.ClosestPoint)  # -> simplify(Line)
int_5 = Integer(0)
int_6 = Integer(1)
number_slider_3 = Slider(1, range=0..3)
number_slider_4 = Slider(3, range=0..3)
loft = Loft(Curves=ln, Options={Adjust=False, Closed=False, LoftEnds=0, LoftSimp=0, LoftType=0, Rebuild=10, Refit=0.01})
dispatch_3 = Dispatch(List=shatter, DispatchPattern=P)  # -> ListA, ListB
ultrim = UltraTrim(data=loft)
shift = ShiftPaths(Data=loft, Offset=-1)
explode_5 = Explode(Curve=rectangle.Rectangle, Recursive=True)  # -> Segments, Vertices
panel_2 = Panel(unflatten)
xy_5 = XYPlane(Origin=Point(0, 0, 0))
crv_5 = Curve(dispatch_3.ListB)
crv_6 = Curve(dispatch_3.ListA)
cull_i_2 = CullIndex(List=explode_5.Segments, Indices=[number_slider_3, number_slider_4], Wrap=True)
item_12 = ListItem(List=explode_5.Segments, Index=[number_slider_3, number_slider_4], Wrap=True)
offset = Offset(Curve=crv_5, Distance=neg, Plane=xy_5, Corners=1)

geoends = Data(reverse(item_6))
geosides = Data(shift)

geoends_2 = Data(geoends)
item_13 = ListItem(List=geoends_2, Index=1, Wrap=True)
crv_7 = Curve(item_13)
explode_6 = Explode(Curve=crv_7, Recursive=True)  # -> Segments, Vertices

# ---- group: Defunct Lateral Path
geosides_2 = Data(geosides)  # disabled
toggle = GroupToggle(ToggleActive=True, ToggleVisible=False)  # disabled
join = BrepJoin(Breps=geosides_2)  # -> Breps, Closed; disabled
edges = BrepEdges(Brep=join.Breps)  # -> Naked, Interior, NonManifold; disabled
dim_2 = Dimensions(Surface=geosides_2)  # -> UDimension, VDimension; disabled
data = Data(edges.Interior)  # disabled
item_14 = ListItem(List=dim_2.VDimension, Index=0, Wrap=True)  # -> flatten(Item); disabled
ma = MassAddition(Input=dim_2.UDimension)  # -> Result, PartialResults; disabled
cull_i_3 = CullIndex(List=item_14, Indices=-1, Wrap=True)  # disabled
cull_i_4 = CullIndex(List=ma.PartialResults, Indices=-1, Wrap=True)  # disabled
panel_3 = Panel("0")  # disabled
panel_4 = Panel("0")  # disabled
ins = InsertItems(List=cull_i_3, Item=panel_3, Indices=panel_3, Wrap=True)  # -> graft(List); disabled
ins_2 = InsertItems(List=cull_i_4, Item=panel_4, Indices=panel_4, Wrap=True)  # disabled
lng = ListLength(List=ins)  # -> flatten(Length); disabled
materialthickness_5 = Data(materialthickness)  # disabled
lng_2 = ListLength(List=lng)  # -> flatten(Length); disabled
data_2 = Data(explode_6.Segments)  # disabled
series = Series(Start=0, Step=materialthickness_5, Count=lng_2)  # disabled
len_2 = Length(Curve=data_2)  # disabled
addition = Addition(A=ins, B=graft(series))  # disabled
panel_5 = Panel("1")  # disabled
shift_2 = ShiftList(List=data_2, Shift=panel_5, Wrap=True)  # disabled
pt_4 = ConstructPoint(XCoordinate=ins_2, YCoordinate=addition, ZCoordinate=0)  # disabled
end = EndPoints(Curve=data_2)  # -> Start, End; disabled
end_2 = EndPoints(Curve=shift_2)  # -> Start, End; disabled
angle = Angle(VectorA=data_2, VectorB=shift_2)  # -> Angle, Reflex; disabled
rectangle_2 = Rectangle(Plane=pt_4, XSize=dim_2.UDimension, YSize=dim_2.VDimension, Radius=0)  # -> Rectangle, Length; disabled
number_slider_5 = Slider(1, range=0..10)  # disabled
explode_7 = Explode(Curve=rectangle_2.Rectangle, Recursive=True)  # -> Segments, Vertices; disabled
deg = Degrees(Radians=angle.Angle)  # disabled
data_3 = Data(end.Start)  # disabled
data_4 = Data(end_2.End)  # disabled
len_3 = Length(Curve=explode_7.Segments)  # disabled
panel_6 = Panel("90")  # disabled
materialthickness_6 = Data(materialthickness)  # disabled
dispatch_4 = Dispatch(List=simplify(explode_7.Segments), DispatchPattern=[True, False])  # -> ListA, ListB; disabled
end_3 = EndPoints(Curve=explode_7.Segments)  # -> Start, End; disabled
angledim = AngularDimension(Center=graft(end.End), PointA=graft(data_3), PointB=graft(data_4), Reflex=False, Text="{0:0.0}°", Size=number_slider_5)  # disabled
number_slider_6 = Slider(-1, range=-1..1)  # disabled
amp = Amplitude(Vector=explode_7.Segments, Amplitude=len_3)  # disabled
python = GhPythonScript(x=deg, y=panel_6)  # -> out, a; disabled
# ---------- python: Python ----------
__author__ = "s-ataylor"
__version__ = "2018.09.13"

import rhinoscriptsyntax as rs
import math

z = x/int(y)

if z > 1:
    z-=1

a = z
# ---------- end python ----------
division = Division(A=materialthickness_6, B=2)  # disabled
vdis = VectorDisplay(Anchor=end_3.Start, Vector=amp)  # disabled
data_5 = Data(dispatch_4.ListA)  # disabled
multiplication_2 = Multiplication(A=python.a, B=division)  # disabled
shift_3 = ShiftList(List=multiplication_2, Shift=number_slider_6, Wrap=True)  # disabled
neg_2 = Negative(Value=shift_3)  # disabled
merge_4 = Merge(Data2=simplify(graft(multiplication_2)), Data3=simplify(graft(neg_2)))  # -> graft(Result); disabled
len_4 = Length(Curve=dispatch_4.ListB)  # disabled
tablength_2 = Data(tablength)  # disabled
data_6 = Data(dispatch_4.ListB)  # disabled
len_5 = Length(Curve=dispatch_4.ListA)  # disabled
tablength_3 = Data(tablength)  # disabled
data_7 = Data(dispatch_4.ListA)  # disabled
expression_6 = Expression(x=len_4, y=tablength_2, Expression="ceiling((x/y)/2)*2")  # disabled
expression_7 = Expression(x=len_5, y=tablength_3, Expression="ceiling((x/y)/2)*2")  # disabled
neg_3 = Negative(Value=merge_4)  # disabled
merge_5 = Merge(Data1=neg_3, Data2=merge_4)  # disabled
divide = DivideCurve(Curve=data_6, Count=expression_6, Kinks=False)  # -> Points, Tangents, Parameters; disabled
divide_2 = DivideCurve(Curve=data_7, Count=expression_7, Kinks=False)  # -> Points, Tangents, Parameters; disabled
shatter_2 = Shatter(Curve=graft(data_6), Parameters=divide.Parameters)  # -> simplify(Segments); disabled
shatter_3 = Shatter(Curve=graft(data_7), Parameters=divide_2.Parameters)  # -> simplify(Segments); disabled
materialthickness_7 = Data(materialthickness)  # disabled
dispatch_5 = Dispatch(List=shatter_2, DispatchPattern=[True, False])  # -> ListA, ListB; disabled
dispatch_6 = Dispatch(List=shatter_3, DispatchPattern=[True, False])  # -> ListA, ListB; disabled
division_2 = Division(A=materialthickness_7, B=2)  # disabled
group_3 = Group(Objects=dispatch_5.ListB)  # disabled
group_4 = Group(Objects=dispatch_5.ListA)  # disabled
group_5 = Group(Objects=dispatch_6.ListB)  # disabled
group_6 = Group(Objects=dispatch_6.ListA)  # disabled
neg_4 = Negative(Value=division_2)  # disabled
merge_6 = Merge(Data1=group_4, Data2=group_3)  # disabled
merge_7 = Merge(Data1=neg_4, Data2=division_2)  # disabled
merge_8 = Merge(Data1=group_6, Data2=group_5)  # disabled
Y = UnitY(Factor=merge_7)  # disabled
X = UnitX(Factor=merge_5)  # disabled
move = Move(Geometry=simplify(merge_6), Motion=simplify(X))  # -> Geometry, Transform; disabled
move_2 = Move(Geometry=simplify(merge_8), Motion=simplify(Y))  # -> Geometry, Transform; disabled
dispatch_7 = Dispatch(List=move.Geometry, DispatchPattern=[True, False])  # -> ListA, ListB; disabled
dispatch_8 = Dispatch(List=move_2.Geometry, DispatchPattern=[True, False])  # -> ListA, ListB; disabled
ungroup = Ungroup(Group=dispatch_7.ListA)  # disabled
ungroup_2 = Ungroup(Group=dispatch_7.ListB)  # disabled
ungroup_3 = Ungroup(Group=dispatch_8.ListA)  # disabled
ungroup_4 = Ungroup(Group=dispatch_8.ListB)  # disabled
weave = Weave(Pattern=[0, 1], Stream0=ungroup, Stream1=ungroup_2, NullGaps=False)  # disabled
weave_2 = Weave(Pattern=[0, 1], Stream0=ungroup_3, Stream1=ungroup_4, NullGaps=False)  # disabled
explode_8 = Explode(Curve=ungroup_4, Recursive=True)  # -> Segments, Vertices; disabled
explode_9 = Explode(Curve=weave, Recursive=True)  # -> Segments, Vertices; disabled
explode_10 = Explode(Curve=weave_2, Recursive=True)  # -> Segments, Vertices; disabled
ultrim_2 = UltraTrim(data=explode_9.Vertices)  # disabled
ultrim_3 = UltraTrim(data=explode_10.Vertices)  # disabled
pline = PolyLine(Vertices=ultrim_2, Closed=False)  # disabled
pline_2 = PolyLine(Vertices=ultrim_3, Closed=False)  # disabled
ultrim_4 = UltraTrim(data=pline_2)  # disabled
ultrim_5 = UltraTrim(data=pline)  # disabled
materialthickness_8 = Data(materialthickness)  # disabled
weave_3 = Weave(Pattern=[0, 1], Stream0=ultrim_5, Stream1=ultrim_4, NullGaps=False)  # disabled
multiplication_3 = Multiplication(A=materialthickness_8, B=5)  # disabled
ext = ExtendCurve(Curve=weave_3, Type=0, Start=multiplication_3, End=multiplication_3)  # disabled
crv_8 = Curve(reparameterize(ext))  # disabled
shift_4 = ShiftList(List=crv_8, Shift=1, Wrap=True)  # disabled
ccx = CurveCurve(CurveA=graft(crv_8), CurveB=graft(shift_4))  # -> Points, ParamsA, ParamsB; disabled
avr = Average(Input=ccx.Points)  # disabled
dist = Distance(PointA=avr, PointB=ccx.Points)  # disabled
sort_2 = SortList(Keys=dist, ValuesA=ccx.Points)  # -> Keys, ValuesA; disabled
item_15 = ListItem(List=sort_2.ValuesA, Index=0, Wrap=True)  # disabled
ultrim_6 = UltraTrim(data=item_15)  # disabled
shift_5 = ShiftList(List=ultrim_6, Shift=-1, Wrap=True)  # -> graft(List); disabled
item_16 = ListItem(List=graft(ultrim_6), Index=0, Wrap=True)  # disabled
item_17 = ListItem(List=shift_5, Index=0, Wrap=True)  # disabled
data_8 = Data(graft(crv_8))  # disabled
merge_9 = Merge(Data1=simplify(item_16), Data2=simplify(item_17))  # disabled
crv_cp = CurveClosestPoint(Point=merge_9, Curve=data_8)  # -> Point, Parameter, Distance; disabled
shatter_4 = Shatter(Curve=data_8, Parameters=crv_cp.Parameter)  # disabled
panel_7 = Panel("1")  # disabled
item_18 = ListItem(List=shatter_4, Index=panel_7, Wrap=True)  # disabled
data_9 = Data(data_5)  # disabled
ultrim_7 = UltraTrim(data=item_18)  # disabled
join_2 = JoinCurves(Curves=ultrim_7, Preserve=False)  # disabled
dispatch_9 = Dispatch(List=ultrim_7, DispatchPattern=[True, False])  # -> ListA, ListB; disabled
item_19 = ListItem(List=data_9, Index=0, Wrap=True)  # disabled
data_10 = Data(dispatch_9.ListB)  # disabled
item_20 = ListItem(List=dispatch_9.ListB, Index=0, Wrap=True)  # disabled
ultrim_8 = UltraTrim(data=item_19)  # disabled
ultrim_9 = UltraTrim(data=item_20)  # disabled
rotate = Rotate(Angle=1.570796327, Plane=PlaneXY(0, 0, 0))  # -> Geometry, Transform; disabled
end_4 = EndPoints(Curve=ultrim_9)  # -> Start, End; disabled
end_5 = EndPoints(Curve=ultrim_8)  # -> Start, End; disabled
data_11 = Data(end_4.End)  # disabled
data_12 = Data(end_5.End)  # disabled
item_21 = ListItem(Index=0, Wrap=True)  # disabled
split = SplitList()  # -> ListA, ListB; disabled
loop_start = LoopStart(Repeat=0)  # -> port, Counter, Data; disabled
loop_end = LoopEnd(port=loop_start.port, Exit=False, TimeOutVal=0, pausedState=False, state="Constant output")  # disabled

# ----
offset_l = OffsetLoose(Curve=explode_6.Segments, Distance=1, Plane=xy)  # -> simplify(Curve)
item_22 = ListItem(List=offset_l, Index=0, Wrap=True)
eval_7 = EvaluateLength(Curve=item_22, Length=0.5, Normalized=True)  # -> Point, Tangent, Parameter
incurve = PointInCurve(Point=eval_7.Point, Curve=crv_7)  # -> Relationship, Point
bool = Boolean(incurve.Relationship)
item_23 = ListItem(List=panel, Index=bool, Wrap=True)
expression_8 = Expression(x=materialthickness_2, y=item_23, Expression="X*Y")
offset_l_2 = OffsetLoose(Curve=explode_6.Segments, Distance=expression_8, Plane=xy)  # -> simplify(Curve)
ext_2 = ExtendCurve(Curve=offset_l_2, Type=0, Start=multiplication, End=multiplication)  # -> simplify(Curve)
ext_3 = ExtendCurve(Curve=explode_6.Segments, Type=0, Start=multiplication, End=multiplication)  # -> simplify(Curve)
graft_5 = GraftTree(Tree=offset_l_2, IncludeEmptyLists=True, IncludeNullItems=True)
shift_6 = ShiftList(List=ext_3, Shift=1, Wrap=True)
shift_7 = ShiftList(List=ext_3, Shift=-1, Wrap=True)
crv_9 = Curve(ext_2)
crv_10 = Curve(ext_2)
shift_8 = ShiftList(List=ext_2, Shift=1, Wrap=True)
ext_4 = ExtendCurve(Curve=graft_5, Type=0, Start=materialthickness_4, End=materialthickness_4)  # -> simplify(Curve)
ccx_2 = CurveCurve(CurveA=reparameterize(crv_9), CurveB=reparameterize(shift_7))  # -> Points, ParamsA, ParamsB
ccx_3 = CurveCurve(CurveA=reparameterize(crv_9), CurveB=reparameterize(shift_6))  # -> Points, ParamsA, ParamsB
ccx_4 = CurveCurve(CurveA=reparameterize(crv_10), CurveB=reparameterize(shift_8))  # -> Points, ParamsA, ParamsB
pshift = ShiftPaths(Data=ext_4, Offset=-1)

null_3 = NullItem(Item=pshift)  # -> NullFlags, InvalidFlags, Description
tmatch = MatchText(Text=null_3.Description, Pattern="Data does not exist", Case=True)
ma_2 = MassAddition(Input=null_3.NullFlags)  # -> Result, PartialResults
ma_3 = MassAddition(Input=null_3.InvalidFlags)  # -> Result, PartialResults
equals = Equality(FirstNumber=ma_2.Result, SecondNumber=ma_3.Result)  # -> Equality, Inequality
equals_2 = Equality(FirstNumber=ma_3.Result, SecondNumber=tmatch)  # -> Equality, Inequality
and = GateAnd(A=equals.Equality, B=equals_2.Equality)

ultrim_10 = UltraTrim(data=ccx_4.ParamsB)
merge_10 = Merge(Data1=simplify(ccx_2.ParamsA), Data2=simplify(ccx_3.ParamsA))
graft_6 = GraftTree(Tree=crv_9, IncludeEmptyLists=True, IncludeNullItems=True)
shift_9 = ShiftList(List=ultrim_10, Shift=-1, Wrap=True)
bnd = Bounds(Numbers=merge_10)
end_6 = EndPoints(Curve=simplify(graft(explode_6.Segments)))  # -> Start, End
graft_7 = GraftTree(Tree=shift_9, IncludeEmptyLists=True, IncludeNullItems=True)
subcrv = SubCurve(BaseCurve=reparameterize(graft_6), Domain=bnd)
filter = StreamFilter(Gate=and, Stream0=pshift, Stream1=ext_4)
shift_10 = ShiftPaths(Data=ext_4, Offset=-1)
merge_11 = Merge(Data1=simplify(graft_7), Data2=simplify(ccx_4.ParamsA))
graft_8 = GraftTree(Tree=crv_10, IncludeEmptyLists=True, IncludeNullItems=True)
ccx_5 = CurveCurve(CurveA=reparameterize(shift_10), CurveB=crv_7)  # -> Points, ParamsA, ParamsB
bnd_2 = Bounds(Numbers=merge_11)
crv_cp_2 = CurveClosestPoint(Point=[end_6.Start, end_6.End], Curve=reparameterize(subcrv))  # -> Point, Parameter, Distance
eval_8 = EvaluateLength(Curve=graft(explode_6.Segments), Length=[0, 1], Normalized=True)  # -> Point, Tangent, Parameter
subcrv_2 = SubCurve(BaseCurve=reparameterize(graft_8), Domain=bnd_2)
expression_9 = Expression(x=ccx_5.ParamsA, Expression="x<.5")
bnd_3 = Bounds(Numbers=crv_cp_2.Parameter)
subcrv_3 = SubCurve(BaseCurve=reparameterize(subcrv), Domain=bnd_3)  # -> simplify(Curve)
crv_cp_3 = CurveClosestPoint(Point=eval_8.Point, Curve=reparameterize(subcrv_2))  # -> Point, Parameter, Distance
dispatch_10 = Dispatch(List=ccx_5.ParamsA, DispatchPattern=expression_9)  # -> ListA, ListB
long_4 = LongestList(ListA=dispatch_10.ListB, ListB=int_6, PaddingMode=2)  # -> ListA, ListB
long_5 = LongestList(ListA=dispatch_10.ListA, ListB=int_5, PaddingMode=2)  # -> ListA, ListB
end_7 = EndPoints(Curve=subcrv_3)  # -> Start, End
ultrim_11 = UltraTrim_2(data=end_7.End)
ultrim_12 = UltraTrim_2(data=end_7.Start)
bnd_4 = Bounds(Numbers=crv_cp_3.Parameter)
crv_11 = Curve(graft(explode_6.Segments))
merge_12 = Merge(Data1=long_5.ListA, Data2=long_5.ListB)
merge_13 = Merge(Data1=long_4.ListA, Data2=long_4.ListB)
shift_11 = ShiftList(List=ultrim_11, Shift=-1, Wrap=True)  # -> simplify(graft(List))
shift_12 = ShiftList(List=ultrim_12, Shift=1, Wrap=True)  # -> simplify(graft(List))
item_24 = ListItem(List=merge_13, Index=0, Wrap=True)
item_25 = ListItem(List=merge_12, Index=0, Wrap=True)
graft_9 = GraftTree(Tree=item_12, IncludeEmptyLists=True, IncludeNullItems=True)
len_6 = Length(Curve=graft_9)
expression_10 = Expression(x=len_6, y=Slider(12, range=0..20), Expression="x/y")
int_7 = Integer(expression_10)
expression_11 = Expression(x=int_7, Expression="ceiling(x/2)*2")
merge_14 = Merge(Data1=shift_12, Data2=shift_11)
crv_cp_4 = CurveClosestPoint(Point=merge_14, Curve=reparameterize(subcrv_2))  # -> Point, Parameter, Distance
merge_15 = Merge(Data1=item_25, Data2=item_24)
tablength_4 = Data(tablength)
eval_9 = EvaluateLength(Curve=ext_4, Length=merge_15, Normalized=True)  # -> Point, Tangent, Parameter
crv_cp_5 = CurveClosestPoint(Point=eval_9.Point, Curve=reparameterize(crv_11))  # -> Point, Parameter, Distance
subcrv_4 = SubCurve(BaseCurve=reparameterize(subcrv_2), Domain=bnd_4)  # -> simplify(Curve)
bnd_5 = Bounds(Numbers=crv_cp_4.Parameter)
bnd_6 = Bounds(Numbers=crv_cp_5.Parameter)
multiplication_4 = Multiplication(A=tablength_4, B="2")
subcrv_5 = SubCurve(BaseCurve=reparameterize(subcrv_2), Domain=bnd_5)  # -> simplify(Curve)
unflatten_2 = UnflattenTree(Tree=offset, Guide=crv_5)
weave_4 = Weave(Pattern=P, Stream0=unflatten_2, Stream1=crv_6, NullGaps=False)
subcrv_6 = SubCurve(BaseCurve=reparameterize(crv_11), Domain=bnd_6)  # -> simplify(Curve)
range_2 = Range(Domain=Domain(0, 1), Steps=expression_11)
graft_10 = GraftTree(Tree=cull_i_2, IncludeEmptyLists=True, IncludeNullItems=True)
end_8 = EndPoints(Curve=graft(explode_6.Segments))  # -> Start, End
crv_12 = Curve(subcrv_4)
ext_5 = ExtendCurve(Curve=crv_12, Type=0, Start=multiplication_4, End=multiplication_4)
len_7 = Length(Curve=graft_10)
P_2 = DispatchPattern([False, True])
shatter_5 = Shatter(Curve=reparameterize(graft_9), Parameters=range_2)
eval_10 = EvaluateLength(Curve=graft(crv_12), Length=[0, 1], Normalized=True)  # -> Point, Tangent, Parameter
crv_cp_6 = CurveClosestPoint(Point=[end_8.Start, end_8.End], Curve=reparameterize(ext_5))  # -> Point, Parameter, Distance
eval_11 = EvaluateLength(Curve=graft(subcrv_6), Length=[0, 1], Normalized=True)  # -> Point, Tangent, Parameter
expression_12 = Expression(x=len_7, y=Slider(12, range=0..20), Expression="x/y")
len_8 = Length(Curve=subcrv_6)
int_8 = Integer(expression_12)
end_9 = EndPoints(Curve=crv_12)  # -> Start, End
crv_cp_7 = CurveClosestPoint(Point=[end_9.Start, end_9.End, end_7.Start, end_7.End], Curve=reparameterize(ext_5))  # -> Point, Parameter, Distance
expression_13 = Expression(x=int_8, Expression="(floor(x/2)*2)+1")
crv_cp_8 = CurveClosestPoint(Point=eval_10.Point, Curve=subcrv_6)  # -> Point, Parameter, Distance
dispatch_11 = Dispatch(List=shatter_5, DispatchPattern=P_2)  # -> ListA, ListB
bnd_7 = Bounds(Numbers=crv_cp_6.Parameter)
bnd_8 = Bounds(Numbers=crv_cp_7.Parameter)
connect = ConnectCurves(Curves=weave_4, Continuity=Slider(0, range=0..2), Close=Toggle(False), Bulge=1)
xy_6 = XYPlane(Origin=Point(0, 0, 0))
subcrv_7 = SubCurve(BaseCurve=reparameterize(ext_5), Domain=bnd_7)  # -> simplify(Curve)
subcrv_8 = SubCurve(BaseCurve=reparameterize(ext_5), Domain=bnd_8)  # -> simplify(Curve)
end_10 = EndPoints(Curve=shatter_5)  # -> Start, End
crv_13 = Curve(dispatch_11.ListB)
crv_14 = Curve(dispatch_11.ListA)
panel_8 = Panel(item_10)
range_3 = Range(Domain=Domain(0, 1), Steps=expression_13)
ext_6 = ExtendCurve(Curve=connect, Type=0, Start=expr("-x", number_slider_2), End=expr("-x", number_slider_2))
ln_2 = Line(StartPoint=end_9.Start, EndPoint=end_7.Start)  # -> simplify(Line)
offset_2 = Offset(Curve=crv_13, Distance=neg, Plane=xy_6, Corners=1)
ln_3 = Line(StartPoint=end_7.End, EndPoint=end_9.End)  # -> simplify(Line)
end_11 = EndPoints(Curve=subcrv_8)  # -> Start, End
end_12 = EndPoints(Curve=subcrv_7)  # -> Start, End
dist_2 = Distance(PointA=eval_11.Point, PointB=crv_cp_8.Point)
P_3 = DispatchPattern([True, False])
shatter_6 = Shatter(Curve=reparameterize(graft_10), Parameters=range_3)
unflatten_3 = UnflattenTree(Tree=offset_2, Guide=crv_13)
len_9 = Length(Curve=ln_3)  # -> simplify(Length)
len_10 = Length(Curve=ln_2)  # -> simplify(Length)
weave_5 = Weave(Pattern=P_2, Stream0=unflatten_3, Stream1=crv_14, NullGaps=False)
merge_16 = Merge(Data1=len_10, Data2=len_9)  # -> simplify(Result)
len_11 = Length(Curve=subcrv_8)
dist_3 = Distance(PointA=end_11.Start, PointB=end_12.Start)
crv_cp_9 = CurveClosestPoint(Point=end_12.Start, Curve=reparameterize(subcrv_8))  # -> Point, Parameter, Distance
dist_4 = Distance(PointA=end_11.End, PointB=end_12.End)
crv_cp_10 = CurveClosestPoint(Point=end_12.End, Curve=reparameterize(subcrv_8))  # -> Point, Parameter, Distance
expression_14 = Expression(x=crv_cp_10.Distance, Expression="x≈0")
expression_15 = Expression(x=crv_cp_9.Distance, Expression="x≈0")
weave_6 = Weave(Pattern=expression_14, Stream0="1", Stream1="-1", NullGaps=False)
weave_7 = Weave(Pattern=expression_15, Stream0="1", Stream1="-1", NullGaps=False)
dispatch_12 = Dispatch(List=shatter_6, DispatchPattern=P_3)  # -> ListA, ListB
expression_16 = Expression(x=dist_3, y=weave_7, Expression="x*y")
expression_17 = Expression(x=dist_4, y=weave_6, Expression="x*y")
xy_7 = XYPlane(Origin=Point(0, 0, 0))
crv_15 = Curve(dispatch_12.ListB)
crv_16 = Curve(dispatch_12.ListA)
merge_17 = Merge(Data1=expression_16, Data2=expression_17)
offset_3 = Offset(Curve=crv_15, Distance=neg, Plane=xy_7, Corners=1)
data_13 = Data(simplify(subcrv_6))
connect_2 = ConnectCurves(Curves=weave_5, Continuity=Slider(0, range=0..2), Close=Toggle(False), Bulge=1)
panel_9 = Panel(merge_17)
unflatten_4 = UnflattenTree(Tree=offset_3, Guide=crv_15)
shift_13 = ShiftPaths(Data=data_13, Offset=-1)
pshift_2 = ShiftPaths(Data=data_13, Offset=-1)
weave_8 = Weave(Pattern=P_3, Stream0=unflatten_4, Stream1=crv_16, NullGaps=False)
null_4 = NullItem(Item=pshift_2)  # -> NullFlags, InvalidFlags, Description
tmatch_2 = MatchText(Text=null_4.Description, Pattern="Data does not exist", Case=True)
ma_4 = MassAddition(Input=null_4.NullFlags)  # -> Result, PartialResults
ma_5 = MassAddition(Input=null_4.InvalidFlags)  # -> Result, PartialResults
panel_10 = Panel(weave_5)
num = Number(len_8)
num_2 = Number(dist_2)
ma_6 = MassAddition(Input=tmatch_2)  # -> Result, PartialResults
number_slider_7 = Slider(2, range=0..10)
equals_3 = Equality(FirstNumber=ma_4.Result, SecondNumber=ma_5.Result)  # -> Equality, Inequality
equals_4 = Equality(FirstNumber=ma_5.Result, SecondNumber=ma_6.Result)  # -> Equality, Inequality
geoends_3 = Data(geoends)
and_2 = GateAnd(A=equals_3.Equality, B=equals_4.Equality)
filter_2 = StreamFilter(Gate=and_2, Stream0=pshift_2, Stream1=data_13)
item_26 = ListItem(List=geoends_3, Index=0, Wrap=True)  # -> Item1, Item
connect_3 = ConnectCurves(Curves=weave_8, Continuity=Slider(0, range=0..2), Close=Toggle(False), Bulge=1)
crv_17 = Curve(connect_3)
ext_7 = ExtendCurve(Curve=crv_17, Type=0, Start=0, End=neg)
group_7 = Group(Objects=shift_13)
item_27 = ListItem(List=num_2, Index=1, Wrap=True)
geosides_3 = Data(geosides)
data_14 = Data()
shift_14 = ShiftPaths(Data=simplify(num), Offset=-1)
ultrim_13 = UltraTrim(data=num)
ultrim_14 = UltraTrim(data=item_27)
repeat = RepeatData(Data=group_7, Length=number_slider_7)  # -> flatten(Data)
repeat_2 = RepeatData(Data=item_26.Item1, Length=number_slider_7)  # -> flatten(Data)
shift_15 = ShiftPaths(Data=simplify(item_27), Offset=-1)
dim_3 = Dimensions(Surface=geosides_3)  # -> UDimension, VDimension
xy_8 = XYPlane(Origin=Point(0, 0, 0))
bbox_2 = BoundingBox(Content=repeat_2, Plane=PlaneXY(0, 0, 0))  # -> Box, Box_2
expression_18 = Expression(x=shift_14, y=shift_15, Expression="x-y")
debox_2 = DeconstructBox(Box=bbox_2.Box)  # -> Plane, X, Y, Z
item_28 = ListItem(List=dim_3.VDimension, Index=0, Wrap=True)  # -> flatten(Item)
dedomain_5 = DeconstructDomain(Domain=debox_2.Z)  # -> Start, End
dedomain_6 = DeconstructDomain(Domain=debox_2.X)  # -> Start, End
dedomain_7 = DeconstructDomain(Domain=debox_2.Y)  # -> Start, End
evalsrf_4 = EvaluateSurface(Surface=reparameterize(bbox_2.Box), Point=Point(0, 0, 0))  # -> Point, Normal, UDirection, VDirection, Frame
consec_4 = ConsecutiveDomains(Numbers=item_28, Additive=True)
consec_5 = ConsecutiveDomains(Numbers=expression_18, Additive=True)
expression_19 = Expression(x=dedomain_6.Start, y=dedomain_6.End, Expression="abs(x-y)")
dedomain_8 = DeconstructDomain(Domain=consec_4)  # -> Start, End
pt_5 = ConstructPoint(XCoordinate=dedomain_6.Start, YCoordinate=dedomain_7.Start, ZCoordinate=dedomain_5.Start)
dedomain_9 = DeconstructDomain(Domain=consec_5)  # -> Start, End
srf_cp_2 = SurfaceClosestPoint(Point=evalsrf_4.Point, Surface=repeat_2)  # -> Point, UVPoint, Distance
xy_9 = XYPlane(Origin=pt_5)
item_29 = ListItem(List=dedomain_8.Start, Index=0, Wrap=True)
int_9 = Integer(0)
ma_7 = MassAddition(Input=expression_19)  # -> Result, PartialResults
item_30 = ListItem(List=dedomain_9.Start, Index=0, Wrap=True)
int_10 = Integer(0)
vec2pt = Vector2Pt(PointA=evalsrf_4.Point, PointB=srf_cp_2.Point, Unitize=False)  # -> Vector, Length
long_6 = LongestList(ListA=int_9, ListB=item_29, PaddingMode=2)  # -> ListA, ListB
cull_i_5 = CullIndex(List=ma_7.PartialResults, Indices=-1, Wrap=True)
long_7 = LongestList(ListA=int_10, ListB=item_30, PaddingMode=2)  # -> ListA, ListB
move_3 = Move(Geometry=evalsrf_4.Frame, Motion=vec2pt.Vector)  # -> Geometry, Transform
merge_18 = Merge(Data1=simplify(long_6.ListA), Data2=simplify(dedomain_8.Start))  # -> graft(Result)
ins_3 = InsertItems(List=cull_i_5, Item="0", Indices="0", Wrap=True)
merge_19 = Merge(Data1=simplify(long_7.ListA), Data2=simplify(dedomain_9.Start))
pt_6 = ConstructPoint(XCoordinate=ins_3, YCoordinate=0, ZCoordinate=0)
pt_7 = ConstructPoint(XCoordinate=merge_19, YCoordinate=expr("x+450", merge_18), ZCoordinate=0)
xy_10 = XYPlane(Origin=pt_6)
panel_11 = Panel("""1
-1""")
rectangle_3 = Rectangle(Plane=pt_7, XSize=shift_14, YSize=dim_3.VDimension, Radius=0)  # -> Rectangle, Length
xy_11 = XYPlane(Origin=Point(0, 0, 0))
explode_11 = Explode(Curve=rectangle_3.Rectangle, Recursive=True)  # -> Segments, Vertices
planesrf_2 = PlaneSurface(Plane=pt_7, XSize=shift_14, YSize=dim_3.VDimension)
dispatch_13 = Dispatch(List=explode_11.Segments, DispatchPattern=[True, False])  # -> ListA, ListB
orient_4 = Orient(Geometry=repeat, Source=xy_9, Target=xy_10)  # -> Geometry, Transform
orient_5 = Orient(Geometry=repeat_2, Source=xy_9, Target=xy_10)  # -> Geometry, Transform
data_15 = Data(simplify(dispatch_13.ListA))
data_16 = Data(simplify(dispatch_13.ListB))
crv_18 = Curve(orient_5.Geometry)
offset_4 = Offset(Curve=graft(crv_18), Distance=panel_11, Plane=xy_11, Corners=1)  # -> simplify(Curve)
pshift_3 = ShiftPaths(Data=offset_4, Offset=-1)
ungroup_5 = Ungroup(Group=orient_4.Geometry)
eval_12 = EvaluateLength(Curve=pshift_3, Length=0.5, Normalized=True)  # -> Point, Tangent, Parameter
incurve_2 = PointInCurve(Point=eval_12.Point, Curve=graft(crv_18))  # -> Relationship, Point
graft_11 = GraftTree(Tree=ungroup_5, IncludeEmptyLists=True, IncludeNullItems=True)  # -> simplify(Tree)
tablength_5 = Data(tablength)
tablength_6 = Data(tablength)
len_12 = Length(Curve=graft_11)
len_13 = Length(Curve=ungroup_5)
dispatch_14 = Dispatch(List=panel_11, DispatchPattern=incurve_2.Relationship)  # -> ListA, ListB

# ---- group: Horizontals
crv_19 = Curve(data_15)
graft_12 = GraftTree(Tree=crv_19, IncludeEmptyLists=True, IncludeNullItems=True)  # -> simplify(Tree)
len_14 = Length(Curve=graft_12)
tablength_7 = Data(tablength)
expression_20 = Expression(x=len_14, y=tablength_7, Expression="x/y")
int_11 = Integer(expression_20)
expression_21 = Expression(x=int_11, Expression="(floor(x/2)*2)+1")
range_4 = Range(Domain=Domain(0, 1), Steps=expression_21)
shatter_7 = Shatter(Curve=reparameterize(graft_12), Parameters=range_4)
P_4 = DispatchPattern([True, False])
dispatch_15 = Dispatch(List=shatter_7, DispatchPattern=P_4)  # -> ListA, ListB
materialthickness_9 = Data(materialthickness)
neg_5 = Negative(Value=materialthickness_9)
xy_12 = XYPlane(Origin=Point(0, 0, 0))
crv_20 = Curve(dispatch_15.ListA)
crv_21 = Curve(dispatch_15.ListB)
offset_5 = Offset(Curve=crv_21, Distance=neg_5, Plane=xy_12, Corners=1)
unflatten_5 = UnflattenTree(Tree=offset_5, Guide=crv_21)
weave_9 = Weave(Pattern=P_4, Stream0=unflatten_5, Stream1=crv_20, NullGaps=False)
materialthickness_10 = Data(materialthickness)
connect_4 = ConnectCurves(Curves=weave_9, Continuity="0", Close=Toggle(False), Bulge=1)
neg_6 = Negative(Value=materialthickness_10)
crv_22 = Curve(connect_4)
ext_8 = ExtendCurve(Curve=crv_22, Type=0, Start=0, End=neg_6)  # -> simplify(Curve)
ultrim_15 = UltraTrim(data=ext_8)

# ----
data_17 = Data(ungroup_5)
expression_22 = Expression(x=len_13, y=tablength_5, Expression="x/y")
expression_23 = Expression(x=len_12, y=tablength_6, Expression="x/y")
item_31 = ListItem(List=crv_19, Index=0, Wrap=True)
expression_24 = Expression(x=len_13, y=tablength_5, Expression="ceiling((x/y)/2)*2")
int_12 = Integer(expression_23)
int_13 = Integer(expression_22)

# ---- group: Verticals
graft_13 = GraftTree(Tree=data_16, IncludeEmptyLists=True, IncludeNullItems=True)
tablength_8 = Data(tablength)
len_15 = Length(Curve=graft_13)
expression_25 = Expression(x=len_15, y=tablength_8, Expression="x/y")
int_14 = Integer(expression_25)
num_3 = Number(reverse(num_2))
expression_26 = Expression(x=int_14, Expression="ceiling(x/2)*2")
graft_14 = GraftTree(Tree=num_3, IncludeEmptyLists=True, IncludeNullItems=True)
xy_13 = XYPlane(Origin=Point(0, 0, 0))
offset_6 = Offset(Curve=graft_13, Distance=expr("-x", graft_14), Plane=xy_13, Corners=1)
range_5 = Range(Domain=Domain(0, 1), Steps=expression_26)
shatter_8 = Shatter(Curve=reparameterize(graft_13), Parameters=range_5)
shatter_9 = Shatter(Curve=reparameterize(offset_6), Parameters=range_5)
P_5 = DispatchPattern([False, True])
dispatch_16 = Dispatch(List=shatter_9, DispatchPattern=P_5)  # -> ListA, ListB
dispatch_17 = Dispatch(List=shatter_8, DispatchPattern=P_5)  # -> ListA, ListB
materialthickness_11 = Data(materialthickness)
neg_7 = Negative(Value=materialthickness_11)
xy_14 = XYPlane(Origin=Point(0, 0, 0))
crv_23 = Curve(simplify(dispatch_16.ListB))
crv_24 = Curve(dispatch_17.ListA)
offset_7 = Offset(Curve=crv_23, Distance=neg_7, Plane=xy_14, Corners=1)  # disabled
unflatten_6 = UnflattenTree(Tree=crv_23, Guide=crv_23)
weave_10 = Weave(Pattern=P_5, Stream0=unflatten_6, Stream1=crv_24, NullGaps=False)
connect_5 = ConnectCurves(Curves=weave_10, Continuity="0", Close=Toggle(False), Bulge=1)  # -> simplify(Curve)
trim = TrimTree(Tree=connect_5, Depth=1)

# ----
expression_27 = Expression(x=int_12, Expression="(floor(x/2)*2)+1")
expression_28 = Expression(x=int_13, Expression="(floor(x/2)*2)+1")
divide_3 = DivideCurve(Curve=data_17, Count=expression_28, Kinks=False)  # -> Points, Tangents, Parameters
divide_4 = DivideCurve(Curve=graft_11, Count=expression_27, Kinks=False)  # -> Points, Tangents, Parameters
shatter_10 = Shatter(Curve=graft(data_17), Parameters=divide_3.Parameters)  # -> simplify(Segments)
shatter_11 = Shatter(Curve=graft_11, Parameters=divide_4.Parameters)
materialthickness_12 = Data(materialthickness)
P_6 = DispatchPattern([False, True])
dispatch_18 = Dispatch(List=shatter_10, DispatchPattern=P_6)  # -> ListA, ListB
expression_29 = Expression(x=materialthickness_12, y=simplify(dispatch_14.ListA), Expression="x*y")
dispatch_19 = Dispatch(List=shatter_11, DispatchPattern=P_6)  # -> ListA, ListB
crv_25 = Curve(simplify(graft(dispatch_18.ListB)))
crv_26 = Curve(dispatch_18.ListA)
shift_16 = ShiftPaths(Data=crv_25, Offset=-1)
xy_15 = XYPlane(Origin=Point(0, 0, 0))
long_8 = LongestList(ListA=shift_16, ListB=expression_29, PaddingMode=2)  # -> ListA, ListB
unflatten_7 = UnflattenTree(Tree=long_8.ListB, Guide=crv_25)
offset_8 = Offset(Curve=crv_25, Distance=unflatten_7, Plane=xy_15, Corners=1)
unflatten_8 = UnflattenTree(Tree=offset_8, Guide=dispatch_18.ListB)
weave_11 = Weave(Pattern=P_6, Stream0=unflatten_8, Stream1=crv_26, NullGaps=False)
panel_12 = Panel(unflatten_7)
geosides_4 = Data(geosides)
explode_12 = Explode(Curve=scale_3.Geometry, Recursive=True)  # -> flatten(Segments), Vertices
geo_5 = Geometry(geosides_4)
tablength_9 = Data(tablength)
geoends_4 = Data(geoends)
graft_15 = GraftTree(Tree=geo_5, IncludeEmptyLists=True, IncludeNullItems=True)
eval_13 = EvaluateLength(Curve=explode_12.Segments, Length=0.5, Normalized=True)  # -> Point, Tangent, Parameter
multiplication_5 = Multiplication(A=tablength_9, B="3")
connect_6 = ConnectCurves(Curves=weave_11, Continuity="0", Close=Toggle(False), Bulge=1)
graft_16 = GraftTree(Tree=geoends_4, IncludeEmptyLists=True, IncludeNullItems=True)
ext_9 = ExtendCurve(Curve=connect_6, Type=0, Start=multiplication_5, End=multiplication_5)  # -> simplify(Curve)
srf_cp_3 = SurfaceClosestPoint(Point=eval_13.Point, Surface=graft_16)  # -> Point, UVPoint, Distance
srf_cp_4 = SurfaceClosestPoint(Point=eval_13.Point, Surface=graft_15)  # -> Point, UVPoint, Distance
expression_30 = Expression(x=srf_cp_3.Distance, Expression="x<1")
expression_31 = Expression(x=srf_cp_4.Distance, Expression="x<1")
dispatch_20 = Dispatch(List=explode_12.Segments, DispatchPattern=expression_30)  # -> ListA, ListB
dispatch_21 = Dispatch(List=explode_12.Segments, DispatchPattern=expression_31)  # -> ListA, ListB
crv_27 = Curve(simplify(dispatch_20.ListA))
crv_28 = Curve(simplify(dispatch_21.ListA))

# ---- group: PatchEnds
ultrim_16 = UltraTrim(data=ext_9)
crv_29 = Curve(reparameterize(ultrim_16))
shift_17 = ShiftList(List=crv_29, Shift=1, Wrap=True)
ccx_6 = CurveCurve(CurveA=graft(crv_29), CurveB=graft(shift_17))  # -> Points, ParamsA, ParamsB
avr_2 = Average(Input=ccx_6.Points)
dist_5 = Distance(PointA=avr_2, PointB=ccx_6.Points)
sort_3 = SortList(Keys=dist_5, ValuesA=ccx_6.Points)  # -> Keys, ValuesA
item_32 = ListItem(List=sort_3.ValuesA, Index=0, Wrap=True)
ultrim_17 = UltraTrim(data=item_32)
shift_18 = ShiftList(List=ultrim_17, Shift=-1, Wrap=True)  # -> graft(List)
item_33 = ListItem(List=graft(ultrim_17), Index=0, Wrap=True)
item_34 = ListItem(List=shift_18, Index=0, Wrap=True)
data_18 = Data(graft(crv_29))
merge_20 = Merge(Data1=simplify(item_33), Data2=simplify(item_34))
crv_cp_11 = CurveClosestPoint(Point=merge_20, Curve=data_18)  # -> Point, Parameter, Distance
shatter_12 = Shatter(Curve=data_18, Parameters=crv_cp_11.Parameter)
item_35 = ListItem(List=shatter_12, Index="1", Wrap=True)
ultrim_18 = UltraTrim(data=item_35)
join_3 = JoinCurves(Curves=ultrim_18, Preserve=False)

# ---- group: ssPatchEnds
ultrim_19 = UltraTrim(data=ext_9)
shift_19 = ShiftList(List=ultrim_19, Shift=1, Wrap=True)
crv_30 = Curve(ultrim_19)
ccx_7 = CurveCurve(CurveA=reparameterize(crv_30), CurveB=reparameterize(shift_19))  # -> Points, ParamsA, ParamsB
trim_2 = TrimTree(Tree=simplify(ccx_7.ParamsB), Depth=1)
shift_20 = ShiftList(List=trim_2, Shift=-1, Wrap=True)
graft_17 = GraftTree(Tree=shift_20, IncludeEmptyLists=True, IncludeNullItems=True)
merge_21 = Merge(Data1=graft_17, Data2=ccx_7.ParamsA)
graft_18 = GraftTree(Tree=crv_30, IncludeEmptyLists=True, IncludeNullItems=True)
bnd_9 = Bounds(Numbers=merge_21)
subcrv_9 = SubCurve(BaseCurve=reparameterize(graft_18), Domain=bnd_9)  # -> simplify(Curve)
ultrim_20 = UltraTrim(data=subcrv_9)
join_4 = JoinCurves(Curves=ultrim_20, Preserve=False)  # -> simplify(Curves)
toggle_2 = GroupToggle(ToggleActive=True, ToggleVisible=False)  # disabled

# ----
group_8 = Group(Objects=crv_27)
group_9 = Group(Objects=crv_28)
flatten = FlattenTree(Tree=group_8, Path="{0}")
unflatten_9 = UnflattenTree(Tree=group_9, Guide=geo_5)
evalsrf_5 = EvaluateSurface(Surface=reparameterize(geosides_4), Point=Point(0, 0, 0))  # -> Point, Normal, Frame
evalsrf_6 = EvaluateSurface(Surface=reparameterize(planesrf_2), Point=Point(0, 0, 0))  # -> Point, Normal, Frame
orient_6 = Orient(Geometry=flatten, Source=move_3.Geometry, Target=xy_8)  # -> Geometry, Transform
orient_7 = Orient(Geometry=orient_6.Geometry, Source=xy_8, Target=xy_10)  # -> simplify(Geometry), Transform
orient_8 = Orient(Geometry=unflatten_9, Source=evalsrf_5.Frame, Target=evalsrf_6.Frame)  # -> Geometry, Transform

tablength_10 = Data(tablength)
weave_12 = Weave(Pattern=[0, 1], Stream0=trim, Stream1=ultrim_15, NullGaps=False)
multiplication_6 = Multiplication(A=tablength_10, B="3")
ext_10 = ExtendCurve(Curve=weave_12, Type=0, Start=multiplication_6, End=multiplication_6)  # -> simplify(Curve)
shift_21 = ShiftList(List=ext_10, Shift=1, Wrap=True)
crv_31 = Curve(ext_10)
ccx_8 = CurveCurve(CurveA=reparameterize(crv_31), CurveB=reparameterize(shift_21))  # -> Points, ParamsA, ParamsB
trim_3 = TrimTree(Tree=simplify(ccx_8.ParamsB), Depth=1)
shift_22 = ShiftList(List=trim_3, Shift=-1, Wrap=True)
graft_19 = GraftTree(Tree=shift_22, IncludeEmptyLists=True, IncludeNullItems=True)
merge_22 = Merge(Data1=graft_19, Data2=ccx_8.ParamsA)
graft_20 = GraftTree(Tree=crv_31, IncludeEmptyLists=True, IncludeNullItems=True)
bnd_10 = Bounds(Numbers=merge_22)
subcrv_10 = SubCurve(BaseCurve=reparameterize(graft_20), Domain=bnd_10)  # -> simplify(Curve)
trim_4 = TrimTree(Tree=subcrv_10, Depth=1)
join_5 = JoinCurves(Curves=trim_4, Preserve=False)

panel_13 = Panel(unflatten_9)
crv_32 = Curve(item_31)
end_13 = EndPoints(Curve=subcrv_6)  # -> Start, End
Z_2 = UnitZ(Factor=1)
end_14 = EndPoints(Curve=crv_32)  # -> Start, End
vec2pt_2 = Vector2Pt(PointA=end_13.Start, PointB=end_13.End, Unitize=False)  # -> Vector, Length
vec2pt_3 = Vector2Pt(PointA=end_14.Start, PointB=end_14.End, Unitize=False)  # -> Vector, Length
Y_2 = UnitY(Factor=1)
materialthickness_13 = Data(materialthickness)
materialthickness_14 = Data(materialthickness)
pl = ConstructPlane(Origin=end_13.Start, XAxis=vec2pt_2.Vector, YAxis=Z_2)  # -> simplify(graft(Plane))
pl_2 = ConstructPlane(Origin=end_14.Start, XAxis=vec2pt_3.Vector, YAxis=Y_2)
redpline = Reduce(Polyline=join_5, Tolerance=Slider(0.1, range=0..0.1))  # -> Polyline, Reduction
inverse = InverseTransform(Transform=orient_4.Transform)
Z_3 = UnitZ(Factor=materialthickness_13)
boundary = BoundarySurfaces(Edges=join_3)
Z_4 = UnitZ(Factor=expr("-x", materialthickness_14))
boundary_2 = BoundarySurfaces(Edges=redpline.Polyline)
ungroup_6 = Ungroup(Group=orient_7.Geometry)
crv_33 = Curve(join_3)
extr = Extrude(Base=boundary, Direction=Z_3)
extr_2 = Extrude(Base=boundary_2, Direction=Z_4)  # -> simplify(Extrusion); disabled
transform = Transform(Geometry=flatten(extr), Transform=inverse)
trim_5 = TrimWithRegion(Curve=ungroup_6, Region=crv_33)  # -> Inside, Outside
orient_9 = Orient(Geometry=flatten(extr), Source=flatten(xy_10), Target=flatten(xy_9))  # -> Geometry, Transform
crv_34 = Curve(trim_5.Inside)
orient_10 = Orient(Geometry=extr_2, Source=pl_2, Target=pl)  # -> Geometry, Transform
crv_35 = Curve(simplify(crv_34))
group_10 = Group(Objects=[crv_35, crv_33])

data_19 = Data(group_10)
data_20 = Data(join_5)

# ==== cluster UltraTrim: Betterer version of Trim
data = ClusterInput()
data_2 = Data(simplify(data))
trim = TrimTree(Tree=data_2, Depth=1)
null = NullItem(Item=trim)  # -> NullFlags, InvalidFlags, Description
tmatch = MatchText(Text=null.Description, Pattern="Data does not exist", Case=True)
equals = Equality(FirstNumber=null.NullFlags, SecondNumber=1)  # -> Equality, Inequality
equals_2 = Equality(FirstNumber=null.InvalidFlags, SecondNumber=tmatch)  # -> Equality, Inequality
equals_3 = Equality(FirstNumber=null.NullFlags, SecondNumber=null.InvalidFlags)  # -> Equality, Inequality
equals_4 = Equality(FirstNumber=equals_3.Equality, SecondNumber=equals_2.Equality)  # -> Equality, Inequality
equals_5 = Equality(FirstNumber=equals.Equality, SecondNumber=equals_4.Equality)  # -> Equality, Inequality
ma = MassAddition(Input=flatten(equals_5.Inequality))  # -> Result, PartialResults
bool = Boolean(ma.Result)
trim_2 = TrimTree(Tree=data_2, Depth=bool)
T = ClusterOutput(trim_2)

# ==== cluster UltraTrim_2: Betterer version of Trim
data = ClusterInput()
data_2 = Data(simplify(data))
trim = TrimTree(Tree=data_2, Depth=1)
null = NullItem(Item=trim)  # -> NullFlags, InvalidFlags, Description
ma = MassAddition(Input=flatten(null.NullFlags))  # -> Result, PartialResults
smaller = SmallerThan(FirstNumber=ma.Result, SecondNumber=1)  # -> SmallerThan, OrEqualTo
trim_2 = TrimTree(Tree=data_2, Depth=smaller.SmallerThan)
T = ClusterOutput(trim_2)
