# Grasshopper definition Brep.ghx (Grasshopper 1.0.7)
# Copyright: Co-de-iT
# plug-ins: Human, EleFront

panel = Panel("""Retail
Retail
Retail
Comm
Resi
Resi 
etc""")
panel_2 = Panel("Main")
panel_3 = Panel("Podium")
f2f = Panel("3.1")
levels = Panel("5")
f2f_2 = Panel("3.1")
levels_2 = Panel("10")
f2f_3 = Panel("4")
levels_3 = Panel("20")
dpipeline = DynamicGeometryPipeline(
    LayerFilter="Horizontal",
    TypeFilter="Curve",
    NameFilter="*",
    GroupByLayer=False,
    GroupByType=False,
    IncludeHidden=True,
    IncludeLocked=True,
    enableFullPath=True,
    listenToAttributes=True)
dpipeline_2 = DynamicGeometryPipeline(
    LayerFilter="Vertical 2",
    TypeFilter="Curve",
    NameFilter="*",
    GroupByLayer=False,
    GroupByType=False,
    IncludeHidden=True,
    IncludeLocked=True,
    enableFullPath=True,
    listenToAttributes=True)
loft = Loft(Curves=dpipeline_2, Options={Adjust=False, Closed=False, LoftEnds=0, LoftSimp=0, LoftType=0, Rebuild=10, Refit=0.01})
panel_4 = Panel("""BuildID
Typology
Levels
F2F
Parent
Efficiency""")
dpipeline_3 = DynamicGeometryPipeline(
    LayerFilter="Brep1",
    TypeFilter="Brep",
    NameFilter="*",
    GroupByLayer=False,
    GroupByType=False,
    IncludeHidden=True,
    IncludeLocked=True,
    enableFullPath=True,
    listenToAttributes=True)
panel_5 = Panel("""BuildID
Typology
Levels
F2F
Parent
Efficiency""")
panel_6 = Panel("""BuildID
Typology
Levels
F2F
Parent
Efficiency""")
dup = DuplicateData(Data="Retail", Number=levels, Order=True)  # -> simplify(Data)
series = Series(Start=Slider(0, range=0..100), Step=f2f, Count=levels)  # -> simplify(Series)
bbox = BoundingBox(Content=dpipeline_2, Plane=PlaneXY(0, 0, 0), UnionBox=True)  # -> Box, Box_2
item = ListItem(List=series, Index=-1, Wrap=True)
debrep = DeconstructBrep(Brep=bbox.Box)  # -> Faces, Edges, Vertices
eval = EvaluateCurve(Curve=reparameterize(dpipeline), Parameter=0)  # -> Point, Tangent, Angle
series_2 = Series(Start=item, Step=f2f_2, Count=levels_2)  # -> simplify(Series)
dup_2 = DuplicateData(Data="Comm", Number=levels_3, Order=True)  # -> simplify(Data)
item_2 = ListItem(List=series_2, Index=-1, Wrap=True)
dup_3 = DuplicateData(Data="Resi", Number=levels_2, Order=True)  # -> simplify(Data)
series_3 = Series(Start=item_2, Step=f2f_3, Count=levels_3)  # -> simplify(Series)
area = Area(Geometry=debrep.Faces)  # -> Area, Centroid
brep = Brep([<brep referenced from the Rhino model> x3])
area_2 = Area(Geometry=bbox.Box)  # -> Area, Centroid
pdecon = Deconstruct(Point=eval.Point)  # -> XComponent, YComponent, ZComponent
pdecon_2 = Deconstruct(Point=area.Centroid)  # -> XComponent, YComponent, ZComponent
rl = Panel(series)
rl_2 = Panel(series_3)
rl_3 = Panel(series_2)
panel_7 = Panel(debrep.Faces)
f2f_4 = Panel(dup)
sort = SortList(Keys=pdecon.ZComponent, ValuesA=dpipeline)  # -> Keys, ValuesA
attributes = DefineObjectAttributes(UserKeys=panel_5, UserValues=panel_4, Layer="Brep3")
sort_2 = SortList(Keys=pdecon_2.ZComponent, ValuesA=debrep.Faces)  # -> Keys, ValuesA
f2f_5 = Panel(dup_3)
f2f_6 = Panel(dup_2)
building_id = Data()
parent = Data()
efficiency = Data()
typology = Data()
storeys = Data()
f2f_7 = Data()
item_3 = ListItem(List=sort_2.ValuesA, Index=0, Wrap=True)
bake = BakeObjects(Geometry=brep, Attributes=attributes, Bake=False)
loft_2 = Loft(Curves=sort.ValuesA, Options={Adjust=False, Closed=False, LoftEnds=0, LoftSimp=0, LoftType=0, Rebuild=10, Refit=0.01})
eval_2 = EvaluateCurve(Curve=reparameterize(dpipeline_2), Parameter=0)  # -> Point, Tangent, Angle
debrep_2 = DeconstructBrep(Brep=item_3)  # -> Faces, Edges, Vertices
merge = Merge()
cap = CapHoles(Brep=loft_2)
join = JoinCurves(Curves=debrep_2.Faces, Preserve=False)
alongcrv = SortAlongCurve(Points=eval_2.Point, Curve=join)  # -> Points, Indices
item_4 = ListItem(List=dpipeline_2, Index=alongcrv.Indices, Wrap=True)
shift = ShiftList(List=item_4, Shift=Slider(1, range=0..1), Wrap=True)
graft = GraftTree(Tree=shift, IncludeEmptyLists=True, IncludeNullItems=True)
graft_2 = GraftTree(Tree=item_4, IncludeEmptyLists=True, IncludeNullItems=True)
item_5 = ListItem(List=graft_2, Index=0, Wrap=True)  # -> simplify(Item)
item_6 = ListItem(List=graft, Index=0, Wrap=True)  # -> simplify(Item)
merge_2 = Merge(Data1=item_5, Data2=item_6)
loft_3 = Loft(Curves=merge_2, Options={Adjust=False, Closed=False, LoftEnds=0, LoftSimp=0, LoftType=0, Rebuild=10, Refit=0.01})
cap_2 = CapHoles()

# ----
# GEOMETERY INPUT
panel_8 = Panel("BREPS::Brep3")
dpipeline_4 = DynamicGeometryPipeline(
    LayerFilter=panel_8,
    TypeFilter="Brep",
    NameFilter="*",
    GroupByLayer=False,
    GroupByType=False,
    IncludeHidden=True,
    IncludeLocked=True,
    enableFullPath=True,
    listenToAttributes=True)

panel_9 = Panel("""3@12=Comm
25@3.1=Resi
4@12=Comm
17@3.1=Resi""")
panel_10 = Panel("BuildID:1")
panel_11 = Panel("""4@4=Basement
3@12=Comm
5@3.1=Resi
10@12=Comm
12@3.1=Resi""")

# ----
# SORT INTO BUILDINGS
panel_12 = Panel("BuildID")
getuv = GetUserValue(Geometry=dpipeline_4, Key=panel_12)
cset = CreateSet(List=getuv)  # -> simplify(graft(Set)), Map
tmatch = MatchText(Text=getuv, Pattern=cset.Set, Case=True)
dispatch = Dispatch(List=dpipeline_4, DispatchPattern=tmatch)  # -> simplify(ListA), ListB

join_2 = TextJoin(Text=panel_11, Join="*")
join_3 = TextJoin(Text=panel_9, Join="*")
data = Data(reverse(panel_11))
merge_3 = Merge(Data1=join_2, Data2=join_3)
building_in_order = Panel(data)
split = TextSplit(Text=merge_3, Separators="*")  # -> simplify(Result)
panel_13 = Panel(split)
split_2 = TextSplit(Text=data, Separators="@")
split_3 = TextSplit(Text=split_2, Separators="=")  # -> graft(Result)
trim = TrimTree(Tree=split_3, Depth=1)
trim_2 = TrimTree(Tree=trim, Depth=1)
item_7 = ListItem(List=trim_2, Index=0, Wrap=True)  # -> Item, Item1, Item2

# ----
# GET LOWEST POINT ON EACH BREP
debrep_3 = DeconstructBrep(Brep=dispatch.ListA)  # -> Faces, Edges, simplify(Vertices)
pdecon_3 = Deconstruct(Point=debrep_3.Vertices)  # -> XComponent, YComponent, ZComponent
sort_3 = SortList(Keys=pdecon_3.ZComponent, ValuesA=debrep_3.Vertices)  # -> reverse(Keys), reverse(ValuesA)
item_8 = ListItem(List=sort_3.Keys, Index=-1, Wrap=True)  # -> simplify(Item)
utrim = UberTrim(data=item_8)

# ----
# CALCULATE HEIGHT OF EACH BREP
bbox_2 = BoundingBox(Content=dispatch.ListA, Plane=PlaneXY(0, 0, 0))  # -> Box, Box_2
debox = DeconstructBox(Box=bbox_2.Box)  # -> Plane, X, Y, Z
dedomain = DeconstructDomain(Domain=debox.Z)  # -> Start, End
subtraction = Subtraction(A=dedomain.End, B=dedomain.Start)

tmatch_2 = MatchText(Text=item_7.Item2, Pattern="Basement", Case=True)  # -> simplify(Match)
getuv_2 = GetUserValue(Geometry=dispatch.ListA, Key="F2F")
getuv_3 = GetUserValue(Geometry=dispatch.ListA, Key="Typology")

# ---- group: typology names
dup_4 = DuplicateData(Data=item_7.Item2, Number=item_7.Item, Order=True)  # -> simplify(flatten(Data))

# ---- group: floor to floor
dup_5 = DuplicateData(Data=item_7.Item1, Number=item_7.Item, Order=True)  # -> simplify(Data)

# ---- group: split above and below ground
join_4 = TextJoin(Text=dup_5, Join="/")
dispatch_2 = Dispatch(List=join_4, DispatchPattern=tmatch_2)  # -> Basement, AboveGround

# ----
dpipeline_5 = DynamicGeometryPipeline(
    LayerFilter="BREPS::Brep4",
    TypeFilter="Brep",
    NameFilter="*",
    GroupByLayer=False,
    GroupByType=False,
    IncludeHidden=True,
    IncludeLocked=True,
    enableFullPath=True,
    listenToAttributes=True)
getuv_4 = GetUserValue(Geometry=dpipeline_5, Key="BuildID")

# ----
# NUMBER OF FLOORS
division = Division(A=subtraction, B=getuv_2)
round = Round(Number=division)  # -> simplify(Nearest), Floor, Ceiling

panel_14 = Panel(getuv_4)
split_4 = TextSplit(Text=dispatch_2.AboveGround, Separators="/")  # -> simplify(Result)
split_5 = TextSplit(Text=dispatch_2.Basement, Separators="/")  # -> simplify(Result)
clean = CleanTree(RemoveNulls=True, RemoveInvalid=True, RemoveEmpty=True, Tree=split_4)  # -> flatten(Tree)
neg = Negative(Value=split_5)
rev = ReverseList(List=clean)
lng = ListLength(List=flatten(dup_5))
clean_2 = CleanTree(RemoveNulls=True, RemoveInvalid=True, RemoveEmpty=True, Tree=neg)

# ----
# PLANE PER LEVEL
series_4 = Series(Start=utrim, Step=getuv_2, Count=round.Nearest)
pt = ConstructPoint(XCoordinate=0, YCoordinate=0, ZCoordinate=series_4)  # -> simplify(Point)
xy = XYPlane(Origin=pt)

consec = ConsecutiveDomains(Numbers=rev, Additive=True)
roof = Data(lng)
consec_2 = ConsecutiveDomains(Numbers=clean_2, Additive=True)
dedomain_2 = DeconstructDomain(Domain=consec)  # -> flatten(Start), End
dedomain_3 = DeconstructDomain(Domain=consec_2)  # -> flatten(Start), End
graft_3 = GraftTree(Tree=dispatch.ListA, IncludeEmptyLists=True, IncludeNullItems=True)
rev_2 = ReverseList(List=dedomain_3.Start)
f2f_8 = Panel(rev_2)

# ---- group: facade
debrep_4 = DeconstructBrep(Brep=dpipeline_5)  # -> Faces, Edges, Vertices
area_3 = Area(Geometry=debrep_4.Faces)  # -> Area, Centroid
panel_15 = Panel("""-1
0""")
sort_4 = SortList(Keys=area_3.Centroid, ValuesA=debrep_4.Faces)  # -> Keys, ValuesA
cull_i = CullIndex(List=sort_4.ValuesA, Indices=panel_15, Wrap=True)

# ----
# FLOOR PLATE CRVS
sec = BrepPlane(Brep=graft_3, Plane=xy)  # -> Curves, Points

# ----
# TYPOLOGY OF FLOOR
dup_6 = DuplicateData(Data=graft(getuv_3), Number=graft(round.Nearest), Order=True)  # -> simplify(Data)
merge_4 = Merge(Data1=rev_2, Data2="0", Data3=dedomain_2.Start)
pt_2 = ConstructPoint(XCoordinate=0, YCoordinate=0, ZCoordinate=merge_4)
bbox_3 = BoundingBox(Content=dispatch.ListA, Plane=PlaneXY(0, 0, 0), UnionBox=True)  # -> Box, Box_2

# ---- group: floor plates
sec_2 = BrepPlane(Brep=dpipeline_5, Plane=pt_2)  # -> flatten(Curves), Points
boundary = BoundarySurfaces(Edges=sec_2.Curves)

# ----
boundary_2 = BoundarySurfaces(Edges=sec.Curves)  # -> simplify(Surfaces)
rl_4 = Panel(merge_4)
debrep_5 = DeconstructBrep(Brep=bbox_3.Box)  # -> Faces, Edges, Vertices
debox_2 = DeconstructBox(Box=bbox_3.Box)  # -> Plane, X, Y, Z
sort_srf = SRT_SrfsByHeight(surfaces=debrep_5.Faces)  # -> heights_2, ordered_surfaces

# ---- group: roof
item_9 = ListItem(List=boundary, Index=-1, Wrap=True)

# ----
utrim_2 = UberTrim(data=boundary_2)
dedomain_4 = DeconstructDomain(Domain=debox_2.Y)  # -> Start, End
dedomain_5 = DeconstructDomain(Domain=debox_2.X)  # -> Start, End
number_slider = Slider(10, range=0..100)
facade = Data(cull_i)
subtraction_2 = Subtraction(A=dedomain_4.End, B=dedomain_4.Start)
subtraction_3 = Subtraction(A=dedomain_5.End, B=dedomain_5.Start)
utrim_3 = UberTrim(data=utrim_2)

# ----
# SORT BY HEIGHT
utrim_4 = UberTrim(data=series_4)
sort_5 = SortList(Keys=utrim_4, ValuesA=utrim_3)  # -> reverse(Keys), reverse(ValuesA)

item_10 = ListItem(List=sort_5.ValuesA, Index=0, Wrap=True)
utrim_5 = UberTrim(data=dup_6)
utrim_6 = UberTrim(data=series_4)
panel_16 = Panel(lng)
sunion = SolidUnion(Breps=dispatch.ListA)
item_11 = ListItem(List=sort_srf.ordered_surfaces, Index=0, Wrap=True)
floorplate = Data(boundary)
roof_2 = Data(item_9)

# ---- group: properties
typology_2 = Data(dup_4)
rl_5 = Data(merge_4)

# ----
# GET FACADE ---- FINISH THIS
debrep_6 = DeconstructBrep(Brep=dispatch.ListA)  # -> Faces, Edges, Vertices
panel_17 = Panel(subtraction_2)
division_2 = Division(A=subtraction_2, B=number_slider)
division_3 = Division(A=subtraction_3, B=number_slider)
evalsrf = EvaluateSurface(Surface=reparameterize(debrep_6.Faces), Point="0.5,0.5")  # -> Point, Normal, UDirection, VDirection, Frame
sdivide = DivideSurface(Surface=item_11, UCount=division_3, VCount=division_2)  # -> Points, Normals, Parameters
properties_typology = Data(utrim_5)
roof_3 = Data(item_10)
floor_plates = Data(utrim_3)
properties_rl = Data(utrim_6)
full_mass = Data(sunion)
viewer = ParamViewer(debrep_6.Faces)
pdecon_4 = Deconstruct(Point=evalsrf.Point)  # -> XComponent, YComponent, ZComponent
sort_6 = SortList(Keys=pdecon_4.ZComponent, ValuesA=debrep_6.Faces)  # -> Keys, ValuesA
Z = UnitZ(Factor=Slider(999999, range=0..1000000))
panel_18 = Panel("""-1
0""")
cull_i_2 = CullIndex(List=sort_6.ValuesA, Indices=panel_18, Wrap=True)
item_12 = ListItem(List=sort_6.ValuesA, Index=panel_18, Wrap=True)
move = Move(Geometry=sdivide.Points, Motion=Z)  # -> simplify(Geometry), Transform
panel_19 = Panel(item_12)
utrim_7 = UberTrim(data=move.Geometry)
mesh = MeshBrep(
    Brep=boundary_2,
    Settings={GridMaxCount=0, GridMinCount=16, JaggedSeams=False, MaxEdgeLength=0, MinEdgeLength=0.0001, MinTolerance=0, Refine=True, RefineAngle=0, RelativeTolerance=0.65, SimplePlanes=True, Tolerance=0})
utrim_8 = UberTrim(data=mesh)
viewer_2 = ParamViewer(utrim_7)
Z_2 = UnitZ(Factor=1)
utrim_9 = UberTrim(data=utrim_8)
neg_2 = Negative(Value=Z_2)
mjoin = MeshJoin(Meshes=utrim_9)
viewer_3 = ParamViewer(mjoin)
meshray = MeshRay(Mesh=mjoin, Point=utrim_7, Direction=neg_2)  # -> Point, Hit

# ==== cluster SRT_SrfsByHeight: Sort surfaces by Z height
surfaces = ClusterInput()  # Surfaces to be sorted
srfs = Data(surfaces)
evalsrf = EvaluateSurface(Surface=srfs, Point="0.5, 0.5")  # -> Point, Normal, UDirection, VDirection, Frame
pdecon = Deconstruct(Point=evalsrf.Point)  # -> XComponent, YComponent, ZComponent
sort = SortList(Keys=pdecon.ZComponent, ValuesA=srfs)  # -> Keys, ValuesA
ordered_srfs = Data(sort.ValuesA)
heights = Data(sort.Keys)
ordered_surfaces = ClusterOutput(ordered_srfs)  # Ordered surfaces
heights_2 = ClusterOutput(heights)  # Heights of the sorted Surfaces

# ==== cluster UberTrim: Better version of Trim
data = ClusterInput()
data_2 = Data(data)
trim = TrimTree(Tree=data_2, Depth=1)
null = NullItem(Item=trim)  # -> NullFlags, InvalidFlags, Description
bool = Boolean(invert(null.NullFlags))
trim_2 = TrimTree(Tree=data_2, Depth=bool)
data_3 = Data(trim_2)
data_4 = ClusterOutput(data_3)
