# Grasshopper definition BrepTestv1.gh (Grasshopper 1.0.5)
# plug-ins: Redback

panel = Panel("""Typology
Levels
F2F""")
panel_2 = Panel("""Residential
10
3.1""")
crv = Curve(<curve referenced from the Rhino model>)

crv_2 = Curve(<curve referenced from the Rhino model>)
crv_3 = Curve(<curve referenced from the Rhino model>)
boundary = BoundarySurfaces(Edges=crv_3)
boundary_2 = BoundarySurfaces(Edges=crv_2)
geo = Geometry(<brep referenced from the Rhino model>)
evalsrf = EvaluateSurface(Surface=reparameterize(boundary_2), Point=Point(0.5, 0.5, 0))  # -> Point, Normal, UDirection, VDirection, Frame
debrep = DeconstructBrep(Brep=geo)  # -> flatten(Faces), Edges, Vertices
sec = BrepPlane(Brep=geo, Plane=evalsrf.Frame)  # -> Curves, Points
bbox = BoundingBox(Content=sec.Curves, Plane=graft(evalsrf.Frame))  # -> Box, Box_2
debox = DeconstructBox(Box=bbox.Box)  # -> Plane, X, Y, Z
planesrf = PlaneSurface(Plane=debox.Plane, XSize=debox.X, YSize=debox.Y)
bvol = BoundaryVolume(Boundaries=flatten([debrep.Faces, planesrf]))

crv_4 = Curve(<curve referenced from the Rhino model>)
boundary_3 = BoundarySurfaces(Edges=crv_4)
geo_2 = Geometry(<brep referenced from the Rhino model>)
evalsrf_2 = EvaluateSurface(Surface=reparameterize(boundary_3), Point=Point(0.5, 0.5, 0))  # -> Point, Normal, UDirection, VDirection, Frame
debrep_2 = DeconstructBrep(Brep=geo_2)  # -> flatten(Faces), Edges, Vertices
sec_2 = BrepPlane(Brep=geo_2, Plane=evalsrf_2.Frame)  # -> Curves, Points
bbox_2 = BoundingBox(Content=sec_2.Curves, Plane=graft(evalsrf_2.Frame))  # -> Box, Box_2
debox_2 = DeconstructBox(Box=bbox_2.Box)  # -> Plane, X, Y, Z
planesrf_2 = PlaneSurface(Plane=debox_2.Plane, XSize=debox_2.X, YSize=debox_2.Y)
bvol_2 = BoundaryVolume(Boundaries=flatten([debrep_2.Faces, planesrf_2]))

crv_5 = Curve(<curve referenced from the Rhino model>)
crv_6 = Curve(<curve referenced from the Rhino model>)
boundary_4 = BoundarySurfaces(Edges=crv_6)
boundary_5 = BoundarySurfaces(Edges=crv_5)
geo_3 = Geometry(<brep referenced from the Rhino model>)
evalsrf_3 = EvaluateSurface(Surface=reparameterize([boundary_5, boundary_4]), Point=Point(0.5, 0.5, 0))  # -> Point, Normal, UDirection, VDirection, Frame
debrep_3 = DeconstructBrep(Brep=geo_3)  # -> flatten(Faces), Edges, Vertices
sec_3 = BrepPlane(Brep=geo_3, Plane=evalsrf_3.Frame)  # -> Curves, Points
bbox_3 = BoundingBox(Content=sec_3.Curves, Plane=graft(evalsrf_3.Frame))  # -> Box, Box_2
debox_3 = DeconstructBox(Box=bbox_3.Box)  # -> Plane, X, Y, Z
planesrf_3 = PlaneSurface(Plane=debox_3.Plane, XSize=debox_3.X, YSize=debox_3.Y)
bvol_3 = BoundaryVolume(Boundaries=flatten([debrep_3.Faces, planesrf_3]))

json = JSON(Key=panel, Value=panel_2)
read = ReadJSON(Object=json, Key="Levels")
boundary_6 = BoundarySurfaces(Edges=crv)

crv_7 = Curve(<curve referenced from the Rhino model>)
boundary_7 = BoundarySurfaces(Edges=crv_7)
geo_4 = Geometry(<brep referenced from the Rhino model>)
evalsrf_4 = EvaluateSurface(Surface=reparameterize([boundary_6, boundary_7]), Point=Point(0.5, 0.5, 0))  # -> Point, Normal, UDirection, VDirection, Frame
debrep_4 = DeconstructBrep(Brep=geo_4)  # -> flatten(Faces), Edges, Vertices
sec_4 = BrepPlane(Brep=geo_4, Plane=evalsrf_4.Frame)  # -> Curves, Points
bbox_4 = BoundingBox(Content=sec_4.Curves, Plane=graft(evalsrf_4.Frame))  # -> Box, Box_2
debox_4 = DeconstructBox(Box=bbox_4.Box)  # -> Plane, X, Y, Z
planesrf_4 = PlaneSurface(Plane=debox_4.Plane, XSize=debox_4.X, YSize=debox_4.Y)
bvol_4 = BoundaryVolume(Boundaries=flatten([debrep_4.Faces, planesrf_4]))

panel_3 = Panel(read)
panel_4 = Panel(json)
brep = Brep(bvol_4)
brep_2 = Brep(bvol_3)
brep_3 = Brep(bvol_2)
brep_4 = Brep(bvol)
