# Grasshopper definition Curve method.ghx (Grasshopper 1.0.7)
# plug-ins: Redback, Human, Bifocals

# TOWER BY CURVES [MULTI STACKING]
# This script uses curves with Rhino user attributes to create multi stacked
# towers. The curves z height within its SubBuildingID determines its hierarchy
# within each tower. Curves require BuildIDs as well as SubBuildIDs.
gallery = ImageGallery(CycleDelay=30, Randomize=False, UseLocalImages=True, UseRemoteImages=True)
# TOWER BY CURVES [SINGLE STACKING]
# This script uses curves with Rhino user attributes to create single
# stacked towers. The curves z height within its BuildingID determines
# its hierarchy within each tower. Curves require BuildIDs, but not SubBuildIDs.
gallery_2 = ImageGallery(CycleDelay=30, Randomize=False, UseLocalImages=True, UseRemoteImages=True)
# TOWER BY CURVES [SUBBUILDID]
# This Script uses Curves with Rhino user attributes to create towers.
# TheSubBuildID of each curve determines its hierarchy within each
# tower. For example, SubBuildID A sits below AA and AB. SubBuild
# AB sits below ABA which sits below ABB.
gallery_3 = ImageGallery(CycleDelay=30, Randomize=False, UseLocalImages=True, UseRemoteImages=True)
# 1. Create building curves
# with the following user
# attributes in Rhino
gallery_4 = ImageGallery(CycleDelay=30, Randomize=False, UseLocalImages=True, UseRemoteImages=True)
# 1. Create building curves
# with the following user
# attributes in Rhino
gallery_5 = ImageGallery(CycleDelay=30, Randomize=False, UseLocalImages=True, UseRemoteImages=True)
# 1. Create building curves
# with the following user
# attributes in Rhino
gallery_6 = ImageGallery(CycleDelay=30, Randomize=False, UseLocalImages=True, UseRemoteImages=True)
panel = Panel("Tower By Curves - Single Stack::Input Curves")  # disabled
panel_2 = Panel("Tower by Curves - SubBuildID::Input Curves")  # disabled
panel_3 = Panel("Curve")  # disabled
# 2. Place curves under the
# layer "Tower by Curves -
# Single Stack", and in the
# sublayer "Input Curves"
panel_4 = Panel("*")  # disabled
panel_5 = Panel("Curve")  # disabled
# 2. Place curves under the
# layer "Tower by Curves -
# SubBuildID", and in the
# sublayer "Input Curves"
panel_6 = Panel("*")  # disabled
# 2. Place curves under the
# layer "Tower by Curves -
# Multi Stack", and in the
# sublayer "Input Curves"
toggle = BooleanToggle(True)
dpipeline = DynamicGeometryPipeline(
    LayerFilter=panel,
    TypeFilter=panel_3,
    NameFilter=panel_4,
    GroupByLayer=False,
    GroupByType=False,
    IncludeHidden=True,
    IncludeLocked=True,
    enableFullPath=True,
    listenToAttributes=True)  # disabled
dpipeline_2 = DynamicGeometryPipeline(
    LayerFilter="Tower By Curves - Multi Stack::Input Curves",
    TypeFilter="Curve",
    NameFilter="*",
    GroupByLayer=False,
    GroupByType=False,
    IncludeHidden=True,
    IncludeLocked=True,
    enableFullPath=True,
    listenToAttributes=True)
dpipeline_3 = DynamicGeometryPipeline(
    LayerFilter=panel_2,
    TypeFilter=panel_5,
    NameFilter=panel_6,
    GroupByLayer=False,
    GroupByType=False,
    IncludeHidden=True,
    IncludeLocked=True,
    enableFullPath=True,
    listenToAttributes=True)  # disabled

# ---- group: Cluster
tower_by_curves_single_stacking = TowerByCurvesZHeight(building_curves=dpipeline)  # -> roof_2, roof_properties_2, full_mass_2, full_mass_properties_2, sub_mass_2, sub_mass_properties_2, facade_3, facade_properties_2, floorplates_2, floorplate_properties_2; disabled

tower_by_curves_subbuildid = TowerByCurves(geo=dpipeline_3)  # -> roof_2, roof_properties_2, full_mass_2, full_mass_properties_2, sub_mass_2, sub_mass_properties_2, facade_3, facade_properties_2, floorplates_2, floorplate_properties_2; disabled

# ----
towers_by_curves_multi_stacking = TowersByCurvesMultiStacking(building_curves=dpipeline_2, multiple_buildings_t_f=toggle)  # -> roof_2, roof_properties_2, full_mass_2, full_mass_properties_2, sub_mass_2, sub_mass_properties_2, facade_3, facade_properties_2, floorplates_2, floorplate_properties_2
# 3 Flick through value list to
# extract different floorplate
# properties
list = ValueList({"RL", "Area", "Typology", "BuildID", "SubBuildID"}, selected="BuildID")  # disabled
# 3 Flick through value list to
# extract different floorplate
# properties
# SORT VIA BUILDID
# SORT VIA Z HEIGHT
list_2 = ValueList({"RL", "Area", "Typology", "BuildID", "SubBuildID"}, selected="Area")  # disabled
# 3 Flick through value list to
# extract different floorplate
# properties
list_3 = ValueList({"RL", "Area", "Typology", "BuildID", "SubBuildID"}, selected="Typology")
read = ReadJSON(Object=tower_by_curves_single_stacking.floorplate_properties_2, Key=list)  # disabled
# PROJECTING FLOOR CURVES ONTO CORRECT FLOOR HEIGHT
# CREATING ROOF GEOMETRY
# EXTRACTING ROOF PROPERTIES
# CREATING FULL MASS
# EXTRACTING FULL MASS PROPERTIES
# CREATING SUB MASS
# EXTRACTING SUB MASS PROPERTIES
# CREATING FACADE
# EXTRACTING FACADE PROPERTIES
# CREATING FLOORPLATES
# EXTRACTING FLOORPLATE PROPERTIES
read_2 = ReadJSON(Object=tower_by_curves_subbuildid.floorplate_properties_2, Key=list_2)  # disabled
brep = Brep(tower_by_curves_single_stacking.floorplates_2)  # disabled
brep_2 = Brep(tower_by_curves_subbuildid.floorplates_2)  # disabled
read_3 = ReadJSON(TowerProperties=towers_by_curves_multi_stacking.floorplate_properties_2, Key=list_3)
tower_geometry = Brep(towers_by_curves_multi_stacking.floorplates_2)
panel_7 = Panel(read_2)  # disabled
panel_8 = Panel(read)  # disabled
output = DataOutput(
    Roof=towers_by_curves_multi_stacking.roof_2,
    Roof_Properties=towers_by_curves_multi_stacking.roof_properties_2,
    Full_Mass=towers_by_curves_multi_stacking.full_mass_2,
    Full_Mass_Properties=towers_by_curves_multi_stacking.full_mass_properties_2,
    Sub_Mass=towers_by_curves_multi_stacking.sub_mass_2,
    Sub_Mass_Properties=towers_by_curves_multi_stacking.sub_mass_properties_2,
    Facade=towers_by_curves_multi_stacking.facade_3,
    Facade_Properties=towers_by_curves_multi_stacking.facade_properties_2,
    Floorplates=towers_by_curves_multi_stacking.floorplates_2,
    Floorplate_Properties=towers_by_curves_multi_stacking.floorplate_properties_2,
    Destination="C:\Users\c-nbungbrakearti\Documents\GitHub\Hackathon2018\Compiled Feaso Components\Massing Methods\Curve Method\Curve Method.ghdata")  # disabled
output_2 = DataOutput(
    Roof=tower_by_curves_single_stacking.roof_2,
    Roof_Properties=tower_by_curves_single_stacking.roof_properties_2,
    Full_Mass=tower_by_curves_single_stacking.full_mass_2,
    Full_Mass_Properties=tower_by_curves_single_stacking.full_mass_properties_2,
    Sub_Mass=tower_by_curves_single_stacking.sub_mass_2,
    Sub_Mass_Properties=tower_by_curves_single_stacking.sub_mass_properties_2,
    Facade=tower_by_curves_single_stacking.facade_3,
    Facade_Properties=tower_by_curves_single_stacking.facade_properties_2,
    Floorplates=tower_by_curves_single_stacking.floorplates_2,
    Floorplate_Properties=tower_by_curves_single_stacking.floorplate_properties_2,
    Destination="C:\Users\c-nbungbrakearti\Documents\GitHub\Hackathon2018\Compiled Feaso Components\Massing Methods\Curve Method\Curve Method.ghdata")  # disabled
output_3 = DataOutput(
    Roof=tower_by_curves_subbuildid.roof_2,
    Roof_Properties=tower_by_curves_subbuildid.roof_properties_2,
    Full_Mass=tower_by_curves_subbuildid.full_mass_2,
    Full_Mass_Properties=tower_by_curves_subbuildid.full_mass_properties_2,
    Sub_Mass=tower_by_curves_subbuildid.sub_mass_2,
    Sub_Mass_Properties=tower_by_curves_subbuildid.sub_mass_properties_2,
    Facade=tower_by_curves_subbuildid.facade_3,
    Facade_Properties=tower_by_curves_subbuildid.facade_properties_2,
    Floorplates=tower_by_curves_subbuildid.floorplates_2,
    Floorplate_Properties=tower_by_curves_subbuildid.floorplate_properties_2,
    Destination="C:\Users\c-nbungbrakearti\Documents\GitHub\Hackathon2018\Compiled Feaso Components\Massing Methods\Curve Method\Curve Method.ghdata")  # disabled
cset = CreateSet(List=flatten(read_3))  # -> Set, Map
mindex = MemberIndex(Set=flatten(read_3), Member=cset.Set)  # -> Index, Count
item = ListItem(List=flatten(tower_geometry), Index=mindex.Index, Wrap=True)
colour_swatches = Shader(graft([ColourSwatch(SwatchColor=RGB(153, 181, 139)), ColourSwatch(SwatchColor=RGB(100, 112, 130)), ColourSwatch(SwatchColor=RGB(235, 110, 110))]))
group = Group(Objects=item)
preview = CustomPreview(Geometry=group, Material=colour_swatches)

# ==== cluster TowerByCurves
geo = ClusterInput()
geo_2 = Geometry(geo)
panel = Panel(geo_2)
clockcrv = ClockwiseCurve(crv=geo_2)
data = Data(geo_2)
panel_2 = Panel(clockcrv)
objatts = ObjectAttributes(ObjectOrAttributes=data)  # -> Name, LayerName, LayerFullPath, Color, MaterialName, LinetypeName, GroupIndices, PlotWeight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
panel_3 = Panel("""BuildID
Typology
F2F
Levels
SubBuildID""")
json = JSON(Key=objatts.UserDataKeys, Value=objatts.UserDataValues)
read = ReadJSON(Object=json, Key=panel_3)
flip = FlipMatrix(Data=read)
read_2 = ReadJSON(Object=json, Key="Typology")  # -> flatten(Value)
read_3 = ReadJSON(Object=json, Key="SubBuildID")  # -> flatten(Value)
read_4 = ReadJSON(Object=json, Key="BuildID")  # -> flatten(Value)
branch = TreeBranch(Tree=simplify(flip), Path="3", MaintainPaths=True)  # -> graft(Branch)
branch_2 = TreeBranch(Tree=simplify(flip), Path="2", MaintainPaths=True)  # -> graft(Branch)
branch_3 = TreeBranch(Tree=flip, Path="0", MaintainPaths=True)
branch_4 = TreeBranch(Tree=flip, Path="4", MaintainPaths=True)
cset = CreateSet(List=flatten(read_4))  # -> Set, Map
addition = Addition(A=branch, B=1)
concat = Concatenate(FragmentA=branch_3, FragmentB=branch_4)
series = Series(Start=0, Step=branch_2, Count=addition)  # -> simplify(Series)
mindex = MemberIndex(Set=flatten(read_4), Member=cset.Set)  # -> Index, Count
panel_4 = Panel(concat)
python = GhPythonScript(ID=concat)  # -> StackID
# ---------- python: Python ----------
__author__ = "B-MBuckley"
__version__ = "2018.10.25"

import rhinoscriptsyntax as rs

StackID = []

for i in range(len(ID)-1):
    StackID.append(ID[0:i+1])
# ---------- end python ----------
item = ListItem(List=series, Index=0, Wrap=True)  # -> flatten(Item1), Item
item_2 = ListItem(List=read_2, Index=mindex.Index, Wrap=True)  # -> simplify(Item)
item_3 = ListItem(List=read_3, Index=mindex.Index, Wrap=True)
item_4 = ListItem(List=read_4, Index=mindex.Index, Wrap=True)
mindex_2 = MemberIndex(Set=panel_4, Member=python)  # -> Index, Count
panel_5 = Panel(item.Item1)
tsort = SortText(Keys=item_3, Values=item_2, Culture=127)  # -> Keys, Values
tsort_2 = SortText(Keys=item_3, Values=item_4, Culture=127)  # -> Keys, Values
item_5 = ListItem(List=panel_5, Index=mindex_2.Index, Wrap=True)
trim = TrimTree(Tree=item_5, Depth=1)
cset_2 = CreateSet(List=tsort_2.Values)  # -> Set, Map
graft = GraftTree(Tree=tsort.Values, IncludeEmptyLists=True, IncludeNullItems=True)
graft_2 = GraftTree(Tree=tsort_2.Keys, IncludeEmptyLists=True, IncludeNullItems=True)
graft_3 = GraftTree(Tree=tsort_2.Values, IncludeEmptyLists=True, IncludeNullItems=True)
ma = MassAddition(Input=trim)  # -> Result, PartialResults
nullrep = ReplaceNulls(Items=ma.Result, Replacements="0")  # -> Items, Count
addition_2 = Addition(A=nullrep.Items, B=series)
data_2 = Data(addition_2)
pt = ConstructPoint(XCoordinate=0, YCoordinate=0, ZCoordinate=data_2)
xy = XYPlane(Origin=pt)
project = Project(Geometry=graft(data), Plane=xy)  # -> simplify(Geometry), Transform
projected_floor_curves = Geometry(project.Geometry)
first_last = FirstLast(List=projected_floor_curves)  # -> FirstValue, LastValue
first_last_2 = FirstLast(List=projected_floor_curves)  # -> FirstValue, LastValue
facade = Loft(
    Curves=[first_last.FirstValue, first_last_2.LastValue],
    Options={Adjust=False, Closed=False, LoftEnds=0, LoftSimp=0, LoftType=0, Rebuild=10, Refit=0.01})  # -> simplify(Loft)
geo_3 = Geometry(flatten(facade))
cap = CapHoles(Brep=geo_3)
item_6 = ListItem(List=cap, Index=mindex.Index, Wrap=True)
item_7 = ListItem(List=geo_3, Index=mindex.Index, Wrap=True)
tsort_3 = SortText(Keys=item_3, Values=item_6, Culture=127)  # -> Keys, Values
tsort_4 = SortText(Keys=item_3, Values=item_7, Culture=127)  # -> Keys, Values
graft_4 = GraftTree(Tree=tsort_3.Values, IncludeEmptyLists=True, IncludeNullItems=True)  # -> simplify(SubMass)
graft_5 = GraftTree(Tree=tsort_4.Values, IncludeEmptyLists=True, IncludeNullItems=True)
debrep = DeconstructBrep(Brep=graft_5)  # -> simplify(Faces), Edges, Vertices
boundary = BoundarySurfaces(Edges=project.Geometry)
floor_surfaces = Geometry(boundary)
cull_i = CullIndex(List=floor_surfaces, Indices=-1, Wrap=True)
group = Group(Objects=cull_i)  # -> flatten(Group)
item_8 = ListItem(List=group, Index=mindex.Index, Wrap=True)
tsort_5 = SortText(Keys=item_3, Values=item_8, Culture=127)  # -> Keys, Values
ungroup = Ungroup(Group=tsort_5.Values)  # -> simplify(Objects)
lng = ListLength(List=ungroup)
geo_4 = Geometry(ungroup)
dup = DuplicateData(Data=graft, Number=lng, Order=True)  # -> simplify(Data)
dup_2 = DuplicateData(Data=graft_2, Number=lng, Order=True)  # -> simplify(Data)
dup_3 = DuplicateData(Data=graft_3, Number=lng, Order=True)  # -> simplify(Data)
area = Area(Geometry=geo_4)  # -> Area, Centroid
xy_2 = XYPlane(Origin=area.Centroid)
pdecon = Deconstruct(Point=area.Centroid)  # -> XComponent, YComponent, simplify(ZComponent)
group_2 = Group(Objects=xy_2)
long = LongestList(ListA=debrep.Faces, ListB=group_2, PaddingMode=2)  # -> graft(ListA), ListB
ungroup_2 = Ungroup(Group=long.ListB)
sec = BrepPlane(Brep=long.ListA, Plane=ungroup_2)  # -> Curves, Points
shift = ShiftPaths(Data=sec.Curves, Offset=-1)
srfsplit = SurfaceSplit(Surface=long.ListA, Curves=shift)
first_last_3 = FirstLast(List=boundary)  # -> FirstValue, LastValue
data_3 = Data(simplify(graft(tsort.Values)))
data_4 = Data(simplify(graft(tsort_2.Keys)))
data_5 = Data(simplify(graft(tsort_2.Values)))
trim_2 = TrimTree(Tree=srfsplit, Depth=1)
trim_3 = TrimTree(Tree=trim_2, Depth=1)
rint = RegionIntersection(CurvesA=flatten(first_last_3.FirstValue), CurvesB=first_last_3.LastValue)
area_2 = Area(Geometry=trim_3)  # -> Area, Centroid
boundary_2 = BoundarySurfaces(Edges=rint)
pdecon_2 = Deconstruct(Point=area_2.Centroid)  # -> XComponent, YComponent, ZComponent
panel_6 = Panel("""RL
Area
Typology
SubBuildID
BuildID""")
panel_7 = Panel("""Typology
SubBuildID
BuildID""")
panel_8 = Panel("""Area
Typology
SubBuildID
BuildID""")
merge = Merge(Data1=simplify(graft(cset_2.Set)))  # -> simplify(Result)
merge_2 = Merge(Data1=simplify(graft(graft)), Data2=simplify(graft(graft_2)), Data3=simplify(graft(graft_3)))  # -> simplify(Result)
merge_3 = Merge(Data1=simplify(graft(dup)), Data2=simplify(graft(dup_2)), Data3=simplify(graft(dup_3)))  # -> simplify(Result)
panel_9 = Panel("""Typology
SubBuildID
BuildID""")
sdiff = SolidDifference(BrepsA=first_last_3.LastValue, BrepsB=flatten(boundary_2))
trim_4 = TrimTree(Tree=graft_5, Depth=1)
sort = SortList(Keys=pdecon_2.ZComponent, ValuesA=trim_3)  # -> Keys, ValuesA
lng_2 = ListLength(List=debrep.Faces)
group_3 = Group(Objects=sdiff)
partition = PartitionList(List=sort.ValuesA, Size=lng_2)
json_2 = JSON(Key=panel_7, Value=merge_3)
item_9 = ListItem(List=flatten(group_3), Index=mindex.Index, Wrap=True)
join = BrepJoin(Breps=partition)  # -> simplify(Breps), Closed
cap_2 = CapHoles(Brep=trim_4)
geo_5 = Geometry(geo_4)
area_3 = Area(Geometry=geo_5)  # -> Area, Centroid
merge_4 = Merge(
    Data1=simplify(graft(pdecon.ZComponent)),
    Data2=simplify(graft(area_3.Area)),
    Data3=simplify(graft(dup)),
    Data4=simplify(graft(dup_2)),
    Data5=simplify(graft(dup_3)))  # -> simplify(Result)
json_3 = JSON(Key=panel_6, Value=merge_4)
trim_5 = TrimTree(Tree=json_3, Depth=1)
tsort_6 = SortText(Keys=item_3, Values=item_9, Culture=127)  # -> Keys, simplify(Values)
ungroup_3 = Ungroup(Group=tsort_6.Values)
trim_6 = TrimTree(Tree=ungroup_3, Depth=1)
area_4 = Area(Geometry=trim_6)  # -> Area, Centroid
sunion = SolidUnion(Breps=cap_2)
json_4 = JSON(Key="BuildID", Value=merge)
json_5 = JSON(Key=panel_9, Value=merge_2)
sub_mass_properties = Data(json_5)
floorplate_properties = Data(trim_5)
full_mass_properties = Data(json_4)
facade_properties = Data(json_2)
full_mass = Data(simplify(graft(sunion)))
floorplates = Data(geo_5)
sub_mass = Geometry(graft_4)
facade_2 = Data(join.Breps)
ungroup_4 = Ungroup(Group=tsort_6.Values)
dup_4 = DuplicateDataMatch(SourceDataTree=ungroup_4, SecondaryData1=data_3)  # -> SourceData, SecondaryData1
dup_5 = DuplicateDataMatch(SourceDataTree=ungroup_4, SecondaryData1=data_4)  # -> SourceData, SecondaryData1
dup_6 = DuplicateDataMatch(SourceDataTree=ungroup_4, SecondaryData1=data_5)  # -> SourceData, SecondaryData1
trim_7 = TrimTree(Tree=dup_4.SecondaryData1, Depth=1)
trim_8 = TrimTree(Tree=dup_5.SecondaryData1, Depth=1)
trim_9 = TrimTree(Tree=dup_6.SecondaryData1, Depth=1)
merge_5 = Merge(
    Data1=simplify(graft(area_4.Area)),
    Data2=simplify(graft(trim_7)),
    Data3=simplify(graft(trim_8)),
    Data4=simplify(graft(trim_9)))  # -> simplify(Result)
json_6 = JSON(Key=panel_8, Value=merge_5)
trim_10 = TrimTree(Tree=json_6, Depth=1)
roof_properties = Data(trim_10)
trim_11 = TrimTree(Tree=ungroup_4, Depth=1)
roof_properties_2 = ClusterOutput(roof_properties)
full_mass_2 = ClusterOutput(full_mass)
full_mass_properties_2 = ClusterOutput(full_mass_properties)
sub_mass_2 = ClusterOutput(sub_mass)
sub_mass_properties_2 = ClusterOutput(sub_mass_properties)
facade_3 = ClusterOutput(facade_2)
floorplates_2 = ClusterOutput(floorplates)
floorplate_properties_2 = ClusterOutput(floorplate_properties)
facade_properties_2 = ClusterOutput(facade_properties)
roof = Data(trim_11)
roof_2 = ClusterOutput(roof)

# ==== cluster TowerByCurvesZHeight: This cluster uses Rhino Curves with user attributes to create a tower based off curve z-height. This cluster can only create single stacked towers.

# ---- group: Cluster Input
building_curves = ClusterInput()

# ----
building_curves_2 = Curve(building_curves)
objatts = ObjectAttributes(ObjectOrAttributes=building_curves_2)  # -> Name, LayerName, LayerFullPath, Color, MaterialName, LinetypeName, GroupIndices, PlotWeight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
panel = Panel("""BuildID
Typology
F2F
Levels""")
json = JSON(Key=objatts.UserDataKeys, Value=objatts.UserDataValues)
read = ReadJSON(Object=json, Key=panel)
mindex = MemberIndex(Set=panel, Member="F2F")  # -> Index, Count
mindex_2 = MemberIndex(Set=panel, Member="Levels")  # -> Index, Count
mindex_3 = MemberIndex(Set=panel, Member="BuildID")  # -> Index, Count
flip = FlipMatrix(Data=read)
branch = TreeBranch(Tree=flip, Path=mindex.Index, MaintainPaths=True)
branch_2 = TreeBranch(Tree=flip, Path=mindex_2.Index, MaintainPaths=True)
branch_3 = TreeBranch(Tree=flip, Path=mindex_3.Index, MaintainPaths=True)
panel_2 = Panel(building_curves_2)
cset = CreateSet(List=branch_3)  # -> Set, Map
tsort = SortText(Keys=cset.Set, Values=cset.Set, Culture=127)  # -> Keys, Values
read_2 = ReadJSON(Object=json, Key="Typology")  # -> flatten(Value)
read_3 = ReadJSON(Object=json, Key="BuildID")  # -> flatten(Value)
mindex_4 = MemberIndex(Set=branch_3, Member=tsort.Keys)  # -> Index, Count
panel_3 = Panel(mindex_4.Index)
cset_2 = CreateSet(List=flatten(read_3))  # -> Set, Map
subbuildid_naming = Panel("""A
B
C
D
E
F
G
H
I
J
K
L
M
M
O
P""")

# ----
# SORT VIA BUILDID
item = ListItem(List=branch, Index=mindex_4.Index, Wrap=True)
item_2 = ListItem(List=branch_2, Index=mindex_4.Index, Wrap=True)
item_3 = ListItem(List=building_curves_2, Index=mindex_4.Index, Wrap=True)

tsort_2 = SortText(Keys=cset_2.Set, Values=cset_2.Set, Culture=127)  # -> Keys, Values
mindex_5 = MemberIndex(Set=flatten(read_3), Member=tsort_2.Keys)  # -> Index, Count
area = Area(Geometry=item_3)  # -> Area, Centroid
item_4 = ListItem(List=read_2, Index=mindex_5.Index, Wrap=True)
pdecon = Deconstruct(Point=area.Centroid)  # -> XComponent, YComponent, ZComponent
item_5 = ListItem(List=read_3, Index=mindex_5.Index, Wrap=True)

# ----
# SORT VIA Z HEIGHT
sort = SortList(Keys=pdecon.ZComponent, ValuesA=item)  # -> Keys, ValuesA
sort_2 = SortList(Keys=pdecon.ZComponent, ValuesA=item_2)  # -> Keys, ValuesA
sort_3 = SortList(Keys=pdecon.ZComponent, ValuesA=item_3)  # -> Keys, ValuesA

sort_4 = SortList(Keys=pdecon.ZComponent, ValuesA=item_4)  # -> Keys, ValuesA
sort_5 = SortList(Keys=pdecon.ZComponent, ValuesA=item_5)  # -> Keys, ValuesA

addition = Addition(A=sort_2.ValuesA, B=1)
series = Series(Start=0, Step=sort.ValuesA, Count=addition)  # -> simplify(Series)
item_6 = ListItem(List=series, Index=0, Wrap=True)  # -> Item1, Item
shift = ShiftPaths(Data=item_6.Item1, Offset=-1)
cull_i = CullIndex(List=shift, Indices=-1, Wrap=True)
# PROJECTING FLOOR CURVES ONTO CORRECT FLOOR HEIGHT
ins = InsertItems(List=cull_i, Item=0, Indices=0, Wrap=True)
data = Data(simplify(graft(ins)))
shift_2 = ShiftPaths(Data=data, Offset=-1)
ma = MassAddition(Input=shift_2)  # -> Result, simplify(graft(PartialResults))
addition_2 = Addition(A=series, B=ma.PartialResults)
pt = ConstructPoint(XCoordinate=0, YCoordinate=0, ZCoordinate=addition_2)
crv = Curve(simplify(graft(sort_3.ValuesA)))
xy = XYPlane(Origin=pt)
project = Project(Geometry=crv, Plane=xy)  # -> simplify(Geometry), Transform
boundary = BoundarySurfaces(Edges=project.Geometry)

projected_floor_curves = Geometry(project.Geometry)
first_last = FirstLast(List=projected_floor_curves)  # -> FirstValue, LastValue
first_last_2 = FirstLast(List=projected_floor_curves)  # -> FirstValue, LastValue
facade = Loft(
    Curves=[first_last.FirstValue, first_last_2.LastValue],
    Options={Adjust=False, Closed=False, LoftEnds=0, LoftSimp=0, LoftType=0, Rebuild=10, Refit=0.01})  # -> simplify(Loft)
floor_surfaces = Geometry(boundary)
cull_i_2 = CullIndex(List=floor_surfaces, Indices=-1, Wrap=True)
geo = Geometry(facade)
group = Group(Objects=cull_i_2)
shift_3 = ShiftPaths(Data=geo, Offset=-1)
shift_4 = ShiftPaths(Data=geo, Offset=-1)
shift_5 = ShiftPaths(Data=group, Offset=-2)
cap = CapHoles(Brep=shift_3)
graft = GraftTree(Tree=cap, IncludeEmptyLists=True, IncludeNullItems=True)  # -> simplify(SubMass)
ungroup = Ungroup(Group=shift_5)  # -> simplify(Objects)
graft_2 = GraftTree(Tree=shift_4, IncludeEmptyLists=True, IncludeNullItems=True)
cset_3 = CreateSet(List=sort_5.ValuesA)  # -> Set, Map
graft_3 = GraftTree(Tree=sort_4.ValuesA, IncludeEmptyLists=True, IncludeNullItems=True)
graft_4 = GraftTree(Tree=sort_5.ValuesA, IncludeEmptyLists=True, IncludeNullItems=True)
lng = ListLength(List=ungroup)
geo_2 = Geometry(ungroup)
dup = DuplicateData(Data=graft_3, Number=lng, Order=True)  # -> simplify(Data)
dup_2 = DuplicateData(Data=graft_4, Number=lng, Order=True)  # -> simplify(Data)

# ----
# EXTRACTING ROOF PROPERTIES
panel_4 = Panel("""Area
Typology
SubBuildID
BuildID""")

# ----
# CREATING FULL MASS
cap_2 = CapHoles(Brep=shift_4)
sunion = SolidUnion(Breps=cap_2)
full_mass = Data(simplify(graft(sunion)))

# ----
# CREATING FLOORPLATES
geo_3 = Geometry(geo_2)
floorplates = Data(geo_3)

# ---- group: Geometry
# CREATING SUB MASS
shift_6 = ShiftPaths(Data=graft, Offset=-1)
sub_mass = Geometry(shift_6)

# ----
full_mass_2 = ClusterOutput(full_mass)
sub_mass_2 = ClusterOutput(sub_mass)
floorplates_2 = ClusterOutput(floorplates)

debrep = DeconstructBrep(Brep=graft_2)  # -> simplify(Faces), Edges, Vertices
area_2 = Area(Geometry=geo_2)  # -> Area, Centroid
xy_2 = XYPlane(Origin=area_2.Centroid)
group_2 = Group(Objects=xy_2)
long = LongestList(ListA=debrep.Faces, ListB=group_2, PaddingMode=2)  # -> graft(ListA), ListB
ungroup_2 = Ungroup(Group=long.ListB)
sec = BrepPlane(Brep=long.ListA, Plane=ungroup_2)  # -> Curves, Points
shift_7 = ShiftPaths(Data=sec.Curves, Offset=-1)
# CREATING FACADE
srfsplit = SurfaceSplit(Surface=long.ListA, Curves=shift_7)
trim = TrimTree(Tree=srfsplit, Depth=1)
trim_2 = TrimTree(Tree=trim, Depth=1)
area_3 = Area(Geometry=trim_2)  # -> Area, Centroid
pdecon_2 = Deconstruct(Point=area_3.Centroid)  # -> XComponent, YComponent, ZComponent
sort_6 = SortList(Keys=pdecon_2.ZComponent, ValuesA=trim_2)  # -> Keys, ValuesA
lng_2 = ListLength(List=debrep.Faces)
partition = PartitionList(List=sort_6.ValuesA, Size=lng_2)
join = BrepJoin(Breps=partition)  # -> simplify(Breps), Closed

shift_8 = ShiftPaths(Data=join.Breps, Offset=-1)

facade_2 = Data(shift_8)

facade_3 = ClusterOutput(facade_2)

first_last_3 = FirstLast(List=boundary)  # -> FirstValue, LastValue
rint = RegionIntersection(CurvesA=flatten(first_last_3.FirstValue), CurvesB=first_last_3.LastValue)
boundary_2 = BoundarySurfaces(Edges=rint)

shift_9 = ShiftPaths(Data=first_last_3.LastValue, Offset=-1)
lng_3 = ListLength(List=shift_9)
split = SplitList(List=subbuildid_naming, Index=lng_3)  # -> ListA, ListB
graft_5 = GraftTree(Tree=split.ListA, IncludeEmptyLists=True, IncludeNullItems=True)
dup_3 = DuplicateData(Data=graft_5, Number=lng, Order=True)  # -> simplify(Data)

# ----
# CREATING ROOF GEOMETRY
sdiff = SolidDifference(BrepsA=first_last_3.LastValue, BrepsB=flatten(boundary_2))
group_3 = Group(Objects=sdiff)
item_7 = ListItem(List=flatten(group_3), Index=mindex_5.Index, Wrap=True)

data_2 = Data(simplify(graft(item_5)))
data_3 = Data(simplify(graft(item_4)))
data_4 = Data(simplify(graft(split.ListA)))
ungroup_3 = Ungroup(Group=item_7)
trim_3 = TrimTree(Tree=ungroup_3, Depth=1)
area_4 = Area(Geometry=trim_3)  # -> Area, Centroid

panel_5 = Panel("""BuildID
Total Floors
GBA
RL""")

# ----
# EXTRACTING FULL MASS PROPERTIES
shift_10 = ShiftPaths(Data=floorplates, Offset=-1)

pdecon_3 = Deconstruct(Point=area_2.Centroid)  # -> XComponent, YComponent, simplify(ZComponent)
area_5 = Area(Geometry=geo_3)  # -> Area, Centroid
# EXTRACTING FLOORPLATE PROPERTIES
panel_6 = Panel("""RL
Area
Typology
SubBuildID
BuildID""")
merge = Merge(
    Data1=simplify(graft(pdecon_3.ZComponent)),
    Data2=simplify(graft(area_5.Area)),
    Data3=simplify(graft(dup)),
    Data4=simplify(graft(dup_3)),
    Data5=simplify(graft(dup_2)))  # -> simplify(Result)
json_2 = JSON(Key=panel_6, Value=merge)

shift_11 = ShiftPaths(Data=area_5.Area, Offset=-1)

shift_12 = ShiftPaths(Data=json_2, Offset=-1)

floorplate_properties = Data(shift_12)

shift_13 = ShiftPaths(Data=floorplate_properties, Offset=-1)
read_4 = ReadJSON(Object=shift_13, Key="RL")
ma_2 = MassAddition(Input=shift_11)  # -> Result, PartialResults
lng_4 = ListLength(List=shift_10)
first_last_4 = FirstLast(List=read_4)  # -> FirstValue, LastValue
merge_2 = Merge(
    Data1=simplify(graft(cset_3.Set)),
    Data2=simplify(graft(lng_4)),
    Data3=simplify(graft(ma_2.Result)),
    Data4=simplify(graft(first_last_4.LastValue)))  # -> simplify(Result)
json_3 = JSON(Key=panel_5, Value=merge_2)
full_mass_properties = Data(json_3)

floorplate_properties_2 = ClusterOutput(floorplate_properties)
full_mass_properties_2 = ClusterOutput(full_mass_properties)

panel_7 = Panel("""Typology
SubBuildID
BuildID""")
merge_3 = Merge(Data1=simplify(graft(dup)), Data2=simplify(graft(dup_3)), Data3=simplify(graft(dup_2)))  # -> simplify(Result)
# EXTRACTING FACADE PROPERTIES
json_4 = JSON(Key=panel_7, Value=merge_3)

shift_14 = ShiftPaths(Data=json_4, Offset=-1)

facade_properties = Data(shift_14)

facade_properties_2 = ClusterOutput(facade_properties)

merge_4 = Merge(Data1=simplify(graft(graft_3)), Data2=simplify(graft(graft_5)), Data3=simplify(graft(graft_4)))  # -> simplify(Result)
# EXTRACTING SUB MASS PROPERTIES
panel_8 = Panel("""Typology
SubBuildID
BuildID""")
json_5 = JSON(Key=panel_8, Value=merge_4)

shift_15 = ShiftPaths(Data=json_5, Offset=-1)

sub_mass_properties = Data(shift_15)

sub_mass_properties_2 = ClusterOutput(sub_mass_properties)

ungroup_4 = Ungroup(Group=item_7)

shift_16 = ShiftPaths(Data=ungroup_4, Offset=-1)

roof = Data(shift_16)

roof_2 = ClusterOutput(roof)

dup_4 = DuplicateDataMatch(SourceDataTree=ungroup_4, SecondaryData1=data_3)  # -> SourceData, SecondaryData1
dup_5 = DuplicateDataMatch(SourceDataTree=ungroup_4, SecondaryData1=data_4)  # -> SourceData, SecondaryData1
dup_6 = DuplicateDataMatch(SourceDataTree=ungroup_4, SecondaryData1=data_2)  # -> SourceData, SecondaryData1
trim_4 = TrimTree(Tree=dup_4.SecondaryData1, Depth=1)
trim_5 = TrimTree(Tree=dup_5.SecondaryData1, Depth=1)
trim_6 = TrimTree(Tree=dup_6.SecondaryData1, Depth=1)
merge_5 = Merge(
    Data1=simplify(graft(area_4.Area)),
    Data2=simplify(graft(trim_4)),
    Data3=simplify(graft(trim_5)),
    Data4=simplify(graft(trim_6)))  # -> simplify(Result)
json_6 = JSON(Key=panel_4, Value=merge_5)

shift_17 = ShiftPaths(Data=json_6, Offset=-1)

roof_properties = Data(shift_17)

roof_properties_2 = ClusterOutput(roof_properties)

# ==== cluster TowersByCurvesMultiStacking

# ---- group: Cluster Input
building_curves = ClusterInput()

# ----
building_curves_2 = Curve(building_curves)
objatts = ObjectAttributes(ObjectOrAttributes=building_curves_2)  # -> Name, LayerName, LayerFullPath, Color, MaterialName, LinetypeName, GroupIndices, PlotWeight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
panel = Panel("""BuildID
SubBuildID
Typology
F2F
Levels""")
json = JSON(Key=objatts.UserDataKeys, Value=objatts.UserDataValues)
read = ReadJSON(Object=json, Key=panel)
mindex = MemberIndex(Set=panel, Member="F2F")  # -> Index, Count
mindex_2 = MemberIndex(Set=panel, Member="Levels")  # -> Index, Count
mindex_3 = MemberIndex(Set=panel, Member="BuildID")  # -> Index, Count
mindex_4 = MemberIndex(Set=panel, Member="SubBuildID")  # -> Index, Count
flip = FlipMatrix(Data=read)
# SORT VIA BUILDID
branch = TreeBranch(Tree=flip, Path=mindex.Index, MaintainPaths=True)
branch_2 = TreeBranch(Tree=flip, Path=mindex_2.Index, MaintainPaths=True)
branch_3 = TreeBranch(Tree=flip, Path=mindex_3.Index, MaintainPaths=True)
branch_4 = TreeBranch(Tree=flip, Path=mindex_4.Index, MaintainPaths=True)

cset = CreateSet(List=branch_3)  # -> Set, Map
tsort = SortText(Keys=cset.Set, Values=cset.Set, Culture=127)  # -> Keys, Values
mindex_5 = MemberIndex(Set=branch_3, Member=tsort.Keys)  # -> simplify(Index), Count
item = ListItem(List=branch, Index=mindex_5.Index, Wrap=True)
item_2 = ListItem(List=branch_2, Index=mindex_5.Index, Wrap=True)
item_3 = ListItem(List=building_curves_2, Index=mindex_5.Index, Wrap=True)
item_4 = ListItem(List=branch_4, Index=mindex_5.Index, Wrap=True)

cset_2 = CreateSet(List=item_4)  # -> Set, Map
tsort_2 = SortText(Keys=cset_2.Set, Values=cset_2.Set, Culture=127)  # -> simplify(Keys), Values
mindex_6 = MemberIndex(Set=item_4, Member=tsort_2.Keys)  # -> simplify(Index), Count
shift = ShiftPaths(Data=mindex_6.Index, Offset=-1)
# SORT VIA Z SUBBUILDID
item_5 = ListItem(List=item, Index=shift, Wrap=True)
item_6 = ListItem(List=item_2, Index=shift, Wrap=True)
item_7 = ListItem(List=item_3, Index=shift, Wrap=True)
match = MatchTreeStructure(DataList=flatten(item_5), TreeMask=mindex_6.Index)
match_2 = MatchTreeStructure(DataList=flatten(item_6), TreeMask=mindex_6.Index)
match_3 = MatchTreeStructure(DataList=flatten(item_7), TreeMask=mindex_6.Index)

area = Area(Geometry=match_3)  # -> Area, Centroid
pdecon = Deconstruct(Point=area.Centroid)  # -> XComponent, YComponent, ZComponent
# SORT VIA Z HEIGHT
sort = SortList(Keys=pdecon.ZComponent, ValuesA=match)  # -> Keys, simplify(ValuesA)
sort_2 = SortList(Keys=pdecon.ZComponent, ValuesA=match_2)  # -> Keys, simplify(ValuesA)
sort_3 = SortList(Keys=pdecon.ZComponent, ValuesA=match_3)  # -> Keys, simplify(ValuesA)

read_2 = ReadJSON(Object=json, Key="Typology")  # -> flatten(Value)
read_3 = ReadJSON(Object=json, Key="BuildID")  # -> flatten(Value)
cset_3 = CreateSet(List=flatten(read_3))  # -> Set, Map
tsort_3 = SortText(Keys=cset_3.Set, Values=cset_3.Set, Culture=127)  # -> Keys, Values
mindex_7 = MemberIndex(Set=flatten(read_3), Member=tsort_3.Keys)  # -> Index, Count

# ---- group: Cluster Input
multiple_buildings_t_f = ClusterInput()

# ----
item_8 = ListItem(List=read_2, Index=mindex_7.Index, Wrap=True)
item_9 = ListItem(List=read_3, Index=mindex_7.Index, Wrap=True)
item_10 = ListItem(List=item_8, Index=shift, Wrap=True)
item_11 = ListItem(List=item_4, Index=shift, Wrap=True)
item_12 = ListItem(List=item_9, Index=shift, Wrap=True)
# PROJECTING FLOOR CURVES ONTO CORRECT FLOOR HEIGHT
multiple_buildings_t_f_2 = Boolean(multiple_buildings_t_f)
match_4 = MatchTreeStructure(DataList=flatten(item_10), TreeMask=mindex_6.Index)
match_5 = MatchTreeStructure(DataList=flatten(item_11), TreeMask=mindex_6.Index)
match_6 = MatchTreeStructure(DataList=flatten(item_12), TreeMask=mindex_6.Index)
sort_4 = SortList(Keys=pdecon.ZComponent, ValuesA=match_4)  # -> Keys, simplify(ValuesA)
sort_5 = SortList(Keys=pdecon.ZComponent, ValuesA=match_5)  # -> Keys, simplify(ValuesA)
sort_6 = SortList(Keys=pdecon.ZComponent, ValuesA=match_6)  # -> Keys, simplify(ValuesA)
graft = GraftTree(Tree=sort_4.ValuesA, IncludeEmptyLists=True, IncludeNullItems=True)
graft_2 = GraftTree(Tree=sort_5.ValuesA, IncludeEmptyLists=True, IncludeNullItems=True)
graft_3 = GraftTree(Tree=sort_6.ValuesA, IncludeEmptyLists=True, IncludeNullItems=True)

# ----
# EXTRACTING FULL MASS PROPERTIES
panel_2 = Panel("""BuildID
Total Floors
GBA""")

# ----
# EXTRACTING ROOF PROPERTIES
panel_3 = Panel("""Area
Typology
SubBuildID
BuildID""")

addition = Addition(A=sort_2.ValuesA, B=1)
series = Series(Start=0, Step=sort.ValuesA, Count=addition)  # -> simplify(Series)
item_13 = ListItem(List=series, Index=0, Wrap=True)  # -> Item1, Item
crv = Curve(simplify(graft(sort_3.ValuesA)))

shift_2 = ShiftPaths(Data=item_13.Item1, Offset=-1)

ins = InsertItems(List=shift_2, Item=0, Indices=0, Wrap=True)  # -> simplify(List)
cull_i = CullIndex(List=ins, Indices=-1, Wrap=True)  # -> simplify(List)
shift_3 = ShiftPaths(Data=shift_2, Offset=-1)
first_last = FirstLast(List=shift_3)  # -> FirstValue, LastValue

shift_4 = ShiftPaths(Data=cull_i, Offset=-1)
tstat = TreeStatistics(Tree=shift_4)  # -> Paths, Length, Count
lng = ListLength(List=shift_4)
dup = DuplicateData(Data="True", Number=tstat.Count, Order=True)  # -> simplify(Data)

subtraction = Subtraction(A=lng, B=1)
dup_2 = DuplicateData(Data="True", Number=tstat.Count, Order=True)  # -> simplify(graft(Data))
dup_3 = DuplicateData(Data="False", Number=subtraction, Order=True)  # -> simplify(Data)

filter = StreamFilter(Gate=multiple_buildings_t_f_2, Stream0=dup, Stream1=dup_2)

merge = Merge(Data1=filter, Data2=dup_3)
dispatch = Dispatch(List=shift_4, DispatchPattern=merge)  # -> ListA, ListB
clean = CleanTree(RemoveNulls=True, RemoveInvalid=True, RemoveEmpty=True, Tree=dispatch.ListA)
clean_2 = CleanTree(RemoveNulls=True, RemoveInvalid=True, RemoveEmpty=True, Tree=dispatch.ListB)
replace = ReplaceItems(List=clean_2, Item=first_last.FirstValue, Indices=0, Wrap=False)  # -> simplify(List)
merge_2 = Merge(Data1=clean, Data2=replace)
ma = MassAddition(Input=merge_2)  # -> Result, simplify(graft(PartialResults))

addition_2 = Addition(A=series, B=ma.PartialResults)

pt = ConstructPoint(XCoordinate=0, YCoordinate=0, ZCoordinate=addition_2)
xy = XYPlane(Origin=pt)
project = Project(Geometry=crv, Plane=xy)  # -> simplify(Geometry), Transform
boundary = BoundarySurfaces(Edges=project.Geometry)

projected_floor_curves = Geometry(project.Geometry)
first_last_2 = FirstLast(List=projected_floor_curves)  # -> FirstValue, LastValue
first_last_3 = FirstLast(List=projected_floor_curves)  # -> FirstValue, LastValue
facade = Loft(
    Curves=[first_last_2.FirstValue, first_last_3.LastValue],
    Options={Adjust=False, Closed=False, LoftEnds=0, LoftSimp=0, LoftType=0, Rebuild=10, Refit=0.01})  # -> simplify(Loft)
floor_surfaces = Geometry(boundary)
cull_i_2 = CullIndex(List=floor_surfaces, Indices=-1, Wrap=True)
geo = Geometry(facade)
shift_5 = ShiftPaths(Data=geo, Offset=-1)
group = Group(Objects=cull_i_2)
shift_6 = ShiftPaths(Data=geo, Offset=-1)
shift_7 = ShiftPaths(Data=group, Offset=-1)
cap = CapHoles(Brep=shift_5)
graft_4 = GraftTree(Tree=cap, IncludeEmptyLists=True, IncludeNullItems=True)  # -> simplify(SubMass)
ungroup = Ungroup(Group=shift_7)  # -> simplify(Objects)
graft_5 = GraftTree(Tree=shift_6, IncludeEmptyLists=True, IncludeNullItems=True)
lng_2 = ListLength(List=ungroup)
dup_4 = DuplicateData(Data=graft, Number=lng_2, Order=True)  # -> simplify(Data)
dup_5 = DuplicateData(Data=graft_2, Number=lng_2, Order=True)  # -> simplify(Data)
dup_6 = DuplicateData(Data=graft_3, Number=lng_2, Order=True)  # -> simplify(Data)
geo_2 = Geometry(ungroup)

# ---- group: Geometry
# CREATING SUB MASS
shift_8 = ShiftPaths(Data=graft_4, Offset=-2)
sub_mass = Geometry(shift_8)

# ----
sub_mass_2 = ClusterOutput(sub_mass)

debrep = DeconstructBrep(Brep=graft_5)  # -> simplify(Faces), Edges, Vertices
area_2 = Area(Geometry=geo_2)  # -> Area, Centroid
xy_2 = XYPlane(Origin=area_2.Centroid)
group_2 = Group(Objects=xy_2)
long = LongestList(ListA=debrep.Faces, ListB=group_2, PaddingMode=2)  # -> graft(ListA), ListB
ungroup_2 = Ungroup(Group=long.ListB)
sec = BrepPlane(Brep=long.ListA, Plane=ungroup_2)  # -> Curves, Points
shift_9 = ShiftPaths(Data=sec.Curves, Offset=-1)
# CREATING FACADE
srfsplit = SurfaceSplit(Surface=long.ListA, Curves=shift_9)
trim = TrimTree(Tree=srfsplit, Depth=1)
trim_2 = TrimTree(Tree=trim, Depth=1)
area_3 = Area(Geometry=trim_2)  # -> Area, Centroid
pdecon_2 = Deconstruct(Point=area_3.Centroid)  # -> XComponent, YComponent, ZComponent
sort_7 = SortList(Keys=pdecon_2.ZComponent, ValuesA=trim_2)  # -> Keys, ValuesA
lng_3 = ListLength(List=debrep.Faces)
partition = PartitionList(List=sort_7.ValuesA, Size=lng_3)
join = BrepJoin(Breps=partition)  # -> simplify(Breps), Closed

shift_10 = ShiftPaths(Data=join.Breps, Offset=-1)

facade_2 = Data(shift_10)

facade_3 = ClusterOutput(facade_2)

first_last_4 = FirstLast(List=boundary)  # -> FirstValue, LastValue
rint = RegionIntersection(CurvesA=flatten(first_last_4.FirstValue), CurvesB=first_last_4.LastValue)
boundary_2 = BoundarySurfaces(Edges=rint)

# ----
# CREATING ROOF GEOMETRY
sdiff = SolidDifference(BrepsA=first_last_4.LastValue, BrepsB=flatten(boundary_2))
group_3 = Group(Objects=sdiff)
item_14 = ListItem(List=flatten(group_3), Index=mindex_7.Index, Wrap=True)

data = Data(simplify(graft(sort_5.ValuesA)))
data_2 = Data(simplify(graft(sort_4.ValuesA)))
data_3 = Data(simplify(graft(sort_6.ValuesA)))
ungroup_3 = Ungroup(Group=item_14)
trim_3 = TrimTree(Tree=ungroup_3, Depth=1)
area_4 = Area(Geometry=trim_3)  # -> Area, Centroid

pdecon_3 = Deconstruct(Point=area_2.Centroid)  # -> XComponent, YComponent, simplify(ZComponent)
# EXTRACTING FLOORPLATE PROPERTIES
panel_4 = Panel("""RL
Area
Typology
SubBuildID
BuildID""")

# ----
# CREATING FULL MASS
cap_2 = CapHoles(Brep=geo)

shift_11 = ShiftPaths(Data=cap_2, Offset=-1)
shift_12 = ShiftPaths(Data=shift_11, Offset=-1)

sunion = SolidUnion(Breps=shift_12)

shift_13 = ShiftPaths(Data=sunion, Offset=-1)
full_mass = Data(simplify(graft(shift_13)))

full_mass_2 = ClusterOutput(full_mass)

merge_3 = Merge(Data1=simplify(graft(dup_4)), Data2=simplify(graft(dup_5)), Data3=simplify(graft(dup_6)))  # -> simplify(Result)
panel_5 = Panel("""Typology
SubBuildID
BuildID""")
# EXTRACTING FACADE PROPERTIES
json_2 = JSON(Key=panel_5, Value=merge_3)

shift_14 = ShiftPaths(Data=json_2, Offset=-1)

facade_properties = Data(shift_14)

facade_properties_2 = ClusterOutput(facade_properties)

merge_4 = Merge(Data1=simplify(graft(graft)), Data2=simplify(graft(graft_2)), Data3=simplify(graft(graft_3)))  # -> simplify(Result)
# EXTRACTING SUB MASS PROPERTIES
panel_6 = Panel("""Typology
SubBuildID
BuildID""")
json_3 = JSON(Key=panel_6, Value=merge_4)

shift_15 = ShiftPaths(Data=json_3, Offset=-2)

sub_mass_properties = Data(shift_15)

sub_mass_properties_2 = ClusterOutput(sub_mass_properties)

# ----
# CREATING FLOORPLATES
geo_3 = Geometry(geo_2)

area_5 = Area(Geometry=geo_3)  # -> Area, Centroid
merge_5 = Merge(
    Data1=simplify(graft(pdecon_3.ZComponent)),
    Data2=simplify(graft(area_5.Area)),
    Data3=simplify(graft(dup_4)),
    Data4=simplify(graft(dup_5)),
    Data5=simplify(graft(dup_6)))  # -> simplify(Result)
json_4 = JSON(Key=panel_4, Value=merge_5)
shift_16 = ShiftPaths(Data=json_4, Offset=-2)
floorplate_properties = Data(shift_16)

shift_17 = ShiftPaths(Data=geo_3, Offset=-1)

floorplates = Data(shift_17)

floorplates_2 = ClusterOutput(floorplates)
floorplate_properties_2 = ClusterOutput(floorplate_properties)

shift_18 = ShiftPaths(Data=area_5.Area, Offset=-1)
shift_19 = ShiftPaths(Data=floorplates, Offset=-1)
lng_4 = ListLength(List=shift_19)

shift_20 = ShiftPaths(Data=shift_18, Offset=-1)

ma_2 = MassAddition(Input=shift_20)  # -> Result, PartialResults
merge_6 = Merge(Data1=simplify(graft(tsort.Keys)), Data2=simplify(graft(lng_4)), Data3=simplify(graft(ma_2.Result)))  # -> simplify(Result)
json_5 = JSON(Key=panel_2, Value=merge_6)
full_mass_properties = Data(json_5)

full_mass_properties_2 = ClusterOutput(full_mass_properties)

ungroup_4 = Ungroup(Group=item_14)

shift_21 = ShiftPaths(Data=ungroup_4, Offset=-1)

roof = Data(simplify(shift_21))

roof_2 = ClusterOutput(roof)

dup_7 = DuplicateDataMatch(SourceDataTree=ungroup_4, SecondaryData1=data_2)  # -> SourceData, SecondaryData1
dup_8 = DuplicateDataMatch(SourceDataTree=ungroup_4, SecondaryData1=data)  # -> SourceData, SecondaryData1
dup_9 = DuplicateDataMatch(SourceDataTree=ungroup_4, SecondaryData1=data_3)  # -> SourceData, SecondaryData1
trim_4 = TrimTree(Tree=dup_7.SecondaryData1, Depth=1)
trim_5 = TrimTree(Tree=dup_8.SecondaryData1, Depth=1)
trim_6 = TrimTree(Tree=dup_9.SecondaryData1, Depth=1)
merge_7 = Merge(
    Data1=simplify(graft(area_4.Area)),
    Data2=simplify(graft(trim_4)),
    Data3=simplify(graft(trim_5)),
    Data4=simplify(graft(trim_6)))  # -> simplify(Result)
json_6 = JSON(Key=panel_3, Value=merge_7)

shift_22 = ShiftPaths(Data=json_6, Offset=-1)

roof_properties = Data(shift_22)

roof_properties_2 = ClusterOutput(roof_properties)
panel_7 = Panel(roof_properties)

# ==== cluster ClockwiseCurve: Reorders controlpoints of curve to clockwise
crv = ClusterInput()
crv_2 = Curve(crv)
cp = ControlPoints(Curve=crv_2)  # -> simplify(Points), Weights, Knots
shift = ShiftList(List=cp.Points, Shift=1, Wrap=True)
pdecon = Deconstruct(Point=cp.Points)  # -> XComponent, YComponent, ZComponent
pdecon_2 = Deconstruct(Point=shift)  # -> XComponent, YComponent, ZComponent
expression = Expression(x=pdecon.XComponent, y=pdecon_2.XComponent, z=pdecon.YComponent, u=pdecon_2.YComponent, Expression="(y-x)*(u+z)")
ma = MassAddition(Input=expression)  # -> Result, PartialResults
larger = LargerThan(FirstNumber=ma.Result, SecondNumber=0)  # -> simplify(LargerThan), OrEqualTo
dispatch = Dispatch(List=simplify(graft(crv_2)), DispatchPattern=larger.LargerThan)  # -> ListA, ListB
flip = FlipCurve(Curve=dispatch.ListB)  # -> Curve, Flag
merge = Merge(Data1=dispatch.ListA, Data2=flip.Curve)  # -> simplify(flatten(Result))
unflatten = UnflattenTree(Tree=merge, Guide=crv_2)
crv_3 = Curve(unflatten)
crv_4 = ClusterOutput(crv_3)
