# Grasshopper definition Curve method_basementtest.gh (Grasshopper 1.0.7)
# plug-ins: treesloth01, Redback, Human, Bifocals

panel = Panel("""Curve
Curve
Curve
Curve""")
dpipeline = DynamicGeometryPipeline(
    LayerFilter="Layer 01::BSMENT TEST",
    TypeFilter="Curve",
    NameFilter="*",
    GroupByLayer=False,
    GroupByType=False,
    IncludeHidden=True,
    IncludeLocked=True,
    enableFullPath=True,
    listenToAttributes=True)
panel_2 = Panel("""Y
Y
X
X""")
panel_3 = Panel("""Resi
Comm
Resi
Resi""")
panel_4 = Panel("""3
3
3
3""")
objatts = ObjectAttributes(ObjectOrAttributes=dpipeline)  # -> Name, LayerName, LayerFullPath, Color, MaterialName, LinetypeName, GroupIndices, PlotWeight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
panel_5 = Panel("""3
15
23
19""")
panel_6 = Panel("""A
A
A
A""")
panel_7 = Panel("""BuildID
Typology
F2F
Levels
SubBuildID""")
json = JSON(Key=objatts.UserDataKeys, Value=objatts.UserDataValues)
entwine = Entwine(Branch00=panel_2, Branch01=panel_3, Branch02=panel_4, Branch03=panel_5, Branch04=panel_6, FlattenInputs=True)  # -> simplify(Result)
read = ReadJSON(Object=json, Key=panel_7)
flip = FlipMatrix(Data=read)
branch = TreeBranch(Tree=simplify(flip), Path="3", MaintainPaths=True)  # -> graft(Branch)
branch_2 = TreeBranch(Tree=simplify(flip), Path="2", MaintainPaths=True)  # -> graft(Branch)
branch_3 = TreeBranch(Tree=flip, Path="0", MaintainPaths=True)
branch_4 = TreeBranch(Tree=flip, Path="4", MaintainPaths=True)
concat = Concatenate(FragmentA=branch_3, FragmentB=branch_4)
addition = Addition(A=branch, B=1)
series = Series(Start=0, Step=branch_2, Count=addition)  # -> simplify(Series)
panel_8 = Panel(concat)
python = GhPythonScript(ID=concat)  # -> StackID
# ---------- python: Python ----------
__author__ = "B-MBuckley"
__version__ = "2018.10.25"

import rhinoscriptsyntax as rs

StackID = []

for i in range(len(ID)-1):
    StackID.append(ID[0:i+1])
# ---------- end python ----------
item = ListItem(List=series, Index=0, Wrap=True)  # -> flatten(Item1), Item
mindex = MemberIndex(Set=panel_8, Member=python)  # -> Index, Count
panel_9 = Panel(item.Item1)
item_2 = ListItem(List=panel_9, Index=mindex.Index, Wrap=True)
trim = TrimTree(Tree=item_2, Depth=1)
ma = MassAddition(Input=trim)  # -> Result, PartialResults
nullrep = ReplaceNulls(Items=ma.Result, Replacements="0")  # -> Items, Count
addition_2 = Addition(A=nullrep.Items, B=series)
data = Data(addition_2)
pt = ConstructPoint(XCoordinate=0, YCoordinate=0, ZCoordinate=data)
xy = XYPlane(Origin=pt)
project = Project(Geometry=graft(dpipeline), Plane=xy)  # -> Geometry, Transform
boundary = BoundarySurfaces(Edges=project.Geometry)
first_last = FirstLast(List=project.Geometry)  # -> FirstValue, LastValue
first_last_2 = FirstLast(List=project.Geometry)  # -> FirstValue, LastValue
first_last_3 = FirstLast(List=boundary)  # -> FirstValue, LastValue
first_last_4 = FirstLast(List=boundary)  # -> FirstValue, LastValue
index = ItemIndex(List=boundary, Item=first_last_4.LastValue)

floors = CullIndex(List=boundary, Indices=index, Wrap=True)  # -> simplify(List)

facade = Loft(
    Curves=[first_last.FirstValue, first_last_2.LastValue],
    Options={Adjust=False, Closed=False, LoftEnds=0, LoftSimp=0, LoftType=0, Rebuild=10, Refit=0.01})  # -> simplify(Loft)
roof = Surface(simplify(first_last_3.LastValue))
json_2 = Data(json)
full_mass = CapHoles(Brep=facade)  # -> simplify(Brep)
