# Grasshopper definition setbacks[3976].gh (Grasshopper 1.0.5)
# plug-ins: treesloth01, Redback, EleFront

panel = Panel("""Typology
Levels
F2F""")
panel_2 = Panel("""Residential
10
3.1""")
crv = Curve(<curve referenced from the Rhino model>)

crv_2 = Curve(<curve referenced from the Rhino model>)
crv_3 = Curve(<curve referenced from the Rhino model>)
boundary = BoundarySurfaces(Edges=crv_2)
boundary_2 = BoundarySurfaces(Edges=crv_3)
geo = Geometry(<brep referenced from the Rhino model>)
evalsrf = EvaluateSurface(Surface=reparameterize([boundary_2, boundary]), Point=Point(0.5, 0.5, 0))  # -> Point, Normal, UDirection, VDirection, Frame
debrep = DeconstructBrep(Brep=geo)  # -> flatten(Faces), Edges, Vertices
sec = BrepPlane(Brep=geo, Plane=evalsrf.Frame)  # -> Curves, Points
bbox = BoundingBox(Content=sec.Curves, Plane=graft(evalsrf.Frame))  # -> Box, Box_2
debox = DeconstructBox(Box=bbox.Box)  # -> Plane, X, Y, Z
planesrf = PlaneSurface(Plane=debox.Plane, XSize=debox.X, YSize=debox.Y)
bvol = BoundaryVolume(Boundaries=flatten([debrep.Faces, planesrf]))

crv_4 = Curve(<curve referenced from the Rhino model>)
boundary_3 = BoundarySurfaces(Edges=crv_4)
geo_2 = Geometry(<brep referenced from the Rhino model>)
evalsrf_2 = EvaluateSurface(Surface=reparameterize(boundary_3), Point=Point(0.5, 0.5, 0))  # -> Point, Normal, UDirection, VDirection, Frame
debrep_2 = DeconstructBrep(Brep=geo_2)  # -> flatten(Faces), Edges, Vertices
sec_2 = BrepPlane(Brep=geo_2, Plane=evalsrf_2.Frame)  # -> Curves, Points
bbox_2 = BoundingBox(Content=sec_2.Curves, Plane=graft(evalsrf_2.Frame))  # -> Box, Box_2
debox_2 = DeconstructBox(Box=bbox_2.Box)  # -> Plane, X, Y, Z
planesrf_2 = PlaneSurface(Plane=debox_2.Plane, XSize=debox_2.X, YSize=debox_2.Y)
bvol_2 = BoundaryVolume(Boundaries=flatten([debrep_2.Faces, planesrf_2]))

crv_5 = Curve(<curve referenced from the Rhino model>)
crv_6 = Curve(<curve referenced from the Rhino model>)
boundary_4 = BoundarySurfaces(Edges=crv_5)
boundary_5 = BoundarySurfaces(Edges=crv_6)
geo_3 = Geometry(<brep referenced from the Rhino model>)
evalsrf_3 = EvaluateSurface(Surface=reparameterize([boundary_5, boundary_4]), Point=Point(0.5, 0.5, 0))  # -> Point, Normal, UDirection, VDirection, Frame
debrep_3 = DeconstructBrep(Brep=geo_3)  # -> flatten(Faces), Edges, Vertices
sec_3 = BrepPlane(Brep=geo_3, Plane=evalsrf_3.Frame)  # -> Curves, Points
bbox_3 = BoundingBox(Content=sec_3.Curves, Plane=graft(evalsrf_3.Frame))  # -> Box, Box_2
debox_3 = DeconstructBox(Box=bbox_3.Box)  # -> Plane, X, Y, Z
planesrf_3 = PlaneSurface(Plane=debox_3.Plane, XSize=debox_3.X, YSize=debox_3.Y)
bvol_3 = BoundaryVolume(Boundaries=flatten([debrep_3.Faces, planesrf_3]))

crv_7 = Curve(<curve referenced from the Rhino model>)
json = JSON(Key=panel, Value=panel_2)
read = ReadJSON(Object=json, Key="Levels")
boundary_6 = BoundarySurfaces(Edges=crv)

crv_8 = Curve(<curve referenced from the Rhino model>)
boundary_7 = BoundarySurfaces(Edges=crv_8)
geo_4 = Geometry(<brep referenced from the Rhino model>)
evalsrf_4 = EvaluateSurface(Surface=reparameterize([boundary_6, boundary_7]), Point=Point(0.5, 0.5, 0))  # -> Point, Normal, UDirection, VDirection, Frame
debrep_4 = DeconstructBrep(Brep=geo_4)  # -> flatten(Faces), Edges, Vertices
sec_4 = BrepPlane(Brep=geo_4, Plane=evalsrf_4.Frame)  # -> Curves, Points
bbox_4 = BoundingBox(Content=sec_4.Curves, Plane=graft(evalsrf_4.Frame))  # -> Box, Box_2
debox_4 = DeconstructBox(Box=bbox_4.Box)  # -> Plane, X, Y, Z
planesrf_4 = PlaneSurface(Plane=debox_4.Plane, XSize=debox_4.X, YSize=debox_4.Y)
bvol_4 = BoundaryVolume(Boundaries=flatten([debrep_4.Faces, planesrf_4]))

panel_3 = Panel("""{
  "major_road": [
    {
      "min": 0,
      "max": 10,
      "setback": 0
    },
    {
      "min": 10,
      "max": 50,
      "setback": 10
    }
  ],
  "secondary_road": [
    {
      "min": 0,
      "max": 15,
      "setback": 3
    },
    {
      "min": 15,
      "max": 50,
      "setback": 6
    }
  ],
  "adjacent_boundary": [
    {
      "min": 0,
      "max": 15,
      "setback": 0
    },
{
      "min": 15,
      "max": 20,
      "setback": 0
    },
{
      "min": 20,
      "max": 50,
      "setback": 0
    }
  ]
}""")
explode = Explode(Curve=crv_7, Recursive=True)  # -> Segments, Vertices
panel_4 = Panel(read)
panel_5 = Panel(json)
panel_6 = Panel("""secondary_road
major_road
secondary_road
adjacent_boundary""")
item = ListItem(List=explode.Segments, Index=1, Wrap=True)
brep = Brep(bvol_4)
brep_2 = Brep(bvol_3)
brep_3 = Brep(bvol)
brep_4 = Brep(bvol_2)

# ----
# AUTO BAKE
# w/ Attributes
panel_7 = Panel("""1
Commercial
3.1
85""")
panel_8 = Panel("""BuildID
Typology
F2F
Efficiency""")
attributes = DefineObjectAttributes(UserKeys=panel_8, UserValues=panel_7)
bake = BakeObjects(Geometry=brep, Attributes=attributes, BakeName="Building", Bake=Toggle(False))

panel_9 = Panel("""{
  "major_road": [
    {
      "min": 0,
      "max": 50,
      "setback": 10
    }
  ],
  "secondary_road": [
    {
      "min": 0,
      "max": 50,
      "setback": 3
    }
  ],
  "adjacent_boundary": [
    {
      "min": 0,
      "max": 50,
      "setback": 1
    }
  ]
}""")
crv_9 = Curve(explode.Segments)
read_2 = ReadJSON(Object=panel_3, Key=panel_6)
xy = XYPlane(Origin=Point(0, 0, 0))
python = GhPythonScript(x=read_2)  # -> out, a
# ---------- python: Python ----------
__author__ = "AB"
__version__ = "2018.09.30"

import rhinoscriptsyntax as rs
import json

a = json.loads(x)
# ---------- end python ----------
python_2 = GhPythonScript(x=python.a)  # -> out, a, b, c
# ---------- python_2: Python ----------
__author__ = "AB"
__version__ = "2018.09.30"

import rhinoscriptsyntax as rs
a=x["min"]
b=x["max"]
c=x["setback"]
# ---------- end python_2 ----------
merge = Merge(Data1=python_2.a, Data2=python_2.b)
sort = SortList(Keys=flatten(merge), ValuesA=flatten(merge))  # -> Keys, ValuesA
cset = CreateSet(List=sort.ValuesA)  # -> Set, Map
boundary_8 = BoundarySurfaces(Edges=crv_9)
consec = ConsecutiveDomains(Numbers=cset.Set, Additive=False)
remap = RemapNumbers(Value=0.5, Source=Domain(0, 1), Target=consec)  # -> Mapped, Clipped
dom = ConstructDomain(DomainStart=python_2.a, DomainEnd=python_2.b)
fdom = FindDomain(Domains=dom, Number=remap.Mapped, Strict=False)  # -> Index, Neighbour
item_2 = ListItem(List=python_2.c, Index=fdom.Index, Wrap=True)
long = LongestList(ListA=item_2, ListB=consec, PaddingMode=2)  # -> ListA, ListB
num = Number(long.ListA)
bnd = Bounds(Numbers=num)
dedomain = DeconstructDomain(Domain=bnd)  # -> Start, End
ext = ExtendCurve(Curve=graft(crv_9), Type=0, Start=dedomain.End, End=dedomain.End)
offset_l = OffsetCurveLoose(Curve=ext, Distance=expr("-x", num), Plane=xy)
panel_10 = Panel(dedomain.End)
dedomain_2 = DeconstructDomain(Domain=long.ListB)  # -> Start, End
num_2 = Number(dedomain_2.End)
num_3 = Number(dedomain_2.Start)
pt = ConstructPoint(XCoordinate=0, YCoordinate=0, ZCoordinate=num_3)
pt_2 = ConstructPoint(XCoordinate=0, YCoordinate=0, ZCoordinate=num_2)
xy_2 = XYPlane(Origin=pt)
flip = FlipMatrix(Data=xy_2)
item_3 = ListItem(List=flip, Index=0, Wrap=True)
xy_3 = XYPlane(Origin=pt_2)
flip_2 = FlipMatrix(Data=xy_3)
item_4 = ListItem(List=flip_2, Index=0, Wrap=True)
project = Project(Geometry=boundary_8, Plane=item_3)  # -> simplify(Geometry), Transform
project_2 = Project(Geometry=boundary_8, Plane=item_4)  # -> simplify(Geometry), Transform
panel_11 = Panel(dedomain_2.Start)
flip_last = FlipLast(Data=offset_l)
shift = ShiftList(List=flip_last, Shift=-1, Wrap=True)
llx = LineLine(Line1=shift, Line2=flip_last)  # -> ParamA, ParamB, PointA, PointB
pline = PolyLine(Vertices=llx.PointA, Closed=True)
explode_2 = Explode(Curve=pline, Recursive=True)  # -> Segments, Vertices
flip_last_2 = FlipLast(Data=explode_2.Segments)
project_3 = Project(Geometry=flip_last_2, Plane=xy_2)  # -> Geometry, Transform
project_4 = Project(Geometry=flip_last_2, Plane=xy_3)  # -> Geometry, Transform
graft = GraftTree(Tree=project_3.Geometry, IncludeEmptyLists=True, IncludeNullItems=True)
graft_2 = GraftTree(Tree=project_4.Geometry, IncludeEmptyLists=True, IncludeNullItems=True)
loft = Loft(
    Curves=[graft, graft_2],
    Options={Adjust=False, Closed=False, LoftEnds=0, LoftSimp=0, LoftType=3, Rebuild=10, Refit=0.01})  # -> simplify(Loft)
shift_2 = ShiftPaths(Data=loft, Offset=-1)
flip_3 = FlipMatrix(Data=shift_2)
bvol_5 = BoundaryVolume(Boundaries=[flip_3, project.Geometry, project_2.Geometry])
sunion = SolidUnion(Breps=flatten(bvol_5))
fmerge = MergeFaces(Brep=sunion)  # -> Breps, Before, After
panel_12 = Panel(flip_last_2)

# ----
# COLLISION CHECK
geo_5 = Geometry(fmerge.Breps)
sunion_2 = SolidUnion(Breps=[brep, geo_5])
sdiff = SolidDifference(BrepsA=brep)
bbx = BrepBrep()  # -> Curves, Points
debrep_5 = DeconstructBrep(Brep=sunion_2)  # -> Faces, Edges, Vertices
debrep_6 = DeconstructBrep(Brep=geo_5)  # -> Faces, Edges, Vertices
lng = ListLength(List=debrep_5.Faces)
lng_2 = ListLength(List=debrep_6.Faces)
expression = Expression(x=lng, y=lng_2, Expression="x=y")
panel_13 = Panel(expression)
