# Grasshopper definition Tower by Multiple Breps.ghx (Grasshopper 1.0.7)
# Copyright: Co-de-iT
# plug-ins: treesloth01, Redback, Human

# ----
# START HERE
# GEOMETERY INPUT
panel = Panel("BREPS::Brep5")
dpipeline = DynamicGeometryPipeline(
    LayerFilter=panel,
    TypeFilter="Brep",
    NameFilter="*",
    GroupByLayer=False,
    GroupByType=False,
    IncludeHidden=True,
    IncludeLocked=True,
    enableFullPath=True,
    listenToAttributes=True)

# ----
# TOWER
tower_by_multiple_breps = TowerByMultipleBreps(geometry=dpipeline)  # -> rooftops_2, roof_properties_2, full_mass_2, full_mass_properties_2, sub_mass_2, sub_mass_properties_2, facade_3, facade_properties_2, floorplates_2, floorplate_properties_2
panel_2 = Panel(tower_by_multiple_breps.rooftops_2)
output = DataOutput(
    Floorplate_Properties=tower_by_multiple_breps.floorplate_properties_2,
    Floorplates=tower_by_multiple_breps.floorplates_2,
    Full_Mass=tower_by_multiple_breps.full_mass_2,
    Full_Mass_Properties=tower_by_multiple_breps.full_mass_properties_2,
    Sub_Mass=tower_by_multiple_breps.sub_mass_properties_2,
    Sub_Mass_Properties=tower_by_multiple_breps.sub_mass_2,
    Facade=tower_by_multiple_breps.facade_3,
    Facade_Properties=tower_by_multiple_breps.facade_properties_2,
    Rooftops=tower_by_multiple_breps.rooftops_2,
    Rooftop_Properties=tower_by_multiple_breps.roof_properties_2,
    Destination="C:\Users\bekjc\Documents\Hackaton\Hackathon2018\Hackaton Multiple Mass.ghdata")
panel_3 = Panel(tower_by_multiple_breps.roof_properties_2)
tower_by_multiple_breps_gh_input = TowerByMultipleBrepsGhInput()  # -> rooftops_2, roof_properties_2, full_mass_2, full_mass_properties_2, sub_mass_2, sub_mass_properties_2, facade_3, facade_properties_2, floorplates_2, floorplate_properties_2; disabled
tower_by_multiple_breps_2 = TowerByMultipleBreps_2()  # -> floorplates_2, floorplate_properties_2, facade_3, facade_properties_2, full_mass_2, full_mass_properties_2, rooftops_2; disabled

# ---- group: FLOOR PLATES
panel_4 = Panel("Typology")  # disabled
panel_5 = Panel("Residential")  # disabled
read = ReadJSON(Object=tower_by_multiple_breps_gh_input.floorplate_properties_2, Key=panel_4)  # disabled
tmatch = MatchText(Text=read, Pattern=panel_5, Case=True)  # disabled
dispatch = Dispatch(List=tower_by_multiple_breps_gh_input.floorplates_2, DispatchPattern=tmatch)  # -> ListA, ListB; disabled
resi = Geometry(dispatch.ListB)  # disabled
comm = Geometry(dispatch.ListA)  # disabled

# ---- group: FACADE
panel_6 = Panel("Typology")  # disabled
panel_7 = Panel("Residential")  # disabled
read_2 = ReadJSON(Object=tower_by_multiple_breps_gh_input.facade_properties_2, Key=panel_6)  # disabled
tmatch_2 = MatchText(Text=read_2, Pattern=panel_7, Case=True)  # disabled
dispatch_2 = Dispatch(List=tower_by_multiple_breps_gh_input.facade_3, DispatchPattern=tmatch_2)  # -> ListA, ListB; disabled
comm_2 = Geometry(dispatch_2.ListA)  # disabled
resi_2 = Geometry(dispatch_2.ListB)  # disabled

# ---- group: SUBMASS
panel_8 = Panel("Typology")  # disabled
panel_9 = Panel("Residential")  # disabled
read_3 = ReadJSON(Object=tower_by_multiple_breps_gh_input.sub_mass_properties_2, Key=panel_8)  # disabled
tmatch_3 = MatchText(Text=read_3, Pattern=panel_9, Case=True)  # disabled
dispatch_3 = Dispatch(List=tower_by_multiple_breps_gh_input.sub_mass_2, DispatchPattern=tmatch_3)  # -> ListA, ListB; disabled
comm_3 = Geometry(dispatch_3.ListA)  # disabled
resi_3 = Geometry(dispatch_3.ListB)  # disabled

# ---- group: ROOFTOPS
panel_10 = Panel("Typology")  # disabled
panel_11 = Panel("Residential")  # disabled
read_4 = ReadJSON(Object=tower_by_multiple_breps_gh_input.roof_properties_2, Key=panel_10)  # disabled
tmatch_4 = MatchText(Text=read_4, Pattern=panel_11, Case=True)  # disabled
dispatch_4 = Dispatch(List=tower_by_multiple_breps_gh_input.rooftops_2, DispatchPattern=tmatch_4)  # -> ListA, ListB; disabled
comm_4 = Geometry(dispatch_4.ListA)  # disabled
resi_4 = Geometry(dispatch_4.ListB)  # disabled

# ---- group: FACADE
panel_12 = Panel("Typology")  # disabled
panel_13 = Panel("Comm")  # disabled
read_5 = ReadJSON(Object=tower_by_multiple_breps.floorplate_properties_2, Key=panel_12)  # disabled
tmatch_5 = MatchText(Text=read_5, Pattern=panel_13, Case=True)  # disabled
dispatch_5 = Dispatch(List=tower_by_multiple_breps.floorplates_2, DispatchPattern=tmatch_5)  # -> ListA, ListB; disabled
comm_5 = Geometry(dispatch_5.ListA)  # disabled
resi_5 = Geometry(dispatch_5.ListB)  # disabled

panel_14 = Panel("Typology")  # disabled
panel_15 = Panel("Comm")  # disabled
read_6 = ReadJSON(Object=tower_by_multiple_breps.facade_properties_2, Key=panel_14)  # disabled
tmatch_6 = MatchText(Text=read_6, Pattern=panel_15, Case=True)  # disabled
dispatch_6 = Dispatch(List=tower_by_multiple_breps.facade_3, DispatchPattern=tmatch_6)  # -> ListA, ListB; disabled
comm_6 = Geometry(dispatch_6.ListA)  # disabled
resi_6 = Geometry(dispatch_6.ListB)  # disabled

# ---- group: SUBMASS
panel_16 = Panel("Typology")  # disabled
panel_17 = Panel("Comm")  # disabled
read_7 = ReadJSON(Object=tower_by_multiple_breps.sub_mass_properties_2, Key=panel_16)  # disabled
tmatch_7 = MatchText(Text=read_7, Pattern=panel_17, Case=True)  # disabled
dispatch_7 = Dispatch(List=tower_by_multiple_breps.sub_mass_2, DispatchPattern=tmatch_7)  # -> ListA, ListB; disabled
comm_7 = Geometry(dispatch_7.ListA)  # disabled
resi_7 = Geometry(dispatch_7.ListB)  # disabled

# ---- group: ROOFTOPS
panel_18 = Panel("Typology")  # disabled
panel_19 = Panel("Comm")  # disabled
read_8 = ReadJSON(Object=tower_by_multiple_breps.roof_properties_2, Key=panel_18)  # disabled
tmatch_8 = MatchText(Text=read_8, Pattern=panel_19, Case=True)  # disabled
dispatch_8 = Dispatch(List=tower_by_multiple_breps.rooftops_2, DispatchPattern=tmatch_8)  # -> ListA, ListB; disabled
comm_8 = Geometry(dispatch_8.ListA)  # disabled
resi_8 = Geometry(dispatch_8.ListB)  # disabled

# ----
output_2 = DataOutput(
    Floorplate_Properties=tower_by_multiple_breps_2.floorplate_properties_2,
    Floorplates=tower_by_multiple_breps_2.floorplates_2,
    Full_Mass=tower_by_multiple_breps_2.full_mass_2,
    Facade=tower_by_multiple_breps_2.facade_3,
    Rooftops=tower_by_multiple_breps_2.rooftops_2,
    Destination="C:\Users\bekjc\Documents\Hackaton\Hackathon2018\Hackaton Multiple Mass.ghdata")  # disabled

dpipeline_2 = DynamicGeometryPipeline(
    LayerFilter="SECTION PLANE",
    TypeFilter="Brep",
    NameFilter="*",
    GroupByLayer=False,
    GroupByType=False,
    IncludeHidden=True,
    IncludeLocked=True,
    enableFullPath=True,
    listenToAttributes=True)

# ----
# SECTION PLANE
panel_20 = Panel("0,0")
evalsrf = EvaluateSurface(Surface=dpipeline_2, Point=panel_20)  # -> Point, unitize(Normal), UDirection, VDirection, Frame

geo = Geometry(tower_by_multiple_breps.facade_3)
branch = TreeBranch(Tree=geo, Path="0", MaintainPaths=True)
data = Data(tower_by_multiple_breps.facade_properties_2)
item = ListItem(List=branch, Index=Slider(73, range=0..100), Wrap=True)
cap = CapHoles(Brep=geo)
geo_2 = Geometry(tower_by_multiple_breps.rooftops_2)

# ----
# ROTATE FRAME FOR SVG PLANE
number_slider = Slider(90, range=0..100)
Z = UnitZ(Factor=1)
align = AlignPlane(Plane=evalsrf.Frame, Direction=Z)  # -> Plane, Angle
neg = Negative(Value=number_slider)
prot = RotatePlane(Plane=align.Plane, Angle=degrees(neg))

group = Group(Objects=tower_by_multiple_breps.floorplates_2)
geo_3 = Geometry(tower_by_multiple_breps.full_mass_2)
sec = BrepPlane(Brep=cap, Plane=evalsrf.Frame)  # -> Curves, Points
data_2 = Data(tower_by_multiple_breps.floorplate_properties_2)
sec_2 = BrepPlane(Brep=geo_3, Plane=evalsrf.Frame)  # -> Curves, Points
long = LongestList(ListA=evalsrf.Frame, ListB=flatten(group), PaddingMode=2)  # -> simplify(graft(ListA)), ListB
join = TextJoin(Text=data_2, Join="*")
null = NullItem(Item=sec_2.Curves)  # -> simplify(NullFlags), InvalidFlags, Description
dispatch_9 = Dispatch(List=geo_3, DispatchPattern=null.NullFlags)  # -> ListA, ListB
dispatch_10 = Dispatch(List=group, DispatchPattern=null.NullFlags)  # -> ListA, ListB
dispatch_11 = Dispatch(List=join, DispatchPattern=null.NullFlags)  # -> ListA, ListB
dispatch_12 = Dispatch(List=long.ListA, DispatchPattern=null.NullFlags)  # -> ListA, ListB
split = TextSplit(Text=dispatch_11.ListB, Separators="*")  # -> simplify(Result)
ungroup = Ungroup(Group=dispatch_10.ListB)

# ---- group: FLOOR PLATE PROPERTIES
clean = CleanTree(RemoveNulls=True, RemoveInvalid=True, RemoveEmpty=True, Tree=split)  # -> simplify(Tree)

# ---- group: FLOOR PLATES
clean_2 = CleanTree(RemoveNulls=True, RemoveInvalid=True, RemoveEmpty=True, Tree=ungroup)  # -> simplify(Tree)

# ---- group: OVERALL MASS
clean_3 = CleanTree(RemoveNulls=True, RemoveInvalid=True, RemoveEmpty=True, Tree=dispatch_9.ListB)  # -> simplify(Tree)

# ---- group: PLANES
clean_4 = CleanTree(RemoveNulls=True, RemoveInvalid=True, RemoveEmpty=True, Tree=dispatch_12.ListB)  # -> simplify(Tree)

# ----
viewer = ParamViewer(tower_by_multiple_breps.floorplates_2)
# LEVEL LINES
sec_3 = BrepPlane(Brep=clean_2, Plane=clean_4)  # -> Curves, Points
# OUTLINE
sec_4 = BrepPlane(Brep=clean_3, Plane=clean_4)  # -> Curves, Points
panel_21 = Panel(clean)
trim = TrimTree(Tree=sec_3.Curves, Depth=1)
boundary = BoundarySurfaces(Edges=sec_4.Curves)  # -> simplify(Surfaces)
data_3 = Data(clean)
srfsplit = SurfaceSplit(Surface=boundary, Curves=trim)  # -> simplify(Fragments)

# ---- group: DEFINE DRAWING PAGE
pln = Plane(prot)
drawing_scale = Panel("1:500")
paper = Panel("A1 (L)")
svg_plane_by_page = RDB_SVGPlaneByPage(plane=pln, page_size=paper, scale=drawing_scale, position=Toggle(True))  # -> json_layout, preview

# ---- group: LEGEND BASE LOCATION / PAGE
# LEGEND
crv = Curve(svg_plane_by_page.preview)

# ---- group: CHECK DRAWING DIRECTION
boundary_2 = BoundarySurfaces(Edges=svg_plane_by_page.preview)
evalsrf_2 = EvaluateSurface(Surface=boundary_2, Point="0,0")  # -> Point, unitize(Normal), UDirection, VDirection, Frame
multiplication = Multiplication(A=evalsrf_2.Normal, B=100)
vdis = VectorDisplay(Anchor=evalsrf_2.Point, Vector=multiplication)

# ----
read_9 = ReadJSON(Object=data_3, Key="Typology")  # -> flatten(Value)
area = Area(Geometry=srfsplit)  # -> Area, Centroid

# ---- group: LEGEND BASE LOCATION
explode = Explode(Curve=crv, Recursive=True)  # -> Segments, Vertices
item_2 = ListItem(List=explode.Vertices, Index=0, Wrap=True)
xy = XYPlane(Origin=pln)
xy_2 = XYPlane(Origin=item_2)
orient = Orient(Geometry=pln, Source=xy, Target=xy_2)  # -> Geometry, Transform

# ---- group: MOVE OUT FROM CORNER
number_slider_2 = Slider(20, range=0..100)
deplane = DeconstructPlane(Plane=pln)  # -> Origin, unitize(XAxis), YAxis, ZAxis
multiplication_2 = Multiplication(A=deplane.YAxis, B=number_slider_2)
multiplication_3 = Multiplication(A=deplane.XAxis, B=number_slider_2)
move = Move(Geometry=orient.Geometry, Motion=multiplication_3)  # -> Geometry, Transform
move_2 = Move(Geometry=move.Geometry, Motion=multiplication_2)  # -> Geometry, Transform

# ----
cset = CreateSet(List=flatten(read_9))  # -> reverse(Set), Map

# ---- group: LEGEND SEPARATION
Z_2 = UnitZ(Factor=Slider(10, range=0..100))
lng = ListLength(List=cset.Set)
arrlinear = LinearArray(Geometry=move_2.Geometry, Direction=Z_2, Count=lng)  # -> Geometry, Transform

# ----
pdecon = Deconstruct(Point=area.Centroid)  # -> XComponent, YComponent, ZComponent
mindex = MemberIndex(Set=read_9, Member=cset.Set)  # -> Index, Count
sort = SortList(Keys=pdecon.ZComponent, ValuesA=srfsplit)  # -> Keys, reverse(flatten(ValuesA))
item_3 = ListItem(List=read_9, Index=mindex.Index, Wrap=True)  # -> simplify(Item)
item_4 = ListItem(List=sort.ValuesA, Index=mindex.Index, Wrap=True)  # -> simplify(Item)

# ---- group: LEGEND BOX SIZE
number_slider_3 = Slider(30, range=0..100)
rectangle = Rectangle(Plane=arrlinear.Geometry, XSize=number_slider_3, YSize=Slider(6, range=0..100), Radius=0)  # -> Rectangle, Length

# ---- group: TEXT LOCATION
addition = Addition(A=number_slider_3, B=Slider(10, range=0..10))
multiplication_4 = Multiplication(A=deplane.XAxis, B=addition)
move_3 = Move(Geometry=arrlinear.Geometry, Motion=multiplication_4)  # -> Geometry, Transform

# ----
graft = GraftTree(Tree=rectangle.Rectangle, IncludeEmptyLists=True, IncludeNullItems=True)

explode_2 = Explode(Curve=sec_4.Curves, Recursive=True)  # -> flatten(Segments), Vertices
eval = EvaluateCurve(Curve=reparameterize(explode_2.Segments), Parameter=0.5)  # -> Point, Tangent, Angle
pdecon_2 = Deconstruct(Point=eval.Point)  # -> XComponent, YComponent, ZComponent
sort_2 = SortList(Keys=pdecon_2.ZComponent, ValuesA=explode_2.Segments)  # -> Keys, ValuesA
first_last = FirstLast(List=sort_2.ValuesA)  # -> FirstValue, LastValue
geo_4 = Geometry(first_last.FirstValue)

panel_22 = Panel("""1
3""")
explode_3 = Explode(Curve=svg_plane_by_page.preview, Recursive=True)  # -> Segments, Vertices
item_5 = ListItem(List=explode_3.Segments, Index=panel_22, Wrap=True)
number_slider_4 = Slider(414, range=0..1000)
X = UnitX(Factor=1)
eval_2 = EvaluateCurve(Curve=reparameterize(item_5), Parameter=0.5)  # -> Point, Tangent, Angle
Y = UnitY(Factor=1)
neg_2 = Negative(Value=Y)

# ---- group: GROUND PLANE LINE
number_slider_5 = Slider(999, range=0..1000)
ext = ExtendCurve(Curve=geo_4, Type=0, Start=number_slider_5, End=number_slider_5)

# ----
file_path = Panel("C:\Users\bekjc\Documents\Hackaton\Hackathon2018\SVG")

# ---- group: CLASS
panel_23 = Panel("""-Stroke
-Fill""")
graft_2 = GraftTree(Tree=cset.Set, IncludeEmptyLists=True, IncludeNullItems=True)  # -> simplify(Tree)
concat = Concatenate(FragmentA=graft_2, FragmentB=panel_23)  # -> simplify(flatten(Result))
graft_3 = GraftTree(Tree=concat, IncludeEmptyLists=True, IncludeNullItems=True)  # -> simplify(Tree)
json = JSON(Key="class", Value=graft_3)

panel_24 = Panel("""Ground
Ground-Fill
Outline
RL""")
json_2 = JSON(Key="class", Value=graft(panel_24))

# ----
css_styling = Panel(""".legendtext{
fill:Black;
}""")
panel_25 = Panel(""".labels{
font-family: "Univers LT Std";
fill: rgb(94,114,123);
stroke: none;
font-size:1.5mm;
text-anchor: middle;
dominant-baseline: middle;
}""")  # disabled
textclass = RDB_TextClass(LOCATION=move_3.Geometry, TEXT=cset.Set)  # -> simplify(OUTPUT), simplify(O); disabled
# ---------- textclass: Python ----------
import Rhino as r
import rhinoscriptsyntax as rs
import json

L = LOCATION

T = TEXT


class text:
    def __init__(self, location, content):
        self.location = location
        self.content = str(content)
        self.type = "text"

O = text(L,T)

print O.location
print O.content
# ---------- end textclass ----------
panel_26 = Panel("legendtext")  # disabled
json_3 = JSON(Key="class", Value="legendtext")
panel_27 = Panel("class")  # disabled
toggle = BooleanToggle(False)  # disabled
json_4 = JSON(Key=panel_27, Value=panel_26)  # disabled
geo2archijson = Geo2ArchiJSON_2(G=textclass.O, properties=json_4, output_type=toggle)  # disabled
draw = DrawSVG_2(objects=geo2archijson, layout=svg_plane_by_page.json_layout, css=panel_25)  # disabled

# ---- group: FILE NAME
concat_2 = Concatenate(FragmentA="legendtext", FragmentB=".svg")  # -> flatten(Result)
panel_28 = Panel(concat_2)

concat_3 = Concatenate(FragmentA=graft_3, FragmentB=".svg")  # -> flatten(Result)
panel_29 = Panel(concat_3)

# ----
concat_4 = Concatenate(FragmentA=panel_24, FragmentB=".svg")  # -> flatten(Result)

graft_4 = GraftTree(Tree=concat_2, IncludeEmptyLists=True, IncludeNullItems=True)

# ----
# SECTION LEVELS
# LEVEL CURVES
# CLASS
# LEGEND BLOCKS
floor_plates = Geometry(item_4)
merge = Merge(Data1=simplify(floor_plates), Data2=simplify(graft))
css_styling_2 = Panel(""".Resi-Stroke{
stroke:black;
stroke-width: *mm;
fill:none;
}

.Resi-Fill{
fill: rgb(204,108,120);
}

.Comm-Stroke{
stroke:black;
stroke-width: *mm;
fill:none;
}

.Comm-Fill{
fill: rgb(130,215,255);
}""")
textclass_2 = RDB_TextClass(LOCATION=move_3.Geometry, TEXT=cset.Set)  # -> simplify(OUTPUT), flatten(O); same code as textclass
graft_5 = GraftTree(Tree=concat_3, IncludeEmptyLists=True, IncludeNullItems=True)

explode_4 = Explode(Curve=floor_plates, Recursive=True)  # -> Segments, Vertices
pdecon_3 = Deconstruct(Point=explode_4.Vertices)  # -> XComponent, YComponent, ZComponent
sort_3 = SortList(Keys=pdecon_3.ZComponent, ValuesA=explode_4.Vertices)  # -> Keys, ValuesA

# ---- group: CONVERT CURVES
topoly = CurveToPolyline(Curve=merge, ToleranceDistance=0, ToleranceAngle=0)  # -> Polyline, Segments

# ----
item_6 = ListItem(List=sort_3.ValuesA, Index=0, Wrap=True)  # -> Item, Item1
dist = Distance(PointA=item_6.Item, PointB=eval_2.Point)  # -> simplify(Distance)
line = LineSDL(Start=item_6.Item, Direction=Y, Length=number_slider_4)
line_2 = LineSDL(Start=item_6.Item, Direction=neg_2, Length=number_slider_4)
merge_2 = Merge(Data1=line, Data2=line_2)
sort_4 = SortList(Keys=dist, ValuesA=merge_2)  # -> Keys, ValuesA
item_7 = ListItem(List=sort_4.ValuesA, Index=0, Wrap=True)
dash = DashPattern(Curve=item_7, Pattern="0.2,1")  # -> Dashes, Gaps
geo_5 = Geometry(flatten(dash.Dashes))
panel_30 = Panel(dash.Dashes)
group_2 = Group(Objects=geo_5)

# ---- group: REPEAT FOR STROKE AND FILL CLASSES
group_3 = Group(Objects=topoly.Polyline)  # -> graft(Group)
lng_2 = ListLength(List=group_3)
multiplication_5 = Multiplication(A=lng_2, B=Slider(2, range=0..10))
repeat = RepeatData(Data=group_3, Length=multiplication_5)  # -> flatten(Data)
ungroup_2 = Ungroup(Group=repeat)  # -> simplify(Objects)

# ---- group: STROKE THICKNESS
mrep = ReplaceMultiText(T=css_styling_2, F="*", R=Slider(0.2, range=0..3))

# ----
geo2archijson_2 = Geo2ArchiJSON_2(G=textclass_2.O, properties=json_3, output_type=Toggle(False))

long_2 = LongestList(ListA=ungroup_2, ListB=json, PaddingMode=2)  # -> ListA, ListB
geo2archijson_3 = Geo2ArchiJSON(G=long_2.ListA, properties=long_2.ListB, output_type=Toggle(False))
draw_2 = DrawSVG(objects=geo2archijson_2, layout=svg_plane_by_page.json_layout, css=css_styling)  # -> simplify(svg)
draw_3 = DrawSVG(objects=geo2archijson_3, layout=svg_plane_by_page.json_layout, css=mrep)  # -> simplify(svg)
write_file = WRITEFILE(content=draw_3, filepath=file_path, filename=graft_5, activate=Toggle(True))

panel_31 = Panel(draw_2)
rep = ReplaceText(Text=draw_2, RecursiveReplace=False)
write_file_2 = WRITEFILE(content=draw_2, filepath=file_path, filename=graft_4, activate=Toggle(True))

Z_3 = UnitZ(Factor=Slider(110, range=0..200))
neg_3 = Negative(Value=Z_3)

# ----
# GROUND AND OUTLINE
ground = Geometry(ext)
outline = Geometry(flatten(sec_4.Curves))
css_styling_3 = Panel(""".Ground{
stroke:black;
stroke-width: 2mm;
fill:none;
}
.Ground-Fill{
stroke:none;
fill:grey;
}
.Outline{
stroke:black;
stroke-width: 0.2mm;
fill:none;
}
.RL{
stroke:black;
stroke-width: 0.2mm;
fill:none;
}""")
graft_6 = GraftTree(Tree=concat_4, IncludeEmptyLists=True, IncludeNullItems=True)

extr = Extrude(Base=ground, Direction=neg_3)
area_2 = Area(Geometry=extr)  # -> Area, Centroid
edgesfaces = EdgesFromFaces(Brep=extr, Points=area_2.Centroid)  # -> Edges, Indices
join_2 = JoinCurves(Curves=edgesfaces.Edges, Preserve=False)  # -> flatten(Curves)
ground_fill = Geometry(join_2)

group_4 = Group(Objects=ground)
group_5 = Group(Objects=outline)
group_6 = Group(Objects=ground_fill)

merge_3 = Merge(Data1=group_4, Data2=group_6, Data3=group_5, Data4=group_2)  # -> simplify(graft(Result))

ungroup_3 = Ungroup(Group=merge_3)  # -> simplify(Objects)
long_3 = LongestList(ListA=json_2, ListB=ungroup_3, PaddingMode=2)  # -> simplify(ListA), ListB

geo2archijson_4 = Geo2ArchiJSON(G=ungroup_3, properties=long_3.ListA, output_type=Toggle(False))
draw_4 = DrawSVG(objects=geo2archijson_4, layout=svg_plane_by_page.json_layout, css=css_styling_3)  # -> simplify(svg)
write_file_3 = WRITEFILE(content=draw_4, filepath=file_path, filename=graft_6, activate=Toggle(True))

panel_32 = Panel(geo2archijson_4)

# ==== cluster TowerByMultipleBreps
geometry = ClusterInput()
geometry_2 = Data(geometry)

# ----
# SORT INTO BUILDINGS
panel = Panel("BuildID")
getuv = GetUserValue(Geometry=geometry_2, Key=panel)
cset = CreateSet(List=getuv)  # -> simplify(graft(Set)), Map
tmatch = MatchText(Text=getuv, Pattern=cset.Set, Case=True)
dispatch = Dispatch(List=geometry_2, DispatchPattern=tmatch)  # -> simplify(ListA), ListB

# ----
# GET LOWEST POINT ON EACH BREP
debrep = DeconstructBrep(Brep=dispatch.ListA)  # -> Faces, Edges, simplify(Vertices)
pdecon = Deconstruct(Point=debrep.Vertices)  # -> XComponent, YComponent, ZComponent
sort = SortList(Keys=pdecon.ZComponent, ValuesA=debrep.Vertices)  # -> reverse(Keys), reverse(ValuesA)
item = ListItem(List=sort.Keys, Index=-1, Wrap=True)  # -> simplify(Item)
utrim = UberTrim(data=item)

# ----
# CALCULATE HEIGHT OF EACH BREP
bbox = BoundingBox(Content=dispatch.ListA, Plane=PlaneXY(0, 0, 0))  # -> Box, Box_2
debox = DeconstructBox(Box=bbox.Box)  # -> Plane, X, Y, Z
dedomain = DeconstructDomain(Domain=debox.Z)  # -> Start, End
subtraction = Subtraction(A=dedomain.End, B=dedomain.Start)

getuv_2 = GetUserValue(Geometry=dispatch.ListA, Key="F2F")
getuv_3 = GetUserValue(Geometry=dispatch.ListA, Key="Typology")
getuv_4 = GetUserValue(Geometry=dispatch.ListA, Key="SubBuildID")

# ----
# CREATE LEVEL NUMBERS
len = TextLength(Text=getuv_4)  # disabled
utrim_2 = UberTrim(data=len)  # disabled
cset_2 = CreateSet(List=utrim_2)  # -> Set, Map; disabled
sort_2 = SortList(Keys=cset_2.Set)  # -> Keys, ValuesA; disabled
num = Number(sort_2.Keys)  # disabled
num_2 = Number(utrim_2)  # disabled
mindex = MemberIndex(Set=num_2, Member=num)  # -> Index, Count; disabled
lng = ListLength(List=mindex.Index)  # disabled
trim = TrimTree(Tree=lng, Depth=1)  # disabled
panel_2 = Panel("\t")  # disabled
join = TextJoin(Text=getuv_4, Join=panel_2)  # disabled
lng_2 = ListLength(List=trim)  # disabled
repeat = RepeatData(Data=join, Length=lng_2)  # disabled
split = TextSplit(Text=repeat, Separators=panel_2)  # disabled
item_2 = ListItem(List=split, Index=mindex.Index, Wrap=True)  # -> simplify(Item); disabled
panel_3 = Panel("^")  # disabled
lng_3 = ListLength(List=item_2)  # disabled
number_slider = Slider(1, range=0..1)  # disabled
panel_4 = Panel("^")  # disabled
join_2 = TextJoin(Text=item_2, Join=panel_3)  # disabled
join_3 = TextJoin(Text=lng_3, Join=panel_4)  # disabled
utrim_3 = UberTrim(data=join_3)  # disabled
utrim_4 = UberTrim(data=join_2)  # disabled
larger = LargerThan(FirstNumber=utrim_3, SecondNumber=number_slider)  # -> LargerThan, OrEqualTo; disabled
lng_4 = ListLength(List=larger.LargerThan)  # disabled
series = Series(Start=0, Step=1, Count=lng_4)  # disabled
dispatch_2 = Dispatch(List=utrim_4, DispatchPattern=larger.LargerThan)  # -> ListA, ListB; disabled
cull = CullPattern(List=series, CullPattern=larger.LargerThan)  # disabled
split_2 = SplitList(List=utrim_4, Index=cull)  # -> ListA, ListB; disabled
split_3 = TextSplit(Text=split_2.ListB, Separators=panel_3)  # -> simplify(Result); disabled
split_4 = TextSplit(Text=split_2.ListA, Separators=panel_3)  # -> simplify(Result); disabled
utrim_5 = UberTrim(data=split_3)  # disabled
item_3 = ListItem(List=utrim_5, Index=0, Wrap=True)  # disabled
len_2 = TextLength(Text=item_3)  # disabled
series_2 = Series(Start=0, Step=1, Count=len_2)  # disabled
chars = Characters(Text=getuv_4)  # -> Result, Unicode; disabled
item_4 = ListItem(List=chars.Result, Index=series_2, Wrap=True)  # -> Item, Item1, Item2; disabled
merge = Merge(Data1=item_4.Item)  # disabled
join_4 = TextJoin(Text=item_4.Item)  # disabled

getuv_5 = GetUserValue(Geometry=dispatch.ListA, Key="BuildID")
getuv_6 = GetUserValue(Geometry=dispatch.ListA, Key="F2F")

# ----
# NUMBER OF FLOORS
division = Division(A=subtraction, B=getuv_2)
round = Round(Number=division)  # -> simplify(Nearest), Floor, Ceiling

# ----
# PLANE PER LEVEL
series_3 = Series(Start=utrim, Step=getuv_2, Count=round.Nearest)
pt = ConstructPoint(XCoordinate=0, YCoordinate=0, ZCoordinate=series_3)  # -> simplify(Point)
xy = XYPlane(Origin=pt)

graft = GraftTree(Tree=dispatch.ListA, IncludeEmptyLists=True, IncludeNullItems=True)

# ---- group: TYPOLOGY
# TYPOLOGY
dup = DuplicateData(Data=graft(getuv_3), Number=graft(round.Nearest), Order=True)  # -> simplify(Data)

# ---- group: SUB BUILD ID
# SUB BUILD ID
dup_2 = DuplicateData(Data=graft(getuv_4), Number=graft(round.Nearest), Order=True)  # -> simplify(Data)

# ---- group: BUILD ID
# BUILD ID
dup_3 = DuplicateData(Data=graft(getuv_5), Number=graft(round.Nearest), Order=True)  # -> simplify(Data)

# F2F
# FACADE
dup_4 = DuplicateData(Data=graft(getuv_6), Number=graft(round.Nearest), Order=True)  # -> simplify(Data)

# ----
# FLOOR PLATE CRVS
sec = BrepPlane(Brep=graft, Plane=xy)  # -> Curves, Points

panel_5 = Panel("""-1
0""")

# ---- group: all floorplates
boundary = BoundarySurfaces(Edges=sec.Curves)  # -> simplify(Surfaces)

# ----
utrim_6 = UberTrim(data=boundary)

# ---- group: sort by height to get tops
area = Area(Geometry=utrim_6)  # -> Area, Centroid
pdecon_2 = Deconstruct(Point=area.Centroid)  # -> XComponent, YComponent, ZComponent
sort_3 = SortList(
    Keys=pdecon_2.ZComponent,
    ValuesFloorplate=utrim_6,
    ValuesTypology=dup,
    ValuesSubBuildID=dup_2,
    ValuesBuildID=dup_3,
    ValuesF2F=dup_4)  # -> reverse(Keys), reverse(ValuesFloorplate), reverse(ValuesTypology), reverse(ValuesSubBuildID), reverse(ValuesBuildID), ValuesF2F
item_5 = ListItem(List=sort_3.ValuesFloorplate, Index=0, Wrap=True)

# ----
cull_i = CullIndex(List=sort_3.ValuesFloorplate, Indices=0, Wrap=True)  # -> simplify(List)

# ---- group: usable space above floor
area_2 = Area(Geometry=item_5)  # -> Area, Centroid
Z = UnitZ(Factor=1)
graft_2 = GraftTree(Tree=getuv_2, IncludeEmptyLists=True, IncludeNullItems=True)
line = LineSDL(Start=area_2.Centroid, Direction=Z, Length=graft_2)

# ----
graft_3 = GraftTree(Tree=dispatch.ListA, IncludeEmptyLists=True, IncludeNullItems=True)
bcx = BrepCurve(Brep=graft_3, Curve=line)  # -> Curves, simplify(Points)
null = NullItem(Item=bcx.Points)  # -> NullFlags, InvalidFlags, Description

# ---- group: F2F
item_6 = ListItem(List=sort_3.ValuesF2F, Index=0, Wrap=True)
cull_i_2 = CullIndex(List=sort_3.ValuesF2F, Indices=0, Wrap=True)  # -> simplify(List)
dispatch_3 = Dispatch(List=item_6, DispatchPattern=null.NullFlags)  # -> ListA, ListB
merge_2 = Merge(Data1=dispatch_3.ListA, Data2=cull_i_2)

# ---- group: Typology
item_7 = ListItem(List=sort_3.ValuesTypology, Index=0, Wrap=True)
cull_i_3 = CullIndex(List=sort_3.ValuesTypology, Indices=0, Wrap=True)  # -> simplify(List)
dispatch_4 = Dispatch(List=item_7, DispatchPattern=null.NullFlags)  # -> ListA, ListB
merge_3 = Merge(Data1=dispatch_4.ListA, Data2=cull_i_3)

# ---- group: BuildID
cull_i_4 = CullIndex(List=sort_3.ValuesBuildID, Indices=0, Wrap=True)  # -> simplify(List)
item_8 = ListItem(List=sort_3.ValuesBuildID, Index=0, Wrap=True)
dispatch_5 = Dispatch(List=item_8, DispatchPattern=null.NullFlags)  # -> ListA, ListB
merge_4 = Merge(Data1=dispatch_5.ListA, Data2=cull_i_4)

# ---- group: SubBuildID
item_9 = ListItem(List=sort_3.ValuesSubBuildID, Index=0, Wrap=True)
cull_i_5 = CullIndex(List=sort_3.ValuesSubBuildID, Indices=0, Wrap=True)  # -> simplify(List)
dispatch_6 = Dispatch(List=item_9, DispatchPattern=null.NullFlags)  # -> ListA, ListB
merge_5 = Merge(Data1=dispatch_6.ListA, Data2=cull_i_5)

# ----
dispatch_7 = Dispatch(List=item_5, DispatchPattern=null.NullFlags)  # -> ListA, ListB
merge_6 = Merge(Data1=dispatch_7.ListA, Data2=cull_i)
area_3 = Area(Geometry=merge_6)  # -> Area, Centroid
pdecon_3 = Deconstruct(Point=area_3.Centroid)  # -> XComponent, YComponent, ZComponent
sort_4 = SortList(
    Keys=pdecon_3.ZComponent,
    ValuesFloorPlate=merge_6,
    ValuesTypology=merge_3,
    ValuesSubBuildID=merge_5,
    ValuesBuildID=merge_4,
    ValuesA=merge_2)  # -> Keys, ValuesFloorPlate, ValuesTypology, ValuesSubBuildID, ValuesBuildID, ValuesA
data = Data(sort_4.Keys)
shift = ShiftList(List=data, Shift=1, Wrap=False)
merge_7 = Merge(Data1=simplify(graft(data)), Data2=simplify(graft(shift)))  # -> simplify(Result)
item_10 = ListItem(List=merge_7, Index=0, Wrap=True)  # -> Item, Item1
dom = ConstructDomain(DomainStart=item_10.Item, DomainEnd=item_10.Item1)  # -> simplify(Domain)
shift_2 = ShiftPaths(Data=dom, Offset=-1)
shift_3 = ShiftPaths(Data=dom, Offset=-1)
branch = TreeBranch(Tree=shift_3, Path="0;1", MaintainPaths=True)
graft_4 = GraftTree(Tree=branch, IncludeEmptyLists=True, IncludeNullItems=True)  # -> simplify(Tree)
group = Group()
panel_6 = Panel("""RL
Typology
SubBuildID
BuildID
F2F""")
merge_8 = Merge(
    Data1=graft(sort_4.Keys),
    Data2=graft(sort_4.ValuesTypology),
    Data3=graft(sort_4.ValuesSubBuildID),
    Data4=graft(sort_4.ValuesBuildID),
    Data5=graft(sort_4.ValuesA))  # -> simplify(Result)
json = JSON(Key=panel_6, Value=merge_8)
utrim_7 = UberTrim(data=json)

# ----
# SUB MASS
panel_7 = Panel("""F2F
Typology
SubBuildID
BuildID""")
merge_9 = Merge(Data1=graft(getuv_2), Data2=graft(getuv_3), Data3=graft(getuv_4), Data4=graft(getuv_5))
sub_mass = Geometry(dispatch.ListA)
json_2 = JSON(Key=panel_7, Value=merge_9)
trim_2 = TrimTree(Tree=json_2, Depth=1)
sub_mass_2 = ClusterOutput(sub_mass)
sub_mass_properties = Data(trim_2)
sub_mass_properties_2 = ClusterOutput(sub_mass_properties)

utrim_8 = UberTrim(data=sort_4.ValuesFloorPlate)
utrim_9 = UberTrim(data=utrim_7)
floorplate_properties = Data(utrim_9)
floorplates = Data(simplify(utrim_8))
floorplate_properties_2 = ClusterOutput(floorplate_properties)
floorplates_2 = ClusterOutput(floorplates)

# ----
# EXPLODE FACADE FACES
debrep_2 = DeconstructBrep(Brep=dispatch.ListA)  # -> Faces, Edges, Vertices
evalsrf = EvaluateSurface(Surface=reparameterize(debrep_2.Faces), Point="0.5,0.5")  # -> Point, Normal, UDirection, VDirection, Frame
devec = DeconstructVector(Vector=evalsrf.Normal)  # -> XComponent, YComponent, ZComponent

# ---- group: remove verticals
number_slider_2 = Slider(1, range=0..1)
neg = Negative(Value=number_slider_2)
equals = Equality(FirstNumber=devec.ZComponent, SecondNumber=number_slider_2)  # -> Equality, Inequality
equals_2 = Equality(FirstNumber=devec.ZComponent, SecondNumber=neg)  # -> Equality, Inequality

# ----
pdecon_4 = Deconstruct(Point=evalsrf.Point)  # -> XComponent, YComponent, ZComponent
sort_5 = SortList(Keys=pdecon_4.ZComponent, ValuesA=debrep_2.Faces)  # -> Keys, ValuesA

or = GateOr(A=equals.Equality, B=equals_2.Equality)
dispatch_8 = Dispatch(List=debrep_2.Faces, DispatchPattern=or)  # -> ListA, ListB

# ---- group: facade
cull_i_6 = CullIndex(List=sort_5.ValuesA, Indices=panel_5, Wrap=True)  # -> simplify(List)

# ----
pt_2 = ConstructPoint(XCoordinate=0, YCoordinate=0, ZCoordinate=sort_4.Keys)
xy_2 = XYPlane(Origin=pt_2)
group_2 = Group(Objects=xy_2)
geo = Geometry(dispatch_8.ListB)
long = LongestList(ListA=geo, ListB=group_2, PaddingMode=2)  # -> ListA, ListB
ungroup = Ungroup(Group=long.ListB)
sec_2 = BrepPlane(Brep=graft(long.ListA), Plane=ungroup)  # -> Curves, Points
shift_4 = ShiftPaths(Data=sec_2.Curves, Offset=-1)  # -> simplify(Data)
srfsplit = SurfaceSplit(Surface=graft(long.ListA), Curves=shift_4)  # -> simplify(Fragments)

# ----
# CUT FACADE FLOORS
facade = Data(srfsplit)
utrim_10 = UberTrim(data=facade)
area_4 = Area(Geometry=utrim_10)  # -> Area, Centroid
pdecon_5 = Deconstruct(Point=area_4.Centroid)  # -> XComponent, YComponent, ZComponent
sort_6 = SortList(Keys=pdecon_5.ZComponent, ValuesA=utrim_10)  # -> Keys, ValuesA, ValuesC, ValuesD, ValuesE
lng_5 = ListLength(List=cull_i_6)
partition = PartitionList(List=sort_6.ValuesA, Size=lng_5)
join_5 = BrepJoin(Breps=partition)  # -> Breps, Closed
utrim_11 = UberTrim(data=join_5.Breps)
utrim_12 = UberTrim(data=utrim_11)
panel_8 = Panel("""Typology
SubBuildID
BuildID""")
merge_10 = Merge(Data2=graft(sort_4.ValuesTypology), Data3=graft(sort_4.ValuesSubBuildID), Data4=graft(sort_4.ValuesBuildID))  # -> simplify(Result)
json_3 = JSON(Key=panel_8, Value=merge_10)
utrim_13 = UberTrim(data=json_3)
utrim_14 = UberTrim(data=utrim_13)
facade_properties = Data(utrim_14)
facade_2 = Data(utrim_12)
facade_3 = ClusterOutput(facade_2)
facade_properties_2 = ClusterOutput(facade_properties)

group_3 = Group(Objects=sort_6.ValuesA)
long_2 = LongestList(ListA=shift_2, ListB=sort_6.Keys, ListC=group_3, PaddingMode=1)  # -> simplify(ListA), simplify(ListB), simplify(ListC)
branch_2 = TreeBranch(Tree=sort_6.ValuesA, Path="0;1", MaintainPaths=True)
branch_3 = TreeBranch(Tree=sort_6.Keys, Path="0;1", MaintainPaths=True)
ungroup_2 = Ungroup(Group=long_2.ListC)
inc = Includes(Value=dom, Domain=simplify(long_2.ListB))  # -> Includes, Deviation
dispatch_9 = Dispatch(List=ungroup_2, DispatchPattern=inc.Includes)  # -> ListA, ListB
inc_2 = Includes(Value=branch_3, Domain=graft_4)  # -> Includes, Deviation
geo_2 = Geometry(dispatch_9.ListA)
join_6 = BrepJoin(Breps=geo_2)  # -> Breps, Closed
shift_5 = ShiftPaths(Data=join_6.Breps, Offset=-1)
branch_4 = TreeBranch(Tree=shift_5, Path="0;0", MaintainPaths=True)
panel_9 = Panel(shift_5)
branch_5 = TreeBranch(Tree=partition, Path="0;1;43", MaintainPaths=True)
item_11 = ListItem(List=branch_5, Index=Slider(45, range=0..100), Wrap=True)
panel_10 = Panel(sort_6.ValuesA)
branch_6 = TreeBranch(Tree=utrim_11, Path="0;1", MaintainPaths=True)
item_12 = ListItem(List=branch_6, Index=0, Wrap=True)
branch_7 = TreeBranch(Tree=utrim_12, Path="0", MaintainPaths=True)
cap = CapHoles(Brep=graft(branch_7))
item_13 = ListItem(List=branch_7, Index=Slider(55, range=0..100), Wrap=True)
panel_11 = Panel(branch_7)

# ----
# ROOF
sunion = SolidUnion(Breps=dispatch.ListA)
data_2 = Data(getuv_5)
panel_12 = Panel("""BuildID
SubBuildID
Typology""")

debrep_3 = DeconstructBrep(Brep=sunion)  # -> Faces, Edges, Vertices
evalsrf_2 = EvaluateSurface(Surface=reparameterize(debrep_3.Faces), Point="0.5,0.5")  # -> Point, Normal, UDirection, VDirection, Frame
devec_2 = DeconstructVector(Vector=evalsrf_2.Normal)  # -> XComponent, YComponent, ZComponent
equals_3 = Equality(FirstNumber=devec_2.ZComponent, SecondNumber=Slider(1, range=0..1))  # -> Equality, Inequality
dispatch_10 = Dispatch(List=debrep_3.Faces, DispatchPattern=equals_3.Equality)  # -> ListA, ListB
utrim_15 = UberTrim(data=dispatch_10.ListA)

# ---- group: TEST POINT FROM ROOFTOP
number_slider_3 = Slider(0.1, range=0..0.1)
data_3 = Data(utrim_15)
Z_2 = UnitZ(Factor=Slider(0.5, range=0..1))
area_5 = Area(Geometry=data_3)  # -> Area, Centroid
neg_2 = Negative(Value=Z_2)
move = Move(Geometry=area_5.Centroid, Motion=neg_2)  # -> graft(Geometry), Transform

# ---- group: DUPLICATE BREPS
group_4 = Group(Objects=dispatch.ListA)
lng_6 = ListLength(List=area_5.Centroid)
dup_5 = DuplicateData(Data=group_4, Number=lng_6, Order=True)
ungroup_3 = Ungroup(Group=dup_5)  # -> simplify(Objects)

# ---- group: Sort rooftops per mass
brepinc = PointInBrep(Brep=ungroup_3, Point=move.Geometry, Strict=False)
dispatch_11 = Dispatch(List=ungroup_3, DispatchPattern=brepinc)  # -> ListA, ListB

# ----
geo_3 = Geometry(dispatch_11.ListA)
getuv_7 = GetUserValue(Geometry=geo_3, Key="BuildID")
getuv_8 = GetUserValue(Geometry=geo_3, Key="SubBuildID")
getuv_9 = GetUserValue(Geometry=geo_3, Key="Typology")
merge_11 = Merge(Data1=simplify(graft(getuv_7)), Data2=simplify(graft(getuv_8)), Data3=simplify(graft(getuv_9)))  # -> simplify(Result)
json_4 = JSON(Key=panel_12, Value=merge_11)
trim_3 = TrimTree(Tree=json_4, Depth=1)
roof_properties = Data(trim_3)
rooftops = Geometry(data_3)
rooftops_2 = ClusterOutput(rooftops)
roof_properties_2 = ClusterOutput(roof_properties)

# ----
# FULL MASS
panel_13 = Panel("BuildID")
cset_3 = CreateSet(List=data_2)  # -> Set, Map
utrim_16 = UberTrim(data=sunion)
json_5 = JSON(Key=panel_13, Value=cset_3.Set)
full_mass_properties = Data(json_5)
full_mass = Data(utrim_16)
full_mass_properties_2 = ClusterOutput(full_mass_properties)
full_mass_2 = ClusterOutput(full_mass)

# ==== cluster TowerByMultipleBrepsGhInput

# ----
# CREATE LEVEL NUMBERS
len = TextLength()  # disabled
utrim = UberTrim(data=len)  # disabled
cset = CreateSet(List=utrim)  # -> Set, Map; disabled
sort = SortList(Keys=cset.Set)  # -> Keys, ValuesA; disabled
num = Number(sort.Keys)  # disabled
num_2 = Number(utrim)  # disabled
mindex = MemberIndex(Set=num_2, Member=num)  # -> Index, Count; disabled
lng = ListLength(List=mindex.Index)  # disabled
trim = TrimTree(Tree=lng, Depth=1)  # disabled
panel = Panel("\t")  # disabled
join = TextJoin(Join=panel)  # disabled
lng_2 = ListLength(List=trim)  # disabled
repeat = RepeatData(Data=join, Length=lng_2)  # disabled
split = TextSplit(Text=repeat, Separators=panel)  # disabled
item = ListItem(List=split, Index=mindex.Index, Wrap=True)  # -> simplify(Item); disabled
panel_2 = Panel("^")  # disabled
lng_3 = ListLength(List=item)  # disabled
number_slider = Slider(1, range=0..1)  # disabled
panel_3 = Panel("^")  # disabled
join_2 = TextJoin(Text=item, Join=panel_2)  # disabled
join_3 = TextJoin(Text=lng_3, Join=panel_3)  # disabled
utrim_2 = UberTrim(data=join_3)  # disabled
utrim_3 = UberTrim(data=join_2)  # disabled
larger = LargerThan(FirstNumber=utrim_2, SecondNumber=number_slider)  # -> LargerThan, OrEqualTo; disabled
lng_4 = ListLength(List=larger.LargerThan)  # disabled
series = Series(Start=0, Step=1, Count=lng_4)  # disabled
dispatch = Dispatch(List=utrim_3, DispatchPattern=larger.LargerThan)  # -> ListA, ListB; disabled
cull = CullPattern(List=series, CullPattern=larger.LargerThan)  # disabled
split_2 = SplitList(List=utrim_3, Index=cull)  # -> ListA, ListB; disabled
split_3 = TextSplit(Text=split_2.ListB, Separators=panel_2)  # -> simplify(Result); disabled
split_4 = TextSplit(Text=split_2.ListA, Separators=panel_2)  # -> simplify(Result); disabled
utrim_4 = UberTrim(data=split_3)  # disabled
item_2 = ListItem(List=utrim_4, Index=0, Wrap=True)  # disabled
len_2 = TextLength(Text=item_2)  # disabled
series_2 = Series(Start=0, Step=1, Count=len_2)  # disabled
chars = Characters()  # -> Result, Unicode; disabled
item_3 = ListItem(List=chars.Result, Index=series_2, Wrap=True)  # -> Item, Item1, Item2; disabled
merge = Merge(Data1=item_3.Item)  # disabled
join_4 = TextJoin(Text=item_3.Item)  # disabled

properties = ClusterInput()
geometry = ClusterInput()
properties_2 = Data(properties)
read = ReadJSON(Object=properties_2, Key="F2F")  # -> graft(Value)
read_2 = ReadJSON(Object=properties_2, Key="Typology")  # -> graft(Value)
read_3 = ReadJSON(Object=properties_2, Key="BuildID")  # -> graft(Value)
# SORT INTO BUILDINGS
geometry_2 = Data(graft(geometry))

# ----
# CALCULATE HEIGHT OF EACH BREP
bbox = BoundingBox(Content=geometry_2, Plane=PlaneXY(0, 0, 0))  # -> Box, Box_2
debox = DeconstructBox(Box=bbox.Box)  # -> Plane, X, Y, Z
dedomain = DeconstructDomain(Domain=debox.Z)  # -> Start, End
subtraction = Subtraction(A=dedomain.End, B=dedomain.Start)

# ----
# GET LOWEST POINT ON EACH BREP
debrep = DeconstructBrep(Brep=geometry_2)  # -> Faces, Edges, simplify(Vertices)
pdecon = Deconstruct(Point=debrep.Vertices)  # -> XComponent, YComponent, ZComponent
sort_2 = SortList(Keys=pdecon.ZComponent, ValuesA=debrep.Vertices)  # -> reverse(Keys), reverse(ValuesA)
item_4 = ListItem(List=sort_2.Keys, Index=-1, Wrap=True)  # -> simplify(Item)
utrim_5 = UberTrim(data=item_4)

# ----
# NUMBER OF FLOORS
division = Division(A=subtraction, B=read)
round = Round(Number=division)  # -> simplify(Nearest), Floor, Ceiling

panel_4 = Panel(round.Nearest)

# ----
# PLANE PER LEVEL
series_3 = Series(Start=utrim_5, Step=read, Count=round.Nearest)
pt = ConstructPoint(XCoordinate=0, YCoordinate=0, ZCoordinate=series_3)  # -> simplify(Point)
xy = XYPlane(Origin=pt)

graft = GraftTree(Tree=geometry_2, IncludeEmptyLists=True, IncludeNullItems=True)

debrep_2 = DeconstructBrep(Brep=geometry_2)  # -> Faces, Edges, Vertices
evalsrf = EvaluateSurface(Surface=reparameterize(debrep_2.Faces), Point="0.5,0.5")  # -> Point, Normal, UDirection, VDirection, Frame
pdecon_2 = Deconstruct(Point=evalsrf.Point)  # -> XComponent, YComponent, ZComponent
sort_3 = SortList(Keys=pdecon_2.ZComponent, ValuesA=debrep_2.Faces)  # -> Keys, ValuesA
panel_5 = Panel("""-1
0""")

# ---- group: BUILD ID
# BUILD ID
# FACADE
dup = DuplicateData(Data=graft(read_3), Number=graft(round.Nearest), Order=True)  # -> simplify(Data)

# ---- group: TYPOLOGY
# TYPOLOGY
dup_2 = DuplicateData(Data=graft(read_2), Number=graft(round.Nearest), Order=True)  # -> simplify(Data)

# ----
# FLOOR PLATE CRVS
sec = BrepPlane(Brep=graft, Plane=xy)  # -> Curves, Points

# ---- group: all floorplates
boundary = BoundarySurfaces(Edges=sec.Curves)  # -> simplify(Surfaces)

# ----
utrim_6 = UberTrim(data=boundary)

# ---- group: sort by height to get tops
area = Area(Geometry=utrim_6)  # -> Area, Centroid
pdecon_3 = Deconstruct(Point=area.Centroid)  # -> XComponent, YComponent, ZComponent
sort_4 = SortList(Keys=pdecon_3.ZComponent, ValuesFloorplate=utrim_6, ValuesTypology=dup_2, ValuesBuildID=dup)  # -> reverse(Keys), reverse(ValuesFloorplate), reverse(ValuesTypology), reverse(ValuesSubBuildID), reverse(ValuesBuildID)
item_5 = ListItem(List=sort_4.ValuesFloorplate, Index=0, Wrap=True)

# ---- group: facade
cull_i = CullIndex(List=sort_3.ValuesA, Indices=panel_5, Wrap=True)  # -> simplify(List)

# ----
cull_i_2 = CullIndex(List=sort_4.ValuesFloorplate, Indices=0, Wrap=True)  # -> simplify(List)

# ---- group: usable space above floor
area_2 = Area(Geometry=item_5)  # -> Area, Centroid
Z = UnitZ(Factor=1)
graft_2 = GraftTree(Tree=read, IncludeEmptyLists=True, IncludeNullItems=True)
line = LineSDL(Start=area_2.Centroid, Direction=Z, Length=graft_2)

# ----
graft_3 = GraftTree(Tree=geometry_2, IncludeEmptyLists=True, IncludeNullItems=True)
bcx = BrepCurve(Brep=graft_3, Curve=line)  # -> Curves, simplify(Points)
null = NullItem(Item=bcx.Points)  # -> NullFlags, InvalidFlags, Description

# ---- group: Typology
item_6 = ListItem(List=sort_4.ValuesTypology, Index=0, Wrap=True)
cull_i_3 = CullIndex(List=sort_4.ValuesTypology, Indices=0, Wrap=True)  # -> simplify(List)
dispatch_2 = Dispatch(List=item_6, DispatchPattern=null.NullFlags)  # -> ListA, ListB
merge_2 = Merge(Data1=dispatch_2.ListA, Data2=cull_i_3)

# ---- group: SubBuildID
item_7 = ListItem(List=sort_4.ValuesSubBuildID, Index=0, Wrap=True)
cull_i_4 = CullIndex(List=sort_4.ValuesSubBuildID, Indices=0, Wrap=True)  # -> simplify(List)
dispatch_3 = Dispatch(List=item_7, DispatchPattern=null.NullFlags)  # -> ListA, ListB
merge_3 = Merge(Data1=dispatch_3.ListA, Data2=cull_i_4)

# ---- group: BuildID
item_8 = ListItem(List=sort_4.ValuesBuildID, Index=0, Wrap=True)
cull_i_5 = CullIndex(List=sort_4.ValuesBuildID, Indices=0, Wrap=True)  # -> simplify(List)
dispatch_4 = Dispatch(List=item_8, DispatchPattern=null.NullFlags)  # -> ListA, ListB
merge_4 = Merge(Data1=dispatch_4.ListA, Data2=cull_i_5)

# ----
dispatch_5 = Dispatch(List=item_5, DispatchPattern=null.NullFlags)  # -> ListA, ListB
merge_5 = Merge(Data1=dispatch_5.ListA, Data2=cull_i_2)
area_3 = Area(Geometry=merge_5)  # -> Area, Centroid
pdecon_4 = Deconstruct(Point=area_3.Centroid)  # -> XComponent, YComponent, ZComponent
sort_5 = SortList(
    Keys=pdecon_4.ZComponent,
    ValuesFloorPlate=merge_5,
    ValuesTypology=merge_2,
    ValuesSubBuildID=merge_3,
    ValuesBuildID=merge_4)  # -> Keys, ValuesFloorPlate, ValuesTypology, ValuesSubBuildID, ValuesBuildID

pt_2 = ConstructPoint(XCoordinate=0, YCoordinate=0, ZCoordinate=sort_5.Keys)
xy_2 = XYPlane(Origin=pt_2)
group = Group(Objects=xy_2)
geo = Geometry(cull_i)
long = LongestList(ListA=geo, ListB=group, PaddingMode=2)  # -> ListA, ListB
ungroup = Ungroup(Group=long.ListB)
sec_2 = BrepPlane(Brep=graft(long.ListA), Plane=ungroup)  # -> Curves, Points
shift = ShiftPaths(Data=sec_2.Curves, Offset=-1)  # -> simplify(Data)
srfsplit = SurfaceSplit(Surface=graft(long.ListA), Curves=shift)  # -> simplify(Fragments)

# ----
# CUT FACADE FLOORS
# EXPLODE FACADE FACES
facade = Data(srfsplit)
utrim_7 = UberTrim(data=facade)
area_4 = Area(Geometry=utrim_7)  # -> Area, Centroid
pdecon_5 = Deconstruct(Point=area_4.Centroid)  # -> XComponent, YComponent, ZComponent
lng_5 = ListLength(List=cull_i)
sort_6 = SortList(Keys=pdecon_5.ZComponent, ValuesA=utrim_7)  # -> Keys, ValuesA, ValuesC, ValuesD, ValuesE
partition = PartitionList(List=sort_6.ValuesA, Size=lng_5)
join_5 = BrepJoin(Breps=partition)  # -> Breps, Closed
utrim_8 = UberTrim(data=join_5.Breps)
panel_6 = Panel("""Typology
SubBuildID
BuildID""")
merge_6 = Merge(Data2=graft(sort_5.ValuesTypology), Data3=graft(sort_5.ValuesSubBuildID), Data4=graft(sort_5.ValuesBuildID))  # -> simplify(Result)
json = JSON(Key=panel_6, Value=merge_6)
utrim_9 = UberTrim(data=json)
utrim_10 = UberTrim(data=utrim_9)
utrim_11 = UberTrim(data=utrim_8)
facade_properties = Data(simplify(utrim_10))
facade_2 = Data(simplify(utrim_11))
facade_3 = ClusterOutput(facade_2)
facade_properties_2 = ClusterOutput(facade_properties)

merge_7 = Merge(
    Data1=graft(sort_5.Keys),
    Data2=graft(sort_5.ValuesTypology),
    Data3=graft(sort_5.ValuesSubBuildID),
    Data4=graft(sort_5.ValuesBuildID))  # -> simplify(Result)
panel_7 = Panel("""RL
Typology
SubBuildID
BuildID""")
json_2 = JSON(Key=panel_7, Value=merge_7)
utrim_12 = UberTrim(data=json_2)

# ----
# SUB MASS
panel_8 = Panel("""F2F
Typology
SubBuildID
BuildID""")
merge_8 = Merge(Data1=graft(read), Data2=graft(read_2), Data4=graft(read_3))
json_3 = JSON(Key=panel_8, Value=merge_8)
sub_mass = Geometry(simplify(geometry_2))
trim_2 = TrimTree(Tree=json_3, Depth=1)
sub_mass_2 = ClusterOutput(sub_mass)
sub_mass_properties = Data(simplify(trim_2))
sub_mass_properties_2 = ClusterOutput(sub_mass_properties)

utrim_13 = UberTrim(data=sort_5.ValuesFloorPlate)
utrim_14 = UberTrim(data=utrim_12)
floorplate_properties = Data(simplify(utrim_14))
floorplates = Data(simplify(utrim_13))
floorplate_properties_2 = ClusterOutput(floorplate_properties)
floorplates_2 = ClusterOutput(floorplates)

# ----
# ROOF
sunion = SolidUnion(Breps=geometry_2)
data = Data(read_3)
panel_9 = Panel("""BuildID
SubBuildID
Typology""")

debrep_3 = DeconstructBrep(Brep=sunion)  # -> Faces, Edges, Vertices
evalsrf_2 = EvaluateSurface(Surface=reparameterize(debrep_3.Faces), Point="0.5,0.5")  # -> Point, Normal, UDirection, VDirection, Frame
devec = DeconstructVector(Vector=evalsrf_2.Normal)  # -> XComponent, YComponent, ZComponent
equals = Equality(FirstNumber=devec.ZComponent, SecondNumber=Slider(1, range=0..1))  # -> Equality, Inequality
dispatch_6 = Dispatch(List=debrep_3.Faces, DispatchPattern=equals.Equality)  # -> ListA, ListB
utrim_15 = UberTrim(data=dispatch_6.ListA)

# ---- group: TEST POINT FROM ROOFTOP
number_slider_2 = Slider(0.1, range=0..0.1)
data_2 = Data(utrim_15)
Z_2 = UnitZ(Factor=Slider(0.5, range=0..1))
area_5 = Area(Geometry=data_2)  # -> Area, Centroid
neg = Negative(Value=Z_2)
move = Move(Geometry=area_5.Centroid, Motion=neg)  # -> graft(Geometry), Transform

# ---- group: DUPLICATE BREPS
group_2 = Group(Objects=geometry_2)
lng_6 = ListLength(List=area_5.Centroid)
dup_3 = DuplicateData(Data=group_2, Number=lng_6, Order=True)
ungroup_2 = Ungroup(Group=dup_3)  # -> simplify(Objects)

# ---- group: Sort rooftops per mass
brepinc = PointInBrep(Brep=ungroup_2, Point=move.Geometry, Strict=False)
dispatch_7 = Dispatch(List=ungroup_2, DispatchPattern=brepinc)  # -> ListA, ListB

# ----
# FULL MASS
panel_10 = Panel("BuildID")
cset_2 = CreateSet(List=data)  # -> Set, Map
json_4 = JSON(Key=panel_10, Value=cset_2.Set)
full_mass_properties = Data(simplify(json_4))
full_mass = Data(simplify(sunion))
full_mass_properties_2 = ClusterOutput(full_mass_properties)
full_mass_2 = ClusterOutput(full_mass)

geo_2 = Geometry(dispatch_7.ListA)
dispatch_8 = Dispatch(List=read, DispatchPattern=brepinc)  # -> ListA, ListB
dispatch_9 = Dispatch(List=read_2, DispatchPattern=brepinc)  # -> ListA, ListB
dispatch_10 = Dispatch(List=read_3, DispatchPattern=brepinc)  # -> ListA, ListB
merge_9 = Merge(
    Data1=simplify(graft(dispatch_10.ListA)),
    Data2=simplify(graft(dispatch_8.ListA)),
    Data3=simplify(graft(dispatch_9.ListA)))  # -> simplify(Result)
json_5 = JSON(Key=panel_9, Value=merge_9)
rooftops = Geometry(simplify(data_2))
rooftops_2 = ClusterOutput(rooftops)

utrim_16 = UberTrim(data=json_5)

roof_properties = Data(simplify(utrim_16))
roof_properties_2 = ClusterOutput(roof_properties)

# ==== cluster TowerByMultipleBreps_2
properties = ClusterInput()
geometry = ClusterInput()
properties_2 = Data(properties)
geometry_2 = Data(geometry)

# ----
# SORT INTO BUILDINGS
panel = Panel("BuildID")
getuv = GetUserValue(Geometry=geometry_2, Key=panel)
cset = CreateSet(List=getuv)  # -> simplify(graft(Set)), Map
tmatch = MatchText(Text=getuv, Pattern=cset.Set, Case=True)
dispatch = Dispatch(List=geometry_2, DispatchPattern=tmatch)  # -> simplify(ListA), ListB

read = ReadJSON(Object=properties_2)
panel_2 = Panel("true = 1")
null = NullItem(Item=getuv)  # -> NullFlags, InvalidFlags, Description
cset_2 = CreateSet(List=null.NullFlags)  # -> Set, Map
filter = StreamFilter(Gate=cset_2.Set)
panel_3 = Panel(cset_2.Set)

# ----
# GET LOWEST POINT ON EACH BREP
debrep = DeconstructBrep(Brep=dispatch.ListA)  # -> Faces, Edges, simplify(Vertices)
pdecon = Deconstruct(Point=debrep.Vertices)  # -> XComponent, YComponent, ZComponent
sort = SortList(Keys=pdecon.ZComponent, ValuesA=debrep.Vertices)  # -> reverse(Keys), reverse(ValuesA)
item = ListItem(List=sort.Keys, Index=-1, Wrap=True)  # -> simplify(Item)
utrim = UberTrim(data=item)

# ----
# CALCULATE HEIGHT OF EACH BREP
bbox = BoundingBox(Content=dispatch.ListA, Plane=PlaneXY(0, 0, 0))  # -> Box, Box_2
debox = DeconstructBox(Box=bbox.Box)  # -> Plane, X, Y, Z
dedomain = DeconstructDomain(Domain=debox.Z)  # -> Start, End
subtraction = Subtraction(A=dedomain.End, B=dedomain.Start)

area = Area(Geometry=debrep.Faces)  # -> Area, Centroid
pdecon_2 = Deconstruct(Point=area.Centroid)  # -> XComponent, YComponent, ZComponent
getuv_2 = GetUserValue(Geometry=dispatch.ListA, Key="F2F")
getuv_3 = GetUserValue(Geometry=dispatch.ListA, Key="Typology")
getuv_4 = GetUserValue(Geometry=dispatch.ListA, Key="SubBuildID")
len = TextLength(Text=getuv_4)
utrim_2 = UberTrim(data=len)
cset_3 = CreateSet(List=utrim_2)  # -> Set, Map
sort_2 = SortList(Keys=cset_3.Set)  # -> Keys, ValuesA
num = Number(sort_2.Keys)
num_2 = Number(utrim_2)
mindex = MemberIndex(Set=num_2, Member=num)  # -> Index, Count
lng = ListLength(List=mindex.Index)
trim = TrimTree(Tree=lng, Depth=1)
join = TextJoin(Text=getuv_4, Join="\t")
lng_2 = ListLength(List=trim)
repeat = RepeatData(Data=join, Length=lng_2)
split = TextSplit(Text=repeat, Separators="\t")
item_2 = ListItem(List=split, Index=mindex.Index, Wrap=True)  # -> simplify(Item)
lng_3 = ListLength(List=item_2)
join_2 = TextJoin(Text=item_2, Join="^")
join_3 = TextJoin(Text=lng_3, Join="^")
utrim_3 = UberTrim(data=join_3)
utrim_4 = UberTrim(data=join_2)
larger = LargerThan(FirstNumber=utrim_3, SecondNumber=Slider(1, range=0..1))  # -> LargerThan, OrEqualTo
lng_4 = ListLength(List=larger.LargerThan)
series = Series(Start=0, Step=1, Count=lng_4)
dispatch_2 = Dispatch(List=utrim_4, DispatchPattern=larger.LargerThan)  # -> ListA, ListB
cull = CullPattern(List=series, CullPattern=larger.LargerThan)
split_2 = SplitList(List=utrim_4, Index=cull)  # -> ListA, ListB
split_3 = TextSplit(Text=split_2.ListB, Separators="^")  # -> simplify(Result)
split_4 = TextSplit(Text=split_2.ListA, Separators="^")  # -> simplify(Result)
utrim_5 = UberTrim(data=split_3)
getuv_5 = GetUserValue(Geometry=dispatch.ListA, Key="BuildID")
sort_3 = SortList(Keys=pdecon_2.ZComponent, ValuesA=debrep.Faces, ValuesB=area.Centroid)  # -> Keys, ValuesA, ValuesB
item_3 = ListItem(List=utrim_5, Index=0, Wrap=True)
chars = Characters(Text=getuv_4)  # -> Result, Unicode
len_2 = TextLength(Text=item_3)
series_2 = Series(Start=0, Step=1, Count=len_2)
item_4 = ListItem(List=chars.Result, Index=series_2, Wrap=True)  # -> Item, Item1, Item2

# ----
# NUMBER OF FLOORS
division = Division(A=subtraction, B=getuv_2)
round = Round(Number=division)  # -> simplify(Nearest), Floor, Ceiling

merge = Merge(Data1=item_4.Item)
panel_4 = Panel(getuv_4)
join_4 = TextJoin(Text=item_4.Item)
panel_5 = Panel(round.Nearest)
panel_6 = Panel(join_4)

# ----
# PLANE PER LEVEL
series_3 = Series(Start=utrim, Step=getuv_2, Count=round.Nearest)
pt = ConstructPoint(XCoordinate=0, YCoordinate=0, ZCoordinate=series_3)  # -> simplify(Point)
xy = XYPlane(Origin=pt)

graft = GraftTree(Tree=dispatch.ListA, IncludeEmptyLists=True, IncludeNullItems=True)
sunion = SolidUnion(Breps=dispatch.ListA)
data = Data(getuv_5)

# ---- group: BUILD ID
dup = DuplicateData(Data=graft(getuv_5), Number=graft(round.Nearest), Order=True)  # -> simplify(Data)

# ---- group: SUB BUILD ID
dup_2 = DuplicateData(Data=graft(getuv_4), Number=graft(round.Nearest), Order=True)  # -> simplify(Data)

# ---- group: TYPOLOGY
# TYPOLOGY OF FLOOR
dup_3 = DuplicateData(Data=graft(getuv_3), Number=graft(round.Nearest), Order=True)  # -> simplify(Data)

dup_4 = DuplicateData(Data=graft(getuv_2), Number=graft(round.Nearest), Order=True)  # -> simplify(Data)

# ----
# FLOOR PLATE CRVS
sec = BrepPlane(Brep=graft, Plane=xy)  # -> Curves, Points

debrep_2 = DeconstructBrep(Brep=dispatch.ListA)  # -> Faces, Edges, Vertices

# ---- group: all floorplates
boundary = BoundarySurfaces(Edges=sec.Curves)  # -> simplify(Surfaces)

# ----
debrep_3 = DeconstructBrep(Brep=sunion)  # -> Faces, Edges, Vertices
evalsrf = EvaluateSurface(Surface=reparameterize(debrep_2.Faces), Point="0.5,0.5")  # -> Point, Normal, UDirection, VDirection, Frame
utrim_6 = UberTrim(data=boundary)

# ---- group: sort by height to get tops
area_2 = Area(Geometry=utrim_6)  # -> Area, Centroid
pdecon_3 = Deconstruct(Point=area_2.Centroid)  # -> XComponent, YComponent, ZComponent
sort_4 = SortList(
    Keys=pdecon_3.ZComponent,
    ValuesFloorplate=utrim_6,
    ValuesTypology=dup_3,
    ValuesSubBuildID=dup_2,
    ValuesBuildID=dup,
    ValuesA=dup_4)  # -> reverse(Keys), reverse(ValuesFloorplate), reverse(ValuesTypology), reverse(ValuesSubBuildID), reverse(ValuesBuildID), ValuesA
item_5 = ListItem(List=sort_4.ValuesFloorplate, Index=0, Wrap=True)

# ----
pdecon_4 = Deconstruct(Point=evalsrf.Point)  # -> XComponent, YComponent, ZComponent
evalsrf_2 = EvaluateSurface(Surface=reparameterize(debrep_3.Faces), Point="0.5,0.5")  # -> Point, Normal, UDirection, VDirection, Frame
panel_7 = Panel("""-1
0""")
sort_5 = SortList(Keys=pdecon_4.ZComponent, ValuesA=debrep_2.Faces)  # -> Keys, ValuesA
devec = DeconstructVector(Vector=evalsrf_2.Normal)  # -> XComponent, YComponent, ZComponent

# ---- group: facade
cull_i = CullIndex(List=sort_5.ValuesA, Indices=panel_7, Wrap=True)  # -> simplify(List)

# ----
geo = Geometry(cull_i)
cull_i_2 = CullIndex(List=sort_4.ValuesFloorplate, Indices=0, Wrap=True)  # -> simplify(List)
equals = Equality(FirstNumber=devec.ZComponent, SecondNumber=Slider(1, range=0..1))  # -> Equality, Inequality

# ---- group: usable space above floor
area_3 = Area(Geometry=item_5)  # -> Area, Centroid
Z = UnitZ(Factor=1)
graft_2 = GraftTree(Tree=getuv_2, IncludeEmptyLists=True, IncludeNullItems=True)
line = LineSDL(Start=area_3.Centroid, Direction=Z, Length=graft_2)

# ----
dispatch_3 = Dispatch(List=debrep_3.Faces, DispatchPattern=equals.Equality)  # -> ListA, ListB
graft_3 = GraftTree(Tree=dispatch.ListA, IncludeEmptyLists=True, IncludeNullItems=True)
utrim_7 = UberTrim(data=dispatch_3.ListA)
bcx = BrepCurve(Brep=graft_3, Curve=line)  # -> Curves, simplify(Points)
group = Group(Objects=dispatch.ListA)
number_slider = Slider(0.1, range=0..0.1)
data_2 = Data(utrim_7)
Z_2 = UnitZ(Factor=Slider(0.5, range=0..1))
null_2 = NullItem(Item=bcx.Points)  # -> NullFlags, InvalidFlags, Description

# ---- group: Typology
item_6 = ListItem(List=sort_4.ValuesTypology, Index=0, Wrap=True)
cull_i_3 = CullIndex(List=sort_4.ValuesTypology, Indices=0, Wrap=True)  # -> simplify(List)
dispatch_4 = Dispatch(List=item_6, DispatchPattern=null_2.NullFlags)  # -> ListA, ListB
merge_2 = Merge(Data1=dispatch_4.ListA, Data2=cull_i_3)

# ---- group: SubBuildID
item_7 = ListItem(List=sort_4.ValuesSubBuildID, Index=0, Wrap=True)
cull_i_4 = CullIndex(List=sort_4.ValuesSubBuildID, Indices=0, Wrap=True)  # -> simplify(List)
dispatch_5 = Dispatch(List=item_7, DispatchPattern=null_2.NullFlags)  # -> ListA, ListB
merge_3 = Merge(Data1=dispatch_5.ListA, Data2=cull_i_4)

# ---- group: BuildID
item_8 = ListItem(List=sort_4.ValuesBuildID, Index=0, Wrap=True)
cull_i_5 = CullIndex(List=sort_4.ValuesBuildID, Indices=0, Wrap=True)  # -> simplify(List)
dispatch_6 = Dispatch(List=item_8, DispatchPattern=null_2.NullFlags)  # -> ListA, ListB
merge_4 = Merge(Data1=dispatch_6.ListA, Data2=cull_i_5)

# ----
area_4 = Area(Geometry=data_2)  # -> Area, Centroid
lng_5 = ListLength(List=area_4.Centroid)
dup_5 = DuplicateData(Data=group, Number=lng_5, Order=True)
neg = Negative(Value=Z_2)

# ---- group: BuildID
item_9 = ListItem(List=sort_4.ValuesA, Index=0, Wrap=True)
cull_i_6 = CullIndex(List=sort_4.ValuesA, Indices=0, Wrap=True)  # -> simplify(List)
dispatch_7 = Dispatch(List=item_9, DispatchPattern=null_2.NullFlags)  # -> ListA, ListB
merge_5 = Merge(Data1=dispatch_7.ListA, Data2=cull_i_6)

# ----
dispatch_8 = Dispatch(List=item_5, DispatchPattern=null_2.NullFlags)  # -> ListA, ListB
merge_6 = Merge(Data1=dispatch_8.ListA, Data2=cull_i_2)
ungroup = Ungroup(Group=dup_5)  # -> simplify(Objects)
move = Move(Geometry=area_4.Centroid, Motion=neg)  # -> graft(Geometry), Transform
area_5 = Area(Geometry=merge_6)  # -> Area, Centroid
brepinc = PointInBrep(Brep=ungroup, Point=move.Geometry, Strict=False)
subbuild_id = Data(getuv_4)
typology = Data(getuv_3)
build_id = Data(getuv_5)
lng_6 = ListLength(List=cull_i)
pdecon_5 = Deconstruct(Point=area_5.Centroid)  # -> XComponent, YComponent, ZComponent
sort_6 = SortList(
    Keys=pdecon_5.ZComponent,
    ValuesFloorPlate=merge_6,
    ValuesTypology=merge_2,
    ValuesSubBuildID=merge_3,
    ValuesBuildID=merge_4,
    ValuesA=merge_5)  # -> Keys, ValuesFloorPlate, ValuesTypology, ValuesSubBuildID, ValuesBuildID, ValuesA
pt_2 = ConstructPoint(XCoordinate=0, YCoordinate=0, ZCoordinate=sort_6.Keys)
xy_2 = XYPlane(Origin=pt_2)
group_2 = Group(Objects=xy_2)
long = LongestList(ListA=geo, ListB=group_2, PaddingMode=2)  # -> ListA, ListB
ungroup_2 = Ungroup(Group=long.ListB)
sec_2 = BrepPlane(Brep=graft(long.ListA), Plane=ungroup_2)  # -> Curves, Points
shift = ShiftPaths(Data=sec_2.Curves, Offset=-1)  # -> simplify(Data)
utrim_8 = UberTrim(data=sec_2.Curves)
srfsplit = SurfaceSplit(Surface=graft(long.ListA), Curves=shift)  # -> simplify(Fragments)
facade = Data(srfsplit)
utrim_9 = UberTrim(data=facade)
area_6 = Area(Geometry=utrim_9)  # -> Area, Centroid
pdecon_6 = Deconstruct(Point=area_6.Centroid)  # -> XComponent, YComponent, ZComponent
sort_7 = SortList(Keys=pdecon_6.ZComponent, ValuesA=utrim_9)  # -> Keys, ValuesA, ValuesC, ValuesD, ValuesE
partition = PartitionList(List=sort_7.ValuesA, Size=lng_6)
dispatch_9 = Dispatch(List=ungroup, DispatchPattern=brepinc)  # -> ListA, ListB
dispatch_10 = Dispatch(List=ungroup, DispatchPattern=brepinc)  # -> ListA, ListB
geo_2 = Geometry(dispatch_9.ListA)
panel_8 = Panel("""RL
Typology
SubBuildID
BuildID
F2F""")
join_5 = BrepJoin(Breps=partition)  # -> Breps, Closed
merge_7 = Merge(Data2=graft(sort_6.ValuesTypology), Data3=graft(sort_6.ValuesSubBuildID), Data4=graft(sort_6.ValuesBuildID))  # -> simplify(Result)
merge_8 = Merge(
    Data1=graft(sort_6.Keys),
    Data2=graft(sort_6.ValuesTypology),
    Data3=graft(sort_6.ValuesSubBuildID),
    Data4=graft(sort_6.ValuesBuildID),
    Data5=graft(sort_6.ValuesA))  # -> simplify(Result)
utrim_10 = UberTrim(data=join_5.Breps)
panel_9 = Panel("""Typology
SubBuildID
BuildID""")
json = JSON(Key=panel_8, Value=merge_8)

cset_4 = CreateSet(List=data)  # -> Set, Map
utrim_11 = UberTrim(data=sunion)
json_2 = JSON(Key="BuildID", Value=cset_4.Set)
full_mass = Data(utrim_11)
full_mass_properties = Data(json_2)
full_mass_2 = ClusterOutput(full_mass)
full_mass_properties_2 = ClusterOutput(full_mass_properties)

utrim_12 = UberTrim(data=json)
rooftops = Geometry(utrim_7)
json_3 = JSON(Key=panel_9, Value=merge_7)
utrim_13 = UberTrim(data=sort_6.ValuesFloorPlate)
rooftops_2 = ClusterOutput(rooftops)
utrim_14 = UberTrim(data=utrim_12)
utrim_15 = UberTrim(data=utrim_10)
utrim_16 = UberTrim(data=json_3)
floorplate_properties = Data(utrim_14)
floorplates = Data(simplify(utrim_13))
utrim_17 = UberTrim(data=utrim_16)
facade_2 = Data(utrim_15)
facade_properties = Data(utrim_17)
facade_3 = ClusterOutput(facade_2)
floorplate_properties_2 = ClusterOutput(floorplate_properties)
floorplates_2 = ClusterOutput(floorplates)
facade_properties_2 = ClusterOutput(facade_properties)

# ==== cluster WRITEFILE: Writes files, also checks for python objects and converts them to text before writing.
activate = ClusterInput()
content = ClusterInput()
filename = ClusterInput()
filepath = ClusterInput()
python = GhPythonScript(CONTENT=content, FILEPATH=filepath, FILENAME=filename, ACTIVATE=activate)  # inputs CONTENT: list
# ---------- python: Python ----------
__author__ = "s-abutler"
__version__ = "2018.09.10"

import rhinoscriptsyntax as rs
from json import dumps
def check(o):
#    print(str(type(o)))
#    return o
    if str(type(o)) == "<type 'dict'>":
        return dumps(o)
    else:
        return o
if ACTIVATE:
    con = list(map(lambda u: check(u), CONTENT))
    conwrite = "\n".join(con)
    dir = FILEPATH+"\\"+FILENAME
    write = True
    try:
        check = open(dir,'r')
        checktext = check.read()
        check.close()
        write = checktext != conwrite
    except:
        write = True
    if write:
        with open(dir,'w') as f:
            f.write(conwrite)
            print("SAVED")
# ---------- end python ----------

# ==== cluster RDB_SVGPlaneByPage: Makes a layout json for svg
plane = ClusterInput()  # Orientation and Location of Page
page_size = ClusterInput()  # Size of Page. Input a page size from A5-A0 followed by the orientation (P) or (L), Example: 'A1 (P)'. Alternatively, input dimensions, eg. '500,500'
scale = ClusterInput()  # Scale of Page
position = ClusterInput()  # Position of Plane relative to the page. True = Plane at Centre, False = Plane at Top Left
preset_standard_page_sizes = Panel("""A5 (L),210,148
A5 (P),148,210
A4 (L),297,210
A4 (P),210,297
A3 (L),420,297
A3 (P),297,420
A2 (L),594,420
A2 (P),420,594
A1 (L),841,594
A1 (P),594,841
A0 (L),1189,841
A0 (P),841,1189""")
split = TextSplit(Text=preset_standard_page_sizes, Separators=",")
item = ListItem(List=split, Index=0, Wrap=True)  # -> flatten(Item)

# ---- group: Find which Page Size is being called and pick it from list
mindex = MemberIndex(Set=item, Member=simplify(page_size))  # -> simplify(flatten(Index)), Count
item_2 = ListItem(List=preset_standard_page_sizes, Index=mindex.Index, Wrap=True)  # -> simplify(Item)
merge = Merge(Data1=simplify(item_2), Data2=simplify(page_size))
item_3 = ListItem(List=merge, Index=0, Wrap=True)

# ----
split_2 = TextSplit(Text=scale, Separators=":")
item_4 = ListItem(List=split_2, Index=0, Wrap=True)  # -> Item, Item1
unit_checker = PythonScript()  # -> out, a
# ---------- unit_checker: Python ----------
import rhinoscriptsyntax as rs
import scriptcontext as sc

a=sc.doc.ModelUnitSystem
a = str(a)
if a == "Millimeters":
    print 1
elif a == "Meters":
    print 1000
else:
    print "Use the metric system"
# ---------- end unit_checker ----------
pos = Boolean(position)
division = Division(A=item_4.Item1, B=unit_checker.out)

# ---- group: Choose location of centre
panel = Panel("""1,1
0.5,0.5""")
item_5 = ListItem(List=panel, Index=pos, Wrap=True)

# ----
num = Number(division)

# ---- group: Extract Dimensions
split_3 = TextSplit(Text=item_3, Separators=",")
item_6 = ListItem(List=reverse(split_3), Index=[0, 1], Wrap=True)  # -> reverse(Item)
num_2 = Number(item_6)

# ----
split_4 = TextSplit(Text=item_5, Separators=",")
plane_2 = Data(plane)
dispatch = Dispatch(List=split_4, DispatchPattern=[True, False])  # -> ListA, ListB

# ---- group: Convert to Scale
expression = Expression(x=num_2, y=num, Expression="x*y")

# ----
dispatch_2 = Dispatch(List=expression, DispatchPattern=[True, False])  # -> ListA, ListB

# ---- group: Create domains
dom = ConstructDomain(DomainStart=expr("-x", dispatch_2.ListB), DomainEnd=0)
dom_2 = ConstructDomain(DomainStart=expr("-x", dispatch_2.ListA), DomainEnd=0)

# ---- group: Remap to match centre pt location
remap = RemapNumbers(Value=dispatch.ListB, Source=Domain(0, 1), Target=dom)  # -> Mapped, Clipped
remap_2 = RemapNumbers(Value=dispatch.ListA, Source=Domain(0, 1), Target=dom_2)  # -> Mapped, Clipped

# ---- group: Adjust Centre Plane
pt = PointOriented(BasePlane=plane_2, UComponent=remap_2.Mapped, VComponent=expr("-x", remap.Mapped), WComponent=0)
pl_origin = PlaneOrigin(Base=plane_2, Origin=pt)

# ----
expression_2 = Expression(x=remap_2.Mapped, y=dispatch_2.ListA, Expression="x+y")
expression_3 = Expression(x=remap.Mapped, y=dispatch_2.ListB, Expression="x+y")

# ---- group: Create Adjusted Domain
dom_3 = ConstructDomain(DomainStart=remap_2.Mapped, DomainEnd=expression_2)
dom_4 = ConstructDomain(DomainStart=remap.Mapped, DomainEnd=expression_3)

# ----
x_dim = Domain(dom_4)
y_dim = Domain(dom_3)
plane_3 = Plane(flatten(pl_origin))
scale_2 = Number(flatten(num))
dims = Number(flatten(num_2))
neg = Negative(Value=x_dim)
python = PythonScript(PLANE=plane_3, PAGE=dims, SCALE=scale_2)  # -> JSON; inputs PAGE: list
# ---------- python: Python ----------
import Rhino as r
import rhinoscriptsyntax as rs
import json
p = PLANE
o = {"plane":[[p.Origin[0],p.Origin[1],p.Origin[2]],[p.XAxis[0],p.XAxis[1],p.XAxis[2]],[p.YAxis[0],p.YAxis[1],p.YAxis[2]]], "page":PAGE, "scale":SCALE}
JSON = json.dumps(o)
# ---------- end python ----------

# ---- group: Construct Crv
rectangle = Rectangle(Plane=plane_2, XSize=y_dim, YSize=neg, Radius=0)  # -> Rectangle, Length

# ----
json = Data(python)
preview = ClusterOutput(rectangle.Rectangle)  # Previews the page curve
json_layout = ClusterOutput(json)  # Layout JSON containing Plane, Page, Scale

# ==== cluster Geo2ArchiJSON: Converts Geometry to ArchiJSON. Version 18.09.10
G = ClusterInput()
output_type = ClusterInput()  # Output Type: 0 = PythonDictionary; 1=JSON String
properties = ClusterInput()  # Properties as a JSON to sync with Geometry. Use JSON Component to build properties. Need to include 'zindex'
int = Integer(output_type)
G_2 = Data(G)
long = LongestList(ListA=G_2, ListB=properties, PaddingMode=2)  # -> ListA, ListB
python = PythonScript(G=long.ListA, P=long.ListB, T=int)  # -> O; inputs G: list, P: list
# ---------- python: Python ----------
import rhinoscriptsyntax as rs
import Rhino as r
import Grasshopper as g
import json
log = []
def Point(geom,prop=None):
    pt = rs.coerce3dpoint(geom)
    pt = [pt[0],pt[1],pt[2]]
    if prop:
        pt = {"type":"Feature","geometry":{'coordinates':pt, 'type': 'point'}}
        pt['properties'] = json.loads(prop)
        return pt
    else:
        return pt
def convertToRPT (geom):
    pt = r.Geometry.Point3d(geom[0],geom[1],geom[2])
    return pt
def PointCollection(geom,prop=None):
    t = geom
    pts = map(lambda g: Point(g), t)
    crv = {"type":"Feature","geometry":{'coordinates':pts, 'type': 'pointcollection'}}
    if prop:
        crv['properties'] = json.loads(prop)
    print(crv)
    return crv
def CurveCollection(geom,prop=None):
    pass
    t = rs.CurvePoints(geom)
    tc = rs.ClosedCurveOrientation(geom)
    if tc == 0: tc = False
    else: tc = True
    tdeg = rs.CurveDegree(geom)
    tcPo = len(t)
    print("tdeg: "+str(tdeg))
    print("tcPo: "+str(tcPo))
    pts = map(lambda g: Point(g), t)
    crv = {"type":"Feature","geometry":{'coordinates':pts, 'type': 'CurveCollection','closed':tc}}
    if tdeg == 1 and tc  : del crv['geometry']['coordinates'][-1]
    if tdeg == 1 and tcPo == 2  : crv['geometry']['type']='line'
    if tdeg >= 2                : crv['geometry']['type']='spline'
    if tdeg == 2 and tcPo == 5  :
        arc = rs.AddArc3Pt(pts[0],pts[4],pts[2])
        pt0 = convertToRPT(pts[0])
        pt2 = convertToRPT(pts[2])
        pt4 = convertToRPT(pts[4])
        arc = r.Geometry.Arc(startPoint = pt0, pointOnInterior = pt2, endPoint = pt4)
        crv['geometry']['type']='arc'
        print(crv['geometry']['coordinates'])
        del crv['geometry']['coordinates'][3]
        del crv['geometry']['coordinates'][1]
    if prop:
        crv['properties'] = json.loads(prop)
    print(crvcollection)
    return crvcollection
def Plane(geom,prop=None):
    pln = {"type":"Feature","geometry":{'coordinates':[geom.XAxis.X,geom.YAxis.X,geom.ZAxis.X,geom.OriginX,geom.XAxis.Y,geom.YAxis.Y,geom.ZAxis.Y,geom.OriginY,geom.XAxis.Z,geom.YAxis.Z,geom.ZAxis.Z,geom.OriginZ,0,0,0,1], 'type': 'xform'}}
    if prop:
        pln['properties'] = json.loads(prop)
    return pln
def Text(geom,prop=None):
    print("TEXT")
    text = Plane(geom.location,prop)
    text['geometry']['type']="text"
    text['geometry']['content']=geom.content
    return text
def Image(geom,prop=None):
    print("Image")
    print(dir(geom))
    image = Plane(geom.location,prop)
    image['geometry']['type']="image"
    image['geometry']['image']=geom.img
    image['geometry']['width']=geom.width
    image['geometry']['height']=geom.height
    return image
def Curve(geom,prop=None):
    t = rs.CurvePoints(geom)
    tc = rs.ClosedCurveOrientation(geom)
    if tc == 0: tc = False
    else: tc = True
    tdeg = rs.CurveDegree(geom)
    tcPo = len(t)
    print("tdeg: "+str(tdeg))
    print("tcPo: "+str(tcPo))
    pts = map(lambda g: Point(g), t)
    crv = {"type":"Feature","geometry":{'coordinates':pts, 'type': 'polyline','closed':tc}}
    if tdeg == 1 and tc  : del crv['geometry']['coordinates'][-1]
    if tdeg == 1 and tcPo == 2  : crv['geometry']['type']='line'
    if tdeg >= 2                : crv['geometry']['type']='spline'
    if tdeg == 2 and tcPo == 5  :
        arc = rs.AddArc3Pt(pts[0],pts[4],pts[2])
        pt0 = convertToRPT(pts[0])
        pt2 = convertToRPT(pts[2])
        pt4 = convertToRPT(pts[4])
        arc = r.Geometry.Arc(startPoint = pt0, pointOnInterior = pt2, endPoint = pt4)
        crv['geometry']['type']='arc'
        print(crv['geometry']['coordinates'])
        del crv['geometry']['coordinates'][3]
        del crv['geometry']['coordinates'][1]
    if prop:
        crv['properties'] = json.loads(prop)
    print(crv)
    return crv
otype = {"0": "Unknown object", "1": Point, "2": "PointCloud", "3":PointCollection, "4": Curve, "5":Plane, "6":Text, "7":CurveCollection, "8":"Surface", "9":Image, "16": "Polysurface", "32": "Mesh", "256": "Light", "512": "Annotation", "4096": "Instance reference", "8192": "Text dot", "16384": "Grip", "32768": "Detail", "65536": "Hatch", "131072": "Morph control", "134217728": "Cage", "268435456": "Phantom", "536870912": "Clipping plane", "1073741824": "Extrusion"}
def Convert(geom,prop):
    print("START CONVERT")
    print(geom)
    ot = otype["1"]
    try:
        ot = otype[str(rs.ObjectType(geom))]
    except:
        #ot = otype[type(geom)]
        othertype = str(type(geom))
        print(othertype)
        if othertype == "<type 'List[object]'>":
            innertype = type(geom[0])
            if innertype=="<type 'PolylineCurve'>":
                ot = otype["7"]
            if innertype=="<type 'Point3d'>":
                ot = otype["3"]
        if othertype == "<type 'Plane'>":
            ot = otype["5"]
        if othertype == "<type 'instance'>":
            if geom.type == "text":
                ot = otype["6"]
            if geom.type == "image":
                ot = otype["9"]
    return(ot(geom,prop))
P = map(lambda g,p: Convert(g,p), G,P)
if T == 0:
    print(P)
    O = [{"type":"FeatureCollection", "features":P}]
if T == 1:
    O = json.dumps({"type":"FeatureCollection", "features":P})
L = log
# ---------- end python ----------
output = ClusterOutput(python)  # ArchiJSON Output

# ==== cluster DrawSVG: Creates SVG output from ArchiJSON objects. Version 18.09.10
objects = ClusterInput()  # ArchiJSON obects
css = ClusterInput()  # CSS Text
layout = ClusterInput()  # Layout Object
python = PythonScript(OBJECTS=objects, LAYOUT=layout, CSS=css)  # -> SVG; inputs OBJECTS: list, CSS: list
# ---------- python: Python ----------
import rhinoscriptsyntax as rs
import sys
import json
import inspect
import Rhino as r
from string import Template

log = []
#The inputs to this node will be stored as a list in the IN variables.
in1 = OBJECTS
def checkRB(ob):
    if str(type(ob)) == "<type 'str'>":
        return json.loads(ob)
    else:
        return ob
in1 = list(map(lambda u: checkRB(u),in1))
array = []
def featurecollection(o):
    for i in o["features"]:
        fCall = function_mappings[i['geometry']['type']]
        props = {}
        try:
            props = i['properties']
        except:
            pass
        obarray.append(fCall(i['geometry'],props))
def feature(o):
    pass
def point(o,w=True):
    pt = r.Geometry.Point3d(o[0],o[1],o[2])
    remap = r.Geometry.Plane.RemapToPlaneSpace(lPlane, pt)
    rpt = remap[1]
    rpt = [rpt[0]/layout['scale'],-1*rpt[1]/layout['scale'],rpt[2]/layout['scale']]
    pt = str(remap[1][0]/layout['scale'])+","+str(remap[1][1]/layout['scale']*-1)
    if w:
        return pt
    else:
        return rpt


def line(o, props):
    #<polyline points="118.85,155.3 118.85,180.7" class="FOPActual" zindex="10"/>
    pts = map(lambda i: point(i,False), o['coordinates'])
    propString = []
    for k in props:
        print(k)
        print(props[k])
        propString.append(str(k)+'=\"'+str(props[k])+'\"')
    pString = " ".join(propString)
    pline = '<line x1="'+str(pts[0][0])+'" y1="'+str(pts[0][1])+'" x2="'+str(pts[1][0])+'" y2="'+str(pts[1][1])+'" '+pString+'/>'
    #pline = NurbsCurve.ByControlPoints(polarray,1,o['properties']['closed'])
    return pline


def polyline(o, props):
    #<polyline points="118.85,155.3 118.85,180.7" class="FOPActual" zindex="10"/>
    polarray = []
    for p in o['coordinates']:
        pt = point(p)
        polarray.append(pt)
    pts = " ".join(polarray)
    propString = []
    for k in props:

        propString.append(str(k)+'=\"'+str(props[k])+'\"')
    pString = " ".join(propString)
    if o['closed']:
        pline = '<polygon points=\"'+pts+'\" '+pString+'/>'
    else: 
        pline = '<polyline points=\"'+pts+'\" '+pString+'/>'
    #pline = NurbsCurve.ByControlPoints(polarray,1,o['properties']['closed'])
    return pline

def text(o, props):
    #<text class="CLASS" zindex="500" transform="matrix(1 0 0 1 210 148.5)">TEXT</text> 
    propString = []
    for k in props:
        propString.append(str(k)+'=\"'+str(props[k])+'\"')
    pString = " ".join(propString)
    gm = o['coordinates']
    planeorigin = [gm[3],gm[7],gm[11]]
    planeremap = point(planeorigin,False)
    matrix = [str(round(gm[0],5)), str(round(gm[1],5)),str(round(gm[4],5)),str(round(gm[5],5)), str(round(planeremap[0],5)), str(round(planeremap[1],5))]
    matrixtext = " ".join(matrix)
    text = '<text '+pString+' transform="matrix(%s)">%s</text>'%(matrixtext,o['content'])
    print text
    return text
def image(o, props):
    #<image width="132.543857" height="132.543857" transform="matrix(-0.173648 -0.984808 0.984808 -0.173648 28.869475 131.454367)" xlink:href="K:\Computational Design Group\20.png"'"/>
    propString = []
    for k in props:
        propString.append(str(k)+'=\"'+str(props[k])+'\"')
    pString = " ".join(propString)
    gm = o['coordinates']
    yvec = [gm[1]*o['height'],gm[5]*o['height'],gm[9]*o['height']]
    planeorigin = [gm[3]+yvec[0],gm[7]+yvec[1],gm[11]+yvec[2]]
    planeremap = point(planeorigin,False)
    imgPlane = r.Geometry.Plane(r.Geometry.Point3d(gm[3],gm[7],gm[11]),r.Geometry.Vector3d(gm[0],gm[4],gm[8]),r.Geometry.Vector3d(gm[1],gm[5],gm[9]))
    worldPlane = r.Geometry.Plane(r.Geometry.Point3d(0,0,0),r.Geometry.Vector3d(1,0,0),r.Geometry.Vector3d(0,1,0))
    transform = r.Geometry.Transform.PlaneToPlane(lPlane,worldPlane)
    imgPlane.Transform(transform)
    npln = [imgPlane.XAxis.X,imgPlane.YAxis.X,imgPlane.ZAxis.X,imgPlane.OriginX,imgPlane.XAxis.Y,imgPlane.YAxis.Y,imgPlane.ZAxis.Y,imgPlane.OriginY,imgPlane.XAxis.Z,imgPlane.YAxis.Z,imgPlane.ZAxis.Z,imgPlane.OriginZ,0,0,0,1]
    matrix = [str(npln[0]), str(npln[1]),str(npln[4]),str(npln[5]), str(planeremap[0]), str(planeremap[1])]
    matrixtext = " ".join(matrix)
    text = '<image transform="matrix(%s)" width="%s" height="%s" xlink:href="%s"/>'%(matrixtext,o['width']/layout['scale'],o['height']/layout['scale'],o['image'])
    print text
    return text
function_mappings = {
        'FeatureCollection':featurecollection,
        'Feature': feature,
        'polyline': polyline,
        'line': line,
        'text': text,
        'image':image,
}
obarray = []
layout = json.loads(LAYOUT)
lPlane = layout['plane']
lOrigin = r.Geometry.Point3d(lPlane[0][0],lPlane[0][1],lPlane[0][2])
lXAx = r.Geometry.Vector3d(lPlane[1][0],lPlane[1][1],lPlane[1][2])
lYAx = r.Geometry.Vector3d(lPlane[2][0],lPlane[2][1],lPlane[2][2])
lPlane = r.Geometry.Plane(lOrigin,lXAx,lYAx)
for i in in1:
    if i["type"]:
        fCall = function_mappings[i['type']]
        fCall(i)
    else:
        fCall = function_mappings[i['geometry']['type']]
        obarray.append(fCall(i['geometry']))

#OUT = log
template =Template("""<?xml version="1.0" encoding="utf-8"?>
<!-- Generator: Grasshopper 1.0.0, Redback Plugin. SVG Version: 6.00 Build 0)  -->
<!DOCTYPE svg PUBLIC "-//W3C//DTD SVG 1.1//EN" "http://www.w3.org/Graphics/SVG/1.1/DTD/svg11.dtd">
<svg version="1.1" xmlns="http://www.w3.org/2000/svg" xmlns:xlink="http://www.w3.org/1999/xlink" x="0px" y="0px"
width="${width}mm" height="${height}mm" viewBox="0 0 ${width} ${height}" xml:space="preserve">
<style type="text/css">
$css
</style>
$svg
</svg>""")
print(layout)
svgdict = {'svg':"\n".join(obarray),'width':layout['page'][0],'height':layout['page'][1],'css':"\n".join(CSS)}
svgfull = template.substitute(svgdict)
SVG = svgfull.split("\n")
# ---------- end python ----------
svg = ClusterOutput(python)  # SVG output

# ==== cluster ReplaceMultiText: Replaces multiple values in a string
T = ClusterInput()
F = ClusterInput()
R = ClusterInput()
python = PythonScript(T=T, F=F, R=R)  # -> O; inputs F: list, R: list
# ---------- python: Python ----------
import string
print F
print R

c=T
for s,r in zip(F,R):
    print s
    print r
    c=string.replace(c,s,str(r))
print(c)
O=c
# ---------- end python ----------
O = ClusterOutput(python)

# ==== cluster Geo2ArchiJSON_2: Converts Geometry to ArchiJSON. Version 18.09.10
G = ClusterInput()
output_type = ClusterInput()  # Output Type: 0 = PythonDictionary; 1=JSON String
properties = ClusterInput()  # Properties as a JSON to sync with Geometry. Use JSON Component to build properties. Need to include 'zindex'
int = Integer(output_type)
G_2 = Data(G)
long = LongestList(ListA=G_2, ListB=properties, PaddingMode=2)  # -> ListA, ListB
python = PythonScript(G=long.ListA, P=long.ListB, T=int)  # -> O; inputs G: list, P: list
# ---------- python: Python ----------
import rhinoscriptsyntax as rs
import Rhino as r
import Grasshopper as g
import json
log = []
def Point(geom,prop=None):
    pt = rs.coerce3dpoint(geom)
    pt = [pt[0],pt[1],pt[2]]
    if prop:
        pt = {"type":"Feature","geometry":{'coordinates':pt, 'type': 'point'}}
        pt['properties'] = json.loads(prop)
        return pt
    else:
        return pt
def convertToRPT (geom):
    pt = r.Geometry.Point3d(geom[0],geom[1],geom[2])
    return pt
def PointCollection(geom,prop=None):
    t = geom
    pts = map(lambda g: Point(g), t)
    crv = {"type":"Feature","geometry":{'coordinates':pts, 'type': 'pointcollection'}}
    if prop:
        crv['properties'] = json.loads(prop)
    print(crv)
    return crv
def CurveCollection(geom,prop=None):
    pass
    t = rs.CurvePoints(geom)
    tc = rs.ClosedCurveOrientation(geom)
    if tc == 0: tc = False
    else: tc = True
    tdeg = rs.CurveDegree(geom)
    tcPo = len(t)
    print("tdeg: "+str(tdeg))
    print("tcPo: "+str(tcPo))
    pts = map(lambda g: Point(g), t)
    crv = {"type":"Feature","geometry":{'coordinates':pts, 'type': 'CurveCollection','closed':tc}}
    if tdeg == 1 and tc  : del crv['geometry']['coordinates'][-1]
    if tdeg == 1 and tcPo == 2  : crv['geometry']['type']='line'
    if tdeg >= 2                : crv['geometry']['type']='spline'
    if tdeg == 2 and tcPo == 5  :
        arc = rs.AddArc3Pt(pts[0],pts[4],pts[2])
        pt0 = convertToRPT(pts[0])
        pt2 = convertToRPT(pts[2])
        pt4 = convertToRPT(pts[4])
        arc = r.Geometry.Arc(startPoint = pt0, pointOnInterior = pt2, endPoint = pt4)
        crv['geometry']['type']='arc'
        print(crv['geometry']['coordinates'])
        del crv['geometry']['coordinates'][3]
        del crv['geometry']['coordinates'][1]
    if prop:
        crv['properties'] = json.loads(prop)
    print(crvcollection)
    return crvcollection
def Plane(geom,prop=None):
    pln = {"type":"Feature","geometry":{'coordinates':[geom.XAxis.X,geom.YAxis.X,geom.ZAxis.X,geom.OriginX,geom.XAxis.Y,geom.YAxis.Y,geom.ZAxis.Y,geom.OriginY,geom.XAxis.Z,geom.YAxis.Z,geom.ZAxis.Z,geom.OriginZ,0,0,0,1], 'type': 'xform'}}
    if prop:
        pln['properties'] = json.loads(prop)
    return pln
def Text(geom,prop=None):
    print("TEXT")
    text = Plane(geom.location,prop)
    text['geometry']['type']="text"
    text['geometry']['content']=geom.content
    return text
def Image(geom,prop=None):
    print("Image")
    print(dir(geom))
    image = Plane(geom.location,prop)
    image['geometry']['type']="image"
    image['geometry']['image']=geom.img
    image['geometry']['width']=geom.width
    image['geometry']['height']=geom.height
    return image
def Curve(geom,prop=None):
    t = rs.CurvePoints(geom)
    tc = rs.ClosedCurveOrientation(geom)
    if tc == 0: tc = False
    else: tc = True
    tdeg = rs.CurveDegree(geom)
    tcPo = len(t)
    print("tdeg: "+str(tdeg))
    print("tcPo: "+str(tcPo))
    pts = map(lambda g: Point(g), t)
    crv = {"type":"Feature","geometry":{'coordinates':pts, 'type': 'polyline','closed':tc}}
    if tdeg == 1 and tc  : del crv['geometry']['coordinates'][-1]
    if tdeg == 1 and tcPo == 2  : crv['geometry']['type']='line'
    if tdeg >= 2                : crv['geometry']['type']='spline'
    if tdeg == 2 and tcPo == 5  :
        arc = rs.AddArc3Pt(pts[0],pts[4],pts[2])
        pt0 = convertToRPT(pts[0])
        pt2 = convertToRPT(pts[2])
        pt4 = convertToRPT(pts[4])
        arc = r.Geometry.Arc(startPoint = pt0, pointOnInterior = pt2, endPoint = pt4)
        crv['geometry']['type']='arc'
        print(crv['geometry']['coordinates'])
        del crv['geometry']['coordinates'][3]
        del crv['geometry']['coordinates'][1]
    if prop:
        crv['properties'] = json.loads(prop)
    print(crv)
    return crv
otype = {"0": "Unknown object", "1": Point, "2": "PointCloud", "3":PointCollection, "4": Curve, "5":Plane, "6":Text, "7":CurveCollection, "8":"Surface", "9":Image, "16": "Polysurface", "32": "Mesh", "256": "Light", "512": "Annotation", "4096": "Instance reference", "8192": "Text dot", "16384": "Grip", "32768": "Detail", "65536": "Hatch", "131072": "Morph control", "134217728": "Cage", "268435456": "Phantom", "536870912": "Clipping plane", "1073741824": "Extrusion"}
def Convert(geom,prop):
    print("START CONVERT")
    print(geom)
    ot = otype["1"]
    try:
        ot = otype[str(rs.ObjectType(geom))]
    except:
        #ot = otype[type(geom)]
        othertype = str(type(geom))
        print(othertype)
        if othertype == "<type 'List[object]'>":
            innertype = str(type(geom[0]))
            if innertype=="<type 'PolylineCurve'>":
                print("PCrv")
                ot = otype["7"]
            if innertype=="<type 'Point3d'>":
                print("PT3D")
                ot = otype["3"]
        if othertype == "<type 'Plane'>":
            ot = otype["5"]
        if othertype == "<type 'instance'>":
            if geom.type == "text":
                ot = otype["6"]
            if geom.type == "image":
                ot = otype["9"]
    return(ot(geom,prop))
P = map(lambda g,p: Convert(g,p), G,P)
if T == 0:
    print(P)
    O = [{"type":"FeatureCollection", "features":P}]
if T == 1:
    O = json.dumps({"type":"FeatureCollection", "features":P})
L = log
# ---------- end python ----------
output = ClusterOutput(python)  # ArchiJSON Output

# ==== cluster DrawSVG_2: Creates SVG output from ArchiJSON objects. Version 18.09.10
objects = ClusterInput()  # ArchiJSON obects
css = ClusterInput()  # CSS Text
layout = ClusterInput()  # Layout Object
python = PythonScript(OBJECTS=objects, LAYOUT=layout, CSS=css)  # -> SVG; inputs OBJECTS: list, CSS: list
# ---------- python: Python ----------
import rhinoscriptsyntax as rs
import sys
import json
import inspect
import Rhino as r
from string import Template

log = []
#The inputs to this node will be stored as a list in the IN variables.
in1 = OBJECTS
def checkRB(ob):
    if str(type(ob)) == "<type 'str'>":
        return json.loads(ob)
    else:
        return ob
in1 = list(map(lambda u: checkRB(u),in1))
array = []
def featurecollection(o):
    for i in o["features"]:
        fCall = function_mappings[i['geometry']['type']]
        props = {}
        try:
            props = i['properties']
        except:
            pass
        obarray.append(fCall(i['geometry'],props))
def feature(o):
    pass
def point(o,w=True):
    pt = r.Geometry.Point3d(o[0],o[1],o[2])
    remap = r.Geometry.Plane.RemapToPlaneSpace(lPlane, pt)
    rpt = remap[1]
    rpt = [rpt[0]/layout['scale'],-1*rpt[1]/layout['scale'],rpt[2]/layout['scale']]
    pt = str(remap[1][0]/layout['scale'])+","+str(remap[1][1]/layout['scale']*-1)
    if w:
        return pt
    else:
        return rpt


def line(o, props):
    #<polyline points="118.85,155.3 118.85,180.7" class="FOPActual" zindex="10"/>
    pts = map(lambda i: point(i,False), o['coordinates'])
    propString = []
    for k in props:
        print(k)
        print(props[k])
        propString.append(str(k)+'=\"'+str(props[k])+'\"')
    pString = " ".join(propString)
    pline = '<line x1="'+str(pts[0][0])+'" y1="'+str(pts[0][1])+'" x2="'+str(pts[1][0])+'" y2="'+str(pts[1][1])+'" '+pString+'/>'
    #pline = NurbsCurve.ByControlPoints(polarray,1,o['properties']['closed'])
    return pline


def polyline(o, props):
    #<polyline points="118.85,155.3 118.85,180.7" class="FOPActual" zindex="10"/>
    polarray = []
    for p in o['coordinates']:
        pt = point(p)
        polarray.append(pt)
    pts = " ".join(polarray)
    propString = []
    for k in props:

        propString.append(str(k)+'=\"'+str(props[k])+'\"')
    pString = " ".join(propString)
    if o['closed']:
        pline = '<polygon points=\"'+pts+'\" '+pString+'/>'
    else: 
        pline = '<polyline points=\"'+pts+'\" '+pString+'/>'
    #pline = NurbsCurve.ByControlPoints(polarray,1,o['properties']['closed'])
    return pline

def text(o, props):
    #<text class="CLASS" zindex="500" transform="matrix(1 0 0 1 210 148.5)">TEXT</text> 
    propString = []
    for k in props:
        propString.append(str(k)+'=\"'+str(props[k])+'\"')
    pString = " ".join(propString)
    gm = o['coordinates']
    planeorigin = [gm[3],gm[7],gm[11]]
    planeremap = point(planeorigin,False)
    matrix = [str(gm[0]), str(gm[1]),str(gm[4]),str(gm[5]), str(planeremap[0]), str(planeremap[1])]
    matrixtext = " ".join(matrix)
    text = '<text '+pString+' transform="matrix(%s)">%s</text>'%(matrixtext,o['content'])
    print text
    return text
def image(o, props):
    #<image width="132.543857" height="132.543857" transform="matrix(-0.173648 -0.984808 0.984808 -0.173648 28.869475 131.454367)" xlink:href="K:\Computational Design Group\20.png"'"/>
    propString = []
    for k in props:
        propString.append(str(k)+'=\"'+str(props[k])+'\"')
    pString = " ".join(propString)
    gm = o['coordinates']
    yvec = [gm[1]*o['height'],gm[5]*o['height'],gm[9]*o['height']]
    planeorigin = [gm[3]+yvec[0],gm[7]+yvec[1],gm[11]+yvec[2]]
    planeremap = point(planeorigin,False)
    imgPlane = r.Geometry.Plane(r.Geometry.Point3d(gm[3],gm[7],gm[11]),r.Geometry.Vector3d(gm[0],gm[4],gm[8]),r.Geometry.Vector3d(gm[1],gm[5],gm[9]))
    worldPlane = r.Geometry.Plane(r.Geometry.Point3d(0,0,0),r.Geometry.Vector3d(1,0,0),r.Geometry.Vector3d(0,1,0))
    transform = r.Geometry.Transform.PlaneToPlane(lPlane,worldPlane)
    imgPlane.Transform(transform)
    npln = [imgPlane.XAxis.X,imgPlane.YAxis.X,imgPlane.ZAxis.X,imgPlane.OriginX,imgPlane.XAxis.Y,imgPlane.YAxis.Y,imgPlane.ZAxis.Y,imgPlane.OriginY,imgPlane.XAxis.Z,imgPlane.YAxis.Z,imgPlane.ZAxis.Z,imgPlane.OriginZ,0,0,0,1]
    matrix = [str(npln[0]), str(npln[1]),str(npln[4]),str(npln[5]), str(planeremap[0]), str(planeremap[1])]
    matrixtext = " ".join(matrix)
    text = '<image transform="matrix(%s)" width="%s" height="%s" xlink:href="%s"/>'%(matrixtext,o['width']/layout['scale'],o['height']/layout['scale'],o['image'])
    print text
    return text
function_mappings = {
        'FeatureCollection':featurecollection,
        'Feature': feature,
        'polyline': polyline,
        'line': line,
        'text': text,
        'image':image,
}
obarray = []
layout = json.loads(LAYOUT)
lPlane = layout['plane']
lOrigin = r.Geometry.Point3d(lPlane[0][0],lPlane[0][1],lPlane[0][2])
lXAx = r.Geometry.Vector3d(lPlane[1][0],lPlane[1][1],lPlane[1][2])
lYAx = r.Geometry.Vector3d(lPlane[2][0],lPlane[2][1],lPlane[2][2])
lPlane = r.Geometry.Plane(lOrigin,lXAx,lYAx)
for i in in1:
    if i["type"]:
        fCall = function_mappings[i['type']]
        fCall(i)
    else:
        fCall = function_mappings[i['geometry']['type']]
        obarray.append(fCall(i['geometry']))

#OUT = log
template =Template("""<?xml version="1.0" encoding="utf-8"?>
<!-- Generator: Grasshopper 1.0.0, Redback Plugin. SVG Version: 6.00 Build 0) Made by Andrew Butler at Cox Architecture -->
<!DOCTYPE svg PUBLIC "-//W3C//DTD SVG 1.1//EN" "http://www.w3.org/Graphics/SVG/1.1/DTD/svg11.dtd">
<svg version="1.1" xmlns="http://www.w3.org/2000/svg" xmlns:xlink="http://www.w3.org/1999/xlink" x="0px" y="0px"
width="${width}mm" height="${height}mm" viewBox="0 0 ${width} ${height}" xml:space="preserve">
<style type="text/css">
$css
</style>
$svg
</svg>""")
print(layout)
svgdict = {'svg':"\n".join(obarray),'width':layout['page'][0],'height':layout['page'][1],'css':"\n".join(CSS)}
svgfull = template.substitute(svgdict)
SVG = svgfull.split("\n")
# ---------- end python ----------
svg = ClusterOutput(python)  # SVG output

# ==== cluster UberTrim: Better version of Trim
data = ClusterInput()
data_2 = Data(data)
trim = TrimTree(Tree=data_2, Depth=1)
null = NullItem(Item=trim)  # -> NullFlags, InvalidFlags, Description
bool = Boolean(invert(null.NullFlags))
trim_2 = TrimTree(Tree=data_2, Depth=bool)
data_3 = Data(trim_2)
data_4 = ClusterOutput(data_3)
