# Grasshopper definition GHtoExcel.gh (Grasshopper 1.0.7)

panel = Panel("Data headings")
panel_2 = Panel("Data tables")
panel_3 = Panel("Group titles")
panel_4 = Panel("Totals")
update_spreadsheet = BooleanToggle(True)

text = ColourSwatch(SwatchColor=RGB(0, 0, 0))
cell = ColourSwatch(SwatchColor=RGB(156, 156, 156))
cell_2 = ColourSwatch(SwatchColor=RGB(156, 73, 73))
text_2 = ColourSwatch(SwatchColor=RGB(82, 130, 116))
cell_3 = ColourSwatch(SwatchColor=RGB(217, 217, 217))
text_3 = ColourSwatch(SwatchColor=RGB(255, 255, 255))
cell_4 = ColourSwatch(SwatchColor=RGB(207, 120, 120))
text_4 = ColourSwatch(SwatchColor=RGB(255, 255, 255))

# ----
# GH to Excel
# Keys that you want to display in each category
# Place these files in the same location as your GRASSHOPPER file.
name_of_excel_file = Panel("Data.xlsx")
name_of_json_file = Panel("AreaCalc.json")
python = PythonScript(x=name_of_excel_file)  # -> a
# ---------- python: Python ----------
import Grasshopper as gh
import Rhino
import rhinoscriptsyntax as rs


GH = str(ghenv.Component.Attributes.Owner.OnPingDocument().FilePath)
DIR = GH.split("\\")
del DIR[-1]
print DIR
DIR2 = x.split("\\")
print DIR2
DIR3 = DIR+DIR2
print DIR3
DIR4 = "\\".join(DIR3)

a = DIR4
# ---------- end python ----------
python_2 = PythonScript(x=name_of_json_file)  # -> a; same code as python
cluster = Cluster(
    spreadsheet=python,
    json=python_2,
    update=update_spreadsheet,
    C_7=text,
    C_3=cell,
    C_8=text_4,
    C_6=cell_2,
    C_4=text_2,
    C_5=cell_3,
    C_2=text_3,
    C=cell_4)
panel_5 = Panel(python_2)

# ==== cluster Cluster
json = ClusterInput()
panel = Panel("C:\Users\William\Documents\GitHub\Hackathon2018\AreaCalc.json")
update = ClusterInput()
bool = Boolean(update)
spreadsheet = ClusterInput()
path = FilePath(json)
path_2 = FilePath(panel)
C = ClusterInput()
C_2 = ClusterInput()
panel_2 = Panel(json)
file = ReadFile(File=path, PerLineParse=True)
file_2 = ReadFile(File=path_2, PerLineParse=True)
C_3 = ClusterInput()
C_4 = ClusterInput()
C_5 = ClusterInput()
C_6 = ClusterInput()
C_7 = ClusterInput()
C_8 = ClusterInput()
panel_3 = Panel(file)
viewer = ParamViewer(panel_3)
panel_4 = Panel(panel_3)
data = ClusterInput()
data_2 = ClusterInput()
data_3 = ClusterInput()
python = GhPythonScript(x=panel_3)  # -> out, a
# ---------- python: Python ----------
__author__ = "William"
__version__ = "2018.10.26"

import rhinoscriptsyntax as rs
import json

x = json.loads(x)

for i in x:
    print i
# ---------- end python ----------
path_3 = FilePath(spreadsheet)
data_4 = Data(data)
data_5 = Data(data_2)
data_6 = Data(data_3)
panel_5 = Panel(path_3)
rep = ReplaceText(Text=python.out, Find="'", Replace="\"", RecursiveReplace=False)
python_2 = GhPythonScript(x=rep)  # -> simplify(out), a
# ---------- python_2: Python ----------
__author__ = "William"
__version__ = "2018.10.26"

import rhinoscriptsyntax as rs
import json

x = json.loads(x)

for key in x.keys():
  print(key)
# ---------- end python_2 ----------
branch = TreeBranch(Tree=python_2.out, Path="{0}", MaintainPaths=True)
merge = Merge()
panel_6 = Panel(branch)
read = ReadJSON(Object=graft(rep), Key=branch)  # -> simplify(Value)
read_2 = ReadJSON(Object=panel_3, Key=data_5)
read_3 = ReadJSON(Key=data_6)
# Make this dynamic so it works if people add in extra keys. Do this by sorting out list length and grouping them
read_4 = ReadJSON(Object=panel_3, Key=data_4)
panel_7 = Panel(branch)
panel_8 = Panel(read)
split = TextSplit(Text=read_2, Separators=",")  # -> simplify(Result)
split_2 = TextSplit(Text=read_3, Separators=",")  # -> simplify(Result)
rev = ReverseList(List=split_2)
merge_2 = Merge(Data1=simplify(graft(data_6)), Data2=split_2)
merge_3 = Merge(Data1=simplify(graft(data_5)), Data2=split)
lng = ListLength(List=read)
merge_4 = Merge(Data1=panel_7, Data2=read)
entwine = Entwine(Branch0X=panel_7, Branch1X=read, FlattenInputs=False)  # -> simplify(Result)
panel_9 = Panel(entwine)
panel_10 = Panel(lng)
viewer_2 = ParamViewer(merge_3)
branch_2 = TreeBranch(Tree=merge_3, Path="{0}", MaintainPaths=True)
renumber = RenumberPaths(Data=panel_9)
spacing_between_tables = Slider(1, range=0..10)
lng_2 = ListLength(List=branch_2)
branch_3 = TreeBranch(Tree=renumber, Path="{0}", MaintainPaths=True)
lng_3 = ListLength(List=viewer_2)
addition = Addition(A=spacing_between_tables, B=3)
addition_2 = Addition(A=addition, B=2)
lng_4 = ListLength(List=branch_3)
addition_3 = Addition(A=lng_2, B=addition_2, C=lng_4)
merge_5 = Merge(Data1=C_6, Data2=C_5)
panel_11 = Panel(renumber)
addition_4 = Addition(A=lng_4, B=addition)
xl_fill = XLFillStyle(Pattern="-4105~0", BackColor=merge_5, ForeColor=Point(255, 255, 255), Opacity=0, Bevel=1)  # -> out, T; inputs BackColor: Color, ForeColor: Color
# ---------- xl_fill: VB ----------
    Component.Params.Input(0).Name = "XL Pattern Type"
    Component.Params.Input(0).Description = "Input for XL_Pattern_Type component"
    Component.Params.Input(1).Name = "Background Color"
    Component.Params.Input(1).Description = "Color input for the cell background"
    Component.Params.Input(2).Name = "Pattern Color"
    Component.Params.Input(2).Description = "Color input for the pattern"
    Component.Params.Input(3).Name = "Opacity"
    Component.Params.Input(3).Description = "Unitized input where 0 = Opaque and 1 = Transparent. (Does not affect cell color)"
    Component.Params.Input(4).Name = "XL Bevel Type"
    Component.Params.Input(4).Description = "Input for XL_Bevel_Type component. (Does not affect cell patterns)"

    Component.Params.Output(1).Name = "Excel Fill Parameters"
    Component.Params.Output(1).Description = "Formatted List of output Fill Parameters"

    Dim strOut As String

    If _Opacity = Nothing Then _Opacity = 0

    Dim patt() As String = split(_Pattern, "~")

    strOut = CStr(patt(0).trim() & "~" & CStr(CInt(_ForeColor.R) & "," & CInt(_ForeColor.G) & "," & CInt(_ForeColor.B)) & "~" & CStr(CInt(_BackColor.R) & "," & CInt(_BackColor.G) & "," & CInt(_BackColor.B)) & "~" & _Opacity & "~" & _Bevel & "~" & patt(1).trim())

    T = strOut
# ---------- end xl_fill ----------
subtraction = Subtraction(A=lng_3, B=1)
pt = ConstructPoint(XCoordinate=1, YCoordinate=addition_3, ZCoordinate=1)
panel_12 = Panel(addition_2)
pt_2 = ConstructPoint(XCoordinate=1, YCoordinate=addition_4, ZCoordinate=1)
dup = DuplicateData(Data="False", Number=subtraction, Order=True)
toggle = BooleanToggle(False)
dup_2 = DuplicateData(Data="10", Number=subtraction, Order=True)
flip = FlipMatrix(Data=renumber)
pt_3 = Point(pt_2)
pt_4 = Point(pt)
merge_6 = Merge(Data1="True", Data2=dup)  # -> flatten(Result)
merge_7 = Merge(Data1=Slider(12, range=0..100), Data2=dup_2)  # -> flatten(Result)
merge_8 = Merge(Data1=C_8, Data2=C_4)
xl_font = XLFontStyle(Name="Arial", Size=merge_7, Color=merge_8, Bold=merge_6)  # -> T; inputs Color: Color
# ---------- xl_font: VB ----------
    Component.Params.Input(0).Name = "Font Name"
    Component.Params.Input(0).Description = "Text input for the Name of an installed font"
    Component.Params.Input(1).Name = "Font Size"
    Component.Params.Input(1).Description = "Number input for the font size"
    Component.Params.Input(2).Name = "Font Color"
    Component.Params.Input(2).Description = "Color input for the font"
    Component.Params.Input(3).Name = "Bold"
    Component.Params.Input(3).Description = "Boolean input specifying if the font will be bold"

    Component.Params.Output(0).Name = "Excel Font Parameters"
    Component.Params.Output(0).Description = "Formatted List of output Font Parameters"

    Dim strOut As String

    Dim vert, horz,size As Integer

    horz = -4108
    vert = -4108

    If _Name = Nothing Then
      _Name = "Arial"
    End If

    If _Size = 0 Then
      size = 8
    Else
      size = _Size
    End If

    strOut = CStr(size & "~" & CStr(CInt(_Color.R) & "," & CInt(_Color.G) & "," & CInt(_Color.B)) & "~" & horz & "~" & vert & "~" & _Bold & "~" & False & "~" & False & "~" & False & "~" & _Name)

    T= strOut
# ---------- end xl_font ----------
pt_5 = Point("{1,2,1}")
xl_data_out = XLDataOut(XL_Path=path_3, Origin=pt_4, Data=merge_2, ByColumn=True, XL_Fill=xl_fill.T, XL_Font=xl_font, Stream=bool)  # -> A, B; inputs XL_Path: list, Origin: list of Point3d, Data: tree, XL_Fill: tree, XL_Line: tree, XL_Font: tree; disabled
# ---------- xl_data_out: VB ----------
    Component.Params.Input(0).Name = "Path"
    Component.Params.Input(0).Description = "Optional input for the XL Path component which specifies the target Workbook and Sheet. If blank the active workbook and worksheet is used, or the worksheet index supplied by an origin component"
    Component.Params.Input(1).Name = "Data Origin"
    Component.Params.Input(1).Description = "Optional point list input which specifies the lower bounds to which data will be written where X = Row, Y = Column, and Z = Sheet Index. If Z = 0 the active sheet will be used. If input is empty cell A1 will be used"
    Component.Params.Input(2).Name = "Data"
    Component.Params.Input(2).Description = "Input for generic data which will be converted into number or text. The first branch of the tree specifies the column location relative to the origin and the list the row location. The second branch specifies the provided sheet index if more than one sheet has been specified from the origin"
    Component.Params.Input(3).Name = "By Column"
    Component.Params.Input(3).Description = "Sets if data will be transposed"
    Component.Params.Input(4).Name = "XL Fill"
    Component.Params.Input(4).Description = "Input for the XL Fill component which will specify the cell's background fill formatting"
    Component.Params.Input(5).Name = "XL Line"
    Component.Params.Input(5).Description = "Input for the XL Line component which will specify the cell's border formatting"
    Component.Params.Input(6).Name = "XL Font"
    Component.Params.Input(6).Description = "Input for the XL Font component which will specify the cell's font formatting"
    Component.Params.Input(7).Name = "Stream"
    Component.Params.Input(7).Description = "If true, data will be written"

    Component.Params.Output(0).Name = "Origin"
    Component.Params.Output(0).Description = "List output of points which specify the lower bounds of written data"
    Component.Params.Output(1).Name = "Bound"
    Component.Params.Output(1).Description = "List output of points which specify the upper bounds of written data"

    If _Stream = True Then

      If data.BranchCount() > 0 Then

        Dim objExcel, excelWorkbook, excelSheet As Object
        Data.SimplifyPaths()

        If XL_Path.Count() > 1 Then
          objExcel = XL_Path.item(0)
          excelWorkbook = XL_Path.item(1)
          excelSheet = XL_Path.item(2)
        Else
          Dim oldCI As System.Globalization.CultureInfo = system.Threading.Thread.CurrentThread.CurrentCulture
          System.Threading.Thread.CurrentThread.CurrentCulture = New System.Globalization.CultureInfo("en-US")

          'Access Active Session of Excel if no Path is specified
          objExcel = System.Runtime.InteropServices.Marshal.GetActiveObject("Excel.Application")
          excelWorkbook = objExcel.activeWorkbook
          excelSheet = objExcel.ActiveSheet
        End If
        objExcel.screenUpdating = False
        '#############################################

        ' Begin Formatting and Populating Data
        Dim i,j,k,m,n,p,u,v,r,s As Integer
        Dim x,y As Integer
        Dim cnt As New list(Of Integer)
        Dim ptA, ptB As New list(Of point3d)
        Dim sTree,pTree,lTree,fTree As New list(Of datatree(Of Object))
        Dim blnP,blnL,blnF As Boolean

        sTree = remapTree(Data)
        pTree = remapTree(XL_Fill)
        lTree = remapTree(XL_Line)
        fTree = remapTree(XL_Font)

        If Origin.count() = 0 Then
          Origin.add(New point3d(excelSheet.usedrange.row, excelSheet.usedrange.column, 0))
        End If

        For j = 0 To Origin.count() - 1 Step 1
          If j > (sTree.count() - 1) Then k = (sTree.count() - 1) Else k = j
          If CInt(origin.item(j).Z) > excelWorkbook.Sheets.Count() Then
            excelWorkbook.Sheets.add(, excelWorkbook.Sheets(excelWorkbook.Sheets.Count()), CInt(origin.item(j).Z - excelWorkbook.Sheets.Count()))
          End If
          If CInt(origin.item(j).Z) <> 0 Then excelSheet = excelWorkbook.Sheets.item(CInt(origin.item(j).Z))
          'finds the longest list of data to set the outer extent of the range
          For i = 0 To sTree.item(k).BranchCount() - 1 Step 1
            cnt.add(sTree.item(k).branch(i).count())
          Next
          Dim counts As Integer()
          counts = cnt.toarray
          Array.Sort(counts)
          Array.reverse(counts)

          If byColumn = True Then
            x = Origin.item(j).Y + counts(0) - 1
            y = Origin.item(j).X + sTree.item(k).BranchCount() - 1
          Else
            x = Origin.item(j).Y + sTree.item(k).BranchCount() - 1
            y = Origin.item(j).X + counts(0) - 1
          End If
          Dim rng As Object

          'specify a range in excel and stream data
          rng = excelSheet.Range(excelSheet.Cells(Origin.item(j).Y, Origin.item(j).X), excelSheet.Cells(x, y))

          If byColumn = True Then
            rng.value = objExcel.transpose(TreeToArr(sTree.item(k)))
          Else
            rng.value = TreeToArr(sTree.item(k))
          End If

          'Set the fill formatting
          If XL_Fill.branchcount() > 0 Then
            blnP = True
            If (XL_Fill.branchcount() = 1 And XL_Fill.branch(0).count() = 1) Then
              Call FillFormat(rng, pTree.item(0).branch(0).item(0))
              blnP = False
            End If
          End If

          'Set the fill formatting
          If XL_Line.branchcount() > 0 Then
            blnL = True
            If (XL_Line.branchcount() = 1 And XL_Line.branch(0).count() = 1) And (CBool(Split(XL_Line.branch(0).item(0), "~")(5).trim()) = False) Then
              Call LineFormat(rng, lTree.item(0).branch(0).item(0))
              blnL = False
            End If
          End If

          'Set the font formatting
          If XL_Font.branchcount() > 0 Then
            blnF = True
            If (XL_Font.branchcount() = 1 And XL_Font.branch(0).count() = 1) Then
              Call FontFormat(rng, fTree.item(0).branch(0).item(0))
              blnF = False
            End If
          End If

          For m = 0 To sTree.item(k).branchcount() - 1 Step 1
            For n = 0 To sTree.item(k).branch(m).count() - 1 Step 1
              If byColumn Then
                r = n
                s = m
              Else
                r = m
                s = n
              End If

              If blnP Then
                If j > pTree.count() - 1 Then p = pTree.count() - 1 Else p = j
                If m > pTree.item(p).branchcount() - 1 Then u = pTree.item(p).branchcount() - 1 Else u = m
                If n > pTree.item(p).branch(u).count() - 1 Then v = pTree.item(p).branch(u).count() - 1 Else v = n
                Call FillFormat(excelSheet.Cells(CInt(Origin.item(j).Y + r), CInt(Origin.item(j).X + s)), CStr(pTree.item(p).branch(u).item(v)))
              End If

              If blnL Then
                If j > lTree.count() - 1 Then p = lTree.count() - 1 Else p = j
                If m > lTree.item(p).branchcount() - 1 Then u = lTree.item(p).branchcount() - 1 Else u = m
                If n > lTree.item(p).branch(u).count() - 1 Then v = lTree.item(p).branch(u).count() - 1 Else v = n
                Call LineFormat(excelSheet.Cells(CInt(Origin.item(j).Y + r), CInt(Origin.item(j).X + s)), CStr(lTree.item(p).branch(u).item(v)))
              End If

              If blnF Then
                If j > fTree.count() - 1 Then p = fTree.count() - 1 Else p = j
                If m > fTree.item(p).branchcount() - 1 Then u = fTree.item(p).branchcount() - 1 Else u = m
                If n > fTree.item(p).branch(u).count() - 1 Then v = fTree.item(p).branch(u).count() - 1 Else v = n
                Call FontFormat(excelSheet.Cells(CInt(Origin.item(j).Y + r), CInt(Origin.item(j).X + s)), CStr(fTree.item(p).branch(u).item(v)))
              End If
            Next
          Next


          'Component Output is the origin cell and bounding cell location
          ptA.add(New Point3d(origin.item(j).X, origin.item(j).Y, excelSheet.Index))
          ptB.add(New Point3d(y, x, excelSheet.Index))
        Next
        excelSheet.activate
        objExcel.screenUpdating = True

        A = ptA
        B = ptB
      End If
    End If
# ---------- xl_data_out: VB additional code ----------
  'Cell Fill format
  Private Function FillFormat(ByVal obj As Object, ByVal strOptions As String)
    Dim arrOpt() As String = Split(strOptions, "~")
    Dim clrB() As String = Split(arrOpt(2), ",")
    Dim clrF() As String = Split(arrOpt(1), ",")
    With obj
      .Interior.Pattern = CInt(arrOpt(0))
      .Interior.Patterncolor = RGB(CInt(clrF(0).trim()), CInt(clrF(1).trim()), CInt(clrF(2).trim()))
      .Interior.color = RGB(CInt(clrB(0).trim()), CInt(clrB(1).trim()), CInt(clrB(2).trim()))

    End With
    Return Nothing
  End Function

  'Cell Line format
  Private Function LineFormat(ByVal obj As Object, ByVal strOptions As String)
    Dim arrOpt() As String = Split(strOptions, "~")
    Dim clrF() As String = Split(arrOpt(2), ",")
    With obj
      .BorderAround(CInt(arrOpt(0)), CInt(arrOpt(1)),, RGB(CInt(clrF(0).trim()), CInt(clrF(1).trim()), CInt(clrF(2).trim())))
    End With
    Return Nothing
  End Function

  'Sets font properties
  Private Function FontFormat(ByVal obj As Object, ByVal strOptions As String)
    Dim arrOpt() As String = Split(strOptions, "~")
    Dim clrF() As String = Split(arrOpt(1), ",")
    With obj
      .Font.Name = CStr(arrOpt(8).trim())
      .Font.Size = CInt(arrOpt(0).trim())
      .Font.Color = RGB(CInt(clrF(0).trim()), CInt(clrF(1).trim()), CInt(clrF(2).trim()))
      .HorizontalAlignment = CInt(arrOpt(2).trim())
      .VerticalAlignment = CInt(arrOpt(3).trim())
      .Font.Bold = CBool(arrOpt(4).trim())
      .Font.Italic = CBool(arrOpt(5).trim())
      .Font.Underline = CBool(arrOpt(6).trim())
      .Font.Strikethrough = CBool(arrOpt(7).trim())
    End With
    Return Nothing
  End Function

  Private Function TreeToArr(ByVal arrTree As Datatree(Of Object))

    Dim i,j,x,y As Integer

    y = 0
    x = arrTree.branchCount() - 1
    For i = 0 To x Step 1
      If y < (arrTree.branch(i).count() - 1)
        y = arrTree.branch(i).count() - 1
      End If
    Next

    Dim arrOut(x,y) As Object

    For i = 0 To x Step 1
      For j = 0 To y Step 1
        If j > (arrTree.branch(i).count() - 1) Then
          arrOut(i, j) = Nothing
        Else
          arrOut(i, j) = arrTree.branch(i).item(j)
        End If
      Next
    Next

    Return arrOut
  End Function
  Function remapTree(ByVal arrTree As datatree(Of Object))
    If arrTree.branchcount() > 0 Then
      Dim i,j,k,m,r,s As Integer
      Dim uTree,tTree As New datatree(Of Object)
      Dim sTree As New list(Of datatree(Of Object))

      If uBound(arrTree.Paths.item(0).indices()) > 1 Then
        For i = 0 To arrTree.branchcount() - 1 Step 1
          Dim tPath As gh_path
          Dim tint() As int32
          tPath = arrTree.Paths.item(i)
          tint = tPath.Indices

          If uBound(tint) > 0 Then
            For j = 0 To arrTree.Branch(i).Count() - 1 Step 1
              uTree.add(arrTree.Branch(i).item(j), New gh_path({tint(uBound(tint) - 1),tint(uBound(tint))}))
            Next
          Else
            For j = 0 To arrTree.Branch(i).Count() - 1 Step 1
              uTree.add(arrTree.Branch(i).item(j), New gh_path({0,i}))
            Next
          End If
        Next
      Else
        uTree = arrTree
      End If

      If uBound(uTree.Paths.item(0).indices()) > 0 Then
        k = uTree.Paths.item(0).indices(uBound(uTree.Paths.item(0).indices()) - 1)
        For i = 0 To uTree.branchcount() - 1 Step 1
          Dim tPath As gh_path
          Dim tint() As int32
          tPath = uTree.Paths.item(i)
          tint = tPath.Indices

          If tint(uBound(tint) - 1) > k Then
            Dim tmpTree As New datatree(Of Object)
            For r = 0 To tTree.branchcount() - 1 Step 1
              For s = 0 To tTree.branch(r).count() - 1 Step 1
                tmpTree.add(tTree.branch(r).item(s), New gh_path(r))
              Next
            Next
            sTree.add(tmpTree)
            tTree.clear
            k = tint(uBound(tint) - 1)
            m = 0
          End If
          For j = 0 To uTree.Branch(i).Count() - 1 Step 1
            tTree.add(uTree.Branch(i).item(j), New gh_path(m))
          Next
          m += 1
        Next

        sTree.add(tTree)
      Else
        sTree.add(uTree)
      End If
      Return sTree
    Else
      Return Nothing
    End If
  End Function
  Function flipMatrix(ByVal arrVal As datatree(Of Object))
    Dim objOut As New DataTree(Of Object)
    Dim source As New GH_Lexer("{A}(B)")
    Dim target As New GH_Lexer("{B}(A)")

    GH_Lexer.PerformLexicalReplace(source, target, arrVal, objOut)

    Return objOut
  End Function
  Function lexGraft(ByVal arrVal As datatree(Of Object))
    Dim objOut As New DataTree(Of Object)
    Dim source As New GH_Lexer("{A}(i)")
    Dim target As New GH_Lexer("{A;0}(i)")

    GH_Lexer.PerformLexicalReplace(source, target, arrVal, objOut)

    Return objOut
  End Function
# ---------- end xl_data_out ----------
xl_data_out_2 = XLDataOut(XL_Path=path_3, Origin=pt_5, Data=flip, ByColumn=True, XL_Fill=xl_fill.T, XL_Font=xl_font, Stream=bool)  # -> A, B; inputs XL_Path: list, Origin: list of Point3d, Data: tree, XL_Fill: tree, XL_Line: tree, XL_Font: tree; same code as xl_data_out
xl_data_out_3 = XLDataOut(XL_Path=path_3, Origin=pt_3, Data=merge_3, ByColumn=True, XL_Fill=xl_fill.T, XL_Font=xl_font, Stream=bool)  # -> A, B; inputs XL_Path: list, Origin: list of Point3d, Data: tree, XL_Fill: tree, XL_Line: tree, XL_Font: tree; disabled; same code as xl_data_out
subtraction_2 = Subtraction(A=addition_2, B=1)
subtraction_3 = Subtraction(A=addition, B=1)
xl_fill_2 = XLFillStyle(Pattern="-4105~0", BackColor=C, ForeColor=Point(255, 255, 255), Opacity=0, Bevel=1)  # -> out, T; inputs BackColor: Color, ForeColor: Color; same code as xl_fill
xl_font_2 = XLFontStyle(Name="Arial", Size=Slider(10, range=0..100), Color=C_2, Bold="True")  # -> T; inputs Color: Color; same code as xl_font
lng_5 = ListLength(List=merge_2)
lng_6 = ListLength(List=merge_3)
lng_7 = ListLength(List=renumber)
item = ListItem(List=flatten(lng_5), Index=0, Wrap=True)
item_2 = ListItem(List=flatten(lng_6), Index=0, Wrap=True)
item_3 = ListItem(List=flatten(lng_7), Index=0, Wrap=True)
addition_5 = Addition(A=item_3, B=item_2, C=subtraction_2)
addition_6 = Addition(A=item_3, B=subtraction_3)
ma = MassAddition(Input=[item_3, item_2, Slider(6, range=0..10)])  # -> Result, PartialResults
ma_2 = MassAddition(Input=[item_3, item_2, Slider(6, range=0..10)])  # -> Result, PartialResults
ma_3 = MassAddition(Input=[ma.Result, item])  # -> Result, PartialResults
ma_4 = MassAddition(Input=[ma_2.Result, item])  # -> Result, PartialResults
pt_6 = ConstructPoint(XCoordinate="1", YCoordinate="1", ZCoordinate="1")
pt_7 = ConstructPoint(XCoordinate="1", YCoordinate=addition_6, ZCoordinate="1")
pt_8 = ConstructPoint(XCoordinate="1", YCoordinate=addition_5, ZCoordinate="1")
subtraction_4 = Subtraction(A=ma_3.Result, B=2)
subtraction_5 = Subtraction(A=ma_4.Result, B=2)
ma_5 = MassAddition(Input=[item_3, item_2, item, addition_2])  # -> Result, PartialResults
xl_fill_3 = XLFillStyle(Pattern="-4105~0", BackColor=C_3, ForeColor=Point(255, 255, 255), Opacity=0, Bevel=1)  # -> out, T; inputs BackColor: Color, ForeColor: Color; same code as xl_fill
xl_font_3 = XLFontStyle(Name="Arial", Size=Slider(15, range=0..100), Color=C_7, Bold=Toggle(True))  # -> out, T; inputs Color: Color
# ---------- xl_font_3: VB ----------
    Component.Params.Input(0).Name = "Font Name"
    Component.Params.Input(0).Description = "Text input for the Name of an installed font"
    Component.Params.Input(1).Name = "Font Size"
    Component.Params.Input(1).Description = "Number input for the font size"
    Component.Params.Input(2).Name = "Font Color"
    Component.Params.Input(2).Description = "Color input for the font"
    Component.Params.Input(3).Name = "Bold"
    Component.Params.Input(3).Description = "Boolean input specifying if the font will be bold"

    Component.Params.Output(1).Name = "Excel Font Parameters"
    Component.Params.Output(1).Description = "Formatted List of output Font Parameters"

    Dim strOut As String

    Dim vert, horz,size As Integer

    horz = -4108
    vert = -4108

    If _Name = Nothing Then
      _Name = "Arial"
    End If

    If _Size = 0 Then
      size = 8
    Else
      size = _Size
    End If

    strOut = CStr(size & "~" & CStr(CInt(_Color.R) & "," & CInt(_Color.G) & "," & CInt(_Color.B)) & "~" & horz & "~" & vert & "~" & _Bold & "~" & False & "~" & False & "~" & False & "~" & _Name)

    T = strOut
# ---------- end xl_font_3 ----------
pt_9 = ConstructPoint(XCoordinate=1, YCoordinate=ma_5.Result, ZCoordinate=1)
subtraction_6 = Subtraction(A=item, B=1)
concat = Concatenate(
    FragmentA="=SUM(",
    FragmentB="C",
    FragmentC=ma.Result,
    FragmentD=":",
    FragmentE="C",
    FragmentF=subtraction_4,
    FragmentG=")")
concat_2 = Concatenate(
    FragmentA="=SUM(",
    FragmentB="B",
    FragmentC=ma_2.Result,
    FragmentD=":",
    FragmentE="B",
    FragmentF=subtraction_5,
    FragmentG=")")
pt_10 = Point(pt_9)
merge_9 = Merge(Data1="Total", Data2=concat_2, Data3=concat)
xl_cell_size = XLCellSize(XL_Path=path_3, Height=0, Width=0, Stream=bool)  # -> out, A, B; inputs XL_Path: list, Target: Point3d
# ---------- xl_cell_size: VB ----------
    Component.Params.Input(0).Name = "Path"
    Component.Params.Input(0).Description = "Optional input for the XL Path component which specifies the Target Workbook and Sheet. If blank the active workbook and worksheet is used, or the worksheet index supplied by an origin component"
    Component.Params.Input(1).Name = "Cell Target"
    Component.Params.Input(1).Description = "Optional point input which specifies the Cell whose column and row will be resized. If Z = 0 the active sheet will be used. If input is empty cell size changes will be applied to the entire sheet."
    Component.Params.Input(2).Name = "Row Height"
    Component.Params.Input(2).Description = "Optional number input which specifies row height associated with a target cell. If blank, willd default to AutoFit"
    Component.Params.Input(3).Name = "Column Width"
    Component.Params.Input(3).Description = "Optional number input which specifies column width associated with a target cell. If blank, willd default to AutoFit"
    Component.Params.Input(4).Name = "Stream Formatting"
    Component.Params.Input(4).Description = "If true, associated rows and columns to given cell location will be resized"

    Component.Params.Output(1).Name = "Origin"
    Component.Params.Output(1).Description = "The lower bounds point location which specifsi where resizing took place if Target input is assigned"
    Component.Params.Output(2).Name = "Bound"
    Component.Params.Output(2).Description = "The upper bounds point location which specifies the extent of resizing"

    If _Stream = True Then

      Dim objExcel, excelWorkbook, excelSheet, chartSheet As Object

      If XL_Path.Count() > 1 Then
        objExcel = XL_Path.item(0)
        excelWorkbook = XL_Path.item(1)
        excelSheet = XL_Path.item(2)
        chartSheet = XL_Path.item(2)
      Else
        Dim oldCI As System.Globalization.CultureInfo = system.Threading.Thread.CurrentThread.CurrentCulture
        System.Threading.Thread.CurrentThread.CurrentCulture = New System.Globalization.CultureInfo("en-US")

        'Access Active Session of Excel if no Path is specified

        objExcel = System.Runtime.InteropServices.Marshal.GetActiveObject("Excel.Application")
        excelWorkbook = objExcel.activeWorkbook

        'Use the Z value for the Origin to set the sheet index to be accessed, 1 = first, 0 = current
        If CInt(Target.Z) = 0 Then
          excelSheet = objExcel.ActiveSheet
        ElseIf CInt(Target.Z) > excelWorkbook.Sheets.Count() Then
          excelWorkbook.Sheets.add(, excelWorkbook.Sheets(excelWorkbook.Sheets.Count()), CInt(Target.Z - excelWorkbook.Sheets.Count()))
          excelSheet = excelWorkbook.Sheets.item(CInt(Target.Z))
        Else
          excelSheet = excelWorkbook.Sheets.item(CInt(Target.Z))
        End If
      End If



      objExcel.screenUpdating = False

      excelSheet.activate()

      If target = Nothing Then
        If math.abs(Height) > 0 Then excelSheet.Rows.RowHeight = Height Else excelSheet.Rows.AutoFit
        If math.abs(Width) > 0 Then excelSheet.Columns.ColumnWidth = Width Else excelSheet.Columns.Autofit
        A = New point3d(1, 1, excelSheet.index)
        B = New point3d(excelSheet.Columns.Count, excelSheet.Rows.Count, excelSheet.index)
      Else
        If math.abs(Height) > 0 Then excelSheet.Rows(CInt(Target.Y)).RowHeight = Height Else excelSheet.Rows(CInt(Target.Y)).AutoFit
        If math.abs(Width) > 0 Then excelSheet.Columns(CInt(Target.X)).ColumnWidth = Width Else excelSheet.Columns(CInt(Target.X)).Autofit
        A = Target
        B = Target
      End If

      objExcel.screenUpdating = True

    End If
# ---------- end xl_cell_size ----------
xl_data_out_4 = XLDataOut(XL_Path=path_3, Origin=pt_10, Data=merge_9, ByColumn=False, XL_Fill=xl_fill_2.T, XL_Font=xl_font_2, Stream=bool)  # -> A, B; inputs XL_Path: list, Origin: list of Point3d, Data: tree, XL_Fill: tree, XL_Line: tree, XL_Font: tree; disabled; same code as xl_data_out
panel_13 = Panel("Total")
panel_14 = Panel(concat_2)
panel_15 = Panel(concat)
panel_16 = Panel(merge_9)
panel_17 = Panel("=SUM(B11:B25)")
xl_data_out_5 = XLDataOut(
    XL_Path=path_3,
    Origin=pt_6,
    Data="Total Building Data",
    ByColumn=False,
    XL_Fill=xl_fill_3.T,
    XL_Font=xl_font_3.T,
    Stream=bool)  # -> A, B; inputs XL_Path: list, Origin: list of Point3d, Data: tree, XL_Fill: tree, XL_Line: tree, XL_Font: tree; disabled; same code as xl_data_out
xl_data_out_6 = XLDataOut(
    XL_Path=path_3,
    Origin=pt_7,
    Data="Sub-Building Data",
    ByColumn=False,
    XL_Fill=xl_fill_3.T,
    XL_Font=xl_font_3.T,
    Stream=bool)  # -> A, B; inputs XL_Path: list, Origin: list of Point3d, Data: tree, XL_Fill: tree, XL_Line: tree, XL_Font: tree; disabled; same code as xl_data_out
xl_data_out_7 = XLDataOut(XL_Path=path_3, Origin=pt_8, Data="Floor Data", ByColumn=False, XL_Fill=xl_fill_3.T, XL_Font=xl_font_3.T, Stream=bool)  # -> A, B; inputs XL_Path: list, Origin: list of Point3d, Data: tree, XL_Fill: tree, XL_Line: tree, XL_Font: tree; disabled; same code as xl_data_out
