# Grasshopper definition Massing_FingerJoint.gh (Grasshopper 1.0.7)
# Copyright: Co-de-iT
# plug-ins: MeshEdit Components, treesloth01, MetaHopper

offset = Slider(6, range=-10..10)
modeloffset = Data(offset)
geometrytoprocess = Geometry([<brep referenced from the Rhino model> x2])
material_thickness = Slider(1.8, range=0..10)
tab_length = Slider(5, range=0..10)
modeloffset_2 = Data(modeloffset)  # disabled

# ---- group: SolidOffset
number_slider = Slider(8, range=0..10)  # disabled
data = Data()
debrep = DeconstructBrep(Brep=data)  # -> Faces, Edges, Vertices; disabled
multiplication = Multiplication(A=modeloffset_2, B=number_slider)  # disabled
offset_2 = OffsetSurface(Surface=debrep.Faces, Distance=modeloffset_2, Retrim=True)  # disabled
abs = Absolute(Value=multiplication)  # disabled
pln = Plane(offset_2)  # disabled
offset_3 = OffsetCurve(Curve=offset_2, Distance=abs, Plane=pln, Corners=1)  # disabled
boundary = BoundarySurfaces(Edges=offset_3)  # disabled
shift = ShiftPaths(Data=boundary, Offset=-1)  # disabled
lng = ListLength(List=shift)  # disabled
series = Series(Start=0, Step=1, Count=lng)  # disabled
cull_i = CullIndex(List=shift, Indices=graft(series), Wrap=True)  # disabled
bbx = BrepBrep(BrepA=boundary, BrepB=cull_i)  # -> Curves, Points; disabled
shift_2 = ShiftPaths(Data=bbx.Curves, Offset=-1)  # disabled
srfsplit = SurfaceSplit(Surface=boundary, Curves=shift_2)  # disabled
area = MeshArea(Mesh=srfsplit)  # -> Area, Centroid; disabled
sort = SortList(Keys=area.Area, ValuesA=srfsplit)  # -> Keys, reverse(ValuesA); disabled
item = ListItem(List=sort.ValuesA, Index=0, Wrap=True)  # disabled
shift_3 = ShiftPaths(Data=simplify(item), Offset=-1)  # disabled
join = BrepJoin(Breps=shift_3)  # -> Breps, Closed; disabled

# ----
scale = Panel("1:1")
crv = Curve()
brep = Brep(geometrytoprocess)
materialthickness = Data(material_thickness)
tablength = Data(tab_length)
null = NullItem(Item=crv)  # -> NullFlags, InvalidFlags, Description
null_2 = NullItem(Item=brep)  # -> NullFlags, InvalidFlags, Description
rep = ReplaceText(Text=scale, Find=":", Replace="/", RecursiveReplace=False)
cull = CullPattern(List=crv, CullPattern=invert(null.NullFlags))
cull_2 = CullPattern(List=brep, CullPattern=invert(null_2.NullFlags))
scale_2 = Scale(Geometry=cull_2, Center=Point(0, 0, 0), Factor=rep)  # -> Geometry, Transform
scale_3 = Scale(Geometry=cull, Center=Point(0, 0, 0), Factor=rep)  # -> Geometry, Transform
xy = XYPlane(Origin=Point(0, 0, 0))
debrep_2 = DeconstructBrep(Brep=scale_2.Geometry)  # -> Faces, Edges, Vertices
geo = Geometry(debrep_2.Faces)
area_2 = Area(Geometry=geo)  # -> Area, Centroid
pdecon = Deconstruct(Point=area_2.Centroid)  # -> XComponent, YComponent, ZComponent
panel = Panel("""-1
1""")
materialthickness_2 = Data(materialthickness)
sort_2 = SortList(Keys=pdecon.ZComponent, ValuesA=geo, ValuesB=area_2.Centroid)  # -> Keys, ValuesA, ValuesB
materialthickness_3 = Data(materialthickness)
item_2 = ListItem(List=sort_2.ValuesA, Index=[0, -1], Wrap=True)
multiplication_2 = Multiplication(A=materialthickness_3, B="20")
item_3 = ListItem(List=item_2, Index=0, Wrap=True)  # -> Item, Item1
materialthickness_4 = Data(materialthickness)
explode = Explode(Curve=item_3.Item1, Recursive=True)  # -> Segments, Vertices
explode_2 = Explode(Curve=item_3.Item, Recursive=True)  # -> Segments, Vertices
eval = EvaluateLength(Curve=reparameterize(explode_2.Segments), Length=0.5, Normalized=True)  # -> Point, Tangent, Parameter
eval_2 = EvaluateLength(Curve=reparameterize(explode.Segments), Length=0.5, Normalized=True)  # -> Point, Tangent, Parameter
cp = ClosestPoint(Point=eval.Point, Cloud=eval_2.Point)  # -> ClosestPoint, CPIndex, Distance
item_4 = ListItem(List=explode.Segments, Index=cp.CPIndex, Wrap=True)
graft = GraftTree(Tree=explode_2.Segments, IncludeEmptyLists=True, IncludeNullItems=True)
graft_2 = GraftTree(Tree=item_4, IncludeEmptyLists=True, IncludeNullItems=True)
eval_3 = EvaluateLength(Curve=graft_2, Length=[0, 1], Normalized=True)  # -> Point, Tangent, Parameter
eval_4 = EvaluateLength(Curve=graft, Length=[0, 1], Normalized=True)  # -> Point, Tangent, Parameter
cp_2 = ClosestPoint(Point=eval_4.Point, Cloud=eval_3.Point)  # -> ClosestPoint, CPIndex, Distance
ln = Line(StartPoint=eval_4.Point, EndPoint=cp_2.ClosestPoint)  # -> simplify(Line)
int = Integer(0)
int_2 = Integer(1)
loft = Loft(Curves=ln, Options={Adjust=False, Closed=False, LoftEnds=0, LoftSimp=0, LoftType=0, Rebuild=10, Refit=0.01})
ultrim = UltraTrim(data=loft)
shift_4 = ShiftPaths(Data=loft, Offset=-1)
modeloffset_3 = Data(modeloffset)
debrep_3 = DeconstructBrep(Brep=shift_4)  # -> Faces, Edges, Vertices
debrep_4 = DeconstructBrep(Brep=item_2)  # -> Faces, Edges, Vertices
offset_4 = OffsetSurface(Surface=debrep_4.Faces, Distance=modeloffset_3, Retrim=True)
data_2 = Data(modeloffset_3)
offset_5 = OffsetSurface(Surface=debrep_3.Faces, Distance=modeloffset_3, Retrim=True)
offset_6 = OffsetCurve(Curve=offset_4, Distance=data_2, Plane=offset_4, Corners=1)
offset_7 = OffsetCurve(Curve=offset_5, Distance=data_2, Plane=offset_5, Corners=1)
explode_3 = Explode(Curve=offset_7, Recursive=True)  # -> Segments, Vertices
boundary_2 = BoundarySurfaces(Edges=offset_6)
item_5 = ListItem(List=explode_3.Segments, Index="1", Wrap=True)  # -> Item1, Item, Item1_2
shift_5 = ShiftPaths(Data=simplify(boundary_2), Offset=-1)
flip = FlipCurve(Curve=item_5.Item1_2)  # -> Curve, Flag
merge = Merge(Data1=item_5.Item1, Data2=flip.Curve)
loft_2 = Loft(Curves=merge, Options={Adjust=False, Closed=False, LoftEnds=0, LoftSimp=0, LoftType=0, Rebuild=10, Refit=0.01})
shift_6 = ShiftPaths(Data=simplify(loft_2), Offset=-1)

geoends = Data(reverse(shift_5))
geosides = Data(shift_6)

geoends_2 = Data(geoends)
item_6 = ListItem(List=geoends_2, Index=1, Wrap=True)
crv_2 = Curve(item_6)
explode_4 = Explode(Curve=crv_2, Recursive=True)  # -> Segments, Vertices
offset_l = OffsetLoose(Curve=explode_4.Segments, Distance=1, Plane=xy)  # -> simplify(Curve)
item_7 = ListItem(List=offset_l, Index=0, Wrap=True)
eval_5 = EvaluateLength(Curve=item_7, Length=0.5, Normalized=True)  # -> Point, Tangent, Parameter
incurve = PointInCurve(Point=eval_5.Point, Curve=crv_2)  # -> Relationship, Point
bool = Boolean(incurve.Relationship)
item_8 = ListItem(List=panel, Index=bool, Wrap=True)
expression = Expression(x=materialthickness_2, y=item_8, Expression="X*Y")
offset_l_2 = OffsetLoose(Curve=explode_4.Segments, Distance=expression, Plane=xy)  # -> simplify(Curve)
ext = ExtendCurve(Curve=offset_l_2, Type=0, Start=multiplication_2, End=multiplication_2)  # -> simplify(Curve)
graft_3 = GraftTree(Tree=offset_l_2, IncludeEmptyLists=True, IncludeNullItems=True)
crv_3 = Curve(ext)
shift_7 = ShiftList(List=ext, Shift=1, Wrap=True)
ext_2 = ExtendCurve(Curve=graft_3, Type=0, Start=materialthickness_4, End=materialthickness_4)  # -> simplify(Curve)
ccx = CurveCurve(CurveA=reparameterize(crv_3), CurveB=reparameterize(shift_7))  # -> Points, ParamsA, ParamsB
shift_8 = ShiftPaths(Data=ccx.ParamsB, Offset=-1)
shift_9 = ShiftList(List=shift_8, Shift=-1, Wrap=True)
graft_4 = GraftTree(Tree=shift_9, IncludeEmptyLists=True, IncludeNullItems=True)
shift_10 = ShiftPaths(Data=ext_2, Offset=-1)
merge_2 = Merge(Data1=simplify(graft_4), Data2=simplify(ccx.ParamsA))
graft_5 = GraftTree(Tree=crv_3, IncludeEmptyLists=True, IncludeNullItems=True)
ccx_2 = CurveCurve(CurveA=reparameterize(shift_10), CurveB=crv_2)  # -> Points, ParamsA, ParamsB
bnd = Bounds(Numbers=merge_2)
eval_6 = EvaluateLength(Curve=graft(explode_4.Segments), Length=[0, 1], Normalized=True)  # -> Point, Tangent, Parameter
subcrv = SubCurve(BaseCurve=reparameterize(graft_5), Domain=bnd)
expression_2 = Expression(x=ccx_2.ParamsA, Expression="x<.5")
crv_cp = CurveClosestPoint(Point=eval_6.Point, Curve=reparameterize(subcrv))  # -> Point, Parameter, Distance
dispatch = Dispatch(List=ccx_2.ParamsA, DispatchPattern=expression_2)  # -> ListA, ListB
long = LongestList(ListA=dispatch.ListB, ListB=int_2, PaddingMode=2)  # -> ListA, ListB
long_2 = LongestList(ListA=dispatch.ListA, ListB=int, PaddingMode=2)  # -> ListA, ListB
bnd_2 = Bounds(Numbers=crv_cp.Parameter)
crv_4 = Curve(graft(explode_4.Segments))
merge_3 = Merge(Data1=long_2.ListA, Data2=long_2.ListB)
merge_4 = Merge(Data1=long.ListA, Data2=long.ListB)
item_9 = ListItem(List=merge_4, Index=0, Wrap=True)
item_10 = ListItem(List=merge_3, Index=0, Wrap=True)
merge_5 = Merge(Data1=item_10, Data2=item_9)
eval_7 = EvaluateLength(Curve=ext_2, Length=merge_5, Normalized=True)  # -> Point, Tangent, Parameter
crv_cp_2 = CurveClosestPoint(Point=eval_7.Point, Curve=reparameterize(crv_4))  # -> Point, Parameter, Distance
subcrv_2 = SubCurve(BaseCurve=reparameterize(subcrv), Domain=bnd_2)  # -> simplify(Curve)
bnd_3 = Bounds(Numbers=crv_cp_2.Parameter)
subcrv_3 = SubCurve(BaseCurve=reparameterize(crv_4), Domain=bnd_3)  # -> simplify(Curve)
crv_5 = Curve(subcrv_2)
eval_8 = EvaluateLength(Curve=graft(crv_5), Length=[0, 1], Normalized=True)  # -> Point, Tangent, Parameter
eval_9 = EvaluateLength(Curve=graft(subcrv_3), Length=[0, 1], Normalized=True)  # -> Point, Tangent, Parameter
len = Length(Curve=subcrv_3)
crv_cp_3 = CurveClosestPoint(Point=eval_8.Point, Curve=subcrv_3)  # -> Point, Parameter, Distance
dist = Distance(PointA=eval_9.Point, PointB=crv_cp_3.Point)
num = Number(len)
data_3 = Data(simplify(subcrv_3))
num_2 = Number(dist)
number_slider_2 = Slider(2, range=0..10)
geoends_3 = Data(geoends)
shift_11 = ShiftPaths(Data=data_3, Offset=-1)
item_11 = ListItem(List=geoends_3, Index=0, Wrap=True)  # -> Item1, Item
group = Group(Objects=shift_11)
item_12 = ListItem(List=num_2, Index=1, Wrap=True)
geosides_2 = Data(geosides)
shift_12 = ShiftPaths(Data=simplify(num), Offset=-1)
ultrim_2 = UltraTrim(data=num)
ultrim_3 = UltraTrim(data=item_12)
repeat = RepeatData(Data=group, Length=number_slider_2)  # -> flatten(Data)
repeat_2 = RepeatData(Data=item_11.Item1, Length=number_slider_2)  # -> flatten(Data)
shift_13 = ShiftPaths(Data=simplify(item_12), Offset=-1)
dim = Dimensions(Surface=geosides_2)  # -> UDimension, VDimension
xy_2 = XYPlane(Origin=Point(0, 0, 0))
bbox = BoundingBox(Content=repeat_2, Plane=PlaneXY(0, 0, 0))  # -> Box, Box_2
expression_3 = Expression(x=shift_12, y=shift_13, Expression="x-y")
debox = DeconstructBox(Box=bbox.Box)  # -> Plane, X, Y, Z
item_13 = ListItem(List=dim.VDimension, Index=0, Wrap=True)  # -> flatten(Item)
dedomain = DeconstructDomain(Domain=debox.Z)  # -> Start, End
dedomain_2 = DeconstructDomain(Domain=debox.X)  # -> Start, End
dedomain_3 = DeconstructDomain(Domain=debox.Y)  # -> Start, End
evalsrf = EvaluateSurface(Surface=reparameterize(bbox.Box), Point=Point(0, 0, 0))  # -> Point, Normal, UDirection, VDirection, Frame
consec = ConsecutiveDomains(Numbers=item_13, Additive=True)
consec_2 = ConsecutiveDomains(Numbers=expression_3, Additive=True)
expression_4 = Expression(x=dedomain_2.Start, y=dedomain_2.End, Expression="abs(x-y)")
dedomain_4 = DeconstructDomain(Domain=consec)  # -> Start, End
pt = ConstructPoint(XCoordinate=dedomain_2.Start, YCoordinate=dedomain_3.Start, ZCoordinate=dedomain.Start)
dedomain_5 = DeconstructDomain(Domain=consec_2)  # -> Start, End
srf_cp = SurfaceClosestPoint(Point=evalsrf.Point, Surface=repeat_2)  # -> Point, UVPoint, Distance
xy_3 = XYPlane(Origin=pt)
item_14 = ListItem(List=dedomain_4.Start, Index=0, Wrap=True)
int_3 = Integer(0)
ma = MassAddition(Input=expression_4)  # -> Result, PartialResults
item_15 = ListItem(List=dedomain_5.Start, Index=0, Wrap=True)
int_4 = Integer(0)
vec2pt = Vector2Pt(PointA=evalsrf.Point, PointB=srf_cp.Point, Unitize=False)  # -> Vector, Length
long_3 = LongestList(ListA=int_3, ListB=item_14, PaddingMode=2)  # -> ListA, ListB
cull_i_2 = CullIndex(List=ma.PartialResults, Indices=-1, Wrap=True)
long_4 = LongestList(ListA=int_4, ListB=item_15, PaddingMode=2)  # -> ListA, ListB
move = Move(Geometry=evalsrf.Frame, Motion=vec2pt.Vector)  # -> Geometry, Transform
merge_6 = Merge(Data1=simplify(long_3.ListA), Data2=simplify(dedomain_4.Start))  # -> graft(Result)
ins = InsertItems(List=cull_i_2, Item="0", Indices="0", Wrap=True)
merge_7 = Merge(Data1=simplify(long_4.ListA), Data2=simplify(dedomain_5.Start))
pt_2 = ConstructPoint(XCoordinate=ins, YCoordinate=0, ZCoordinate=0)
pt_3 = ConstructPoint(XCoordinate=merge_7, YCoordinate=expr("x+450", merge_6), ZCoordinate=0)
xy_4 = XYPlane(Origin=pt_2)
panel_2 = Panel("""1
-1""")
rectangle = Rectangle(Plane=pt_3, XSize=shift_12, YSize=dim.VDimension, Radius=0)  # -> Rectangle, Length
xy_5 = XYPlane(Origin=Point(0, 0, 0))
explode_5 = Explode(Curve=rectangle.Rectangle, Recursive=True)  # -> Segments, Vertices
planesrf = PlaneSurface(Plane=pt_3, XSize=shift_12, YSize=dim.VDimension)
dispatch_2 = Dispatch(List=explode_5.Segments, DispatchPattern=[True, False])  # -> ListA, ListB
orient = Orient(Geometry=repeat, Source=xy_3, Target=xy_4)  # -> Geometry, Transform
orient_2 = Orient(Geometry=repeat_2, Source=xy_3, Target=xy_4)  # -> Geometry, Transform
data_4 = Data(simplify(dispatch_2.ListA))
data_5 = Data(simplify(dispatch_2.ListB))
panel_3 = Panel(data_5)
crv_6 = Curve(orient_2.Geometry)
offset_8 = Offset(Curve=graft(crv_6), Distance=panel_2, Plane=xy_5, Corners=1)  # -> simplify(Curve)
pshift = ShiftPaths(Data=offset_8, Offset=-1)
ungroup = Ungroup(Group=orient.Geometry)
eval_10 = EvaluateLength(Curve=pshift, Length=0.5, Normalized=True)  # -> Point, Tangent, Parameter
incurve_2 = PointInCurve(Point=eval_10.Point, Curve=graft(crv_6))  # -> Relationship, Point
graft_6 = GraftTree(Tree=ungroup, IncludeEmptyLists=True, IncludeNullItems=True)  # -> simplify(Tree)
tablength_2 = Data(tablength)
tablength_3 = Data(tablength)
len_2 = Length(Curve=graft_6)
len_3 = Length(Curve=ungroup)
dispatch_3 = Dispatch(List=panel_2, DispatchPattern=incurve_2.Relationship)  # -> ListA, ListB

# ---- group: Horizontals
crv_7 = Curve(data_4)
graft_7 = GraftTree(Tree=crv_7, IncludeEmptyLists=True, IncludeNullItems=True)  # -> simplify(Tree)
len_4 = Length(Curve=graft_7)
tablength_4 = Data(tablength)
expression_5 = Expression(x=len_4, y=tablength_4, Expression="x/y")
int_5 = Integer(expression_5)
expression_6 = Expression(x=int_5, Expression="(floor(x/2)*2)+1")
range = Range(Domain=Domain(0, 1), Steps=expression_6)
shatter = Shatter(Curve=reparameterize(graft_7), Parameters=range)
P = DispatchPattern([True, False])
dispatch_4 = Dispatch(List=shatter, DispatchPattern=P)  # -> ListA, ListB
materialthickness_5 = Data(materialthickness)
neg = Negative(Value=materialthickness_5)
xy_6 = XYPlane(Origin=Point(0, 0, 0))
crv_8 = Curve(dispatch_4.ListA)
crv_9 = Curve(dispatch_4.ListB)
offset_9 = Offset(Curve=crv_9, Distance=neg, Plane=xy_6, Corners=1)
unflatten = UnflattenTree(Tree=offset_9, Guide=crv_9)
weave = Weave(Pattern=P, Stream0=unflatten, Stream1=crv_8, NullGaps=False)
materialthickness_6 = Data(materialthickness)
connect = ConnectCurves(Curves=weave, Continuity="0", Close=Toggle(False), Bulge=1)
neg_2 = Negative(Value=materialthickness_6)
crv_10 = Curve(connect)
ext_3 = ExtendCurve(Curve=crv_10, Type=0, Start=0, End=neg_2)  # -> simplify(Curve)
ultrim_4 = UltraTrim(data=ext_3)

# ----
data_6 = Data(ungroup)
expression_7 = Expression(x=len_3, y=tablength_2, Expression="x/y")
expression_8 = Expression(x=len_2, y=tablength_3, Expression="x/y")
item_16 = ListItem(List=crv_7, Index=0, Wrap=True)
expression_9 = Expression(x=len_3, y=tablength_2, Expression="ceiling((x/y)/2)*2")
int_6 = Integer(expression_8)
int_7 = Integer(expression_7)

# ---- group: Verticals
graft_8 = GraftTree(Tree=data_5, IncludeEmptyLists=True, IncludeNullItems=True)
tablength_5 = Data(tablength)
len_5 = Length(Curve=graft_8)
expression_10 = Expression(x=len_5, y=tablength_5, Expression="x/y")
int_8 = Integer(expression_10)
num_3 = Number(reverse(num_2))
expression_11 = Expression(x=int_8, Expression="ceiling(x/2)*2")
graft_9 = GraftTree(Tree=num_3, IncludeEmptyLists=True, IncludeNullItems=True)
xy_7 = XYPlane(Origin=Point(0, 0, 0))
offset_10 = Offset(Curve=graft_8, Distance=expr("-x", simplify(graft_9)), Plane=xy_7, Corners=1)
range_2 = Range(Domain=Domain(0, 1), Steps=expression_11)
shatter_2 = Shatter(Curve=reparameterize(graft_8), Parameters=range_2)
shatter_3 = Shatter(Curve=reparameterize(offset_10), Parameters=range_2)
P_2 = DispatchPattern([False, True])
dispatch_5 = Dispatch(List=shatter_3, DispatchPattern=P_2)  # -> ListA, ListB
dispatch_6 = Dispatch(List=shatter_2, DispatchPattern=P_2)  # -> ListA, ListB
materialthickness_7 = Data(materialthickness)
neg_3 = Negative(Value=materialthickness_7)
xy_8 = XYPlane(Origin=Point(0, 0, 0))
crv_11 = Curve(simplify(dispatch_5.ListB))
crv_12 = Curve(dispatch_6.ListA)
offset_11 = Offset(Curve=crv_11, Distance=neg_3, Plane=xy_8, Corners=1)  # disabled
unflatten_2 = UnflattenTree(Tree=crv_11, Guide=crv_11)
weave_2 = Weave(Pattern=P_2, Stream0=unflatten_2, Stream1=crv_12, NullGaps=False)
connect_2 = ConnectCurves(Curves=weave_2, Continuity="0", Close=Toggle(False), Bulge=1)  # -> simplify(Curve)
trim = TrimTree(Tree=connect_2, Depth=1)

# ----
expression_12 = Expression(x=int_6, Expression="(floor(x/2)*2)+1")
expression_13 = Expression(x=int_7, Expression="(floor(x/2)*2)+1")
divide = DivideCurve(Curve=data_6, Count=expression_13, Kinks=False)  # -> Points, Tangents, Parameters
divide_2 = DivideCurve(Curve=graft_6, Count=expression_12, Kinks=False)  # -> Points, Tangents, Parameters
shatter_4 = Shatter(Curve=graft(data_6), Parameters=divide.Parameters)  # -> simplify(Segments)
len_6 = Length(Curve=graft_8)
shatter_5 = Shatter(Curve=graft_6, Parameters=divide_2.Parameters)
materialthickness_8 = Data(materialthickness)
P_3 = DispatchPattern([False, True])
panel_4 = Panel(len_6)
dispatch_7 = Dispatch(List=shatter_4, DispatchPattern=P_3)  # -> ListA, ListB
expression_14 = Expression(x=materialthickness_8, y=simplify(dispatch_3.ListA), Expression="x*y")
dispatch_8 = Dispatch(List=shatter_5, DispatchPattern=P_3)  # -> ListA, ListB
crv_13 = Curve(simplify(graft(dispatch_7.ListB)))
shift_14 = ShiftPaths(Data=simplify(crv_13), Offset=-1)
crv_14 = Curve(dispatch_7.ListA)
xy_9 = XYPlane(Origin=Point(0, 0, 0))
long_5 = LongestList(ListA=shift_14, ListB=expression_14, PaddingMode=2)  # -> ListA, ListB
unflatten_3 = UnflattenTree(Tree=long_5.ListB, Guide=crv_13)
offset_12 = Offset(Curve=crv_13, Distance=unflatten_3, Plane=xy_9, Corners=1)
unflatten_4 = UnflattenTree(Tree=offset_12, Guide=dispatch_7.ListB)
weave_3 = Weave(Pattern=P_3, Stream0=unflatten_4, Stream1=crv_14, NullGaps=False)
panel_5 = Panel(unflatten_3)
geosides_3 = Data(geosides)
explode_6 = Explode(Curve=scale_3.Geometry, Recursive=True)  # -> flatten(Segments), Vertices
geo_2 = Geometry(geosides_3)
tablength_6 = Data(tablength)
geoends_4 = Data(geoends)
graft_10 = GraftTree(Tree=geo_2, IncludeEmptyLists=True, IncludeNullItems=True)
eval_11 = EvaluateLength(Curve=explode_6.Segments, Length=0.5, Normalized=True)  # -> Point, Tangent, Parameter
multiplication_3 = Multiplication(A=tablength_6, B="3")
connect_3 = ConnectCurves(Curves=weave_3, Continuity="0", Close=Toggle(False), Bulge=1)
graft_11 = GraftTree(Tree=geoends_4, IncludeEmptyLists=True, IncludeNullItems=True)
ext_4 = ExtendCurve(Curve=connect_3, Type=0, Start=multiplication_3, End=multiplication_3)  # -> simplify(Curve)
srf_cp_2 = SurfaceClosestPoint(Point=eval_11.Point, Surface=graft_11)  # -> Point, UVPoint, Distance
srf_cp_3 = SurfaceClosestPoint(Point=eval_11.Point, Surface=graft_10)  # -> Point, UVPoint, Distance
expression_15 = Expression(x=srf_cp_2.Distance, Expression="x<1")
expression_16 = Expression(x=srf_cp_3.Distance, Expression="x<1")
dispatch_9 = Dispatch(List=explode_6.Segments, DispatchPattern=expression_15)  # -> ListA, ListB
dispatch_10 = Dispatch(List=explode_6.Segments, DispatchPattern=expression_16)  # -> ListA, ListB
crv_15 = Curve(simplify(dispatch_9.ListA))
crv_16 = Curve(simplify(dispatch_10.ListA))

# ---- group: PatchEnds
ultrim_5 = UltraTrim(data=ext_4)
crv_17 = Curve(reparameterize(ultrim_5))
shift_15 = ShiftList(List=crv_17, Shift=1, Wrap=True)
ccx_3 = CurveCurve(CurveA=graft(crv_17), CurveB=graft(shift_15))  # -> Points, ParamsA, ParamsB
avr = Average(Input=ccx_3.Points)
dist_2 = Distance(PointA=avr, PointB=ccx_3.Points)
sort_3 = SortList(Keys=dist_2, ValuesA=ccx_3.Points)  # -> Keys, ValuesA
item_17 = ListItem(List=sort_3.ValuesA, Index=0, Wrap=True)
ultrim_6 = UltraTrim(data=item_17)
shift_16 = ShiftList(List=ultrim_6, Shift=-1, Wrap=True)  # -> graft(List)
item_18 = ListItem(List=graft(ultrim_6), Index=0, Wrap=True)
item_19 = ListItem(List=shift_16, Index=0, Wrap=True)
data_7 = Data(graft(crv_17))
merge_8 = Merge(Data1=simplify(item_18), Data2=simplify(item_19))
crv_cp_4 = CurveClosestPoint(Point=merge_8, Curve=data_7)  # -> Point, Parameter, Distance
shatter_6 = Shatter(Curve=data_7, Parameters=crv_cp_4.Parameter)
item_20 = ListItem(List=shatter_6, Index="1", Wrap=True)
ultrim_7 = UltraTrim(data=item_20)
join_2 = JoinCurves(Curves=ultrim_7, Preserve=False)

# ---- group: ssPatchEnds
ultrim_8 = UltraTrim(data=ext_4)
shift_17 = ShiftList(List=ultrim_8, Shift=1, Wrap=True)
crv_18 = Curve(ultrim_8)
ccx_4 = CurveCurve(CurveA=reparameterize(crv_18), CurveB=reparameterize(shift_17))  # -> Points, ParamsA, ParamsB
trim_2 = TrimTree(Tree=simplify(ccx_4.ParamsB), Depth=1)
shift_18 = ShiftList(List=trim_2, Shift=-1, Wrap=True)
graft_12 = GraftTree(Tree=shift_18, IncludeEmptyLists=True, IncludeNullItems=True)
merge_9 = Merge(Data1=graft_12, Data2=ccx_4.ParamsA)
graft_13 = GraftTree(Tree=crv_18, IncludeEmptyLists=True, IncludeNullItems=True)
bnd_4 = Bounds(Numbers=merge_9)
subcrv_4 = SubCurve(BaseCurve=reparameterize(graft_13), Domain=bnd_4)  # -> simplify(Curve)
ultrim_9 = UltraTrim(data=subcrv_4)
join_3 = JoinCurves(Curves=ultrim_9, Preserve=False)  # -> simplify(Curves)
toggle = GroupToggle(ToggleActive=True, ToggleVisible=False)  # disabled

# ----
group_2 = Group(Objects=crv_15)
group_3 = Group(Objects=crv_16)
flatten = FlattenTree(Tree=group_2, Path="{0}")
unflatten_5 = UnflattenTree(Tree=group_3, Guide=geo_2)
evalsrf_2 = EvaluateSurface(Surface=reparameterize(geosides_3), Point=Point(0, 0, 0))  # -> Point, Normal, Frame
evalsrf_3 = EvaluateSurface(Surface=reparameterize(planesrf), Point=Point(0, 0, 0))  # -> Point, Normal, Frame
orient_3 = Orient(Geometry=flatten, Source=move.Geometry, Target=xy_2)  # -> Geometry, Transform
orient_4 = Orient(Geometry=orient_3.Geometry, Source=xy_2, Target=xy_4)  # -> simplify(Geometry), Transform
orient_5 = Orient(Geometry=unflatten_5, Source=evalsrf_2.Frame, Target=evalsrf_3.Frame)  # -> Geometry, Transform

tablength_7 = Data(tablength)
weave_4 = Weave(Pattern=[0, 1], Stream0=trim, Stream1=ultrim_4, NullGaps=False)
multiplication_4 = Multiplication(A=tablength_7, B="3")
ext_5 = ExtendCurve(Curve=weave_4, Type=0, Start=multiplication_4, End=multiplication_4)  # -> simplify(Curve)
shift_19 = ShiftList(List=ext_5, Shift=1, Wrap=True)
crv_19 = Curve(ext_5)
ccx_5 = CurveCurve(CurveA=reparameterize(crv_19), CurveB=reparameterize(shift_19))  # -> Points, ParamsA, ParamsB
trim_3 = TrimTree(Tree=simplify(ccx_5.ParamsB), Depth=1)
shift_20 = ShiftList(List=trim_3, Shift=-1, Wrap=True)
graft_14 = GraftTree(Tree=shift_20, IncludeEmptyLists=True, IncludeNullItems=True)
merge_10 = Merge(Data1=graft_14, Data2=ccx_5.ParamsA)
graft_15 = GraftTree(Tree=crv_19, IncludeEmptyLists=True, IncludeNullItems=True)
bnd_5 = Bounds(Numbers=merge_10)
subcrv_5 = SubCurve(BaseCurve=reparameterize(graft_15), Domain=bnd_5)  # -> simplify(Curve)
trim_4 = TrimTree(Tree=subcrv_5, Depth=1)
join_4 = JoinCurves(Curves=trim_4, Preserve=False)

panel_6 = Panel(unflatten_5)
crv_20 = Curve(item_16)
end = EndPoints(Curve=subcrv_3)  # -> Start, End
Z = UnitZ(Factor=1)
end_2 = EndPoints(Curve=crv_20)  # -> Start, End
explode_7 = Explode(Recursive=True)  # -> Segments, Vertices
vec2pt_2 = Vector2Pt(PointA=end.Start, PointB=end.End, Unitize=False)  # -> Vector, Length
vec2pt_3 = Vector2Pt(PointA=end_2.Start, PointB=end_2.End, Unitize=False)  # -> Vector, Length
Y = UnitY(Factor=1)
materialthickness_9 = Data(materialthickness)
materialthickness_10 = Data(materialthickness)
pl = ConstructPlane(Origin=end.Start, XAxis=vec2pt_2.Vector, YAxis=Z)  # -> simplify(graft(Plane))
pl_2 = ConstructPlane(Origin=end_2.Start, XAxis=vec2pt_3.Vector, YAxis=Y)
redpline = Reduce(Polyline=join_4, Tolerance=Slider(0.1, range=0..0.1))  # -> Polyline, Reduction
inverse = InverseTransform(Transform=orient.Transform)
Z_2 = UnitZ(Factor=materialthickness_9)
boundary_3 = BoundarySurfaces(Edges=join_2)
Z_3 = UnitZ(Factor=expr("-x", materialthickness_10))
boundary_4 = BoundarySurfaces(Edges=redpline.Polyline)
ungroup_2 = Ungroup(Group=simplify(orient_4.Geometry))
crv_21 = Curve(simplify(join_2))
extr = Extrude(Base=boundary_3, Direction=Z_2)
extr_2 = Extrude(Base=boundary_4, Direction=Z_3)  # -> simplify(Extrusion)
trim_5 = TrimWithRegion(Curve=ungroup_2, Region=crv_21)  # -> Inside, Outside
transform = Transform(Geometry=flatten(extr), Transform=inverse)
crv_22 = Curve(trim_5.Inside)
orient_6 = Orient(Geometry=extr_2, Source=pl_2, Target=pl)  # -> Geometry, Transform
orient_7 = Orient(Geometry=flatten(extr), Source=flatten(xy_4), Target=flatten(xy_3))  # -> Geometry, Transform
crv_23 = Curve(simplify(crv_22))
group_4 = Group(Objects=[crv_23, crv_21])

data_8 = Data(group_4)
data_9 = Data(join_4)

# ==== cluster UltraTrim: Betterer version of Trim
data = ClusterInput()
data_2 = Data(simplify(data))
trim = TrimTree(Tree=data_2, Depth=1)
null = NullItem(Item=trim)  # -> NullFlags, InvalidFlags, Description
tmatch = MatchText(Text=null.Description, Pattern="Data does not exist", Case=True)
equals = Equality(FirstNumber=null.NullFlags, SecondNumber=1)  # -> Equality, Inequality
equals_2 = Equality(FirstNumber=null.InvalidFlags, SecondNumber=tmatch)  # -> Equality, Inequality
equals_3 = Equality(FirstNumber=null.NullFlags, SecondNumber=null.InvalidFlags)  # -> Equality, Inequality
equals_4 = Equality(FirstNumber=equals_3.Equality, SecondNumber=equals_2.Equality)  # -> Equality, Inequality
equals_5 = Equality(FirstNumber=equals.Equality, SecondNumber=equals_4.Equality)  # -> Equality, Inequality
ma = MassAddition(Input=flatten(equals_5.Inequality))  # -> Result, PartialResults
bool = Boolean(ma.Result)
trim_2 = TrimTree(Tree=data_2, Depth=bool)
T = ClusterOutput(trim_2)
