# Grasshopper definition Brep.ghx (Grasshopper 1.0.7)
# Copyright: Co-de-iT
# plug-ins: treesloth01, Human, EleFront

panel = Panel("""Retail
Retail
Retail
Comm
Resi
Resi 
etc""")
panel_2 = Panel("Main")
panel_3 = Panel("Podium")
f2f = Panel("3.1")
levels = Panel("5")
f2f_2 = Panel("3.1")
levels_2 = Panel("10")
f2f_3 = Panel("4")
levels_3 = Panel("20")
dpipeline = DynamicGeometryPipeline(
    LayerFilter="Horizontal",
    TypeFilter="Curve",
    NameFilter="*",
    GroupByLayer=False,
    GroupByType=False,
    IncludeHidden=True,
    IncludeLocked=True,
    enableFullPath=True,
    listenToAttributes=True)
dpipeline_2 = DynamicGeometryPipeline(
    LayerFilter="Vertical 2",
    TypeFilter="Curve",
    NameFilter="*",
    GroupByLayer=False,
    GroupByType=False,
    IncludeHidden=True,
    IncludeLocked=True,
    enableFullPath=True,
    listenToAttributes=True)
loft = Loft(Curves=dpipeline_2, Options={Adjust=False, Closed=False, LoftEnds=0, LoftSimp=0, LoftType=0, Rebuild=10, Refit=0.01})
panel_4 = Panel("""BuildID
Typology
Levels
F2F
Parent
Efficiency""")
dpipeline_3 = DynamicGeometryPipeline(
    LayerFilter="Brep1",
    TypeFilter="Brep",
    NameFilter="*",
    GroupByLayer=False,
    GroupByType=False,
    IncludeHidden=True,
    IncludeLocked=True,
    enableFullPath=True,
    listenToAttributes=True)
panel_5 = Panel("""BuildID
Typology
Levels
F2F
Parent
Efficiency""")
panel_6 = Panel("""BuildID
Typology
Levels
F2F
Parent
Efficiency""")
dup = DuplicateData(Data="Retail", Number=levels, Order=True)  # -> simplify(Data)
series = Series(Start=Slider(0, range=0..100), Step=f2f, Count=levels)  # -> simplify(Series)
bbox = BoundingBox(Content=dpipeline_2, Plane=PlaneXY(0, 0, 0), UnionBox=True)  # -> Box, Box_2
item = ListItem(List=series, Index=-1, Wrap=True)
debrep = DeconstructBrep(Brep=bbox.Box)  # -> Faces, Edges, Vertices
eval = EvaluateCurve(Curve=reparameterize(dpipeline), Parameter=0)  # -> Point, Tangent, Angle
series_2 = Series(Start=item, Step=f2f_2, Count=levels_2)  # -> simplify(Series)
dup_2 = DuplicateData(Data="Comm", Number=levels_3, Order=True)  # -> simplify(Data)
item_2 = ListItem(List=series_2, Index=-1, Wrap=True)
dup_3 = DuplicateData(Data="Resi", Number=levels_2, Order=True)  # -> simplify(Data)
series_3 = Series(Start=item_2, Step=f2f_3, Count=levels_3)  # -> simplify(Series)
area = Area(Geometry=debrep.Faces)  # -> Area, Centroid
brep = Brep([<brep referenced from the Rhino model> x3])
area_2 = Area(Geometry=bbox.Box)  # -> Area, Centroid
pdecon = Deconstruct(Point=eval.Point)  # -> XComponent, YComponent, ZComponent
pdecon_2 = Deconstruct(Point=area.Centroid)  # -> XComponent, YComponent, ZComponent
rl = Panel(series)
rl_2 = Panel(series_3)
rl_3 = Panel(series_2)
panel_7 = Panel(debrep.Faces)
f2f_4 = Panel(dup)
sort = SortList(Keys=pdecon.ZComponent, ValuesA=dpipeline)  # -> Keys, ValuesA
attributes = DefineObjectAttributes(UserKeys=panel_5, UserValues=panel_4, Layer="Brep3")
sort_2 = SortList(Keys=pdecon_2.ZComponent, ValuesA=debrep.Faces)  # -> Keys, ValuesA
f2f_5 = Panel(dup_3)
f2f_6 = Panel(dup_2)
building_id = Data()
parent = Data()
efficiency = Data()
typology = Data()
storeys = Data()
f2f_7 = Data()
item_3 = ListItem(List=sort_2.ValuesA, Index=0, Wrap=True)
bake = BakeObjects(Geometry=brep, Attributes=attributes, Bake=False)
loft_2 = Loft(Curves=sort.ValuesA, Options={Adjust=False, Closed=False, LoftEnds=0, LoftSimp=0, LoftType=0, Rebuild=10, Refit=0.01})
eval_2 = EvaluateCurve(Curve=reparameterize(dpipeline_2), Parameter=0)  # -> Point, Tangent, Angle
debrep_2 = DeconstructBrep(Brep=item_3)  # -> Faces, Edges, Vertices
merge = Merge()
cap = CapHoles(Brep=loft_2)
join = JoinCurves(Curves=debrep_2.Faces, Preserve=False)
alongcrv = SortAlongCurve(Points=eval_2.Point, Curve=join)  # -> Points, Indices
item_4 = ListItem(List=dpipeline_2, Index=alongcrv.Indices, Wrap=True)
shift = ShiftList(List=item_4, Shift=Slider(1, range=0..1), Wrap=True)
graft = GraftTree(Tree=shift, IncludeEmptyLists=True, IncludeNullItems=True)
graft_2 = GraftTree(Tree=item_4, IncludeEmptyLists=True, IncludeNullItems=True)
item_5 = ListItem(List=graft_2, Index=0, Wrap=True)  # -> simplify(Item)
item_6 = ListItem(List=graft, Index=0, Wrap=True)  # -> simplify(Item)
merge_2 = Merge(Data1=item_5, Data2=item_6)
loft_3 = Loft(Curves=merge_2, Options={Adjust=False, Closed=False, LoftEnds=0, LoftSimp=0, LoftType=0, Rebuild=10, Refit=0.01})
cap_2 = CapHoles()

# ----
# GEOMETERY INPUT
panel_8 = Panel("BREPS::Brep3")
dpipeline_4 = DynamicGeometryPipeline(
    LayerFilter=panel_8,
    TypeFilter="Brep",
    NameFilter="*",
    GroupByLayer=False,
    GroupByType=False,
    IncludeHidden=True,
    IncludeLocked=True,
    enableFullPath=True,
    listenToAttributes=True)

geometry = Data(dpipeline_4)
panel_9 = Panel("""3@12=Comm
25@3.1=Resi
4@12=Comm
17@3.1=Resi""")
panel_10 = Panel("BuildID:1")
panel_11 = Panel("""4@4=Basement
3@12=Comm
5@3.1=Resi
10@12=Comm
12@3.1=Resi""")

# ----
# SORT INTO BUILDINGS
panel_12 = Panel("BuildID")
getuv = GetUserValue(Geometry=geometry, Key=panel_12)
cset = CreateSet(List=getuv)  # -> simplify(graft(Set)), Map
tmatch = MatchText(Text=getuv, Pattern=cset.Set, Case=True)
dispatch = Dispatch(List=geometry, DispatchPattern=tmatch)  # -> simplify(ListA), ListB

join_2 = TextJoin(Text=panel_11, Join="*")
join_3 = TextJoin(Text=panel_9, Join="*")
data = Data(reverse(panel_11))
merge_3 = Merge(Data1=join_2, Data2=join_3)
building_in_order = Panel(data)
split = TextSplit(Text=merge_3, Separators="*")  # -> simplify(Result)
panel_13 = Panel(split)
split_2 = TextSplit(Text=data, Separators="@")
split_3 = TextSplit(Text=split_2, Separators="=")  # -> graft(Result)
trim = TrimTree(Tree=split_3, Depth=1)
trim_2 = TrimTree(Tree=trim, Depth=1)
item_7 = ListItem(List=trim_2, Index=0, Wrap=True)  # -> Item, Item1, Item2

# ----
# GET LOWEST POINT ON EACH BREP
debrep_3 = DeconstructBrep(Brep=dispatch.ListA)  # -> Faces, Edges, simplify(Vertices)
pdecon_3 = Deconstruct(Point=debrep_3.Vertices)  # -> XComponent, YComponent, ZComponent
sort_3 = SortList(Keys=pdecon_3.ZComponent, ValuesA=debrep_3.Vertices)  # -> reverse(Keys), reverse(ValuesA)
item_8 = ListItem(List=sort_3.Keys, Index=-1, Wrap=True)  # -> simplify(Item)
utrim = UberTrim(data=item_8)

# ----
# CALCULATE HEIGHT OF EACH BREP
bbox_2 = BoundingBox(Content=dispatch.ListA, Plane=PlaneXY(0, 0, 0))  # -> Box, Box_2
debox = DeconstructBox(Box=bbox_2.Box)  # -> Plane, X, Y, Z
dedomain = DeconstructDomain(Domain=debox.Z)  # -> Start, End
subtraction = Subtraction(A=dedomain.End, B=dedomain.Start)

tmatch_2 = MatchText(Text=item_7.Item2, Pattern="Basement", Case=True)  # -> simplify(Match)
getuv_2 = GetUserValue(Geometry=dispatch.ListA, Key="F2F")
getuv_3 = GetUserValue(Geometry=dispatch.ListA, Key="Typology")

# ---- group: typology names
dup_4 = DuplicateData(Data=item_7.Item2, Number=item_7.Item, Order=True)  # -> simplify(flatten(Data))

# ---- group: floor to floor
dup_5 = DuplicateData(Data=item_7.Item1, Number=item_7.Item, Order=True)  # -> simplify(Data)

# ---- group: split above and below ground
join_4 = TextJoin(Text=dup_5, Join="/")
dispatch_2 = Dispatch(List=join_4, DispatchPattern=tmatch_2)  # -> Basement, AboveGround

# ----
dpipeline_5 = DynamicGeometryPipeline(
    LayerFilter="BREPS::Brep4",
    TypeFilter="Brep",
    NameFilter="*",
    GroupByLayer=False,
    GroupByType=False,
    IncludeHidden=True,
    IncludeLocked=True,
    enableFullPath=True,
    listenToAttributes=True)
getuv_4 = GetUserValue(Geometry=dpipeline_5, Key="BuildID")

# ----
# NUMBER OF FLOORS
division = Division(A=subtraction, B=getuv_2)
round = Round(Number=division)  # -> simplify(Nearest), Floor, Ceiling

panel_14 = Panel(getuv_4)
split_4 = TextSplit(Text=dispatch_2.AboveGround, Separators="/")  # -> simplify(Result)
split_5 = TextSplit(Text=dispatch_2.Basement, Separators="/")  # -> simplify(Result)
clean = CleanTree(RemoveNulls=True, RemoveInvalid=True, RemoveEmpty=True, Tree=split_4)  # -> flatten(Tree)
neg = Negative(Value=split_5)
rev = ReverseList(List=clean)
lng = ListLength(List=flatten(dup_5))
clean_2 = CleanTree(RemoveNulls=True, RemoveInvalid=True, RemoveEmpty=True, Tree=neg)

# ----
# PLANE PER LEVEL
series_4 = Series(Start=utrim, Step=getuv_2, Count=round.Nearest)
pt = ConstructPoint(XCoordinate=0, YCoordinate=0, ZCoordinate=series_4)  # -> simplify(Point)
xy = XYPlane(Origin=pt)

consec = ConsecutiveDomains(Numbers=rev, Additive=True)
roof = Data(lng)
consec_2 = ConsecutiveDomains(Numbers=clean_2, Additive=True)
dedomain_2 = DeconstructDomain(Domain=consec)  # -> flatten(Start), End
graft_3 = GraftTree(Tree=dispatch.ListA, IncludeEmptyLists=True, IncludeNullItems=True)
dedomain_3 = DeconstructDomain(Domain=consec_2)  # -> flatten(Start), End
rev_2 = ReverseList(List=dedomain_3.Start)
f2f_8 = Panel(rev_2)
# TYPOLOGY OF FLOOR
dup_6 = DuplicateData(Data=graft(getuv_3), Number=graft(round.Nearest), Order=True)  # -> simplify(Data)

# ----
# FLOOR PLATE CRVS
sec = BrepPlane(Brep=graft_3, Plane=xy)  # -> Curves, Points

# ---- group: facade
debrep_4 = DeconstructBrep(Brep=dpipeline_5)  # -> Faces, Edges, Vertices
area_3 = Area(Geometry=debrep_4.Faces)  # -> Area, Centroid
panel_15 = Panel("""-1
0""")
sort_4 = SortList(Keys=area_3.Centroid, ValuesA=debrep_4.Faces)  # -> Keys, ValuesA
cull_i = CullIndex(List=sort_4.ValuesA, Indices=panel_15, Wrap=True)

# ----
debrep_5 = DeconstructBrep(Brep=dispatch.ListA)  # -> Faces, Edges, Vertices

# ---- group: all floorplates
boundary = BoundarySurfaces(Edges=sec.Curves)  # -> simplify(Surfaces)

# ----
merge_4 = Merge(Data1=rev_2, Data2="0", Data3=dedomain_2.Start)
pt_2 = ConstructPoint(XCoordinate=0, YCoordinate=0, ZCoordinate=merge_4)
evalsrf = EvaluateSurface(Surface=reparameterize(debrep_5.Faces), Point="0.5,0.5")  # -> Point, Normal, UDirection, VDirection, Frame

# ---- group: floor plates
sec_2 = BrepPlane(Brep=dpipeline_5, Plane=pt_2)  # -> flatten(Curves), Points
boundary_2 = BoundarySurfaces(Edges=sec_2.Curves)

# ----
rl_4 = Panel(merge_4)
utrim_2 = UberTrim(data=boundary)

# ---- group: sort by height to get tops
area_4 = Area(Geometry=utrim_2)  # -> Area, Centroid
pdecon_4 = Deconstruct(Point=area_4.Centroid)  # -> XComponent, YComponent, ZComponent
sort_5 = SortList(Keys=pdecon_4.ZComponent, ValuesA=utrim_2, ValuesB=dup_6)  # -> reverse(Keys), reverse(ValuesA), reverse(ValuesB)
item_9 = ListItem(List=sort_5.ValuesA, Index=0, Wrap=True)

# ----
pdecon_5 = Deconstruct(Point=evalsrf.Point)  # -> XComponent, YComponent, ZComponent

# ---- group: roof
item_10 = ListItem(List=boundary_2, Index=-1, Wrap=True)

# ----
sunion = SolidUnion(Breps=dispatch.ListA)
debrep_6 = DeconstructBrep(Brep=sunion)  # -> Faces, Edges, Vertices
evalsrf_2 = EvaluateSurface(Surface=reparameterize(debrep_6.Faces), Point="0.5,0.5")  # -> Point, Normal, UDirection, VDirection, Frame
devec = DeconstructVector(Vector=evalsrf_2.Normal)  # -> XComponent, YComponent, ZComponent
sort_6 = SortList(Keys=pdecon_5.ZComponent, ValuesA=debrep_5.Faces)  # -> Keys, ValuesA
panel_16 = Panel("""-1
0""")
facade = Data(cull_i)
panel_17 = Panel(lng)
floorplate = Data(boundary_2)
roof_2 = Data(item_10)

# ---- group: properties
typology_2 = Data(dup_4)
rl_5 = Data(merge_4)

# ----
equals = Equality(FirstNumber=devec.ZComponent, SecondNumber=Slider(1, range=0..1))  # -> Equality, Inequality

# ---- group: facade
cull_i_2 = CullIndex(List=sort_6.ValuesA, Indices=panel_16, Wrap=True)  # -> simplify(List)

# ----
cull_i_3 = CullIndex(List=sort_5.ValuesA, Indices=0, Wrap=True)  # -> simplify(List)
geo = Geometry(cull_i_2)
dispatch_3 = Dispatch(List=debrep_6.Faces, DispatchPattern=equals.Equality)  # -> ListA, ListB

# ---- group: usable space above floor
area_5 = Area(Geometry=item_9)  # -> Area, Centroid
Z = UnitZ(Factor=1)
graft_4 = GraftTree(Tree=getuv_2, IncludeEmptyLists=True, IncludeNullItems=True)
line = LineSDL(Start=area_5.Centroid, Direction=Z, Length=graft_4)

# ----
graft_5 = GraftTree(Tree=dispatch.ListA, IncludeEmptyLists=True, IncludeNullItems=True)
cull_i_4 = CullIndex(List=sort_5.ValuesB, Indices=0, Wrap=True)  # -> simplify(List)
item_11 = ListItem(List=sort_5.ValuesB, Index=0, Wrap=True)
bcx = BrepCurve(Brep=graft_5, Curve=line)  # -> Curves, simplify(Points)
null = NullItem(Item=bcx.Points)  # -> NullFlags, InvalidFlags, Description
dispatch_4 = Dispatch(List=item_11, DispatchPattern=null.NullFlags)  # -> ListA, ListB
merge_5 = Merge(Data1=dispatch_4.ListA, Data2=cull_i_4)
dispatch_5 = Dispatch(List=item_9, DispatchPattern=null.NullFlags)  # -> ListA, ListB
merge_6 = Merge(Data1=dispatch_5.ListA, Data2=cull_i_3)
area_6 = Area(Geometry=merge_6)  # -> Area, Centroid
pdecon_6 = Deconstruct(Point=area_6.Centroid)  # -> XComponent, YComponent, ZComponent
lng_2 = ListLength(List=cull_i_2)
geo_2 = Geometry()  # disabled
sort_7 = SortList(Keys=pdecon_6.ZComponent, ValuesA=merge_6, ValuesB=merge_5)  # -> Keys, ValuesA, ValuesB
pt_3 = ConstructPoint(XCoordinate=0, YCoordinate=0, ZCoordinate=sort_7.Keys)
xy_2 = XYPlane(Origin=pt_3)
group = Group(Objects=xy_2)
long = LongestList(ListA=geo, ListB=group, PaddingMode=2)  # -> ListA, ListB
ungroup = Ungroup(Group=long.ListB)
sec_3 = BrepPlane(Brep=graft(long.ListA), Plane=ungroup)  # -> Curves, Points
shift_2 = ShiftPaths(Data=sec_3.Curves, Offset=-1)  # -> simplify(Data)
utrim_3 = UberTrim(data=sec_3.Curves)
srfsplit = SurfaceSplit(Surface=graft(long.ListA), Curves=shift_2)  # -> simplify(Fragments)
facade_2 = Data(srfsplit)
utrim_4 = UberTrim(data=facade_2)
area_7 = Area(Geometry=utrim_4)  # -> Area, Centroid
pdecon_7 = Deconstruct(Point=area_7.Centroid)  # -> XComponent, YComponent, ZComponent
sort_8 = SortList(Keys=pdecon_7.ZComponent, ValuesA=utrim_4)  # -> Keys, ValuesA
partition = PartitionList(List=sort_8.ValuesA, Size=lng_2)
tstat = TreeStatistics(Tree=geo_2)  # -> Paths, Length, Count; disabled
dpath = DeconstructPath(Branch=tstat.Paths)  # disabled
join_5 = BrepJoin(Breps=partition)  # -> Breps, Closed
properties_typology = Data(simplify(sort_7.ValuesB))
usable_floorplates = Data(simplify(sort_7.ValuesA))
properties_rl = Data(simplify(sort_7.Keys))
full_mass = Data(sunion)
rooftops = Geometry(dispatch_3.ListA)
lng_3 = ListLength(List=dpath)  # -> simplify(flatten(Length)); disabled
utrim_5 = UberTrim(data=join_5.Breps)
facade_3 = Data(utrim_5)
cset_2 = CreateSet(List=lng_3)  # -> Set, Map; disabled
subtraction_2 = Subtraction(A=cset_2.Set, B=1)  # disabled
shift_3 = ShiftPaths(Data=geo_2, Offset=subtraction_2)  # disabled

# ==== cluster UberTrim: Better version of Trim
data = ClusterInput()
data_2 = Data(data)
trim = TrimTree(Tree=data_2, Depth=1)
null = NullItem(Item=trim)  # -> NullFlags, InvalidFlags, Description
bool = Boolean(invert(null.NullFlags))
trim_2 = TrimTree(Tree=data_2, Depth=bool)
data_3 = Data(trim_2)
data_4 = ClusterOutput(data_3)
