# Grasshopper definition BEK TEXT.gh (Grasshopper 1.0.7)
# plug-ins: Redback

textclass = RDB_TextClass()  # -> simplify(OUTPUT), simplify(O)
# ---------- textclass: Python ----------
import Rhino as r
import rhinoscriptsyntax as rs
import json

L = LOCATION

T = TEXT


class text:
    def __init__(self, location, content):
        self.location = location
        self.content = str(content)
        self.type = "text"

O = text(L,T)

print O.location
print O.content
# ---------- end textclass ----------
panel = Panel(""".labels{
font-family: "Univers LT Std";
fill: rgb(94,114,123);
stroke: none;
font-size:1.5mm;
text-anchor: middle;
dominant-baseline: middle;
}""")
json = JSON(Key="class", Value="text")
geo2archijson = Geo2ArchiJSON(G=textclass.O, properties=json, output_type=Toggle(False))
draw = DrawSVG(objects=geo2archijson, css=panel)

# ==== cluster Geo2ArchiJSON: Converts Geometry to ArchiJSON. Version 18.09.10
G = ClusterInput()
output_type = ClusterInput()  # Output Type: 0 = PythonDictionary; 1=JSON String
properties = ClusterInput()  # Properties as a JSON to sync with Geometry. Use JSON Component to build properties. Need to include 'zindex'
int = Integer(output_type)
G_2 = Data(G)
long = LongestList(ListA=G_2, ListB=properties, PaddingMode=2)  # -> ListA, ListB
python = PythonScript(G=long.ListA, P=long.ListB, T=int)  # -> O; inputs G: list, P: list
# ---------- python: Python ----------
import rhinoscriptsyntax as rs
import Rhino as r
import Grasshopper as g
import json
log = []
def Point(geom,prop=None):
    pt = rs.coerce3dpoint(geom)
    pt = [pt[0],pt[1],pt[2]]
    if prop:
        pt = {"type":"Feature","geometry":{'coordinates':pt, 'type': 'point'}}
        pt['properties'] = json.loads(prop)
        return pt
    else:
        return pt
def convertToRPT (geom):
    pt = r.Geometry.Point3d(geom[0],geom[1],geom[2])
    return pt
def PointCollection(geom,prop=None):
    t = geom
    pts = map(lambda g: Point(g), t)
    crv = {"type":"Feature","geometry":{'coordinates':pts, 'type': 'pointcollection'}}
    if prop:
        crv['properties'] = json.loads(prop)
    print(crv)
    return crv
def CurveCollection(geom,prop=None):
    pass
    t = rs.CurvePoints(geom)
    tc = rs.ClosedCurveOrientation(geom)
    if tc == 0: tc = False
    else: tc = True
    tdeg = rs.CurveDegree(geom)
    tcPo = len(t)
    print("tdeg: "+str(tdeg))
    print("tcPo: "+str(tcPo))
    pts = map(lambda g: Point(g), t)
    crv = {"type":"Feature","geometry":{'coordinates':pts, 'type': 'CurveCollection','closed':tc}}
    if tdeg == 1 and tc  : del crv['geometry']['coordinates'][-1]
    if tdeg == 1 and tcPo == 2  : crv['geometry']['type']='line'
    if tdeg >= 2                : crv['geometry']['type']='spline'
    if tdeg == 2 and tcPo == 5  :
        arc = rs.AddArc3Pt(pts[0],pts[4],pts[2])
        pt0 = convertToRPT(pts[0])
        pt2 = convertToRPT(pts[2])
        pt4 = convertToRPT(pts[4])
        arc = r.Geometry.Arc(startPoint = pt0, pointOnInterior = pt2, endPoint = pt4)
        crv['geometry']['type']='arc'
        print(crv['geometry']['coordinates'])
        del crv['geometry']['coordinates'][3]
        del crv['geometry']['coordinates'][1]
    if prop:
        crv['properties'] = json.loads(prop)
    print(crvcollection)
    return crvcollection
def Plane(geom,prop=None):
    pln = {"type":"Feature","geometry":{'coordinates':[geom.XAxis.X,geom.YAxis.X,geom.ZAxis.X,geom.OriginX,geom.XAxis.Y,geom.YAxis.Y,geom.ZAxis.Y,geom.OriginY,geom.XAxis.Z,geom.YAxis.Z,geom.ZAxis.Z,geom.OriginZ,0,0,0,1], 'type': 'xform'}}
    if prop:
        pln['properties'] = json.loads(prop)
    return pln
def Text(geom,prop=None):
    print("TEXT")
    text = Plane(geom.location,prop)
    text['geometry']['type']="text"
    text['geometry']['content']=geom.content
    return text
def Image(geom,prop=None):
    print("Image")
    print(dir(geom))
    image = Plane(geom.location,prop)
    image['geometry']['type']="image"
    image['geometry']['image']=geom.img
    image['geometry']['width']=geom.width
    image['geometry']['height']=geom.height
    return image
def Curve(geom,prop=None):
    t = rs.CurvePoints(geom)
    tc = rs.ClosedCurveOrientation(geom)
    if tc == 0: tc = False
    else: tc = True
    tdeg = rs.CurveDegree(geom)
    tcPo = len(t)
    print("tdeg: "+str(tdeg))
    print("tcPo: "+str(tcPo))
    pts = map(lambda g: Point(g), t)
    crv = {"type":"Feature","geometry":{'coordinates':pts, 'type': 'polyline','closed':tc}}
    if tdeg == 1 and tc  : del crv['geometry']['coordinates'][-1]
    if tdeg == 1 and tcPo == 2  : crv['geometry']['type']='line'
    if tdeg >= 2                : crv['geometry']['type']='spline'
    if tdeg == 2 and tcPo == 5  :
        arc = rs.AddArc3Pt(pts[0],pts[4],pts[2])
        pt0 = convertToRPT(pts[0])
        pt2 = convertToRPT(pts[2])
        pt4 = convertToRPT(pts[4])
        arc = r.Geometry.Arc(startPoint = pt0, pointOnInterior = pt2, endPoint = pt4)
        crv['geometry']['type']='arc'
        print(crv['geometry']['coordinates'])
        del crv['geometry']['coordinates'][3]
        del crv['geometry']['coordinates'][1]
    if prop:
        crv['properties'] = json.loads(prop)
    print(crv)
    return crv
otype = {"0": "Unknown object", "1": Point, "2": "PointCloud", "3":PointCollection, "4": Curve, "5":Plane, "6":Text, "7":CurveCollection, "8":"Surface", "9":Image, "16": "Polysurface", "32": "Mesh", "256": "Light", "512": "Annotation", "4096": "Instance reference", "8192": "Text dot", "16384": "Grip", "32768": "Detail", "65536": "Hatch", "131072": "Morph control", "134217728": "Cage", "268435456": "Phantom", "536870912": "Clipping plane", "1073741824": "Extrusion"}
def Convert(geom,prop):
    print("START CONVERT")
    print(geom)
    ot = otype["1"]
    try:
        ot = otype[str(rs.ObjectType(geom))]
    except:
        #ot = otype[type(geom)]
        othertype = str(type(geom))
        print(othertype)
        if othertype == "<type 'List[object]'>":
            innertype = str(type(geom[0]))
            if innertype=="<type 'PolylineCurve'>":
                print("PCrv")
                ot = otype["7"]
            if innertype=="<type 'Point3d'>":
                print("PT3D")
                ot = otype["3"]
        if othertype == "<type 'Plane'>":
            ot = otype["5"]
        if othertype == "<type 'instance'>":
            if geom.type == "text":
                ot = otype["6"]
            if geom.type == "image":
                ot = otype["9"]
    return(ot(geom,prop))
P = map(lambda g,p: Convert(g,p), G,P)
if T == 0:
    print(P)
    O = [{"type":"FeatureCollection", "features":P}]
if T == 1:
    O = json.dumps({"type":"FeatureCollection", "features":P})
L = log
# ---------- end python ----------
output = ClusterOutput(python)  # ArchiJSON Output

# ==== cluster DrawSVG: Creates SVG output from ArchiJSON objects. Version 18.09.10
objects = ClusterInput()  # ArchiJSON obects
css = ClusterInput()  # CSS Text
layout = ClusterInput()  # Layout Object
python = PythonScript(OBJECTS=objects, LAYOUT=layout, CSS=css)  # -> SVG; inputs OBJECTS: list, CSS: list
# ---------- python: Python ----------
import rhinoscriptsyntax as rs
import sys
import json
import inspect
import Rhino as r
from string import Template

log = []
#The inputs to this node will be stored as a list in the IN variables.
in1 = OBJECTS
def checkRB(ob):
    if str(type(ob)) == "<type 'str'>":
        return json.loads(ob)
    else:
        return ob
in1 = list(map(lambda u: checkRB(u),in1))
array = []
def featurecollection(o):
    for i in o["features"]:
        fCall = function_mappings[i['geometry']['type']]
        props = {}
        try:
            props = i['properties']
        except:
            pass
        obarray.append(fCall(i['geometry'],props))
def feature(o):
    pass
def point(o,w=True):
    pt = r.Geometry.Point3d(o[0],o[1],o[2])
    remap = r.Geometry.Plane.RemapToPlaneSpace(lPlane, pt)
    rpt = remap[1]
    rpt = [rpt[0]/layout['scale'],-1*rpt[1]/layout['scale'],rpt[2]/layout['scale']]
    pt = str(remap[1][0]/layout['scale'])+","+str(remap[1][1]/layout['scale']*-1)
    if w:
        return pt
    else:
        return rpt


def line(o, props):
    #<polyline points="118.85,155.3 118.85,180.7" class="FOPActual" zindex="10"/>
    pts = map(lambda i: point(i,False), o['coordinates'])
    propString = []
    for k in props:
        print(k)
        print(props[k])
        propString.append(str(k)+'=\"'+str(props[k])+'\"')
    pString = " ".join(propString)
    pline = '<line x1="'+str(pts[0][0])+'" y1="'+str(pts[0][1])+'" x2="'+str(pts[1][0])+'" y2="'+str(pts[1][1])+'" '+pString+'/>'
    #pline = NurbsCurve.ByControlPoints(polarray,1,o['properties']['closed'])
    return pline


def polyline(o, props):
    #<polyline points="118.85,155.3 118.85,180.7" class="FOPActual" zindex="10"/>
    polarray = []
    for p in o['coordinates']:
        pt = point(p)
        polarray.append(pt)
    pts = " ".join(polarray)
    propString = []
    for k in props:

        propString.append(str(k)+'=\"'+str(props[k])+'\"')
    pString = " ".join(propString)
    if o['closed']:
        pline = '<polygon points=\"'+pts+'\" '+pString+'/>'
    else: 
        pline = '<polyline points=\"'+pts+'\" '+pString+'/>'
    #pline = NurbsCurve.ByControlPoints(polarray,1,o['properties']['closed'])
    return pline

def text(o, props):
    #<text class="CLASS" zindex="500" transform="matrix(1 0 0 1 210 148.5)">TEXT</text> 
    propString = []
    for k in props:
        propString.append(str(k)+'=\"'+str(props[k])+'\"')
    pString = " ".join(propString)
    gm = o['coordinates']
    planeorigin = [gm[3],gm[7],gm[11]]
    planeremap = point(planeorigin,False)
    matrix = [str(gm[0]), str(gm[1]),str(gm[4]),str(gm[5]), str(planeremap[0]), str(planeremap[1])]
    matrixtext = " ".join(matrix)
    text = '<text '+pString+' transform="matrix(%s)">%s</text>'%(matrixtext,o['content'])
    print text
    return text
def image(o, props):
    #<image width="132.543857" height="132.543857" transform="matrix(-0.173648 -0.984808 0.984808 -0.173648 28.869475 131.454367)" xlink:href="K:\Computational Design Group\20.png"'"/>
    propString = []
    for k in props:
        propString.append(str(k)+'=\"'+str(props[k])+'\"')
    pString = " ".join(propString)
    gm = o['coordinates']
    yvec = [gm[1]*o['height'],gm[5]*o['height'],gm[9]*o['height']]
    planeorigin = [gm[3]+yvec[0],gm[7]+yvec[1],gm[11]+yvec[2]]
    planeremap = point(planeorigin,False)
    imgPlane = r.Geometry.Plane(r.Geometry.Point3d(gm[3],gm[7],gm[11]),r.Geometry.Vector3d(gm[0],gm[4],gm[8]),r.Geometry.Vector3d(gm[1],gm[5],gm[9]))
    worldPlane = r.Geometry.Plane(r.Geometry.Point3d(0,0,0),r.Geometry.Vector3d(1,0,0),r.Geometry.Vector3d(0,1,0))
    transform = r.Geometry.Transform.PlaneToPlane(lPlane,worldPlane)
    imgPlane.Transform(transform)
    npln = [imgPlane.XAxis.X,imgPlane.YAxis.X,imgPlane.ZAxis.X,imgPlane.OriginX,imgPlane.XAxis.Y,imgPlane.YAxis.Y,imgPlane.ZAxis.Y,imgPlane.OriginY,imgPlane.XAxis.Z,imgPlane.YAxis.Z,imgPlane.ZAxis.Z,imgPlane.OriginZ,0,0,0,1]
    matrix = [str(npln[0]), str(npln[1]),str(npln[4]),str(npln[5]), str(planeremap[0]), str(planeremap[1])]
    matrixtext = " ".join(matrix)
    text = '<image transform="matrix(%s)" width="%s" height="%s" xlink:href="%s"/>'%(matrixtext,o['width']/layout['scale'],o['height']/layout['scale'],o['image'])
    print text
    return text
function_mappings = {
        'FeatureCollection':featurecollection,
        'Feature': feature,
        'polyline': polyline,
        'line': line,
        'text': text,
        'image':image,
}
obarray = []
layout = json.loads(LAYOUT)
lPlane = layout['plane']
lOrigin = r.Geometry.Point3d(lPlane[0][0],lPlane[0][1],lPlane[0][2])
lXAx = r.Geometry.Vector3d(lPlane[1][0],lPlane[1][1],lPlane[1][2])
lYAx = r.Geometry.Vector3d(lPlane[2][0],lPlane[2][1],lPlane[2][2])
lPlane = r.Geometry.Plane(lOrigin,lXAx,lYAx)
for i in in1:
    if i["type"]:
        fCall = function_mappings[i['type']]
        fCall(i)
    else:
        fCall = function_mappings[i['geometry']['type']]
        obarray.append(fCall(i['geometry']))

#OUT = log
template =Template("""<?xml version="1.0" encoding="utf-8"?>
<!-- Generator: Grasshopper 1.0.0, Redback Plugin. SVG Version: 6.00 Build 0) Made by Andrew Butler at Cox Architecture -->
<!DOCTYPE svg PUBLIC "-//W3C//DTD SVG 1.1//EN" "http://www.w3.org/Graphics/SVG/1.1/DTD/svg11.dtd">
<svg version="1.1" xmlns="http://www.w3.org/2000/svg" xmlns:xlink="http://www.w3.org/1999/xlink" x="0px" y="0px"
width="${width}mm" height="${height}mm" viewBox="0 0 ${width} ${height}" xml:space="preserve">
<style type="text/css">
$css
</style>
$svg
</svg>""")
print(layout)
svgdict = {'svg':"\n".join(obarray),'width':layout['page'][0],'height':layout['page'][1],'css':"\n".join(CSS)}
svgfull = template.substitute(svgdict)
SVG = svgfull.split("\n")
# ---------- end python ----------
svg = ClusterOutput(python)  # SVG output
