# Grasshopper definition Curve method.ghx (Grasshopper 1.0.7)
# plug-ins: treesloth01, Human, Bifocals

panel = Panel("""Curve
Curve
Curve
Curve""")
dpipeline = DynamicGeometryPipeline(
    LayerFilter="Layer 01::Input Curves",
    TypeFilter="Curve",
    NameFilter="*",
    GroupByLayer=False,
    GroupByType=False,
    IncludeHidden=True,
    IncludeLocked=True,
    enableFullPath=True,
    listenToAttributes=True)
panel_2 = Panel("""Y
Y
X
X""")

# ---- group: Cluster
tower_by_curves = TowerByCurves(geo=dpipeline)  # -> roof_2, roof_properties_2, full_mass_3, full_mass_properties_2, facade_3, facade_properties_2, floorplates_2, floorplate_properties_2

# ----
panel_3 = Panel("""Resi
Comm
Resi
Resi""")
panel_4 = Panel("""3
3
3
3""")
panel_5 = Panel("""3
15
23
19""")
panel_6 = Panel("""A
A
A
A""")
output = DataOutput(
    Roofs=tower_by_curves.roof_2,
    Roof_Properties=tower_by_curves.roof_properties_2,
    Full_Mass=tower_by_curves.full_mass_3,
    Full_Mass_Properties=tower_by_curves.full_mass_properties_2,
    Facade=tower_by_curves.facade_3,
    Facade_Properties=tower_by_curves.facade_properties_2,
    Floorpates=tower_by_curves.floorplates_2,
    Floorplates_Properties=tower_by_curves.floorplate_properties_2,
    Destination="C:\Users\b-mbuckley\Documents\Hackathon2018\Curve Method.ghdata")
entwine = Entwine(Branch00=panel_2, Branch01=panel_3, Branch02=panel_4, Branch03=panel_5, Branch04=panel_6, FlattenInputs=True)  # -> simplify(Result)

keysearch = KeyValueSearch(Search="BuildID")
keysearch_2 = KeyValueSearch(Search="SubBuildID")
bucketsimitems = BucketSimItems(flatlist=flatten(keysearch), synchronous=flatten(keysearch_2))  # -> buckets_2, synchbuckets_2, synchbuckets2_2, synchbuckets3_2
panel_7 = Panel(keysearch_2)
explode = Explode(Curve=bucketsimitems.synchbuckets2_2, Recursive=True)  # -> Segments, Vertices
panel_8 = Panel(bucketsimitems.buckets_2)
item = ListItem(List=explode.Vertices, Index=0, Wrap=True)
pdecon = Deconstruct(Point=item)  # -> XComponent, YComponent, ZComponent
shift = ShiftPaths(Data=pdecon.ZComponent, Offset=-1)
sort = SortList(Keys=shift, ValuesA=bucketsimitems.synchbuckets2_2)  # -> Keys, ValuesA
branch = TreeBranch(Tree=sort.ValuesA, Path=Slider(0, range=0..1), MaintainPaths=True)
project = Project(Geometry=sort.ValuesA, Plane=PlaneXY(0, 0, 0))  # -> Geometry, Transform
crossref = CrossReference(ListA=project.Geometry, ListB=project.Geometry, CrossMode=1)  # -> ListA, ListB
ccx = CurveCurve(CurveA=crossref.ListA, CurveB=crossref.ListB)  # -> Points, ParamsA, ParamsB
panel_9 = Panel(sort.ValuesA)

input = DataInput(Destination="C:\Users\b-mbuckley\Documents\Hackathon2018\Curve Method.ghdata")  # -> Roofs, Roof_Properties, Full_Mass, Full_Mass_Properties, Facade, Facade_Properties, Floorpates, Floorplates_Properties

# ==== cluster BucketSimItems
synchronous2 = ClusterInput()
flatlist = ClusterInput()
synchronous3 = ClusterInput()
synchronous = ClusterInput()
flatlist_2 = Data(flatten(flatlist))
synchronous2_2 = Data(flatten(synchronous2))
synchronous3_2 = Data(flatten(synchronous3))
synchronous_2 = Data(flatten(synchronous))
data = Data(simplify(graft(synchronous2_2)))
data_2 = Data(simplify(graft(synchronous3_2)))
data_3 = Data(simplify(graft(flatlist_2)))
data_4 = Data(simplify(graft(synchronous_2)))
cset = CreateSet(List=flatlist_2)  # -> Set, Map
mindex = MemberIndex(Set=cset.Set, Member=flatlist_2)  # -> flatten(Index), Count
viewer = ParamViewer(data_3)
replace = ReplacePaths(Data=data_3, Search=viewer, Replace=mindex.Index)
replace_2 = ReplacePaths(Data=data, Search=viewer, Replace=mindex.Index)
replace_3 = ReplacePaths(Data=data_2, Search=viewer, Replace=mindex.Index)
replace_4 = ReplacePaths(Data=data_4, Search=viewer, Replace=mindex.Index)
buckets = Data(replace)
synchbuckets2 = Data(replace_2)
synchbuckets3 = Data(replace_3)
synchbuckets = Data(replace_4)
buckets_2 = ClusterOutput(buckets)
synchbuckets2_2 = ClusterOutput(synchbuckets2)
synchbuckets3_2 = ClusterOutput(synchbuckets3)
synchbuckets_2 = ClusterOutput(synchbuckets)

# ==== cluster TowerByCurves
geo = ClusterInput()
geo_2 = Geometry(geo)
clockcrv = ClockwiseCurve(crv=geo_2)
data = Data(clockcrv)
objatts = ObjectAttributes(ObjectOrAttributes=data)  # -> Name, LayerName, LayerFullPath, Color, MaterialName, LinetypeName, GroupIndices, PlotWeight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
getuv = GetUserValue(Geometry=data, Key="Levels")
getuv_2 = GetUserValue(Geometry=data, Key="BuildID")
getuv_3 = GetUserValue(Geometry=data, Key="F2F")
getuv_4 = GetUserValue(Geometry=data, Key="SubBuildID")
panel = Panel("""BuildID
Typology
F2F
Levels
SubBuildID""")
json = JSON(Key=objatts.UserDataKeys, Value=objatts.UserDataValues)
read = ReadJSON(Object=json, Key=panel)
getuv_5 = GetUserValue(Geometry=read, Key="Typology")
json_2 = JSON(Key=objatts.UserDataKeys, Value=objatts.UserDataValues)
flip = FlipMatrix(Data=read)
branch = TreeBranch(Tree=simplify(flip), Path="3", MaintainPaths=True)  # -> graft(Branch)
branch_2 = TreeBranch(Tree=simplify(flip), Path="2", MaintainPaths=True)  # -> graft(Branch)
branch_3 = TreeBranch(Tree=flip, Path="0", MaintainPaths=True)
branch_4 = TreeBranch(Tree=flip, Path="4", MaintainPaths=True)
addition = Addition(A=branch, B=1)
concat = Concatenate(FragmentA=branch_3, FragmentB=branch_4)
series = Series(Start=0, Step=branch_2, Count=addition)  # -> simplify(Series)
panel_2 = Panel(concat)
python = GhPythonScript(ID=concat)  # -> StackID
# ---------- python: Python ----------
__author__ = "B-MBuckley"
__version__ = "2018.10.25"

import rhinoscriptsyntax as rs

StackID = []

for i in range(len(ID)-1):
    StackID.append(ID[0:i+1])
# ---------- end python ----------
item = ListItem(List=series, Index=0, Wrap=True)  # -> flatten(Item1), Item
read_2 = ReadJSON(Object=json, Key="BuildID")  # -> flatten(Value)
read_3 = ReadJSON(Object=json, Key="SubBuildID")  # -> flatten(Value)
read_4 = ReadJSON(Object=json, Key="Typology")  # -> flatten(Value)
panel_3 = Panel(item.Item1)
mindex = MemberIndex(Set=panel_2, Member=python)  # -> Index, Count
cset = CreateSet(List=flatten(read_2))  # -> Set, Map
item_2 = ListItem(List=panel_3, Index=mindex.Index, Wrap=True)
mindex_2 = MemberIndex(Set=flatten(read_2), Member=cset.Set)  # -> Index, Count
trim = TrimTree(Tree=item_2, Depth=1)
item_3 = ListItem(List=read_4, Index=mindex_2.Index, Wrap=True)  # -> simplify(Item)
item_4 = ListItem(List=read_3, Index=mindex_2.Index, Wrap=True)
ma = MassAddition(Input=trim)  # -> Result, PartialResults
item_5 = ListItem(List=read_2, Index=mindex_2.Index, Wrap=True)
tsort = SortText(Keys=item_4, Values=item_5, Culture=127)  # -> Keys, Values
nullrep = ReplaceNulls(Items=ma.Result, Replacements="0")  # -> Items, Count
tsort_2 = SortText(Keys=item_4, Values=item_3, Culture=127)  # -> Keys, Values
addition_2 = Addition(A=nullrep.Items, B=series)
graft = GraftTree(Tree=tsort_2.Values, IncludeEmptyLists=True, IncludeNullItems=True)
graft_2 = GraftTree(Tree=tsort.Values, IncludeEmptyLists=True, IncludeNullItems=True)
graft_3 = GraftTree(Tree=tsort.Keys, IncludeEmptyLists=True, IncludeNullItems=True)
data_2 = Data(addition_2)
pt = ConstructPoint(XCoordinate=0, YCoordinate=0, ZCoordinate=data_2)
xy = XYPlane(Origin=pt)
project = Project(Geometry=graft(data), Plane=xy)  # -> simplify(Geometry), Transform
boundary = BoundarySurfaces(Edges=project.Geometry)
cull_i = CullIndex(List=boundary, Indices=-1, Wrap=True)
group = Group(Objects=cull_i)  # -> flatten(Group)
item_6 = ListItem(List=group, Index=mindex_2.Index, Wrap=True)
tsort_3 = SortText(Keys=item_4, Values=item_6, Culture=127)  # -> Keys, Values
ungroup = Ungroup(Group=tsort_3.Values)  # -> simplify(Objects)
lng = ListLength(List=ungroup)
dup = DuplicateData(Data=graft, Number=lng, Order=True)  # -> simplify(Data)
dup_2 = DuplicateData(Data=graft_2, Number=lng, Order=True)  # -> simplify(Data)
geo_3 = Geometry(ungroup)
dup_3 = DuplicateData(Data=graft_3, Number=lng, Order=True)  # -> simplify(Data)
area = Area(Geometry=geo_3)  # -> Area, Centroid
xy_2 = XYPlane(Origin=area.Centroid)
pdecon = Deconstruct(Point=area.Centroid)  # -> XComponent, YComponent, simplify(ZComponent)
group_2 = Group(Objects=xy_2)
merge = Merge(
    Data1=simplify(graft(pdecon.ZComponent)),
    Data2=simplify(graft(dup)),
    Data3=simplify(graft(dup_3)),
    Data4=simplify(graft(dup_2)))  # -> simplify(Result)
panel_4 = Panel("""RL
Typology
SubBuildID
BuildID""")
first_last = FirstLast(List=project.Geometry)  # -> FirstValue, LastValue
first_last_2 = FirstLast(List=project.Geometry)  # -> FirstValue, LastValue
first_last_3 = FirstLast(List=boundary)  # -> FirstValue, LastValue
first_last_4 = FirstLast(List=boundary)  # -> FirstValue, LastValue
first_last_5 = FirstLast(List=boundary)  # -> FirstValue, LastValue
json_3 = JSON(Key=panel_4, Value=merge)
panel_5 = Panel(xy_2)
facade = Loft(
    Curves=[first_last.FirstValue, first_last_2.LastValue],
    Options={Adjust=False, Closed=False, LoftEnds=0, LoftSimp=0, LoftType=0, Rebuild=10, Refit=0.01})  # -> simplify(Loft)
geo_4 = Geometry(flatten(facade))
item_7 = ListItem(List=geo_4, Index=mindex_2.Index, Wrap=True)
tsort_4 = SortText(Keys=item_4, Values=item_7, Culture=127)  # -> Keys, simplify(Values)
branch_5 = TreeBranch(Tree=tsort_4.Values, Path=Slider(0, range=0..100), MaintainPaths=True)
graft_4 = GraftTree(Tree=tsort_4.Values, IncludeEmptyLists=True, IncludeNullItems=True)
debrep = DeconstructBrep(Brep=graft_4)  # -> simplify(Faces), Edges, Vertices
long = LongestList(ListA=debrep.Faces, ListB=group_2, PaddingMode=2)  # -> graft(ListA), ListB
ungroup_2 = Ungroup(Group=long.ListB)
sec = BrepPlane(Brep=long.ListA, Plane=ungroup_2)  # -> Curves, Points
index = ItemIndex(List=boundary, Item=first_last_4.LastValue)
rint = RegionIntersection(CurvesA=flatten(first_last_5.FirstValue), CurvesB=first_last_5.LastValue)
geo_5 = Geometry(geo_3)
trim_2 = TrimTree(Tree=json_3, Depth=1)
sdiff = SolidDifference(BrepsA=first_last_5.LastValue, BrepsB=flatten(first_last_5.FirstValue))
shift = ShiftPaths(Data=sec.Curves, Offset=-1)
boundary_2 = BoundarySurfaces(Edges=rint)
number_slider = Slider(5, range=0..10)
srfsplit = SurfaceSplit(Surface=long.ListA, Curves=shift)
sdiff_2 = SolidDifference(BrepsA=first_last_5.LastValue, BrepsB=flatten(boundary_2))
trim_3 = TrimTree(Tree=srfsplit, Depth=1)
group_3 = Group(Objects=sdiff_2)
trim_4 = TrimTree(Tree=trim_3, Depth=1)
item_8 = ListItem(List=flatten(group_3), Index=mindex_2.Index, Wrap=True)
branch_6 = TreeBranch(Tree=trim_4, Path="0,0", MaintainPaths=True)
area_2 = Area(Geometry=trim_4)  # -> Area, Centroid
tsort_5 = SortText(Keys=item_4, Values=item_8, Culture=127)  # -> Keys, simplify(Values)
lng_2 = ListLength(List=debrep.Faces)
pdecon_2 = Deconstruct(Point=area_2.Centroid)  # -> XComponent, YComponent, ZComponent
ungroup_3 = Ungroup(Group=tsort_5.Values)
sort = SortList(Keys=pdecon_2.ZComponent, ValuesA=trim_4)  # -> Keys, ValuesA
full_mass = CapHoles(Brep=facade)  # -> simplify(Brep)
trim_5 = TrimTree(Tree=ungroup_3, Depth=1)
panel_6 = Panel("""Typology
SubBuildID
BuildID""")
merge_2 = Merge(Data1=simplify(graft(dup)), Data2=simplify(graft(dup_3)), Data3=simplify(graft(dup_2)))  # -> simplify(Result)
partition = PartitionList(List=sort.ValuesA, Size=lng_2)
merge_3 = Merge(Data1=simplify(graft(dup_2)))  # -> simplify(Result)
item_9 = ListItem(List=flatten(full_mass), Index=mindex_2.Index, Wrap=True)
join = BrepJoin(Breps=partition)  # -> simplify(Breps), Closed
tsort_6 = SortText(Keys=item_4, Values=item_9, Culture=127)  # -> Keys, simplify(Values)
panel_7 = Panel("""Typology
SubBuildID
BuildID""")
merge_4 = Merge(Data1=simplify(graft(dup)), Data2=simplify(graft(dup_3)), Data3=simplify(graft(dup_2)))  # -> simplify(Result)
json_4 = JSON(Key=panel_6, Value=merge_2)
json_5 = JSON(Key="BuildID", Value=merge_3)
roof = Data(trim_5)
sunion = SolidUnion(Breps=tsort_6.Values)
trim_6 = TrimTree(Tree=json_4, Depth=2)
full_mass_properties = Data(json_5)
branch_7 = TreeBranch(Tree=sunion, Path=Slider(0, range=0..100), MaintainPaths=True)
json_6 = JSON(Key=panel_7, Value=merge_4)
full_mass_2 = Data(simplify(graft(sunion)))
roof_properties = Data(trim_6)
trim_7 = TrimTree(Tree=join.Breps, Depth=2)
trim_8 = TrimTree(Tree=json_6, Depth=2)
trim_9 = TrimTree(Tree=trim_2, Depth=1)
trim_10 = TrimTree(Tree=geo_5, Depth=1)
floorplate_properties = Data(trim_9)
facade_properties = Data(trim_8)
floorplates = Data(trim_10)
facade_2 = Data(trim_7)
floorplate_properties_2 = ClusterOutput(floorplate_properties)
full_mass_properties_2 = ClusterOutput(full_mass_properties)
facade_properties_2 = ClusterOutput(facade_properties)
roof_properties_2 = ClusterOutput(roof_properties)
full_mass_3 = ClusterOutput(full_mass_2)
floorplates_2 = ClusterOutput(floorplates)
facade_3 = ClusterOutput(facade_2)

# ---- group: Cluster Output
roof_2 = ClusterOutput(roof)

# ==== cluster ClockwiseCurve: Reorders controlpoints of curve to clockwise
crv = ClusterInput()
crv_2 = Curve(crv)
cp = ControlPoints(Curve=crv_2)  # -> simplify(Points), Weights, Knots
shift = ShiftList(List=cp.Points, Shift=1, Wrap=True)
pdecon = Deconstruct(Point=cp.Points)  # -> XComponent, YComponent, ZComponent
pdecon_2 = Deconstruct(Point=shift)  # -> XComponent, YComponent, ZComponent
expression = Expression(x=pdecon.XComponent, y=pdecon_2.XComponent, z=pdecon.YComponent, u=pdecon_2.YComponent, Expression="(y-x)*(u+z)")
ma = MassAddition(Input=expression)  # -> Result, PartialResults
larger = LargerThan(FirstNumber=ma.Result, SecondNumber=0)  # -> simplify(LargerThan), OrEqualTo
dispatch = Dispatch(List=simplify(graft(crv_2)), DispatchPattern=larger.LargerThan)  # -> ListA, ListB
flip = FlipCurve(Curve=dispatch.ListB)  # -> Curve, Flag
merge = Merge(Data1=dispatch.ListA, Data2=flip.Curve)  # -> simplify(flatten(Result))
unflatten = UnflattenTree(Tree=merge, Guide=crv_2)
crv_3 = Curve(unflatten)
crv_4 = ClusterOutput(crv_3)
