# Grasshopper definition GHtoExcel.gh (Grasshopper 1.0.7)

# 06: Sequential Recording
# A new feature, Record, allows single items or list of data to be streamed sequentially by column or row, recording data as it changes
panel = Panel("{2,3,1}")
# 05: Correlated Data
# Data tree's can be transferred to sheets in the following Structure
# {S;C}(R)
# {Sheet ; Column} (Row)
# Any preceeding branches will be truncated into this structure
# {A;B;S;C}(R) = {S;C}(R)
panel_2 = Panel("""{3,1,1}
{3,1,2}
{3,1,3}""")
press_me = Button()
panel_3 = Panel("""Value
Recorded
On
Sheet1
Equals""")
move_this_slider = Slider(6, range=1..10)
toggle_me = BooleanToggle(True)
panel_4 = Panel("""I
Am
Column
C
On
Sheet1""")
panel_5 = Panel("""I
Am
Column
C
On
Sheet2""")
pt = Point(panel_2)
panel_6 = Panel("""I
Am
Column
C
On
Sheet3""")
merge = Merge(Data1=graft(panel_4), Data2=graft(panel_5), Data3=graft(panel_6))
merge_2 = Merge(Data1=panel_3, Data2=move_this_slider)
flip = FlipMatrix(Data=merge)  # -> simplify(graft(Data))
panel_7 = Panel("Data tables")
panel_8 = Panel("Group titles")
panel_9 = Panel("Totals")
panel_10 = Panel("Data headings")
xl_data_record = XLDataRecordStream(Origin=panel, Data=merge_2, ByColumn=False, Stream=toggle_me)  # -> out, A, B; inputs XL_Path: list, Origin: Point3d, Data: list, XL_Fill: list, XL_Line: list, XL_Font: list
# ---------- xl_data_record: VB ----------
    Component.Params.Input(0).Name = "Path"
    Component.Params.Input(0).Description = "Optional input for the XL Path component which specifies the target Workbook and Sheet. If blank the active workbook and worksheet is used, or the worksheet index supplied by an origin component"
    Component.Params.Input(1).Name = "Data Origin"
    Component.Params.Input(1).Description = "Optional point list input which specifies the lower bounds to which data will be written where X = Row, Y = Column, and Z = Sheet Index. If Z = 0 the active sheet will be used. If input is empty cell A1 will be used"
    Component.Params.Input(2).Name = "Data"
    Component.Params.Input(2).Description = "Input for generic data which will be converted into number or text. The first branch of the tree specifies the column location relative to the origin and the list the row location. The second branch specifies the provided sheet index if more than one sheet has been specified from the origin"
    Component.Params.Input(3).Name = "By Column"
    Component.Params.Input(3).Description = "Sets if data will be transposed"
    Component.Params.Input(4).Name = "XL Fill"
    Component.Params.Input(4).Description = "Input for the XL Fill component which will specify the cell's background fill formatting"
    Component.Params.Input(5).Name = "XL Line"
    Component.Params.Input(5).Description = "Input for the XL Line component which will specify the cell's border formatting"
    Component.Params.Input(6).Name = "XL Font"
    Component.Params.Input(6).Description = "Input for the XL Font component which will specify the cell's font formatting"
    Component.Params.Input(7).Name = "Stream"
    Component.Params.Input(7).Description = "If true, data will be written"

    Component.Params.Output(0).Name = "Origin"
    Component.Params.Output(0).Description = "List output of points which specify the lower bounds of written data"
    Component.Params.Output(1).Name = "Bound"
    Component.Params.Output(1).Description = "List output of points which specify the upper bounds of written data"

    If _Stream = True Then

      If data.Count() > 0 Then

        Dim objExcel, excelWorkbook, excelSheet As Object

        If XL_Path.Count() > 1 Then
          objExcel = XL_Path.item(0)
          excelWorkbook = XL_Path.item(1)
          excelSheet = XL_Path.item(2)
        Else
          Dim oldCI As System.Globalization.CultureInfo = system.Threading.Thread.CurrentThread.CurrentCulture
          System.Threading.Thread.CurrentThread.CurrentCulture = New System.Globalization.CultureInfo("en-US")

          'Access Active Session of Excel if no Path is specified
          objExcel = System.Runtime.InteropServices.Marshal.GetActiveObject("Excel.Application")
          excelWorkbook = objExcel.activeWorkbook
          excelSheet = objExcel.ActiveSheet
        End If
        objExcel.screenUpdating = False
        '#############################################

        ' Begin Formatting and Populating Data
        Dim i,t As Integer
        Dim Xmax,Ymax As Integer
        Dim cnt As New list(Of Integer)
        Dim blnP, blnL, blnF As Boolean
        Dim ptA, ptB As New list(Of point3d)
        Dim org,bnd As point3d

        Ymax = excelSheet.usedrange.columns(excelSheet.usedrange.columns.count).column
        Xmax = excelSheet.usedrange.rows(excelSheet.usedrange.rows.count).row


        ' if there is no origin specified use first open cell
        If Origin = Nothing Then
          If byColumn Then
            Origin.X = Ymax
            Origin.Y = 1
          Else
            Origin.X = 1
            Origin.Y = Xmax
          End If
        Else
          If ymax < origin.x Then ymax = origin.x - 1
          If xmax < origin.y Then xmax = origin.y - 1
        End If

        If objExcel.WorksheetFunction.CountA(excelSheet.range(excelSheet.cells(xmax, ymax), excelSheet.cells(xmax, ymax))) = 0 Then
          If origin.x = yMax Then yMax = yMax - 1
          If origin.y = xMax Then xmax = xmax - 1
        End If

        Dim rng As Object
        If byColumn Then
          org.X = ymax + 1
          org.y = origin.y
          bnd.x = ymax + 1
          bnd.y = origin.y + Data.count() - 1
        Else
          org.X = origin.x
          org.y = xmax + 1
          bnd.x = origin.x + Data.count() - 1
          bnd.y = xmax + 1
        End If

        'specify a range in excel and stream data
        rng = excelSheet.Range(excelSheet.Cells(org.Y, org.X), excelSheet.Cells(bnd.Y, bnd.X))

        If byColumn Then
          rng.value = objExcel.transpose(TreeToArr(Data))
        Else
          rng.value = TreeToArr(Data)
        End If

        ' Begin Formatting

        'Set the fill formatting
        If XL_Fill.count() > 0 Then
          blnP = True
          If XL_Fill.count() = 1  Then
            Call FillFormat(rng, XL_Fill.item(0))
            blnP = False
          End If
        End If

        'Set the fill formatting
        If XL_Line.count() > 0 Then
          blnL = True
          If (XL_Line.count() = 1) And (CBool(Split(XL_Line.item(0), "~")(5).trim()) = False) Then
            Call LineFormat(rng, XL_Line.item(0))
            blnL = False
          End If
        End If

        'Set the font formatting
        If XL_Font.count() > 0 Then
          blnF = True
          If XL_Font.count() = 1 Then
            Call FontFormat(rng, XL_Font.item(0))
            blnF = False
          End If
        End If

        For i = 0 To Data.count() - 1 Step 1

          If blnP Then
            If i > XL_Fill.count() - 1 Then t = XL_Fill.count - 1 Else t = i
            If byColumn Then
              Call FillFormat(excelSheet.Cells(org.Y + i, org.X), CStr(XL_Fill.item(t)))
            Else
              Call FillFormat(excelSheet.Cells(org.Y, org.X + i), CStr(XL_Fill.item(t)))
            End If
          End If

          If blnL Then
            If i > XL_Line.count() - 1 Then t = XL_Line.count - 1 Else t = i
            If byColumn Then
              Call LineFormat(excelSheet.Cells(org.Y + i, org.X), CStr(XL_Line.item(t)))
            Else
              Call LineFormat(excelSheet.Cells(org.Y, org.X + i), CStr(XL_Line.item(t)))
            End If
          End If

          If blnF Then
            If i > XL_Font.count() - 1 Then t = XL_Font.count - 1 Else t = i
            If byColumn Then
              Call FontFormat(excelSheet.Cells(org.Y + i, org.X), CStr(XL_Font.item(t)))
            Else
              Call FontFormat(excelSheet.Cells(org.Y, org.X + i), CStr(XL_Font.item(t)))
            End If
          End If
        Next

        objExcel.screenUpdating = True

        A = New point3d(excelSheet.usedrange.column, excelSheet.usedrange.row, excelSheet.Index)
        B = New point3d(excelSheet.usedrange.columns(excelSheet.usedrange.columns.count).column, excelSheet.usedrange.rows(excelSheet.usedrange.rows.count).row, excelSheet.Index)
      End If
    End If
# ---------- xl_data_record: VB additional code ----------
  'Cell Fill format
  Private Function FillFormat(ByVal obj As Object, ByVal strOptions As String)
    Dim arrOpt() As String = Split(strOptions, "~")
    Dim clrB() As String = Split(arrOpt(2), ",")
    Dim clrF() As String = Split(arrOpt(1), ",")
    With obj
      .Interior.Pattern = CInt(arrOpt(0))
      .Interior.Patterncolor = RGB(CInt(clrF(0).trim()), CInt(clrF(1).trim()), CInt(clrF(2).trim()))
      .Interior.color = RGB(CInt(clrB(0).trim()), CInt(clrB(1).trim()), CInt(clrB(2).trim()))

    End With
    Return Nothing
  End Function

  'Cell Line format
  Private Function LineFormat(ByVal obj As Object, ByVal strOptions As String)
    Dim arrOpt() As String = Split(strOptions, "~")
    Dim clrF() As String = Split(arrOpt(2), ",")
    With obj
      .BorderAround(CInt(arrOpt(0)), CInt(arrOpt(1)),, RGB(CInt(clrF(0).trim()), CInt(clrF(1).trim()), CInt(clrF(2).trim())))
    End With
    Return Nothing
  End Function

  'Sets font properties
  Private Function FontFormat(ByVal obj As Object, ByVal strOptions As String)
    Dim arrOpt() As String = Split(strOptions, "~")
    Dim clrF() As String = Split(arrOpt(1), ",")
    With obj
      .Font.Name = CStr(arrOpt(8).trim())
      .Font.Size = CInt(arrOpt(0).trim())
      .Font.Color = RGB(CInt(clrF(0).trim()), CInt(clrF(1).trim()), CInt(clrF(2).trim()))
      .HorizontalAlignment = CInt(arrOpt(2).trim())
      .VerticalAlignment = CInt(arrOpt(3).trim())
      .Font.Bold = CBool(arrOpt(4).trim())
      .Font.Italic = CBool(arrOpt(5).trim())
      .Font.Underline = CBool(arrOpt(6).trim())
      .Font.Strikethrough = CBool(arrOpt(7).trim())
    End With
    Return Nothing
  End Function

  Private Function TreeToArr(ByVal arrList As List(Of Object))

    Dim i,x,y As Integer

    x = 0
    y = arrList.count() - 1

    Dim arrOut(x,y) As Object

    For i = 0 To y Step 1
      arrOut(0, i) = arrList.item(i)
    Next

    Return arrOut
  End Function
  Function remapTree(ByVal arrTree As datatree(Of Object))
    If arrTree.branchcount() > 0 Then
      Dim i,j,k,m,r,s As Integer
      Dim uTree,tTree As New datatree(Of Object)
      Dim sTree As New list(Of datatree(Of Object))

      If uBound(arrTree.Paths.item(0).indices()) > 1 Then
        For i = 0 To arrTree.branchcount() - 1 Step 1
          Dim tPath As gh_path
          Dim tint() As int32
          tPath = arrTree.Paths.item(i)
          tint = tPath.Indices

          If uBound(tint) > 0 Then
            For j = 0 To arrTree.Branch(i).Count() - 1 Step 1
              uTree.add(arrTree.Branch(i).item(j), New gh_path({tint(uBound(tint) - 1),tint(uBound(tint))}))
            Next
          Else
            For j = 0 To arrTree.Branch(i).Count() - 1 Step 1
              uTree.add(arrTree.Branch(i).item(j), New gh_path({0,i}))
            Next
          End If
        Next
      Else
        uTree = arrTree
      End If

      If uBound(uTree.Paths.item(0).indices()) > 0 Then
        k = uTree.Paths.item(0).indices(uBound(uTree.Paths.item(0).indices()) - 1)
        For i = 0 To uTree.branchcount() - 1 Step 1
          Dim tPath As gh_path
          Dim tint() As int32
          tPath = uTree.Paths.item(i)
          tint = tPath.Indices

          If tint(uBound(tint) - 1) > k Then
            Dim tmpTree As New datatree(Of Object)
            For r = 0 To tTree.branchcount() - 1 Step 1
              For s = 0 To tTree.branch(r).count() - 1 Step 1
                tmpTree.add(tTree.branch(r).item(s), New gh_path(r))
              Next
            Next
            sTree.add(tmpTree)
            tTree.clear
            k = tint(uBound(tint) - 1)
            m = 0
          End If
          For j = 0 To uTree.Branch(i).Count() - 1 Step 1
            tTree.add(uTree.Branch(i).item(j), New gh_path(m))
          Next
          m += 1
        Next

        sTree.add(tTree)
      Else
        sTree.add(uTree)
      End If
      Return sTree
    Else
      Return Nothing
    End If
  End Function
  Function flipMatrix(ByVal arrVal As datatree(Of Object))
    Dim objOut As New DataTree(Of Object)
    Dim source As New GH_Lexer("{A}(B)")
    Dim target As New GH_Lexer("{B}(A)")

    GH_Lexer.PerformLexicalReplace(source, target, arrVal, objOut)

    Return objOut
  End Function
  Function lexGraft(ByVal arrVal As datatree(Of Object))
    Dim objOut As New DataTree(Of Object)
    Dim source As New GH_Lexer("{A}(i)")
    Dim target As New GH_Lexer("{A;0}(i)")

    GH_Lexer.PerformLexicalReplace(source, target, arrVal, objOut)

    Return objOut
  End Function
# ---------- end xl_data_record ----------
json_file = Panel("C:\Users\William\Desktop\BumbleBee\json.json")
excel_sheet = Panel("C:\Users\William\Desktop\BumbleBee\Book1.xlxs")
xl_data_out = XLDataOut(Origin=pt, Data=flip, ByColumn=Toggle(False), Stream=press_me)  # -> A, B; inputs XL_Path: list, Origin: list of Point3d, Data: tree, XL_Fill: tree, XL_Line: tree, XL_Font: tree; same code as xl_data_out
cluster = Cluster(
    path_2=json_file,
    path=excel_sheet,
    bool=Toggle(False),
    color_2=ColourSwatch(SwatchColor=RGB(0, 0, 0)),
    backcolor=ColourSwatch(SwatchColor=RGB(193, 255, 181)),
    d2=ColourSwatch(SwatchColor=RGB(255, 255, 255)),
    d2_2=ColourSwatch(SwatchColor=RGB(179, 161, 196)),
    d1_2=ColourSwatch(SwatchColor=RGB(255, 255, 255)),
    d1=ColourSwatch(SwatchColor=RGB(73, 156, 146)),
    color=ColourSwatch(SwatchColor=RGB(255, 255, 255)),
    backcolor_2=ColourSwatch(SwatchColor=RGB(157, 207, 177)))

# ==== cluster Cluster
path = ClusterInput()
path_2 = ClusterInput()
path_3 = FilePath(path)
path_4 = FilePath(path_2)
bool = ClusterInput()
file = ReadFile(File=path_4, PerLineParse=True)
bool_2 = Boolean(bool)
panel = Panel(file)
backcolor = ClusterInput()
backcolor_2 = ClusterInput()
color = ClusterInput()
d1 = ClusterInput()
d2 = ClusterInput()
d2_2 = ClusterInput()
d1_2 = ClusterInput()
color_2 = ClusterInput()
panel_2 = Panel("""LevelNames
GFA
NSA""")
panel_3 = Panel("""BuildID
FSR
GBA""")
panel_4 = Panel("""Typology
F2F
NumberOfLevels""")
read = ReadJSON(Object=file, Key=panel_4)
read_2 = ReadJSON(Object=file, Key=panel_2)
# Make this dynamic so it works if people add in extra keys. Do this by sorting out list length and grouping them
read_3 = ReadJSON(Object=file, Key=panel_3)
merge = Merge(Data1=simplify(graft(panel_3)), Data2=simplify(graft(read_3)))
split = TextSplit(Text=read, Separators=",")  # -> simplify(Result)
split_2 = TextSplit(Text=read_2, Separators=",")  # -> simplify(Result)
rev = ReverseList(List=split_2)
merge_2 = Merge(Data1=simplify(graft(panel_2)), Data2=rev)
merge_3 = Merge(Data1=simplify(graft(panel_4)), Data2=split)
viewer = ParamViewer(merge_3)
number_slider = Slider(8, range=0..10)
branch = TreeBranch(Tree=merge_3, Path="{0}", MaintainPaths=True)
lng = ListLength(List=branch)
number_slider_2 = Slider(5, range=0..10)
branch_2 = TreeBranch(Tree=merge, Path="{0}", MaintainPaths=True)
lng_2 = ListLength(List=viewer)
lng_3 = ListLength(List=branch_2)
merge_4 = Merge(Data1=d1, Data2=d2_2)
addition = Addition(A=lng, B=number_slider, C=lng_3)
xl_fill = XLFillStyle(Pattern="-4105~0", BackColor=merge_4, ForeColor=Point(255, 255, 255), Opacity=0, Bevel=1)  # -> out, T; inputs BackColor: Color, ForeColor: Color
# ---------- xl_fill: VB ----------
    Component.Params.Input(0).Name = "XL Pattern Type"
    Component.Params.Input(0).Description = "Input for XL_Pattern_Type component"
    Component.Params.Input(1).Name = "Background Color"
    Component.Params.Input(1).Description = "Color input for the cell background"
    Component.Params.Input(2).Name = "Pattern Color"
    Component.Params.Input(2).Description = "Color input for the pattern"
    Component.Params.Input(3).Name = "Opacity"
    Component.Params.Input(3).Description = "Unitized input where 0 = Opaque and 1 = Transparent. (Does not affect cell color)"
    Component.Params.Input(4).Name = "XL Bevel Type"
    Component.Params.Input(4).Description = "Input for XL_Bevel_Type component. (Does not affect cell patterns)"

    Component.Params.Output(1).Name = "Excel Fill Parameters"
    Component.Params.Output(1).Description = "Formatted List of output Fill Parameters"

    Dim strOut As String

    If _Opacity = Nothing Then _Opacity = 0

    Dim patt() As String = split(_Pattern, "~")

    strOut = CStr(patt(0).trim() & "~" & CStr(CInt(_ForeColor.R) & "," & CInt(_ForeColor.G) & "," & CInt(_ForeColor.B)) & "~" & CStr(CInt(_BackColor.R) & "," & CInt(_BackColor.G) & "," & CInt(_BackColor.B)) & "~" & _Opacity & "~" & _Bevel & "~" & patt(1).trim())

    T = strOut
# ---------- end xl_fill ----------
addition_2 = Addition(A=lng_3, B=number_slider_2)
subtraction = Subtraction(A=lng_2, B=1)
pt = ConstructPoint(XCoordinate=1, YCoordinate=addition, ZCoordinate=1)
pt_2 = Point(pt)
pt_3 = ConstructPoint(XCoordinate=1, YCoordinate=addition_2, ZCoordinate=1)
dup = DuplicateData(Data="False", Number=subtraction, Order=True)
toggle = BooleanToggle(False)
dup_2 = DuplicateData(Data="10", Number=subtraction, Order=True)
pt_4 = Point(pt_3)
merge_5 = Merge(Data1="True", Data2=dup)  # -> flatten(Result)
merge_6 = Merge(Data1=Slider(15, range=0..100), Data2=dup_2)  # -> flatten(Result)
merge_7 = Merge(Data1=d1_2, Data2=d2)
xl_font = XLFontStyle(Name="Arial", Size=merge_6, Color=merge_7, Bold=merge_5)  # -> T; inputs Color: Color
# ---------- xl_font: VB ----------
    Component.Params.Input(0).Name = "Font Name"
    Component.Params.Input(0).Description = "Text input for the Name of an installed font"
    Component.Params.Input(1).Name = "Font Size"
    Component.Params.Input(1).Description = "Number input for the font size"
    Component.Params.Input(2).Name = "Font Color"
    Component.Params.Input(2).Description = "Color input for the font"
    Component.Params.Input(3).Name = "Bold"
    Component.Params.Input(3).Description = "Boolean input specifying if the font will be bold"

    Component.Params.Output(0).Name = "Excel Font Parameters"
    Component.Params.Output(0).Description = "Formatted List of output Font Parameters"

    Dim strOut As String

    Dim vert, horz,size As Integer

    horz = -4108
    vert = -4108

    If _Name = Nothing Then
      _Name = "Arial"
    End If

    If _Size = 0 Then
      size = 8
    Else
      size = _Size
    End If

    strOut = CStr(size & "~" & CStr(CInt(_Color.R) & "," & CInt(_Color.G) & "," & CInt(_Color.B)) & "~" & horz & "~" & vert & "~" & _Bold & "~" & False & "~" & False & "~" & False & "~" & _Name)

    T= strOut
# ---------- end xl_font ----------
pt_5 = Point("{1,2,1}")
xl_data_out = XLDataOut(XL_Path=path_3, Origin=pt_2, Data=merge_2, ByColumn=True, XL_Fill=xl_fill.T, XL_Font=xl_font, Stream=bool_2)  # -> A, B; inputs XL_Path: list, Origin: list of Point3d, Data: tree, XL_Fill: tree, XL_Line: tree, XL_Font: tree
# ---------- xl_data_out: VB ----------
    Component.Params.Input(0).Name = "Path"
    Component.Params.Input(0).Description = "Optional input for the XL Path component which specifies the target Workbook and Sheet. If blank the active workbook and worksheet is used, or the worksheet index supplied by an origin component"
    Component.Params.Input(1).Name = "Data Origin"
    Component.Params.Input(1).Description = "Optional point list input which specifies the lower bounds to which data will be written where X = Row, Y = Column, and Z = Sheet Index. If Z = 0 the active sheet will be used. If input is empty cell A1 will be used"
    Component.Params.Input(2).Name = "Data"
    Component.Params.Input(2).Description = "Input for generic data which will be converted into number or text. The first branch of the tree specifies the column location relative to the origin and the list the row location. The second branch specifies the provided sheet index if more than one sheet has been specified from the origin"
    Component.Params.Input(3).Name = "By Column"
    Component.Params.Input(3).Description = "Sets if data will be transposed"
    Component.Params.Input(4).Name = "XL Fill"
    Component.Params.Input(4).Description = "Input for the XL Fill component which will specify the cell's background fill formatting"
    Component.Params.Input(5).Name = "XL Line"
    Component.Params.Input(5).Description = "Input for the XL Line component which will specify the cell's border formatting"
    Component.Params.Input(6).Name = "XL Font"
    Component.Params.Input(6).Description = "Input for the XL Font component which will specify the cell's font formatting"
    Component.Params.Input(7).Name = "Stream"
    Component.Params.Input(7).Description = "If true, data will be written"

    Component.Params.Output(0).Name = "Origin"
    Component.Params.Output(0).Description = "List output of points which specify the lower bounds of written data"
    Component.Params.Output(1).Name = "Bound"
    Component.Params.Output(1).Description = "List output of points which specify the upper bounds of written data"

    If _Stream = True Then

      If data.BranchCount() > 0 Then

        Dim objExcel, excelWorkbook, excelSheet As Object
        Data.SimplifyPaths()

        If XL_Path.Count() > 1 Then
          objExcel = XL_Path.item(0)
          excelWorkbook = XL_Path.item(1)
          excelSheet = XL_Path.item(2)
        Else
          Dim oldCI As System.Globalization.CultureInfo = system.Threading.Thread.CurrentThread.CurrentCulture
          System.Threading.Thread.CurrentThread.CurrentCulture = New System.Globalization.CultureInfo("en-US")

          'Access Active Session of Excel if no Path is specified
          objExcel = System.Runtime.InteropServices.Marshal.GetActiveObject("Excel.Application")
          excelWorkbook = objExcel.activeWorkbook
          excelSheet = objExcel.ActiveSheet
        End If
        objExcel.screenUpdating = False
        '#############################################

        ' Begin Formatting and Populating Data
        Dim i,j,k,m,n,p,u,v,r,s As Integer
        Dim x,y As Integer
        Dim cnt As New list(Of Integer)
        Dim ptA, ptB As New list(Of point3d)
        Dim sTree,pTree,lTree,fTree As New list(Of datatree(Of Object))
        Dim blnP,blnL,blnF As Boolean

        sTree = remapTree(Data)
        pTree = remapTree(XL_Fill)
        lTree = remapTree(XL_Line)
        fTree = remapTree(XL_Font)

        If Origin.count() = 0 Then
          Origin.add(New point3d(excelSheet.usedrange.row, excelSheet.usedrange.column, 0))
        End If

        For j = 0 To Origin.count() - 1 Step 1
          If j > (sTree.count() - 1) Then k = (sTree.count() - 1) Else k = j
          If CInt(origin.item(j).Z) > excelWorkbook.Sheets.Count() Then
            excelWorkbook.Sheets.add(, excelWorkbook.Sheets(excelWorkbook.Sheets.Count()), CInt(origin.item(j).Z - excelWorkbook.Sheets.Count()))
          End If
          If CInt(origin.item(j).Z) <> 0 Then excelSheet = excelWorkbook.Sheets.item(CInt(origin.item(j).Z))
          'finds the longest list of data to set the outer extent of the range
          For i = 0 To sTree.item(k).BranchCount() - 1 Step 1
            cnt.add(sTree.item(k).branch(i).count())
          Next
          Dim counts As Integer()
          counts = cnt.toarray
          Array.Sort(counts)
          Array.reverse(counts)

          If byColumn = True Then
            x = Origin.item(j).Y + counts(0) - 1
            y = Origin.item(j).X + sTree.item(k).BranchCount() - 1
          Else
            x = Origin.item(j).Y + sTree.item(k).BranchCount() - 1
            y = Origin.item(j).X + counts(0) - 1
          End If
          Dim rng As Object

          'specify a range in excel and stream data
          rng = excelSheet.Range(excelSheet.Cells(Origin.item(j).Y, Origin.item(j).X), excelSheet.Cells(x, y))

          If byColumn = True Then
            rng.value = objExcel.transpose(TreeToArr(sTree.item(k)))
          Else
            rng.value = TreeToArr(sTree.item(k))
          End If

          'Set the fill formatting
          If XL_Fill.branchcount() > 0 Then
            blnP = True
            If (XL_Fill.branchcount() = 1 And XL_Fill.branch(0).count() = 1) Then
              Call FillFormat(rng, pTree.item(0).branch(0).item(0))
              blnP = False
            End If
          End If

          'Set the fill formatting
          If XL_Line.branchcount() > 0 Then
            blnL = True
            If (XL_Line.branchcount() = 1 And XL_Line.branch(0).count() = 1) And (CBool(Split(XL_Line.branch(0).item(0), "~")(5).trim()) = False) Then
              Call LineFormat(rng, lTree.item(0).branch(0).item(0))
              blnL = False
            End If
          End If

          'Set the font formatting
          If XL_Font.branchcount() > 0 Then
            blnF = True
            If (XL_Font.branchcount() = 1 And XL_Font.branch(0).count() = 1) Then
              Call FontFormat(rng, fTree.item(0).branch(0).item(0))
              blnF = False
            End If
          End If

          For m = 0 To sTree.item(k).branchcount() - 1 Step 1
            For n = 0 To sTree.item(k).branch(m).count() - 1 Step 1
              If byColumn Then
                r = n
                s = m
              Else
                r = m
                s = n
              End If

              If blnP Then
                If j > pTree.count() - 1 Then p = pTree.count() - 1 Else p = j
                If m > pTree.item(p).branchcount() - 1 Then u = pTree.item(p).branchcount() - 1 Else u = m
                If n > pTree.item(p).branch(u).count() - 1 Then v = pTree.item(p).branch(u).count() - 1 Else v = n
                Call FillFormat(excelSheet.Cells(CInt(Origin.item(j).Y + r), CInt(Origin.item(j).X + s)), CStr(pTree.item(p).branch(u).item(v)))
              End If

              If blnL Then
                If j > lTree.count() - 1 Then p = lTree.count() - 1 Else p = j
                If m > lTree.item(p).branchcount() - 1 Then u = lTree.item(p).branchcount() - 1 Else u = m
                If n > lTree.item(p).branch(u).count() - 1 Then v = lTree.item(p).branch(u).count() - 1 Else v = n
                Call LineFormat(excelSheet.Cells(CInt(Origin.item(j).Y + r), CInt(Origin.item(j).X + s)), CStr(lTree.item(p).branch(u).item(v)))
              End If

              If blnF Then
                If j > fTree.count() - 1 Then p = fTree.count() - 1 Else p = j
                If m > fTree.item(p).branchcount() - 1 Then u = fTree.item(p).branchcount() - 1 Else u = m
                If n > fTree.item(p).branch(u).count() - 1 Then v = fTree.item(p).branch(u).count() - 1 Else v = n
                Call FontFormat(excelSheet.Cells(CInt(Origin.item(j).Y + r), CInt(Origin.item(j).X + s)), CStr(fTree.item(p).branch(u).item(v)))
              End If
            Next
          Next


          'Component Output is the origin cell and bounding cell location
          ptA.add(New Point3d(origin.item(j).X, origin.item(j).Y, excelSheet.Index))
          ptB.add(New Point3d(y, x, excelSheet.Index))
        Next
        excelSheet.activate
        objExcel.screenUpdating = True

        A = ptA
        B = ptB
      End If
    End If
# ---------- xl_data_out: VB additional code ----------
  'Cell Fill format
  Private Function FillFormat(ByVal obj As Object, ByVal strOptions As String)
    Dim arrOpt() As String = Split(strOptions, "~")
    Dim clrB() As String = Split(arrOpt(2), ",")
    Dim clrF() As String = Split(arrOpt(1), ",")
    With obj
      .Interior.Pattern = CInt(arrOpt(0))
      .Interior.Patterncolor = RGB(CInt(clrF(0).trim()), CInt(clrF(1).trim()), CInt(clrF(2).trim()))
      .Interior.color = RGB(CInt(clrB(0).trim()), CInt(clrB(1).trim()), CInt(clrB(2).trim()))

    End With
    Return Nothing
  End Function

  'Cell Line format
  Private Function LineFormat(ByVal obj As Object, ByVal strOptions As String)
    Dim arrOpt() As String = Split(strOptions, "~")
    Dim clrF() As String = Split(arrOpt(2), ",")
    With obj
      .BorderAround(CInt(arrOpt(0)), CInt(arrOpt(1)),, RGB(CInt(clrF(0).trim()), CInt(clrF(1).trim()), CInt(clrF(2).trim())))
    End With
    Return Nothing
  End Function

  'Sets font properties
  Private Function FontFormat(ByVal obj As Object, ByVal strOptions As String)
    Dim arrOpt() As String = Split(strOptions, "~")
    Dim clrF() As String = Split(arrOpt(1), ",")
    With obj
      .Font.Name = CStr(arrOpt(8).trim())
      .Font.Size = CInt(arrOpt(0).trim())
      .Font.Color = RGB(CInt(clrF(0).trim()), CInt(clrF(1).trim()), CInt(clrF(2).trim()))
      .HorizontalAlignment = CInt(arrOpt(2).trim())
      .VerticalAlignment = CInt(arrOpt(3).trim())
      .Font.Bold = CBool(arrOpt(4).trim())
      .Font.Italic = CBool(arrOpt(5).trim())
      .Font.Underline = CBool(arrOpt(6).trim())
      .Font.Strikethrough = CBool(arrOpt(7).trim())
    End With
    Return Nothing
  End Function

  Private Function TreeToArr(ByVal arrTree As Datatree(Of Object))

    Dim i,j,x,y As Integer

    y = 0
    x = arrTree.branchCount() - 1
    For i = 0 To x Step 1
      If y < (arrTree.branch(i).count() - 1)
        y = arrTree.branch(i).count() - 1
      End If
    Next

    Dim arrOut(x,y) As Object

    For i = 0 To x Step 1
      For j = 0 To y Step 1
        If j > (arrTree.branch(i).count() - 1) Then
          arrOut(i, j) = Nothing
        Else
          arrOut(i, j) = arrTree.branch(i).item(j)
        End If
      Next
    Next

    Return arrOut
  End Function
  Function remapTree(ByVal arrTree As datatree(Of Object))
    If arrTree.branchcount() > 0 Then
      Dim i,j,k,m,r,s As Integer
      Dim uTree,tTree As New datatree(Of Object)
      Dim sTree As New list(Of datatree(Of Object))

      If uBound(arrTree.Paths.item(0).indices()) > 1 Then
        For i = 0 To arrTree.branchcount() - 1 Step 1
          Dim tPath As gh_path
          Dim tint() As int32
          tPath = arrTree.Paths.item(i)
          tint = tPath.Indices

          If uBound(tint) > 0 Then
            For j = 0 To arrTree.Branch(i).Count() - 1 Step 1
              uTree.add(arrTree.Branch(i).item(j), New gh_path({tint(uBound(tint) - 1),tint(uBound(tint))}))
            Next
          Else
            For j = 0 To arrTree.Branch(i).Count() - 1 Step 1
              uTree.add(arrTree.Branch(i).item(j), New gh_path({0,i}))
            Next
          End If
        Next
      Else
        uTree = arrTree
      End If

      If uBound(uTree.Paths.item(0).indices()) > 0 Then
        k = uTree.Paths.item(0).indices(uBound(uTree.Paths.item(0).indices()) - 1)
        For i = 0 To uTree.branchcount() - 1 Step 1
          Dim tPath As gh_path
          Dim tint() As int32
          tPath = uTree.Paths.item(i)
          tint = tPath.Indices

          If tint(uBound(tint) - 1) > k Then
            Dim tmpTree As New datatree(Of Object)
            For r = 0 To tTree.branchcount() - 1 Step 1
              For s = 0 To tTree.branch(r).count() - 1 Step 1
                tmpTree.add(tTree.branch(r).item(s), New gh_path(r))
              Next
            Next
            sTree.add(tmpTree)
            tTree.clear
            k = tint(uBound(tint) - 1)
            m = 0
          End If
          For j = 0 To uTree.Branch(i).Count() - 1 Step 1
            tTree.add(uTree.Branch(i).item(j), New gh_path(m))
          Next
          m += 1
        Next

        sTree.add(tTree)
      Else
        sTree.add(uTree)
      End If
      Return sTree
    Else
      Return Nothing
    End If
  End Function
  Function flipMatrix(ByVal arrVal As datatree(Of Object))
    Dim objOut As New DataTree(Of Object)
    Dim source As New GH_Lexer("{A}(B)")
    Dim target As New GH_Lexer("{B}(A)")

    GH_Lexer.PerformLexicalReplace(source, target, arrVal, objOut)

    Return objOut
  End Function
  Function lexGraft(ByVal arrVal As datatree(Of Object))
    Dim objOut As New DataTree(Of Object)
    Dim source As New GH_Lexer("{A}(i)")
    Dim target As New GH_Lexer("{A;0}(i)")

    GH_Lexer.PerformLexicalReplace(source, target, arrVal, objOut)

    Return objOut
  End Function
# ---------- end xl_data_out ----------
xl_data_out_2 = XLDataOut(XL_Path=path_3, Origin=pt_5, Data=merge, ByColumn=True, XL_Fill=xl_fill.T, XL_Font=xl_font, Stream=bool_2)  # -> A, B; inputs XL_Path: list, Origin: list of Point3d, Data: tree, XL_Fill: tree, XL_Line: tree, XL_Font: tree; same code as xl_data_out
xl_data_out_3 = XLDataOut(XL_Path=path_3, Origin=pt_4, Data=merge_3, ByColumn=True, XL_Fill=xl_fill.T, XL_Font=xl_font, Stream=bool_2)  # -> A, B; inputs XL_Path: list, Origin: list of Point3d, Data: tree, XL_Fill: tree, XL_Line: tree, XL_Font: tree; same code as xl_data_out
subtraction_2 = Subtraction(A=number_slider, B=1)
subtraction_3 = Subtraction(A=number_slider_2, B=1)
xl_fill_2 = XLFillStyle(Pattern="-4105~0", BackColor=backcolor_2, ForeColor=Point(255, 255, 255), Opacity=0, Bevel=1)  # -> out, T; inputs BackColor: Color, ForeColor: Color; same code as xl_fill
xl_font_2 = XLFontStyle(Name="Arial", Size=Slider(10, range=0..100), Color=color, Bold="True")  # -> T; inputs Color: Color; same code as xl_font
lng_4 = ListLength(List=merge_2)
lng_5 = ListLength(List=merge_3)
lng_6 = ListLength(List=merge)
item = ListItem(List=flatten(lng_4), Index=0, Wrap=True)
item_2 = ListItem(List=flatten(lng_5), Index=0, Wrap=True)
item_3 = ListItem(List=flatten(lng_6), Index=0, Wrap=True)
addition_3 = Addition(A=item_3, B=item_2, C=subtraction_2)
addition_4 = Addition(A=item_3, B=subtraction_3)
ma = MassAddition(Input=[item_3, item_2, Slider(6, range=0..10)])  # -> Result, PartialResults
ma_2 = MassAddition(Input=[item_3, item_2, Slider(6, range=0..10)])  # -> Result, PartialResults
ma_3 = MassAddition(Input=[ma.Result, item])  # -> Result, PartialResults
ma_4 = MassAddition(Input=[ma_2.Result, item])  # -> Result, PartialResults
pt_6 = ConstructPoint(XCoordinate="1", YCoordinate="1", ZCoordinate="1")
pt_7 = ConstructPoint(XCoordinate="1", YCoordinate=addition_4, ZCoordinate="1")
pt_8 = ConstructPoint(XCoordinate="1", YCoordinate=addition_3, ZCoordinate="1")
subtraction_4 = Subtraction(A=ma_3.Result, B=2)
subtraction_5 = Subtraction(A=ma_4.Result, B=2)
ma_5 = MassAddition(Input=[item_3, item_2, item, number_slider])  # -> Result, PartialResults
xl_fill_3 = XLFillStyle(Pattern="-4105~0", BackColor=backcolor, ForeColor=Point(255, 255, 255), Opacity=0, Bevel=1)  # -> out, T; inputs BackColor: Color, ForeColor: Color; same code as xl_fill
xl_font_3 = XLFontStyle(Name="Arial", Size=Slider(19, range=0..100), Color=color_2, Bold=Toggle(False))  # -> out, T; inputs Color: Color
# ---------- xl_font_3: VB ----------
    Component.Params.Input(0).Name = "Font Name"
    Component.Params.Input(0).Description = "Text input for the Name of an installed font"
    Component.Params.Input(1).Name = "Font Size"
    Component.Params.Input(1).Description = "Number input for the font size"
    Component.Params.Input(2).Name = "Font Color"
    Component.Params.Input(2).Description = "Color input for the font"
    Component.Params.Input(3).Name = "Bold"
    Component.Params.Input(3).Description = "Boolean input specifying if the font will be bold"

    Component.Params.Output(1).Name = "Excel Font Parameters"
    Component.Params.Output(1).Description = "Formatted List of output Font Parameters"

    Dim strOut As String

    Dim vert, horz,size As Integer

    horz = -4108
    vert = -4108

    If _Name = Nothing Then
      _Name = "Arial"
    End If

    If _Size = 0 Then
      size = 8
    Else
      size = _Size
    End If

    strOut = CStr(size & "~" & CStr(CInt(_Color.R) & "," & CInt(_Color.G) & "," & CInt(_Color.B)) & "~" & horz & "~" & vert & "~" & _Bold & "~" & False & "~" & False & "~" & False & "~" & _Name)

    T = strOut
# ---------- end xl_font_3 ----------
pt_9 = ConstructPoint(XCoordinate=1, YCoordinate=ma_5.Result, ZCoordinate=1)
concat = Concatenate(
    FragmentA="=SUM(",
    FragmentB="C",
    FragmentC=ma.Result,
    FragmentD=":",
    FragmentE="C",
    FragmentF=subtraction_4,
    FragmentG=")")
subtraction_6 = Subtraction(A=item, B=1)
concat_2 = Concatenate(
    FragmentA="=SUM(",
    FragmentB="B",
    FragmentC=ma_2.Result,
    FragmentD=":",
    FragmentE="B",
    FragmentF=subtraction_5,
    FragmentG=")")
pt_10 = Point(pt_9)
merge_8 = Merge(Data1=subtraction_6, Data2=concat_2, Data3=concat)
xl_cell_size = XLCellSize(XL_Path=path_3, Height=0, Width=0, Stream=bool_2)  # -> out, A, B; inputs XL_Path: list, Target: Point3d
# ---------- xl_cell_size: VB ----------
    Component.Params.Input(0).Name = "Path"
    Component.Params.Input(0).Description = "Optional input for the XL Path component which specifies the Target Workbook and Sheet. If blank the active workbook and worksheet is used, or the worksheet index supplied by an origin component"
    Component.Params.Input(1).Name = "Cell Target"
    Component.Params.Input(1).Description = "Optional point input which specifies the Cell whose column and row will be resized. If Z = 0 the active sheet will be used. If input is empty cell size changes will be applied to the entire sheet."
    Component.Params.Input(2).Name = "Row Height"
    Component.Params.Input(2).Description = "Optional number input which specifies row height associated with a target cell. If blank, willd default to AutoFit"
    Component.Params.Input(3).Name = "Column Width"
    Component.Params.Input(3).Description = "Optional number input which specifies column width associated with a target cell. If blank, willd default to AutoFit"
    Component.Params.Input(4).Name = "Stream Formatting"
    Component.Params.Input(4).Description = "If true, associated rows and columns to given cell location will be resized"

    Component.Params.Output(1).Name = "Origin"
    Component.Params.Output(1).Description = "The lower bounds point location which specifsi where resizing took place if Target input is assigned"
    Component.Params.Output(2).Name = "Bound"
    Component.Params.Output(2).Description = "The upper bounds point location which specifies the extent of resizing"

    If _Stream = True Then

      Dim objExcel, excelWorkbook, excelSheet, chartSheet As Object

      If XL_Path.Count() > 1 Then
        objExcel = XL_Path.item(0)
        excelWorkbook = XL_Path.item(1)
        excelSheet = XL_Path.item(2)
        chartSheet = XL_Path.item(2)
      Else
        Dim oldCI As System.Globalization.CultureInfo = system.Threading.Thread.CurrentThread.CurrentCulture
        System.Threading.Thread.CurrentThread.CurrentCulture = New System.Globalization.CultureInfo("en-US")

        'Access Active Session of Excel if no Path is specified

        objExcel = System.Runtime.InteropServices.Marshal.GetActiveObject("Excel.Application")
        excelWorkbook = objExcel.activeWorkbook

        'Use the Z value for the Origin to set the sheet index to be accessed, 1 = first, 0 = current
        If CInt(Target.Z) = 0 Then
          excelSheet = objExcel.ActiveSheet
        ElseIf CInt(Target.Z) > excelWorkbook.Sheets.Count() Then
          excelWorkbook.Sheets.add(, excelWorkbook.Sheets(excelWorkbook.Sheets.Count()), CInt(Target.Z - excelWorkbook.Sheets.Count()))
          excelSheet = excelWorkbook.Sheets.item(CInt(Target.Z))
        Else
          excelSheet = excelWorkbook.Sheets.item(CInt(Target.Z))
        End If
      End If



      objExcel.screenUpdating = False

      excelSheet.activate()

      If target = Nothing Then
        If math.abs(Height) > 0 Then excelSheet.Rows.RowHeight = Height Else excelSheet.Rows.AutoFit
        If math.abs(Width) > 0 Then excelSheet.Columns.ColumnWidth = Width Else excelSheet.Columns.Autofit
        A = New point3d(1, 1, excelSheet.index)
        B = New point3d(excelSheet.Columns.Count, excelSheet.Rows.Count, excelSheet.index)
      Else
        If math.abs(Height) > 0 Then excelSheet.Rows(CInt(Target.Y)).RowHeight = Height Else excelSheet.Rows(CInt(Target.Y)).AutoFit
        If math.abs(Width) > 0 Then excelSheet.Columns(CInt(Target.X)).ColumnWidth = Width Else excelSheet.Columns(CInt(Target.X)).Autofit
        A = Target
        B = Target
      End If

      objExcel.screenUpdating = True

    End If
# ---------- end xl_cell_size ----------
xl_data_out_4 = XLDataOut(XL_Path=path_3, Origin=pt_10, Data=merge_8, ByColumn=False, XL_Fill=xl_fill_2.T, XL_Font=xl_font_2, Stream=bool_2)  # -> A, B; inputs XL_Path: list, Origin: list of Point3d, Data: tree, XL_Fill: tree, XL_Line: tree, XL_Font: tree; same code as xl_data_out
panel_5 = Panel(subtraction_6)
panel_6 = Panel(concat_2)
panel_7 = Panel(concat)
panel_8 = Panel(merge_8)
panel_9 = Panel("=SUM(B11:B25)")
xl_data_out_5 = XLDataOut(
    XL_Path=path_3,
    Origin=pt_6,
    Data="Total Building Data",
    ByColumn=False,
    XL_Fill=xl_fill_3.T,
    XL_Font=xl_font_3.T,
    Stream=bool_2)  # -> A, B; inputs XL_Path: list, Origin: list of Point3d, Data: tree, XL_Fill: tree, XL_Line: tree, XL_Font: tree; same code as xl_data_out
xl_data_out_6 = XLDataOut(
    XL_Path=path_3,
    Origin=pt_7,
    Data="Sub-Building Data",
    ByColumn=False,
    XL_Fill=xl_fill_3.T,
    XL_Font=xl_font_3.T,
    Stream=bool_2)  # -> A, B; inputs XL_Path: list, Origin: list of Point3d, Data: tree, XL_Fill: tree, XL_Line: tree, XL_Font: tree; same code as xl_data_out
xl_data_out_7 = XLDataOut(XL_Path=path_3, Origin=pt_8, Data="Floor Data", ByColumn=False, XL_Fill=xl_fill_3.T, XL_Font=xl_font_3.T, Stream=bool_2)  # -> A, B; inputs XL_Path: list, Origin: list of Point3d, Data: tree, XL_Fill: tree, XL_Line: tree, XL_Font: tree; same code as xl_data_out
