# Grasshopper definition JSONToTextGenerator.ghx (Grasshopper 1.0.7)
# plug-ins: Redback

panel = Panel("C:\Users\William\Desktop\BumbleBee")
panel_2 = Panel("""BuildID
Typology
F2F
NumberOfLevels
LevelNames
FSR
GBA
GFA
NSA""")
panel_3 = Panel("""0001
Resi,Comm
3.1,5
10,5
G,1,2,3,4,5,6,7,8,9,10,11,12,13,14
2:1
175
10,10,10,10,10,10,10,10,10,10,10,10,10,10,10
10,10,0,0,0,0,0,0,0,0,0,0,0,0,0""")
tsort = SortText(Keys=panel_2, Values=panel_3, Culture=127)  # -> Keys, Values
json = JSON(Key=panel_2, Value=panel_3)
panel_4 = Panel(json)
graft = GraftTree(Tree=tsort.Values, IncludeEmptyLists=True, IncludeNullItems=True)
read = ReadJSON(Object=json, Key=panel_2)
concat = Concatenate(FragmentB=tsort.Keys, FragmentC=".txt")  # -> graft(Result)
input = DataInput(Destination="C:\Users\William\Documents\GitHub\Hackathon2018\Area Cals.ghdata")
panel_5 = Panel(read)
write_file = WRITEFILE(content=graft, filepath=panel, filename=concat, activate=Toggle(False))
panel_6 = Panel(input)
panel_7 = Panel(concat)
write_file_2 = WRITEFILE(content=json, filepath=panel, filename="json.json", activate=Toggle(False))

# ==== cluster WRITEFILE: Writes files, also checks for python objects and converts them to text before writing.
activate = ClusterInput()
content = ClusterInput()
filename = ClusterInput()
filepath = ClusterInput()
python = GhPythonScript(CONTENT=content, FILEPATH=filepath, FILENAME=filename, ACTIVATE=activate)  # inputs CONTENT: list
# ---------- python: Python ----------
__author__ = "s-abutler"
__version__ = "2018.09.10"

import rhinoscriptsyntax as rs
from json import dumps
def check(o):
#    print(str(type(o)))
#    return o
    if str(type(o)) == "<type 'dict'>":
        return dumps(o)
    else:
        return o
if ACTIVATE:
    con = list(map(lambda u: check(u), CONTENT))
    conwrite = "\n".join(con)
    dir = FILEPATH+"\\"+FILENAME
    with open(dir,'w') as f:
        f.write(conwrite)
# ---------- end python ----------
