# Grasshopper definition Massing_FingerJoint.gh (Grasshopper 1.0.7)
# Copyright: Co-de-iT
# plug-ins: MeshEdit Components, treesloth01, Human, MetaHopper

geometrytoprocess = Geometry(<brep referenced from the Rhino model>)
crv = Curve([<curve referenced from the Rhino model> x2])
item = ListItem(List=geometrytoprocess, Index=0, Wrap=True)
pt = Point(Point(233276.6737, -38903.38311, 15600))
topoly = CurveToPolyline(Curve=crv, ToleranceDistance=Slider(400, range=0..1000), ToleranceAngle=0)  # -> Polyline, Segments
Z = UnitZ(Factor=pt)
Z_2 = UnitZ(Factor=Slider(1000, range=0..1000))
material_thickness = Slider(1.8, range=0..10)
surfacecurves = Curve([<curve referenced from the Rhino model> x2])
scale = Panel("1:1")
tab_length = Slider(3.2, range=0..10)
crv_2 = Curve(<curve referenced from the Rhino model>)
extr = Extrude(Base=crv_2, Direction=Z_2)
hatchtable = HatchTable(Update=True)
crv_3 = Curve()
number_slider = Slider(6, range=-10..10)
cap = CapHoles(Brep=extr)
null = NullItem(Item=crv_3)  # -> NullFlags, InvalidFlags, Description
list = ItemSelector(hatchtable, {"Solid", "Hatch2", "Hatch3", "Grid", "HatchDash", "Grid60"}, selected="Hatch2")
rep = ReplaceText(Text=scale, Find=":", Replace="/", RecursiveReplace=False)
materialthickness = Data(material_thickness)
debrep = DeconstructBrep(Brep=cap)  # -> Faces, Edges, Vertices
tablength = Data(tab_length)
cull = CullPattern(List=crv_3, CullPattern=invert(null.NullFlags))
multiplication = Multiplication(A=number_slider, B=Slider(7, range=0..10))
offset = OffsetSurface(Surface=debrep.Faces, Distance=number_slider, Retrim=True)
abs = Absolute(Value=multiplication)
scale_2 = Scale(Geometry=cap, Center=Point(0, 0, 0), Factor=rep)  # -> Geometry, Transform
scale_3 = Scale(Geometry=cull, Center=Point(0, 0, 0), Factor=rep)  # -> Geometry, Transform
offset_2 = OffsetCurve(Curve=offset, Distance=abs, Plane=offset, Corners=1)
geo = Geometry(<brep referenced from the Rhino model>)
rep_2 = ReplaceText(Text="1:500", Find=":", Replace="/", RecursiveReplace=False)
boundary = BoundarySurfaces(Edges=offset_2)
shift = ShiftPaths(Data=boundary, Offset=-1)
xy = XYPlane(Origin=Point(0, 0, 0))
scale_4 = Scale(Geometry=geo, Center=Point(0, 0, 0), Factor=rep_2)  # -> Geometry, Transform
debrep_2 = DeconstructBrep(Brep=scale_2.Geometry)  # -> Faces, Edges, Vertices
geo_2 = Geometry([<brep referenced from the Rhino model> x2])
lng = ListLength(List=shift)
geo_3 = Geometry(debrep_2.Faces)
series = Series(Start=0, Step=1, Count=lng)
dispatch = Dispatch(List=geo_2, DispatchPattern=[True, False])  # -> ListA, ListB
xy_2 = XYPlane(Origin=Point(0, 0, 0))
debrep_3 = DeconstructBrep(Brep=scale_4.Geometry)  # -> Faces, Edges, Vertices
item_2 = ListItem(List=debrep_3.Faces, Index=[-1, -2], Wrap=True)  # -> flatten(Item)
item_3 = ListItem(List=scale_4.Geometry, Index=2, Wrap=True)
cull_i = CullIndex(List=shift, Indices=graft(series), Wrap=True)
bbx = BrepBrep(BrepA=dispatch.ListA, BrepB=dispatch.ListB)  # -> Curves, Points
number_slider_2 = Slider(2, range=0..10)
area = Area(Geometry=geo_3)  # -> Area, Centroid
cull_i_2 = CullIndex(List=debrep_3.Faces, Indices=[-1, -2], Wrap=True)
scale_5 = Scale(Geometry=bbx.Curves, Center=Point(0, 0, 0), Factor=rep_2)  # -> Geometry, Transform
bbx_2 = BrepBrep(BrepA=boundary, BrepB=cull_i)  # -> Curves, Points
explode = Explode(Curve=scale_5.Geometry, Recursive=True)  # -> flatten(Segments), Vertices
evalsrf = EvaluateSurface(Surface=reparameterize(item_2), Point=Point(0, 0, 0))  # -> Point, Normal, Frame
shift_2 = ShiftPaths(Data=bbx_2.Curves, Offset=-1)
dim = Dimensions(Surface=cull_i_2)  # -> UDimension, VDimension
item_4 = ListItem(List=dim.VDimension, Index=0, Wrap=True)  # -> flatten(Item)
pdecon = Deconstruct(Point=area.Centroid)  # -> XComponent, YComponent, ZComponent
geo_4 = Geometry(cull_i_2)
srfsplit = SurfaceSplit(Surface=boundary, Curves=shift_2)
consec = ConsecutiveDomains(Numbers=item_4, Additive=True)
panel = Panel("""-1
1""")
expression = Expression(x=dim.UDimension, y=number_slider_2, Expression="x-y")
materialthickness_2 = Data(materialthickness)
graft = GraftTree(Tree=geo_4, IncludeEmptyLists=True, IncludeNullItems=True)
eval = EvaluateLength(Curve=explode.Segments, Length=0.5, Normalized=True)  # -> Point, Tangent, Parameter
sort = SortList(Keys=pdecon.ZComponent, ValuesA=geo_3, ValuesB=area.Centroid)  # -> Keys, ValuesA, ValuesB
xy_3 = XYPlane(Origin=Point(0, 0, 0))
consec_2 = ConsecutiveDomains(Numbers=expression, Additive=True)
neg = Negative(Value=number_slider_2)
dedomain = DeconstructDomain(Domain=consec)  # -> Start, End
area_2 = MeshArea(Mesh=srfsplit)  # -> Area, Centroid
int = Integer(0)
materialthickness_3 = Data(materialthickness)
dedomain_2 = DeconstructDomain(Domain=consec_2)  # -> Start, End
orient = Orient(Geometry=item_2, Source=evalsrf.Frame, Target=xy_3)  # -> Geometry, Transform
bbox = BoundingBox(Content=orient.Geometry, Plane=xy_2)  # -> Box, Box_2
debox = DeconstructBox(Box=bbox.Box)  # -> Plane, X, Y, Z
dedomain_3 = DeconstructDomain(Domain=debox.X)  # -> Start, End
expression_2 = Expression(x=dedomain_3.Start, y=dedomain_3.End, Expression="y-x")
consec_3 = ConsecutiveDomains(Numbers=expression_2, Additive=True)
dedomain_4 = DeconstructDomain(Domain=consec_3)  # -> Start, End
item_5 = ListItem(List=dedomain_4.Start, Index=0, Wrap=True)
srf_cp = SurfaceClosestPoint(Point=eval.Point, Surface=graft)  # -> Point, UVPoint, Distance
item_6 = ListItem(List=sort.ValuesA, Index=[0, -1], Wrap=True)
item_7 = ListItem(List=dedomain.Start, Index=0, Wrap=True)
sort_2 = SortList(Keys=area_2.Area, ValuesA=srfsplit)  # -> Keys, reverse(ValuesA)
int_2 = Integer(0)
long = LongestList(ListA=int, ListB=item_5, PaddingMode=2)  # -> ListA, ListB
multiplication_2 = Multiplication(A=materialthickness_3, B="20")
item_8 = ListItem(List=dedomain_2.Start, Index=0, Wrap=True)
int_3 = Integer(0)
expression_3 = Expression(x=srf_cp.Distance, Expression="x<1")
item_9 = ListItem(List=sort_2.ValuesA, Index=0, Wrap=True)
long_2 = LongestList(ListA=int_2, ListB=item_7, PaddingMode=2)  # -> ListA, ListB
merge = Merge(Data1=simplify(long.ListA), Data2=simplify(dedomain_4.Start))
long_3 = LongestList(ListA=int_3, ListB=item_8, PaddingMode=2)  # -> ListA, ListB
item_10 = ListItem(List=item_6, Index=0, Wrap=True)  # -> Item, Item1
dispatch_2 = Dispatch(List=explode.Segments, DispatchPattern=expression_3)  # -> ListA, ListB
merge_2 = Merge(Data1=simplify(long_2.ListA), Data2=simplify(dedomain.Start))  # -> graft(Result)
shift_3 = ShiftPaths(Data=simplify(item_9), Offset=-1)
pt_2 = ConstructPoint(XCoordinate=merge, YCoordinate=0, ZCoordinate=0)
merge_3 = Merge(Data1=simplify(long_3.ListA), Data2=simplify(dedomain_2.Start))
pt_3 = ConstructPoint(XCoordinate=merge_3, YCoordinate=expr("x+450", merge_2), ZCoordinate=0)
crv_4 = Curve(simplify(dispatch_2.ListA))
xy_4 = XYPlane(Origin=pt_2)
materialthickness_4 = Data(materialthickness)
explode_2 = Explode(Curve=item_10.Item1, Recursive=True)  # -> Segments, Vertices
explode_3 = Explode(Curve=item_10.Item, Recursive=True)  # -> Segments, Vertices
rectangle = Rectangle(Plane=pt_3, XSize=dim.UDimension, YSize=dim.VDimension, Radius=0)  # -> Rectangle, Length
join = BrepJoin(Breps=shift_3)  # -> Breps, Closed
group = Group(Objects=crv_4)
orient_2 = Orient(Geometry=orient.Geometry, Source=xy_3, Target=xy_4)  # -> Geometry, Transform
group_2 = Group(Objects=rectangle.Rectangle)  # -> flatten(Group)
eval_2 = EvaluateLength(Curve=reparameterize(explode_3.Segments), Length=0.5, Normalized=True)  # -> Point, Tangent, Parameter
eval_3 = EvaluateLength(Curve=reparameterize(explode_2.Segments), Length=0.5, Normalized=True)  # -> Point, Tangent, Parameter
planesrf = PlaneSurface(Plane=pt_3, XSize=dim.UDimension, YSize=dim.VDimension)
unflatten = UnflattenTree(Tree=group, Guide=geo_4)
crv_5 = Curve(orient_2.Geometry)
evalsrf_2 = EvaluateSurface(Surface=reparameterize(cull_i_2), Point=Point(0, 0, 0))  # -> Point, Normal, Frame
evalsrf_3 = EvaluateSurface(Surface=reparameterize(planesrf), Point=Point(0, 0, 0))  # -> Point, Normal, Frame
explode_4 = Explode(Curve=crv_5, Recursive=True)  # -> Segments, Vertices
graft_2 = GraftTree(Tree=explode_4.Segments, IncludeEmptyLists=True, IncludeNullItems=True)
len = Length(Curve=graft_2)
cp = ClosestPoint(Point=eval_2.Point, Cloud=eval_3.Point)  # -> ClosestPoint, CPIndex, Distance
item_11 = ListItem(List=group_2, Index=0, Wrap=True)
expression_4 = Expression(x=len, y=Slider(12, range=0..20), Expression="x/y")
item_12 = ListItem(List=explode_2.Segments, Index=cp.CPIndex, Wrap=True)
int_4 = Integer(expression_4)
orient_3 = Orient(Geometry=unflatten, Source=evalsrf_2.Frame, Target=evalsrf_3.Frame)  # -> Geometry, Transform
expression_5 = Expression(x=int_4, Expression="(floor(x/2)*2)+1")
graft_3 = GraftTree(Tree=explode_3.Segments, IncludeEmptyLists=True, IncludeNullItems=True)
graft_4 = GraftTree(Tree=item_12, IncludeEmptyLists=True, IncludeNullItems=True)
eval_4 = EvaluateLength(Curve=graft_4, Length=[0, 1], Normalized=True)  # -> Point, Tangent, Parameter
eval_5 = EvaluateLength(Curve=graft_3, Length=[0, 1], Normalized=True)  # -> Point, Tangent, Parameter
range = Range(Domain=Domain(0, 1), Steps=expression_5)
eval_6 = EvaluateLength(Curve=rectangle.Rectangle, Length=Slider(0.538, range=0..1), Normalized=True)  # -> Point, Tangent, Parameter
cp_2 = ClosestPoint(Point=eval_5.Point, Cloud=eval_4.Point)  # -> ClosestPoint, CPIndex, Distance
P = DispatchPattern([False, True])
shatter = Shatter(Curve=reparameterize(graft_2), Parameters=range)
ln = Line(StartPoint=eval_5.Point, EndPoint=cp_2.ClosestPoint)  # -> simplify(Line)
int_5 = Integer(0)
int_6 = Integer(1)
number_slider_3 = Slider(1, range=0..3)
number_slider_4 = Slider(3, range=0..3)
loft = Loft(Curves=ln, Options={Adjust=False, Closed=False, LoftEnds=0, LoftSimp=0, LoftType=0, Rebuild=10, Refit=0.01})
dispatch_3 = Dispatch(List=shatter, DispatchPattern=P)  # -> ListA, ListB
ultrim = UltraTrim(data=loft)
shift_4 = ShiftPaths(Data=loft, Offset=-1)
explode_5 = Explode(Curve=rectangle.Rectangle, Recursive=True)  # -> Segments, Vertices
panel_2 = Panel(unflatten)
xy_5 = XYPlane(Origin=Point(0, 0, 0))
crv_6 = Curve(dispatch_3.ListB)
crv_7 = Curve(dispatch_3.ListA)
cull_i_3 = CullIndex(List=explode_5.Segments, Indices=[number_slider_3, number_slider_4], Wrap=True)
item_13 = ListItem(List=explode_5.Segments, Index=[number_slider_3, number_slider_4], Wrap=True)
offset_3 = Offset(Curve=crv_6, Distance=neg, Plane=xy_5, Corners=1)

geoends = Data(reverse(item_6))
geosides = Data(shift_4)

geoends_2 = Data(geoends)
item_14 = ListItem(List=geoends_2, Index=1, Wrap=True)
crv_8 = Curve(item_14)
explode_6 = Explode(Curve=crv_8, Recursive=True)  # -> Segments, Vertices
offset_l = OffsetLoose(Curve=explode_6.Segments, Distance=1, Plane=xy)  # -> simplify(Curve)
item_15 = ListItem(List=offset_l, Index=0, Wrap=True)
eval_7 = EvaluateLength(Curve=item_15, Length=0.5, Normalized=True)  # -> Point, Tangent, Parameter
incurve = PointInCurve(Point=eval_7.Point, Curve=crv_8)  # -> Relationship, Point
bool = Boolean(incurve.Relationship)
item_16 = ListItem(List=panel, Index=bool, Wrap=True)
expression_6 = Expression(x=materialthickness_2, y=item_16, Expression="X*Y")
offset_l_2 = OffsetLoose(Curve=explode_6.Segments, Distance=expression_6, Plane=xy)  # -> simplify(Curve)
ext = ExtendCurve(Curve=offset_l_2, Type=0, Start=multiplication_2, End=multiplication_2)  # -> simplify(Curve)
graft_5 = GraftTree(Tree=offset_l_2, IncludeEmptyLists=True, IncludeNullItems=True)
crv_9 = Curve(ext)
shift_5 = ShiftList(List=ext, Shift=1, Wrap=True)
ext_2 = ExtendCurve(Curve=graft_5, Type=0, Start=materialthickness_4, End=materialthickness_4)  # -> simplify(Curve)
ccx = CurveCurve(CurveA=reparameterize(crv_9), CurveB=reparameterize(shift_5))  # -> Points, ParamsA, ParamsB
shift_6 = ShiftPaths(Data=ccx.ParamsB, Offset=-1)
shift_7 = ShiftList(List=shift_6, Shift=-1, Wrap=True)
graft_6 = GraftTree(Tree=shift_7, IncludeEmptyLists=True, IncludeNullItems=True)
shift_8 = ShiftPaths(Data=ext_2, Offset=-1)
merge_4 = Merge(Data1=simplify(graft_6), Data2=simplify(ccx.ParamsA))
graft_7 = GraftTree(Tree=crv_9, IncludeEmptyLists=True, IncludeNullItems=True)
ccx_2 = CurveCurve(CurveA=reparameterize(shift_8), CurveB=crv_8)  # -> Points, ParamsA, ParamsB
bnd = Bounds(Numbers=merge_4)
eval_8 = EvaluateLength(Curve=graft(explode_6.Segments), Length=[0, 1], Normalized=True)  # -> Point, Tangent, Parameter
subcrv = SubCurve(BaseCurve=reparameterize(graft_7), Domain=bnd)
expression_7 = Expression(x=ccx_2.ParamsA, Expression="x<.5")
crv_cp = CurveClosestPoint(Point=eval_8.Point, Curve=reparameterize(subcrv))  # -> Point, Parameter, Distance
dispatch_4 = Dispatch(List=ccx_2.ParamsA, DispatchPattern=expression_7)  # -> ListA, ListB
long_4 = LongestList(ListA=dispatch_4.ListB, ListB=int_6, PaddingMode=2)  # -> ListA, ListB
long_5 = LongestList(ListA=dispatch_4.ListA, ListB=int_5, PaddingMode=2)  # -> ListA, ListB
bnd_2 = Bounds(Numbers=crv_cp.Parameter)
crv_10 = Curve(graft(explode_6.Segments))
merge_5 = Merge(Data1=long_5.ListA, Data2=long_5.ListB)
merge_6 = Merge(Data1=long_4.ListA, Data2=long_4.ListB)
item_17 = ListItem(List=merge_6, Index=0, Wrap=True)
item_18 = ListItem(List=merge_5, Index=0, Wrap=True)
graft_8 = GraftTree(Tree=item_13, IncludeEmptyLists=True, IncludeNullItems=True)
len_2 = Length(Curve=graft_8)
expression_8 = Expression(x=len_2, y=Slider(12, range=0..20), Expression="x/y")
int_7 = Integer(expression_8)
expression_9 = Expression(x=int_7, Expression="ceiling(x/2)*2")
merge_7 = Merge(Data1=item_18, Data2=item_17)
eval_9 = EvaluateLength(Curve=ext_2, Length=merge_7, Normalized=True)  # -> Point, Tangent, Parameter
crv_cp_2 = CurveClosestPoint(Point=eval_9.Point, Curve=reparameterize(crv_10))  # -> Point, Parameter, Distance
subcrv_2 = SubCurve(BaseCurve=reparameterize(subcrv), Domain=bnd_2)  # -> simplify(Curve)
bnd_3 = Bounds(Numbers=crv_cp_2.Parameter)
unflatten_2 = UnflattenTree(Tree=offset_3, Guide=crv_6)
weave = Weave(Pattern=P, Stream0=unflatten_2, Stream1=crv_7, NullGaps=False)
subcrv_3 = SubCurve(BaseCurve=reparameterize(crv_10), Domain=bnd_3)  # -> simplify(Curve)
range_2 = Range(Domain=Domain(0, 1), Steps=expression_9)
graft_9 = GraftTree(Tree=cull_i_3, IncludeEmptyLists=True, IncludeNullItems=True)
crv_11 = Curve(subcrv_2)
len_3 = Length(Curve=graft_9)
P_2 = DispatchPattern([False, True])
shatter_2 = Shatter(Curve=reparameterize(graft_8), Parameters=range_2)
eval_10 = EvaluateLength(Curve=graft(crv_11), Length=[0, 1], Normalized=True)  # -> Point, Tangent, Parameter
eval_11 = EvaluateLength(Curve=graft(subcrv_3), Length=[0, 1], Normalized=True)  # -> Point, Tangent, Parameter
expression_10 = Expression(x=len_3, y=Slider(12, range=0..20), Expression="x/y")
len_4 = Length(Curve=subcrv_3)
int_8 = Integer(expression_10)
expression_11 = Expression(x=int_8, Expression="(floor(x/2)*2)+1")
crv_cp_3 = CurveClosestPoint(Point=eval_10.Point, Curve=subcrv_3)  # -> Point, Parameter, Distance
dispatch_5 = Dispatch(List=shatter_2, DispatchPattern=P_2)  # -> ListA, ListB
connect = ConnectCurves(Curves=weave, Continuity=Slider(0, range=0..2), Close=Toggle(False), Bulge=1)
xy_6 = XYPlane(Origin=Point(0, 0, 0))
end = EndPoints(Curve=shatter_2)  # -> Start, End
crv_12 = Curve(dispatch_5.ListB)
crv_13 = Curve(dispatch_5.ListA)
panel_3 = Panel(item_11)
range_3 = Range(Domain=Domain(0, 1), Steps=expression_11)
ext_3 = ExtendCurve(Curve=connect, Type=0, Start=expr("-x", number_slider_2), End=expr("-x", number_slider_2))
offset_4 = Offset(Curve=crv_12, Distance=neg, Plane=xy_6, Corners=1)
dist = Distance(PointA=eval_11.Point, PointB=crv_cp_3.Point)
P_3 = DispatchPattern([True, False])
shatter_3 = Shatter(Curve=reparameterize(graft_9), Parameters=range_3)
unflatten_3 = UnflattenTree(Tree=offset_4, Guide=crv_12)
weave_2 = Weave(Pattern=P_2, Stream0=unflatten_3, Stream1=crv_13, NullGaps=False)
dispatch_6 = Dispatch(List=shatter_3, DispatchPattern=P_3)  # -> ListA, ListB
xy_7 = XYPlane(Origin=Point(0, 0, 0))
crv_14 = Curve(dispatch_6.ListB)
crv_15 = Curve(dispatch_6.ListA)
offset_5 = Offset(Curve=crv_14, Distance=neg, Plane=xy_7, Corners=1)
data = Data(Toggle(True))
data_2 = Data(data)
filter = StreamFilter(Gate=data_2, Stream0=geometrytoprocess, Stream1=item)
debrep_4 = DeconstructBrep(Brep=filter)  # -> Faces, Edges, Vertices
edges = BrepEdges(Brep=debrep_4.Faces)  # -> Naked, Interior, NonManifold
join_2 = JoinCurves(Curves=edges.Naked, Preserve=False)
contour = Contour(Shape=filter, Point=Point(0, 0, 0), Direction=Z, Distance=Slider(100, range=0..10000))  # -> flatten(Contours)
brep = Brep(filter)
crv_16 = Curve(join_2)
null_2 = NullItem(Item=brep)  # -> NullFlags, InvalidFlags, Description
cull_2 = CullPattern(List=brep, CullPattern=invert(null_2.NullFlags))
createhatch = CreateHatch(Bake=Button(), Curves=crv_16, HatchPatternName=list, HatchScale=Slider(50, range=0..100), HatchRotation=0)  # -> HatchGeometry, HatchObjects
crv_17 = Curve(createhatch.HatchGeometry)
data_3 = Data(simplify(subcrv_3))
connect_2 = ConnectCurves(Curves=weave_2, Continuity=Slider(0, range=0..2), Close=Toggle(False), Bulge=1)
unflatten_4 = UnflattenTree(Tree=offset_5, Guide=crv_14)
shift_9 = ShiftPaths(Data=data_3, Offset=-1)
pshift = ShiftPaths(Data=data_3, Offset=-1)
weave_3 = Weave(Pattern=P_3, Stream0=unflatten_4, Stream1=crv_15, NullGaps=False)
null_3 = NullItem(Item=pshift)  # -> NullFlags, InvalidFlags, Description
tmatch = MatchText(Text=null_3.Description, Pattern="Data does not exist", Case=True)
ma = MassAddition(Input=null_3.NullFlags)  # -> Result, PartialResults
ma_2 = MassAddition(Input=null_3.InvalidFlags)  # -> Result, PartialResults
panel_4 = Panel(weave_2)
num = Number(len_4)
num_2 = Number(dist)
ma_3 = MassAddition(Input=tmatch)  # -> Result, PartialResults
number_slider_5 = Slider(2, range=0..10)
equals = Equality(FirstNumber=ma.Result, SecondNumber=ma_2.Result)  # -> Equality, Inequality
equals_2 = Equality(FirstNumber=ma_2.Result, SecondNumber=ma_3.Result)  # -> Equality, Inequality
geoends_3 = Data(geoends)
and = GateAnd(A=equals.Equality, B=equals_2.Equality)
filter_2 = StreamFilter(Gate=and, Stream0=pshift, Stream1=data_3)
item_19 = ListItem(List=geoends_3, Index=0, Wrap=True)  # -> Item1, Item
connect_3 = ConnectCurves(Curves=weave_3, Continuity=Slider(0, range=0..2), Close=Toggle(False), Bulge=1)
crv_18 = Curve(connect_3)
ext_4 = ExtendCurve(Curve=crv_18, Type=0, Start=0, End=neg)
group_3 = Group(Objects=shift_9)
item_20 = ListItem(List=num_2, Index=1, Wrap=True)
geosides_2 = Data(geosides)
data_4 = Data()
shift_10 = ShiftPaths(Data=simplify(num), Offset=-1)
ultrim_2 = UltraTrim(data=num)
ultrim_3 = UltraTrim(data=item_20)
repeat = RepeatData(Data=group_3, Length=number_slider_5)  # -> flatten(Data)
repeat_2 = RepeatData(Data=item_19.Item1, Length=number_slider_5)  # -> flatten(Data)
shift_11 = ShiftPaths(Data=simplify(item_20), Offset=-1)
dim_2 = Dimensions(Surface=geosides_2)  # -> UDimension, VDimension
xy_8 = XYPlane(Origin=Point(0, 0, 0))
bbox_2 = BoundingBox(Content=repeat_2, Plane=PlaneXY(0, 0, 0))  # -> Box, Box_2
expression_12 = Expression(x=shift_10, y=shift_11, Expression="x-y")
debox_2 = DeconstructBox(Box=bbox_2.Box)  # -> Plane, X, Y, Z
item_21 = ListItem(List=dim_2.VDimension, Index=0, Wrap=True)  # -> flatten(Item)
dedomain_5 = DeconstructDomain(Domain=debox_2.Z)  # -> Start, End
dedomain_6 = DeconstructDomain(Domain=debox_2.X)  # -> Start, End
dedomain_7 = DeconstructDomain(Domain=debox_2.Y)  # -> Start, End
evalsrf_4 = EvaluateSurface(Surface=reparameterize(bbox_2.Box), Point=Point(0, 0, 0))  # -> Point, Normal, UDirection, VDirection, Frame
consec_4 = ConsecutiveDomains(Numbers=item_21, Additive=True)
consec_5 = ConsecutiveDomains(Numbers=expression_12, Additive=True)
expression_13 = Expression(x=dedomain_6.Start, y=dedomain_6.End, Expression="abs(x-y)")
dedomain_8 = DeconstructDomain(Domain=consec_4)  # -> Start, End
pt_4 = ConstructPoint(XCoordinate=dedomain_6.Start, YCoordinate=dedomain_7.Start, ZCoordinate=dedomain_5.Start)
dedomain_9 = DeconstructDomain(Domain=consec_5)  # -> Start, End
srf_cp_2 = SurfaceClosestPoint(Point=evalsrf_4.Point, Surface=repeat_2)  # -> Point, UVPoint, Distance
xy_9 = XYPlane(Origin=pt_4)
item_22 = ListItem(List=dedomain_8.Start, Index=0, Wrap=True)
int_9 = Integer(0)
ma_4 = MassAddition(Input=expression_13)  # -> Result, PartialResults
item_23 = ListItem(List=dedomain_9.Start, Index=0, Wrap=True)
int_10 = Integer(0)
vec2pt = Vector2Pt(PointA=evalsrf_4.Point, PointB=srf_cp_2.Point, Unitize=False)  # -> Vector, Length
long_6 = LongestList(ListA=int_9, ListB=item_22, PaddingMode=2)  # -> ListA, ListB
cull_i_4 = CullIndex(List=ma_4.PartialResults, Indices=-1, Wrap=True)
long_7 = LongestList(ListA=int_10, ListB=item_23, PaddingMode=2)  # -> ListA, ListB
move = Move(Geometry=evalsrf_4.Frame, Motion=vec2pt.Vector)  # -> Geometry, Transform
merge_8 = Merge(Data1=simplify(long_6.ListA), Data2=simplify(dedomain_8.Start))  # -> graft(Result)
ins = InsertItems(List=cull_i_4, Item="0", Indices="0", Wrap=True)
merge_9 = Merge(Data1=simplify(long_7.ListA), Data2=simplify(dedomain_9.Start))
pt_5 = ConstructPoint(XCoordinate=ins, YCoordinate=0, ZCoordinate=0)
pt_6 = ConstructPoint(XCoordinate=merge_9, YCoordinate=expr("x+450", merge_8), ZCoordinate=0)
xy_10 = XYPlane(Origin=pt_5)
panel_5 = Panel("""1
-1""")
rectangle_2 = Rectangle(Plane=pt_6, XSize=shift_10, YSize=dim_2.VDimension, Radius=0)  # -> Rectangle, Length
xy_11 = XYPlane(Origin=Point(0, 0, 0))
explode_7 = Explode(Curve=rectangle_2.Rectangle, Recursive=True)  # -> Segments, Vertices
planesrf_2 = PlaneSurface(Plane=pt_6, XSize=shift_10, YSize=dim_2.VDimension)
dispatch_7 = Dispatch(List=explode_7.Segments, DispatchPattern=[True, False])  # -> ListA, ListB
orient_4 = Orient(Geometry=repeat, Source=xy_9, Target=xy_10)  # -> Geometry, Transform
orient_5 = Orient(Geometry=repeat_2, Source=xy_9, Target=xy_10)  # -> Geometry, Transform
data_5 = Data(simplify(dispatch_7.ListA))
data_6 = Data(simplify(dispatch_7.ListB))
panel_6 = Panel(data_6)
crv_19 = Curve(orient_5.Geometry)
offset_6 = Offset(Curve=graft(crv_19), Distance=panel_5, Plane=xy_11, Corners=1)  # -> simplify(Curve)
pshift_2 = ShiftPaths(Data=offset_6, Offset=-1)
ungroup = Ungroup(Group=orient_4.Geometry)
eval_12 = EvaluateLength(Curve=pshift_2, Length=0.5, Normalized=True)  # -> Point, Tangent, Parameter
incurve_2 = PointInCurve(Point=eval_12.Point, Curve=graft(crv_19))  # -> Relationship, Point
graft_10 = GraftTree(Tree=ungroup, IncludeEmptyLists=True, IncludeNullItems=True)  # -> simplify(Tree)
tablength_2 = Data(tablength)
tablength_3 = Data(tablength)
len_5 = Length(Curve=graft_10)
len_6 = Length(Curve=ungroup)
dispatch_8 = Dispatch(List=panel_5, DispatchPattern=incurve_2.Relationship)  # -> ListA, ListB

# ---- group: Horizontals
crv_20 = Curve(data_5)
graft_11 = GraftTree(Tree=crv_20, IncludeEmptyLists=True, IncludeNullItems=True)  # -> simplify(Tree)
len_7 = Length(Curve=graft_11)
tablength_4 = Data(tablength)
expression_14 = Expression(x=len_7, y=tablength_4, Expression="x/y")
int_11 = Integer(expression_14)
expression_15 = Expression(x=int_11, Expression="(floor(x/2)*2)+1")
range_4 = Range(Domain=Domain(0, 1), Steps=expression_15)
shatter_4 = Shatter(Curve=reparameterize(graft_11), Parameters=range_4)
P_4 = DispatchPattern([True, False])
dispatch_9 = Dispatch(List=shatter_4, DispatchPattern=P_4)  # -> ListA, ListB
materialthickness_5 = Data(materialthickness)
neg_2 = Negative(Value=materialthickness_5)
xy_12 = XYPlane(Origin=Point(0, 0, 0))
crv_21 = Curve(dispatch_9.ListA)
crv_22 = Curve(dispatch_9.ListB)
offset_7 = Offset(Curve=crv_22, Distance=neg_2, Plane=xy_12, Corners=1)
unflatten_5 = UnflattenTree(Tree=offset_7, Guide=crv_22)
weave_4 = Weave(Pattern=P_4, Stream0=unflatten_5, Stream1=crv_21, NullGaps=False)
materialthickness_6 = Data(materialthickness)
connect_4 = ConnectCurves(Curves=weave_4, Continuity="0", Close=Toggle(False), Bulge=1)
neg_3 = Negative(Value=materialthickness_6)
crv_23 = Curve(connect_4)
ext_5 = ExtendCurve(Curve=crv_23, Type=0, Start=0, End=neg_3)  # -> simplify(Curve)
ultrim_4 = UltraTrim(data=ext_5)

# ----
data_7 = Data(ungroup)
expression_16 = Expression(x=len_6, y=tablength_2, Expression="x/y")
expression_17 = Expression(x=len_5, y=tablength_3, Expression="x/y")
item_24 = ListItem(List=crv_20, Index=0, Wrap=True)
expression_18 = Expression(x=len_6, y=tablength_2, Expression="ceiling((x/y)/2)*2")
int_12 = Integer(expression_17)
int_13 = Integer(expression_16)

# ---- group: Verticals
graft_12 = GraftTree(Tree=data_6, IncludeEmptyLists=True, IncludeNullItems=True)
tablength_5 = Data(tablength)
len_8 = Length(Curve=graft_12)
expression_19 = Expression(x=len_8, y=tablength_5, Expression="x/y")
int_14 = Integer(expression_19)
num_3 = Number(reverse(num_2))
expression_20 = Expression(x=int_14, Expression="ceiling(x/2)*2")
graft_13 = GraftTree(Tree=num_3, IncludeEmptyLists=True, IncludeNullItems=True)
xy_13 = XYPlane(Origin=Point(0, 0, 0))
offset_8 = Offset(Curve=graft_12, Distance=expr("-x", simplify(graft_13)), Plane=xy_13, Corners=1)
range_5 = Range(Domain=Domain(0, 1), Steps=expression_20)
shatter_5 = Shatter(Curve=reparameterize(graft_12), Parameters=range_5)
shatter_6 = Shatter(Curve=reparameterize(offset_8), Parameters=range_5)
P_5 = DispatchPattern([False, True])
dispatch_10 = Dispatch(List=shatter_6, DispatchPattern=P_5)  # -> ListA, ListB
dispatch_11 = Dispatch(List=shatter_5, DispatchPattern=P_5)  # -> ListA, ListB
materialthickness_7 = Data(materialthickness)
neg_4 = Negative(Value=materialthickness_7)
xy_14 = XYPlane(Origin=Point(0, 0, 0))
crv_24 = Curve(simplify(dispatch_10.ListB))
crv_25 = Curve(dispatch_11.ListA)
offset_9 = Offset(Curve=crv_24, Distance=neg_4, Plane=xy_14, Corners=1)  # disabled
unflatten_6 = UnflattenTree(Tree=crv_24, Guide=crv_24)
weave_5 = Weave(Pattern=P_5, Stream0=unflatten_6, Stream1=crv_25, NullGaps=False)
connect_5 = ConnectCurves(Curves=weave_5, Continuity="0", Close=Toggle(False), Bulge=1)  # -> simplify(Curve)
trim = TrimTree(Tree=connect_5, Depth=1)

# ----
expression_21 = Expression(x=int_12, Expression="(floor(x/2)*2)+1")
expression_22 = Expression(x=int_13, Expression="(floor(x/2)*2)+1")
divide = DivideCurve(Curve=data_7, Count=expression_22, Kinks=False)  # -> Points, Tangents, Parameters
divide_2 = DivideCurve(Curve=graft_10, Count=expression_21, Kinks=False)  # -> Points, Tangents, Parameters
shatter_7 = Shatter(Curve=graft(data_7), Parameters=divide.Parameters)  # -> simplify(Segments)
len_9 = Length(Curve=graft_12)
shatter_8 = Shatter(Curve=graft_10, Parameters=divide_2.Parameters)
materialthickness_8 = Data(materialthickness)
P_6 = DispatchPattern([False, True])
panel_7 = Panel(len_9)
dispatch_12 = Dispatch(List=shatter_7, DispatchPattern=P_6)  # -> ListA, ListB
expression_23 = Expression(x=materialthickness_8, y=simplify(dispatch_8.ListA), Expression="x*y")
dispatch_13 = Dispatch(List=shatter_8, DispatchPattern=P_6)  # -> ListA, ListB
crv_26 = Curve(simplify(graft(dispatch_12.ListB)))
crv_27 = Curve(dispatch_12.ListA)
shift_12 = ShiftPaths(Data=crv_26, Offset=-1)
xy_15 = XYPlane(Origin=Point(0, 0, 0))
long_8 = LongestList(ListA=shift_12, ListB=expression_23, PaddingMode=2)  # -> ListA, ListB
unflatten_7 = UnflattenTree(Tree=long_8.ListB, Guide=crv_26)
offset_10 = Offset(Curve=crv_26, Distance=unflatten_7, Plane=xy_15, Corners=1)
unflatten_8 = UnflattenTree(Tree=offset_10, Guide=dispatch_12.ListB)
weave_6 = Weave(Pattern=P_6, Stream0=unflatten_8, Stream1=crv_27, NullGaps=False)
panel_8 = Panel(unflatten_7)
geosides_3 = Data(geosides)
explode_8 = Explode(Curve=scale_3.Geometry, Recursive=True)  # -> flatten(Segments), Vertices
geo_5 = Geometry(geosides_3)
tablength_6 = Data(tablength)
geoends_4 = Data(geoends)
graft_14 = GraftTree(Tree=geo_5, IncludeEmptyLists=True, IncludeNullItems=True)
eval_13 = EvaluateLength(Curve=explode_8.Segments, Length=0.5, Normalized=True)  # -> Point, Tangent, Parameter
multiplication_3 = Multiplication(A=tablength_6, B="3")
connect_6 = ConnectCurves(Curves=weave_6, Continuity="0", Close=Toggle(False), Bulge=1)
graft_15 = GraftTree(Tree=geoends_4, IncludeEmptyLists=True, IncludeNullItems=True)
ext_6 = ExtendCurve(Curve=connect_6, Type=0, Start=multiplication_3, End=multiplication_3)  # -> simplify(Curve)
srf_cp_3 = SurfaceClosestPoint(Point=eval_13.Point, Surface=graft_15)  # -> Point, UVPoint, Distance
srf_cp_4 = SurfaceClosestPoint(Point=eval_13.Point, Surface=graft_14)  # -> Point, UVPoint, Distance
expression_24 = Expression(x=srf_cp_3.Distance, Expression="x<1")
expression_25 = Expression(x=srf_cp_4.Distance, Expression="x<1")
dispatch_14 = Dispatch(List=explode_8.Segments, DispatchPattern=expression_24)  # -> ListA, ListB
dispatch_15 = Dispatch(List=explode_8.Segments, DispatchPattern=expression_25)  # -> ListA, ListB
crv_28 = Curve(simplify(dispatch_14.ListA))
crv_29 = Curve(simplify(dispatch_15.ListA))

# ---- group: PatchEnds
ultrim_5 = UltraTrim(data=ext_6)
crv_30 = Curve(reparameterize(ultrim_5))
shift_13 = ShiftList(List=crv_30, Shift=1, Wrap=True)
ccx_3 = CurveCurve(CurveA=graft(crv_30), CurveB=graft(shift_13))  # -> Points, ParamsA, ParamsB
avr = Average(Input=ccx_3.Points)
dist_2 = Distance(PointA=avr, PointB=ccx_3.Points)
sort_3 = SortList(Keys=dist_2, ValuesA=ccx_3.Points)  # -> Keys, ValuesA
item_25 = ListItem(List=sort_3.ValuesA, Index=0, Wrap=True)
ultrim_6 = UltraTrim(data=item_25)
shift_14 = ShiftList(List=ultrim_6, Shift=-1, Wrap=True)  # -> graft(List)
item_26 = ListItem(List=graft(ultrim_6), Index=0, Wrap=True)
item_27 = ListItem(List=shift_14, Index=0, Wrap=True)
data_8 = Data(graft(crv_30))
merge_10 = Merge(Data1=simplify(item_26), Data2=simplify(item_27))
crv_cp_4 = CurveClosestPoint(Point=merge_10, Curve=data_8)  # -> Point, Parameter, Distance
shatter_9 = Shatter(Curve=data_8, Parameters=crv_cp_4.Parameter)
item_28 = ListItem(List=shatter_9, Index="1", Wrap=True)
ultrim_7 = UltraTrim(data=item_28)
join_3 = JoinCurves(Curves=ultrim_7, Preserve=False)

# ---- group: ssPatchEnds
ultrim_8 = UltraTrim(data=ext_6)
shift_15 = ShiftList(List=ultrim_8, Shift=1, Wrap=True)
crv_31 = Curve(ultrim_8)
ccx_4 = CurveCurve(CurveA=reparameterize(crv_31), CurveB=reparameterize(shift_15))  # -> Points, ParamsA, ParamsB
trim_2 = TrimTree(Tree=simplify(ccx_4.ParamsB), Depth=1)
shift_16 = ShiftList(List=trim_2, Shift=-1, Wrap=True)
graft_16 = GraftTree(Tree=shift_16, IncludeEmptyLists=True, IncludeNullItems=True)
merge_11 = Merge(Data1=graft_16, Data2=ccx_4.ParamsA)
graft_17 = GraftTree(Tree=crv_31, IncludeEmptyLists=True, IncludeNullItems=True)
bnd_4 = Bounds(Numbers=merge_11)
subcrv_4 = SubCurve(BaseCurve=reparameterize(graft_17), Domain=bnd_4)  # -> simplify(Curve)
ultrim_9 = UltraTrim(data=subcrv_4)
join_4 = JoinCurves(Curves=ultrim_9, Preserve=False)  # -> simplify(Curves)
toggle = GroupToggle(ToggleActive=True, ToggleVisible=False)  # disabled

# ----
group_4 = Group(Objects=crv_28)
group_5 = Group(Objects=crv_29)
flatten = FlattenTree(Tree=group_4, Path="{0}")
unflatten_9 = UnflattenTree(Tree=group_5, Guide=geo_5)
evalsrf_5 = EvaluateSurface(Surface=reparameterize(geosides_3), Point=Point(0, 0, 0))  # -> Point, Normal, Frame
evalsrf_6 = EvaluateSurface(Surface=reparameterize(planesrf_2), Point=Point(0, 0, 0))  # -> Point, Normal, Frame
orient_6 = Orient(Geometry=flatten, Source=move.Geometry, Target=xy_8)  # -> Geometry, Transform
orient_7 = Orient(Geometry=orient_6.Geometry, Source=xy_8, Target=xy_10)  # -> simplify(Geometry), Transform
orient_8 = Orient(Geometry=unflatten_9, Source=evalsrf_5.Frame, Target=evalsrf_6.Frame)  # -> Geometry, Transform

tablength_7 = Data(tablength)
weave_7 = Weave(Pattern=[0, 1], Stream0=trim, Stream1=ultrim_4, NullGaps=False)
multiplication_4 = Multiplication(A=tablength_7, B="3")
ext_7 = ExtendCurve(Curve=weave_7, Type=0, Start=multiplication_4, End=multiplication_4)  # -> simplify(Curve)
shift_17 = ShiftList(List=ext_7, Shift=1, Wrap=True)
crv_32 = Curve(ext_7)
ccx_5 = CurveCurve(CurveA=reparameterize(crv_32), CurveB=reparameterize(shift_17))  # -> Points, ParamsA, ParamsB
trim_3 = TrimTree(Tree=simplify(ccx_5.ParamsB), Depth=1)
shift_18 = ShiftList(List=trim_3, Shift=-1, Wrap=True)
graft_18 = GraftTree(Tree=shift_18, IncludeEmptyLists=True, IncludeNullItems=True)
merge_12 = Merge(Data1=graft_18, Data2=ccx_5.ParamsA)
graft_19 = GraftTree(Tree=crv_32, IncludeEmptyLists=True, IncludeNullItems=True)
bnd_5 = Bounds(Numbers=merge_12)
subcrv_5 = SubCurve(BaseCurve=reparameterize(graft_19), Domain=bnd_5)  # -> simplify(Curve)
trim_4 = TrimTree(Tree=subcrv_5, Depth=1)
join_5 = JoinCurves(Curves=trim_4, Preserve=False)

panel_9 = Panel(unflatten_9)
crv_33 = Curve(item_24)
end_2 = EndPoints(Curve=subcrv_3)  # -> Start, End
Z_3 = UnitZ(Factor=1)
end_3 = EndPoints(Curve=crv_33)  # -> Start, End
vec2pt_2 = Vector2Pt(PointA=end_2.Start, PointB=end_2.End, Unitize=False)  # -> Vector, Length
vec2pt_3 = Vector2Pt(PointA=end_3.Start, PointB=end_3.End, Unitize=False)  # -> Vector, Length
Y = UnitY(Factor=1)
materialthickness_9 = Data(materialthickness)
materialthickness_10 = Data(materialthickness)
pl = ConstructPlane(Origin=end_2.Start, XAxis=vec2pt_2.Vector, YAxis=Z_3)  # -> simplify(graft(Plane))
pl_2 = ConstructPlane(Origin=end_3.Start, XAxis=vec2pt_3.Vector, YAxis=Y)
redpline = Reduce(Polyline=join_5, Tolerance=Slider(0.1, range=0..0.1))  # -> Polyline, Reduction
inverse = InverseTransform(Transform=orient_4.Transform)
Z_4 = UnitZ(Factor=materialthickness_9)
boundary_2 = BoundarySurfaces(Edges=join_3)
Z_5 = UnitZ(Factor=expr("-x", materialthickness_10))
boundary_3 = BoundarySurfaces(Edges=redpline.Polyline)
ungroup_2 = Ungroup(Group=simplify(orient_7.Geometry))
crv_34 = Curve(simplify(join_3))
extr_2 = Extrude(Base=boundary_2, Direction=Z_4)
extr_3 = Extrude(Base=boundary_3, Direction=Z_5)  # -> simplify(Extrusion)
transform = Transform(Geometry=flatten(extr_2), Transform=inverse)
trim_5 = TrimWithRegion(Curve=ungroup_2, Region=crv_34)  # -> Inside, Outside
orient_9 = Orient(Geometry=flatten(extr_2), Source=flatten(xy_10), Target=flatten(xy_9))  # -> Geometry, Transform
crv_35 = Curve(trim_5.Inside)
orient_10 = Orient(Geometry=extr_3, Source=pl_2, Target=pl)  # -> Geometry, Transform
crv_36 = Curve(simplify(crv_35))
group_6 = Group(Objects=[crv_36, crv_34])

data_9 = Data(group_6)
data_10 = Data(join_5)

# ==== cluster UltraTrim: Betterer version of Trim
data = ClusterInput()
data_2 = Data(simplify(data))
trim = TrimTree(Tree=data_2, Depth=1)
null = NullItem(Item=trim)  # -> NullFlags, InvalidFlags, Description
tmatch = MatchText(Text=null.Description, Pattern="Data does not exist", Case=True)
equals = Equality(FirstNumber=null.NullFlags, SecondNumber=1)  # -> Equality, Inequality
equals_2 = Equality(FirstNumber=null.InvalidFlags, SecondNumber=tmatch)  # -> Equality, Inequality
equals_3 = Equality(FirstNumber=null.NullFlags, SecondNumber=null.InvalidFlags)  # -> Equality, Inequality
equals_4 = Equality(FirstNumber=equals_3.Equality, SecondNumber=equals_2.Equality)  # -> Equality, Inequality
equals_5 = Equality(FirstNumber=equals.Equality, SecondNumber=equals_4.Equality)  # -> Equality, Inequality
ma = MassAddition(Input=flatten(equals_5.Inequality))  # -> Result, PartialResults
bool = Boolean(ma.Result)
trim_2 = TrimTree(Tree=data_2, Depth=bool)
T = ClusterOutput(trim_2)
