# Grasshopper definition Brep.gh (Grasshopper 0.9.76)
# plug-ins: Human

dpipeline = DynamicGeometryPipeline(
    LayerFilter="Vertical",
    TypeFilter="Curve",
    NameFilter="*",
    enableFullPath=True,
    GroupByLayer=False,
    GroupByType=False,
    IncludeHidden=True,
    IncludeLocked=True,
    listenToAttributes=True)
bbox = BoundingBox(Plane=PlaneXY(0, 0, 0))  # -> Box, Box_2
building_id = Data()
efficiency = Data()
typology = Data()
parent = Data()
storeys = Data()
f2f = Data()
