# Grasshopper definition Diagram Section.ghx (Grasshopper 1.0.7)
# Copyright: Co-de-iT
# plug-ins: treesloth01, Redback, Human

input = DataInput(Destination="C:\Users\bekjc\Documents\Hackaton\Hackathon2018\MultiBreps.ghdata")  # -> Multi_Breps, Properties; disabled
panel = Panel(input.Properties)  # disabled
tower_by_multiple_breps = TowerByMultipleBreps(geometry=input.Multi_Breps, properties=input.Properties)  # -> floorplates_2, floorplate_properties_2, facade_3, facade_properties_2, full_mass_2, full_mass_properties_2, rooftops_2; disabled
output = DataOutput(
    Floorplate_Properties=tower_by_multiple_breps.floorplate_properties_2,
    Floorplates=tower_by_multiple_breps.floorplates_2,
    Full_Mass=tower_by_multiple_breps.full_mass_2,
    Facade=tower_by_multiple_breps.facade_3,
    Rooftops=tower_by_multiple_breps.rooftops_2,
    Destination="C:\Users\bekjc\Documents\Hackaton\Hackathon2018\Hackaton Multiple Mass.ghdata")  # disabled
preset_standard_page_sizes = Panel("""A5 (L),210,148
A5 (P),148,210
A4 (L),297,210
A4 (P),210,297
A3 (L),420,297
A3 (P),297,420
A2 (L),594,420
A2 (P),420,594
A1 (L),841,594
A1 (P),594,841
A0 (L),1189,841
A0 (P),841,1189""")

dpipeline = DynamicGeometryPipeline(
    LayerFilter="SECTION PLANE",
    TypeFilter="Brep",
    NameFilter="*",
    GroupByLayer=False,
    GroupByType=False,
    IncludeHidden=True,
    IncludeLocked=True,
    enableFullPath=True,
    listenToAttributes=True)

# ----
# GEOMETERY INPUT
panel_2 = Panel("BREPS::Brep3")
dpipeline_2 = DynamicGeometryPipeline(
    LayerFilter=panel_2,
    TypeFilter="Brep",
    NameFilter="*",
    GroupByLayer=False,
    GroupByType=False,
    IncludeHidden=True,
    IncludeLocked=True,
    enableFullPath=True,
    listenToAttributes=True)

# ----
# SECTION PLANE
panel_3 = Panel("0,0")
evalsrf = EvaluateSurface(Surface=dpipeline, Point=panel_3)  # -> Point, unitize(Normal), UDirection, VDirection, Frame

# ----
# ROTATE FRAME FOR SVG PLANE
number_slider = Slider(90, range=0..100)
Z = UnitZ(Factor=1)
align = AlignPlane(Plane=evalsrf.Frame, Direction=Z)  # -> Plane, Angle
neg = Negative(Value=number_slider)
prot = RotatePlane(Plane=align.Plane, Angle=degrees(neg))

pln = Plane(prot)

# ---- group: DEFINE DRAWING PAGE
drawing_scale = Panel("1:500")
paper = Panel("A1 (L)")
svg_plane_by_page = RDB_SVGPlaneByPage(plane=pln, page_size=paper, scale=drawing_scale, position=Toggle(True))  # -> json_layout, preview

# ---- group: CHECK DRAWING DIRECTION
boundary = BoundarySurfaces(Edges=svg_plane_by_page.preview)
evalsrf_2 = EvaluateSurface(Surface=boundary, Point="0,0")  # -> Point, unitize(Normal), UDirection, VDirection, Frame
multiplication = Multiplication(A=evalsrf_2.Normal, B=100)
vdis = VectorDisplay(Anchor=evalsrf_2.Point, Vector=multiplication)

# ----
xy = XYPlane(Origin=pln)

# ---- group: LEGEND RECTANGLES / LEGEND LOCATION
crv = Curve(svg_plane_by_page.preview)
explode = Explode(Curve=crv, Recursive=True)  # -> Segments, Vertices
item = ListItem(List=explode.Vertices, Index=0, Wrap=True)
xy_2 = XYPlane(Origin=item)
orient = Orient(Geometry=pln, Source=xy, Target=xy_2)  # -> Geometry, Transform

# ----
tower_by_multiple_breps_2 = TowerByMultipleBreps(geometry=dpipeline_2)  # -> floorplates_2, floorplate_properties_2, facade_3, facade_properties_2, full_mass_2, full_mass_properties_2, rooftops_2
svg_plane_by_page_2 = RDB_SVGPlaneByPage(plane=PlaneXY(0, 0, 0), page_size="A3 (P)", scale="1:500", position=True)  # -> json_layout, preview
geo = Geometry()
panel_4 = Panel("""stroke-width: 0.02mm;
fill: rgb(0,0,0)""")
geo2archijson = Geo2ArchiJSON(output_type=1)
draw = DrawSVG()
# LEVEL LINES
sec = BrepPlane(Brep=tower_by_multiple_breps_2.floorplates_2, Plane=evalsrf.Frame)  # -> Curves, Points
# OUTLINE
sec_2 = BrepPlane(Brep=tower_by_multiple_breps_2.full_mass_2, Plane=evalsrf.Frame)  # -> Curves, Points
css_styling = Panel(""".Resi-Stroke{
stroke:black;
stroke-width: *mm;
fill:none;
}

.Resi-Fill{
fill: rgb(204,108,120);
}

.Comm-Stroke{
stroke:black;
stroke-width: *mm;
fill:none;
}

.Comm-Fill{
fill: rgb(130,215,255);
}""")
clean = CleanTree(RemoveNulls=True, RemoveInvalid=True, RemoveEmpty=True, Tree=sec_2.Curves)

# ---- group: STROKE THICKNESS
number_slider_2 = Slider(0.02, range=0..0.1)
# CSS Styling: .Resi-Stroke{
# stroke:black;
# stroke-width: *mm;
# fill:none;
# }
# 
# .Resi-Fill{
# fill: rgb(204,108,120);
# }
# 
# .Comm-Stroke{
# stroke:black;
# stroke-width: *mm;
# fill:none;
# }
# 
# .Comm-Fill{
# fill: rgb(130,215,255);
# }
mrep = ReplaceMultiText(T=css_styling, F="*", R=Slider(0.1, range=0..0.1))

# ----
# DISPATCH LINES CUT FOR SECTION
null = NullItem(Item=sec.Curves)  # -> NullFlags, InvalidFlags, Description
trim = TrimTree(Tree=null.NullFlags, Depth=1)
dispatch = Dispatch(List=tower_by_multiple_breps_2.floorplate_properties_2, DispatchPattern=trim)  # -> ListA, ListB
clean_2 = CleanTree(RemoveNulls=True, RemoveInvalid=True, RemoveEmpty=True, Tree=dispatch.ListB)

boundary_2 = BoundarySurfaces(Edges=clean)  # -> simplify(flatten(Surfaces))

# ----
# OUTLINE
number_slider_3 = Slider(4, range=0..10)
multiplication_2 = Multiplication(A=evalsrf.Normal, B=number_slider_3)
clean_3 = CleanTree(RemoveNulls=True, RemoveInvalid=True, RemoveEmpty=True, Tree=sec.Curves)  # -> simplify(flatten(Tree))
bcx = BrepCurve(Brep=boundary_2, Curve=clean_3)  # -> flatten(Curves), Points
extr = Extrude(Base=bcx.Curves, Direction=multiplication_2)

splitmul = SplitBrepMultiple(Brep=boundary_2, Cutters=extr)
debrep = DeconstructBrep(Brep=splitmul)  # -> Faces, Edges, Vertices
read = ReadJSON(Object=clean_2, Key="Typology")
join = JoinCurves(Curves=debrep.Edges, Preserve=False)  # -> flatten(Curves)
cset = CreateSet(List=read)  # -> Set, Map

# ---- group: CLASS
panel_5 = Panel("""-Stroke
-Fill""")
graft = GraftTree(Tree=cset.Set, IncludeEmptyLists=True, IncludeNullItems=True)  # -> simplify(Tree)
concat = Concatenate(FragmentA=graft, FragmentB=panel_5)  # -> simplify(flatten(Result))
graft_2 = GraftTree(Tree=concat, IncludeEmptyLists=True, IncludeNullItems=True)  # -> simplify(Tree)
json = JSON(Key="class", Value=graft_2)

# ---- group: LEGEND RECTANGLES
number_slider_4 = Slider(20, range=0..100)
deplane = DeconstructPlane(Plane=pln)  # -> Origin, unitize(XAxis), YAxis, ZAxis
multiplication_3 = Multiplication(A=deplane.XAxis, B=number_slider_4)
multiplication_4 = Multiplication(A=deplane.YAxis, B=number_slider_4)
lng = ListLength(List=cset.Set)
Z_2 = UnitZ(Factor=Slider(20, range=0..100))
number_slider_5 = Slider(50, range=0..100)
move = Move(Geometry=orient.Geometry, Motion=multiplication_3)  # -> Geometry, Transform
move_2 = Move(Geometry=move.Geometry, Motion=multiplication_4)  # -> Geometry, Transform
arrlinear = LinearArray(Geometry=move_2.Geometry, Direction=Z_2, Count=lng)  # -> Geometry, Transform
rectangle = Rectangle(Plane=arrlinear.Geometry, XSize=number_slider_5, YSize=Slider(11, range=0..100), Radius=0)  # -> Rectangle, Length

# ----
addition = Addition(A=number_slider_5, B=Slider(10, range=0..10))
multiplication_5 = Multiplication(A=deplane.XAxis, B=addition)
graft_3 = GraftTree(Tree=rectangle.Rectangle, IncludeEmptyLists=True, IncludeNullItems=True)
move_3 = Move(Geometry=arrlinear.Geometry, Motion=multiplication_5)  # -> Geometry, Transform
textclass = RDB_TextClass(LOCATION=graft(move_3.Geometry), TEXT=graft(cset.Set))  # -> simplify(OUTPUT), flatten(O)
# ---------- textclass: Python ----------
import Rhino as r
import rhinoscriptsyntax as rs
import json

L = LOCATION

T = TEXT


class text:
    def __init__(self, location, content):
        self.location = location
        self.content = str(content)
        self.type = "text"

O = text(L,T)

print O.location
print O.content
# ---------- end textclass ----------
panel_6 = Panel(cset.Set)
draw_2 = DrawSVG_2(objects=textclass.OUTPUT, layout=svg_plane_by_page.json_layout, css=mrep)  # -> simplify(svg)
mindex = MemberIndex(Set=read, Member=cset.Set)  # -> Index, Count
file_path = Panel("C:\Users\bekjc\Documents\Hackaton\Hackathon2018\SVG")
item_2 = ListItem(List=read, Index=mindex.Index, Wrap=True)  # -> simplify(Item)
item_3 = ListItem(List=join, Index=mindex.Index, Wrap=True)  # -> simplify(Item)
floor_plates = Geometry(item_3)
merge = Merge(Data1=simplify(floor_plates), Data2=simplify(graft_3))
topoly = CurveToPolyline(Curve=merge, ToleranceDistance=0, ToleranceAngle=0)  # -> Polyline, Segments

# ---- group: REPEAT FOR STROKE AND FILL CLASSES
group = Group(Objects=topoly.Polyline)  # -> graft(Group)
lng_2 = ListLength(List=group)
multiplication_6 = Multiplication(A=lng_2, B=Slider(2, range=0..10))
repeat = RepeatData(Data=group, Length=multiplication_6)  # -> flatten(Data)
ungroup = Ungroup(Group=repeat)  # -> simplify(Objects)

# ----
long = LongestList(ListA=ungroup, ListB=json, PaddingMode=2)  # -> ListA, ListB
geo2archijson_2 = Geo2ArchiJSON_2(G=long.ListA, properties=long.ListB, output_type=Toggle(False))
draw_3 = DrawSVG_2(objects=geo2archijson_2, layout=svg_plane_by_page.json_layout, css=mrep)  # -> simplify(svg)

# ---- group: FILE NAME
concat_2 = Concatenate(FragmentA=graft_2, FragmentB=".svg")  # -> flatten(Result)
panel_7 = Panel(concat_2)

# ----
graft_4 = GraftTree(Tree=concat_2, IncludeEmptyLists=True, IncludeNullItems=True)
explode_2 = Explode(Curve=clean, Recursive=True)  # -> Segments, Vertices
eval = EvaluateCurve(Curve=reparameterize(explode_2.Segments), Parameter=0.5)  # -> Point, Tangent, Angle
# Can be editted live in photoshop. Open a file the same size then go to "File, place linked"
write_file = WRITEFILE(content=draw_3, filepath=file_path, filename=graft_4, activate=Toggle(True))
pdecon = Deconstruct(Point=eval.Point)  # -> XComponent, YComponent, ZComponent
sort = SortList(Keys=pdecon.ZComponent, ValuesA=explode_2.Segments)  # -> Keys, ValuesA
number_slider_6 = Slider(999, range=0..1000)
first_last = FirstLast(List=sort.ValuesA)  # -> FirstValue, LastValue
geo_2 = Geometry(first_last.FirstValue)
ext = ExtendCurve(Curve=geo_2, Type=0, Start=number_slider_6, End=number_slider_6)
Z_3 = UnitZ(Factor=Slider(60, range=0..100))
ground = Geometry(ext)
neg_2 = Negative(Value=Z_3)
extr_2 = Extrude(Base=ground, Direction=neg_2)

# ---- group: CLASS
panel_8 = Panel("""Ground
Ground-Fill
Outline""")
json_2 = JSON(Key="class", Value=graft(panel_8))

# ----
area = Area(Geometry=extr_2)  # -> Area, Centroid
edgesfaces = EdgesFromFaces(Brep=extr_2, Points=area.Centroid)  # -> Edges, Indices
outline = Geometry(clean)
join_2 = JoinCurves(Curves=edgesfaces.Edges, Preserve=False)  # -> flatten(Curves)
merge_2 = Merge(Data1=flatten(ground), Data2=flatten(join_2), Data3=flatten(outline))  # -> graft(Result)
css_styling_2 = Panel(""".Ground{
stroke:black;
stroke-width: 2mm;
fill:none;
}
.Ground-Fill{
stroke:none;
fill:grey;
}
.Outline{
stroke:black;
stroke-width: 2mm;
fill:none;
}""")
long_2 = LongestList(ListA=merge_2, ListB=json_2, PaddingMode=2)  # -> ListA, ListB
panel_9 = Panel(long_2.ListA)
geo2archijson_3 = Geo2ArchiJSON_2(G=merge_2, properties=json_2, output_type=Toggle(False))
draw_4 = DrawSVG_2(objects=geo2archijson_3, layout=svg_plane_by_page.json_layout, css=css_styling_2)  # -> simplify(svg)
concat_3 = Concatenate(FragmentA=panel_8, FragmentB=".svg")  # -> flatten(Result)
panel_10 = Panel(concat_3)
graft_5 = GraftTree(Tree=concat_3, IncludeEmptyLists=True, IncludeNullItems=True)
write_file_2 = WRITEFILE(content=draw_4, filepath=file_path, filename=graft_5, activate=Toggle(True))

# ==== cluster TowerByMultipleBreps
properties = ClusterInput()
geometry = ClusterInput()
properties_2 = Data(properties)
geometry_2 = Data(geometry)

# ----
# SORT INTO BUILDINGS
panel = Panel("BuildID")
getuv = GetUserValue(Geometry=geometry_2, Key=panel)
cset = CreateSet(List=getuv)  # -> simplify(graft(Set)), Map
tmatch = MatchText(Text=getuv, Pattern=cset.Set, Case=True)
dispatch = Dispatch(List=geometry_2, DispatchPattern=tmatch)  # -> simplify(ListA), ListB

read = ReadJSON(Object=properties_2)
panel_2 = Panel("true = 1")
null = NullItem(Item=getuv)  # -> NullFlags, InvalidFlags, Description
cset_2 = CreateSet(List=null.NullFlags)  # -> Set, Map
filter = StreamFilter(Gate=cset_2.Set)
panel_3 = Panel(cset_2.Set)

# ----
# GET LOWEST POINT ON EACH BREP
debrep = DeconstructBrep(Brep=dispatch.ListA)  # -> Faces, Edges, simplify(Vertices)
pdecon = Deconstruct(Point=debrep.Vertices)  # -> XComponent, YComponent, ZComponent
sort = SortList(Keys=pdecon.ZComponent, ValuesA=debrep.Vertices)  # -> reverse(Keys), reverse(ValuesA)
item = ListItem(List=sort.Keys, Index=-1, Wrap=True)  # -> simplify(Item)
utrim = UberTrim(data=item)

# ----
# CALCULATE HEIGHT OF EACH BREP
bbox = BoundingBox(Content=dispatch.ListA, Plane=PlaneXY(0, 0, 0))  # -> Box, Box_2
debox = DeconstructBox(Box=bbox.Box)  # -> Plane, X, Y, Z
dedomain = DeconstructDomain(Domain=debox.Z)  # -> Start, End
subtraction = Subtraction(A=dedomain.End, B=dedomain.Start)

area = Area(Geometry=debrep.Faces)  # -> Area, Centroid
pdecon_2 = Deconstruct(Point=area.Centroid)  # -> XComponent, YComponent, ZComponent
getuv_2 = GetUserValue(Geometry=dispatch.ListA, Key="F2F")
getuv_3 = GetUserValue(Geometry=dispatch.ListA, Key="Typology")
getuv_4 = GetUserValue(Geometry=dispatch.ListA, Key="SubBuildID")
len = TextLength(Text=getuv_4)
utrim_2 = UberTrim(data=len)
cset_3 = CreateSet(List=utrim_2)  # -> Set, Map
sort_2 = SortList(Keys=cset_3.Set)  # -> Keys, ValuesA
num = Number(sort_2.Keys)
num_2 = Number(utrim_2)
mindex = MemberIndex(Set=num_2, Member=num)  # -> Index, Count
lng = ListLength(List=mindex.Index)
trim = TrimTree(Tree=lng, Depth=1)
join = TextJoin(Text=getuv_4, Join="\t")
lng_2 = ListLength(List=trim)
repeat = RepeatData(Data=join, Length=lng_2)
split = TextSplit(Text=repeat, Separators="\t")
item_2 = ListItem(List=split, Index=mindex.Index, Wrap=True)  # -> simplify(Item)
lng_3 = ListLength(List=item_2)
join_2 = TextJoin(Text=item_2, Join="^")
join_3 = TextJoin(Text=lng_3, Join="^")
utrim_3 = UberTrim(data=join_3)
utrim_4 = UberTrim(data=join_2)
larger = LargerThan(FirstNumber=utrim_3, SecondNumber=Slider(1, range=0..1))  # -> LargerThan, OrEqualTo
lng_4 = ListLength(List=larger.LargerThan)
series = Series(Start=0, Step=1, Count=lng_4)
dispatch_2 = Dispatch(List=utrim_4, DispatchPattern=larger.LargerThan)  # -> ListA, ListB
cull = CullPattern(List=series, CullPattern=larger.LargerThan)
split_2 = SplitList(List=utrim_4, Index=cull)  # -> ListA, ListB
split_3 = TextSplit(Text=split_2.ListB, Separators="^")  # -> simplify(Result)
split_4 = TextSplit(Text=split_2.ListA, Separators="^")  # -> simplify(Result)
utrim_5 = UberTrim(data=split_3)
getuv_5 = GetUserValue(Geometry=dispatch.ListA, Key="BuildID")
sort_3 = SortList(Keys=pdecon_2.ZComponent, ValuesA=debrep.Faces, ValuesB=area.Centroid)  # -> Keys, ValuesA, ValuesB
item_3 = ListItem(List=utrim_5, Index=0, Wrap=True)
chars = Characters(Text=getuv_4)  # -> Result, Unicode
len_2 = TextLength(Text=item_3)
series_2 = Series(Start=0, Step=1, Count=len_2)
item_4 = ListItem(List=chars.Result, Index=series_2, Wrap=True)  # -> Item, Item1, Item2

# ----
# NUMBER OF FLOORS
division = Division(A=subtraction, B=getuv_2)
round = Round(Number=division)  # -> simplify(Nearest), Floor, Ceiling

merge = Merge(Data1=item_4.Item)
panel_4 = Panel(getuv_4)
join_4 = TextJoin(Text=item_4.Item)
panel_5 = Panel(round.Nearest)
panel_6 = Panel(join_4)

# ----
# PLANE PER LEVEL
series_3 = Series(Start=utrim, Step=getuv_2, Count=round.Nearest)
pt = ConstructPoint(XCoordinate=0, YCoordinate=0, ZCoordinate=series_3)  # -> simplify(Point)
xy = XYPlane(Origin=pt)

graft = GraftTree(Tree=dispatch.ListA, IncludeEmptyLists=True, IncludeNullItems=True)
sunion = SolidUnion(Breps=dispatch.ListA)
data = Data(getuv_5)

# ---- group: BUILD ID
dup = DuplicateData(Data=graft(getuv_5), Number=graft(round.Nearest), Order=True)  # -> simplify(Data)

# ---- group: SUB BUILD ID
dup_2 = DuplicateData(Data=graft(getuv_4), Number=graft(round.Nearest), Order=True)  # -> simplify(Data)

# ---- group: TYPOLOGY
# TYPOLOGY OF FLOOR
dup_3 = DuplicateData(Data=graft(getuv_3), Number=graft(round.Nearest), Order=True)  # -> simplify(Data)

dup_4 = DuplicateData(Data=graft(getuv_2), Number=graft(round.Nearest), Order=True)  # -> simplify(Data)

# ----
# FLOOR PLATE CRVS
sec = BrepPlane(Brep=graft, Plane=xy)  # -> Curves, Points

debrep_2 = DeconstructBrep(Brep=dispatch.ListA)  # -> Faces, Edges, Vertices

# ---- group: all floorplates
boundary = BoundarySurfaces(Edges=sec.Curves)  # -> simplify(Surfaces)

# ----
debrep_3 = DeconstructBrep(Brep=sunion)  # -> Faces, Edges, Vertices
evalsrf = EvaluateSurface(Surface=reparameterize(debrep_2.Faces), Point="0.5,0.5")  # -> Point, Normal, UDirection, VDirection, Frame
utrim_6 = UberTrim(data=boundary)

# ---- group: sort by height to get tops
area_2 = Area(Geometry=utrim_6)  # -> Area, Centroid
pdecon_3 = Deconstruct(Point=area_2.Centroid)  # -> XComponent, YComponent, ZComponent
sort_4 = SortList(
    Keys=pdecon_3.ZComponent,
    ValuesFloorplate=utrim_6,
    ValuesTypology=dup_3,
    ValuesSubBuildID=dup_2,
    ValuesBuildID=dup,
    ValuesA=dup_4)  # -> reverse(Keys), reverse(ValuesFloorplate), reverse(ValuesTypology), reverse(ValuesSubBuildID), reverse(ValuesBuildID), ValuesA
item_5 = ListItem(List=sort_4.ValuesFloorplate, Index=0, Wrap=True)

# ----
pdecon_4 = Deconstruct(Point=evalsrf.Point)  # -> XComponent, YComponent, ZComponent
evalsrf_2 = EvaluateSurface(Surface=reparameterize(debrep_3.Faces), Point="0.5,0.5")  # -> Point, Normal, UDirection, VDirection, Frame
panel_7 = Panel("""-1
0""")
sort_5 = SortList(Keys=pdecon_4.ZComponent, ValuesA=debrep_2.Faces)  # -> Keys, ValuesA
devec = DeconstructVector(Vector=evalsrf_2.Normal)  # -> XComponent, YComponent, ZComponent

# ---- group: facade
cull_i = CullIndex(List=sort_5.ValuesA, Indices=panel_7, Wrap=True)  # -> simplify(List)

# ----
geo = Geometry(cull_i)
cull_i_2 = CullIndex(List=sort_4.ValuesFloorplate, Indices=0, Wrap=True)  # -> simplify(List)
equals = Equality(FirstNumber=devec.ZComponent, SecondNumber=Slider(1, range=0..1))  # -> Equality, Inequality

# ---- group: usable space above floor
area_3 = Area(Geometry=item_5)  # -> Area, Centroid
Z = UnitZ(Factor=1)
graft_2 = GraftTree(Tree=getuv_2, IncludeEmptyLists=True, IncludeNullItems=True)
line = LineSDL(Start=area_3.Centroid, Direction=Z, Length=graft_2)

# ----
dispatch_3 = Dispatch(List=debrep_3.Faces, DispatchPattern=equals.Equality)  # -> ListA, ListB
graft_3 = GraftTree(Tree=dispatch.ListA, IncludeEmptyLists=True, IncludeNullItems=True)
utrim_7 = UberTrim(data=dispatch_3.ListA)
bcx = BrepCurve(Brep=graft_3, Curve=line)  # -> Curves, simplify(Points)
group = Group(Objects=dispatch.ListA)
number_slider = Slider(0.1, range=0..0.1)
data_2 = Data(utrim_7)
Z_2 = UnitZ(Factor=Slider(0.5, range=0..1))
null_2 = NullItem(Item=bcx.Points)  # -> NullFlags, InvalidFlags, Description

# ---- group: Typology
item_6 = ListItem(List=sort_4.ValuesTypology, Index=0, Wrap=True)
cull_i_3 = CullIndex(List=sort_4.ValuesTypology, Indices=0, Wrap=True)  # -> simplify(List)
dispatch_4 = Dispatch(List=item_6, DispatchPattern=null_2.NullFlags)  # -> ListA, ListB
merge_2 = Merge(Data1=dispatch_4.ListA, Data2=cull_i_3)

# ---- group: SubBuildID
item_7 = ListItem(List=sort_4.ValuesSubBuildID, Index=0, Wrap=True)
cull_i_4 = CullIndex(List=sort_4.ValuesSubBuildID, Indices=0, Wrap=True)  # -> simplify(List)
dispatch_5 = Dispatch(List=item_7, DispatchPattern=null_2.NullFlags)  # -> ListA, ListB
merge_3 = Merge(Data1=dispatch_5.ListA, Data2=cull_i_4)

# ---- group: BuildID
item_8 = ListItem(List=sort_4.ValuesBuildID, Index=0, Wrap=True)
cull_i_5 = CullIndex(List=sort_4.ValuesBuildID, Indices=0, Wrap=True)  # -> simplify(List)
dispatch_6 = Dispatch(List=item_8, DispatchPattern=null_2.NullFlags)  # -> ListA, ListB
merge_4 = Merge(Data1=dispatch_6.ListA, Data2=cull_i_5)

# ----
area_4 = Area(Geometry=data_2)  # -> Area, Centroid
lng_5 = ListLength(List=area_4.Centroid)
dup_5 = DuplicateData(Data=group, Number=lng_5, Order=True)
neg = Negative(Value=Z_2)

# ---- group: BuildID
item_9 = ListItem(List=sort_4.ValuesA, Index=0, Wrap=True)
cull_i_6 = CullIndex(List=sort_4.ValuesA, Indices=0, Wrap=True)  # -> simplify(List)
dispatch_7 = Dispatch(List=item_9, DispatchPattern=null_2.NullFlags)  # -> ListA, ListB
merge_5 = Merge(Data1=dispatch_7.ListA, Data2=cull_i_6)

# ----
dispatch_8 = Dispatch(List=item_5, DispatchPattern=null_2.NullFlags)  # -> ListA, ListB
merge_6 = Merge(Data1=dispatch_8.ListA, Data2=cull_i_2)
ungroup = Ungroup(Group=dup_5)  # -> simplify(Objects)
move = Move(Geometry=area_4.Centroid, Motion=neg)  # -> graft(Geometry), Transform
area_5 = Area(Geometry=merge_6)  # -> Area, Centroid
brepinc = PointInBrep(Brep=ungroup, Point=move.Geometry, Strict=False)
subbuild_id = Data(getuv_4)
typology = Data(getuv_3)
build_id = Data(getuv_5)
lng_6 = ListLength(List=cull_i)
pdecon_5 = Deconstruct(Point=area_5.Centroid)  # -> XComponent, YComponent, ZComponent
sort_6 = SortList(
    Keys=pdecon_5.ZComponent,
    ValuesFloorPlate=merge_6,
    ValuesTypology=merge_2,
    ValuesSubBuildID=merge_3,
    ValuesBuildID=merge_4,
    ValuesA=merge_5)  # -> Keys, ValuesFloorPlate, ValuesTypology, ValuesSubBuildID, ValuesBuildID, ValuesA
pt_2 = ConstructPoint(XCoordinate=0, YCoordinate=0, ZCoordinate=sort_6.Keys)
xy_2 = XYPlane(Origin=pt_2)
group_2 = Group(Objects=xy_2)
long = LongestList(ListA=geo, ListB=group_2, PaddingMode=2)  # -> ListA, ListB
ungroup_2 = Ungroup(Group=long.ListB)
sec_2 = BrepPlane(Brep=graft(long.ListA), Plane=ungroup_2)  # -> Curves, Points
shift = ShiftPaths(Data=sec_2.Curves, Offset=-1)  # -> simplify(Data)
utrim_8 = UberTrim(data=sec_2.Curves)
srfsplit = SurfaceSplit(Surface=graft(long.ListA), Curves=shift)  # -> simplify(Fragments)
facade = Data(srfsplit)
utrim_9 = UberTrim(data=facade)
area_6 = Area(Geometry=utrim_9)  # -> Area, Centroid
pdecon_6 = Deconstruct(Point=area_6.Centroid)  # -> XComponent, YComponent, ZComponent
sort_7 = SortList(Keys=pdecon_6.ZComponent, ValuesA=utrim_9)  # -> Keys, ValuesA, ValuesC, ValuesD, ValuesE
partition = PartitionList(List=sort_7.ValuesA, Size=lng_6)
dispatch_9 = Dispatch(List=ungroup, DispatchPattern=brepinc)  # -> ListA, ListB
dispatch_10 = Dispatch(List=ungroup, DispatchPattern=brepinc)  # -> ListA, ListB
geo_2 = Geometry(dispatch_9.ListA)
panel_8 = Panel("""RL
Typology
SubBuildID
BuildID
F2F""")
join_5 = BrepJoin(Breps=partition)  # -> Breps, Closed
merge_7 = Merge(Data2=graft(sort_6.ValuesTypology), Data3=graft(sort_6.ValuesSubBuildID), Data4=graft(sort_6.ValuesBuildID))  # -> simplify(Result)
merge_8 = Merge(
    Data1=graft(sort_6.Keys),
    Data2=graft(sort_6.ValuesTypology),
    Data3=graft(sort_6.ValuesSubBuildID),
    Data4=graft(sort_6.ValuesBuildID),
    Data5=graft(sort_6.ValuesA))  # -> simplify(Result)
utrim_10 = UberTrim(data=join_5.Breps)
panel_9 = Panel("""Typology
SubBuildID
BuildID""")
json = JSON(Key=panel_8, Value=merge_8)

cset_4 = CreateSet(List=data)  # -> Set, Map
utrim_11 = UberTrim(data=sunion)
json_2 = JSON(Key="BuildID", Value=cset_4.Set)
full_mass = Data(utrim_11)
full_mass_properties = Data(json_2)
full_mass_2 = ClusterOutput(full_mass)
full_mass_properties_2 = ClusterOutput(full_mass_properties)

utrim_12 = UberTrim(data=json)
rooftops = Geometry(utrim_7)
json_3 = JSON(Key=panel_9, Value=merge_7)
utrim_13 = UberTrim(data=sort_6.ValuesFloorPlate)
rooftops_2 = ClusterOutput(rooftops)
utrim_14 = UberTrim(data=utrim_12)
utrim_15 = UberTrim(data=utrim_10)
utrim_16 = UberTrim(data=json_3)
floorplate_properties = Data(utrim_14)
floorplates = Data(simplify(utrim_13))
utrim_17 = UberTrim(data=utrim_16)
facade_2 = Data(utrim_15)
facade_properties = Data(utrim_17)
facade_3 = ClusterOutput(facade_2)
floorplate_properties_2 = ClusterOutput(floorplate_properties)
floorplates_2 = ClusterOutput(floorplates)
facade_properties_2 = ClusterOutput(facade_properties)

# ==== cluster RDB_SVGPlaneByPage: Makes a layout json for svg
plane = ClusterInput()  # Orientation and Location of Page
page_size = ClusterInput()  # Size of Page. Input a page size from A5-A0 followed by the orientation (P) or (L), Example: 'A1 (P)'. Alternatively, input dimensions, eg. '500,500'
scale = ClusterInput()  # Scale of Page
position = ClusterInput()  # Position of Plane relative to the page. True = Plane at Centre, False = Plane at Top Left
preset_standard_page_sizes = Panel("""A5 (L),210,148
A5 (P),148,210
A4 (L),297,210
A4 (P),210,297
A3 (L),420,297
A3 (P),297,420
A2 (L),594,420
A2 (P),420,594
A1 (L),841,594
A1 (P),594,841
A0 (L),1189,841
A0 (P),841,1189""")
split = TextSplit(Text=preset_standard_page_sizes, Separators=",")
item = ListItem(List=split, Index=0, Wrap=True)  # -> flatten(Item)

# ---- group: Find which Page Size is being called and pick it from list
mindex = MemberIndex(Set=item, Member=simplify(page_size))  # -> simplify(flatten(Index)), Count
item_2 = ListItem(List=preset_standard_page_sizes, Index=mindex.Index, Wrap=True)  # -> simplify(Item)
merge = Merge(Data1=simplify(item_2), Data2=simplify(page_size))
item_3 = ListItem(List=merge, Index=0, Wrap=True)

# ----
split_2 = TextSplit(Text=scale, Separators=":")
item_4 = ListItem(List=split_2, Index=0, Wrap=True)  # -> Item, Item1
unit_checker = PythonScript()  # -> out, a
# ---------- unit_checker: Python ----------
import rhinoscriptsyntax as rs
import scriptcontext as sc

a=sc.doc.ModelUnitSystem
a = str(a)
if a == "Millimeters":
    print 1
elif a == "Meters":
    print 1000
else:
    print "Use the metric system"
# ---------- end unit_checker ----------
pos = Boolean(position)
division = Division(A=item_4.Item1, B=unit_checker.out)

# ---- group: Choose location of centre
panel = Panel("""1,1
0.5,0.5""")
item_5 = ListItem(List=panel, Index=pos, Wrap=True)

# ----
num = Number(division)

# ---- group: Extract Dimensions
split_3 = TextSplit(Text=item_3, Separators=",")
item_6 = ListItem(List=reverse(split_3), Index=[0, 1], Wrap=True)  # -> reverse(Item)
num_2 = Number(item_6)

# ----
split_4 = TextSplit(Text=item_5, Separators=",")
plane_2 = Data(plane)
dispatch = Dispatch(List=split_4, DispatchPattern=[True, False])  # -> ListA, ListB

# ---- group: Convert to Scale
expression = Expression(x=num_2, y=num, Expression="x*y")

# ----
dispatch_2 = Dispatch(List=expression, DispatchPattern=[True, False])  # -> ListA, ListB

# ---- group: Create domains
dom = ConstructDomain(DomainStart=expr("-x", dispatch_2.ListB), DomainEnd=0)
dom_2 = ConstructDomain(DomainStart=expr("-x", dispatch_2.ListA), DomainEnd=0)

# ---- group: Remap to match centre pt location
remap = RemapNumbers(Value=dispatch.ListB, Source=Domain(0, 1), Target=dom)  # -> Mapped, Clipped
remap_2 = RemapNumbers(Value=dispatch.ListA, Source=Domain(0, 1), Target=dom_2)  # -> Mapped, Clipped

# ---- group: Adjust Centre Plane
pt = PointOriented(BasePlane=plane_2, UComponent=remap_2.Mapped, VComponent=expr("-x", remap.Mapped), WComponent=0)
pl_origin = PlaneOrigin(Base=plane_2, Origin=pt)

# ----
expression_2 = Expression(x=remap_2.Mapped, y=dispatch_2.ListA, Expression="x+y")
expression_3 = Expression(x=remap.Mapped, y=dispatch_2.ListB, Expression="x+y")

# ---- group: Create Adjusted Domain
dom_3 = ConstructDomain(DomainStart=remap_2.Mapped, DomainEnd=expression_2)
dom_4 = ConstructDomain(DomainStart=remap.Mapped, DomainEnd=expression_3)

# ----
x_dim = Domain(dom_4)
y_dim = Domain(dom_3)
plane_3 = Plane(flatten(pl_origin))
scale_2 = Number(flatten(num))
dims = Number(flatten(num_2))
neg = Negative(Value=x_dim)
python = PythonScript(PLANE=plane_3, PAGE=dims, SCALE=scale_2)  # -> JSON; inputs PAGE: list
# ---------- python: Python ----------
import Rhino as r
import rhinoscriptsyntax as rs
import json
p = PLANE
o = {"plane":[[p.Origin[0],p.Origin[1],p.Origin[2]],[p.XAxis[0],p.XAxis[1],p.XAxis[2]],[p.YAxis[0],p.YAxis[1],p.YAxis[2]]], "page":PAGE, "scale":SCALE}
JSON = json.dumps(o)
# ---------- end python ----------

# ---- group: Construct Crv
rectangle = Rectangle(Plane=plane_2, XSize=y_dim, YSize=neg, Radius=0)  # -> Rectangle, Length

# ----
json = Data(python)
preview = ClusterOutput(rectangle.Rectangle)  # Previews the page curve
json_layout = ClusterOutput(json)  # Layout JSON containing Plane, Page, Scale

# ==== cluster DrawSVG: Creates SVG output from ArchiJSON objects. Version 18.09.10
objects = ClusterInput()  # ArchiJSON obects
css = ClusterInput()  # CSS Text
layout = ClusterInput()  # Layout Object
python = PythonScript(OBJECTS=objects, LAYOUT=layout, CSS=css)  # -> SVG; inputs OBJECTS: list, CSS: list
# ---------- python: Python ----------
import rhinoscriptsyntax as rs
import sys
import json
import inspect
import Rhino as r
from string import Template

log = []
#The inputs to this node will be stored as a list in the IN variables.
in1 = OBJECTS
def checkRB(ob):
    if str(type(ob)) == "<type 'str'>":
        return json.loads(ob)
    else:
        return ob
in1 = list(map(lambda u: checkRB(u),in1))
array = []
def featurecollection(o):
    for i in o["features"]:
        fCall = function_mappings[i['geometry']['type']]
        props = {}
        try:
            props = i['properties']
        except:
            pass
        obarray.append(fCall(i['geometry'],props))
def feature(o):
    pass
def point(o,w=True):
    pt = r.Geometry.Point3d(o[0],o[1],o[2])
    remap = r.Geometry.Plane.RemapToPlaneSpace(lPlane, pt)
    rpt = remap[1]
    rpt = [rpt[0]/layout['scale'],-1*rpt[1]/layout['scale'],rpt[2]/layout['scale']]
    pt = str(remap[1][0]/layout['scale'])+","+str(remap[1][1]/layout['scale']*-1)
    if w:
        return pt
    else:
        return rpt


def line(o, props):
    #<polyline points="118.85,155.3 118.85,180.7" class="FOPActual" zindex="10"/>
    pts = map(lambda i: point(i,False), o['coordinates'])
    propString = []
    for k in props:
        print(k)
        print(props[k])
        propString.append(str(k)+'=\"'+str(props[k])+'\"')
    pString = " ".join(propString)
    pline = '<line x1="'+str(pts[0][0])+'" y1="'+str(pts[0][1])+'" x2="'+str(pts[1][0])+'" y2="'+str(pts[1][1])+'" '+pString+'/>'
    #pline = NurbsCurve.ByControlPoints(polarray,1,o['properties']['closed'])
    return pline


def polyline(o, props):
    #<polyline points="118.85,155.3 118.85,180.7" class="FOPActual" zindex="10"/>
    polarray = []
    for p in o['coordinates']:
        pt = point(p)
        polarray.append(pt)
    pts = " ".join(polarray)
    propString = []
    for k in props:

        propString.append(str(k)+'=\"'+str(props[k])+'\"')
    pString = " ".join(propString)
    if o['closed']:
        pline = '<polygon points=\"'+pts+'\" '+pString+'/>'
    else: 
        pline = '<polyline points=\"'+pts+'\" '+pString+'/>'
    #pline = NurbsCurve.ByControlPoints(polarray,1,o['properties']['closed'])
    return pline

def text(o, props):
    #<text class="CLASS" zindex="500" transform="matrix(1 0 0 1 210 148.5)">TEXT</text> 
    propString = []
    for k in props:
        propString.append(str(k)+'=\"'+str(props[k])+'\"')
    pString = " ".join(propString)
    gm = o['coordinates']
    planeorigin = [gm[3],gm[7],gm[11]]
    planeremap = point(planeorigin,False)
    matrix = [str(gm[0]), str(gm[1]),str(gm[4]),str(gm[5]), str(planeremap[0]), str(planeremap[1])]
    matrixtext = " ".join(matrix)
    text = '<text '+pString+' transform="matrix(%s)">%s</text>'%(matrixtext,o['content'])
    print text
    return text
def image(o, props):
    #<image width="132.543857" height="132.543857" transform="matrix(-0.173648 -0.984808 0.984808 -0.173648 28.869475 131.454367)" xlink:href="K:\Computational Design Group\20.png"'"/>
    propString = []
    for k in props:
        propString.append(str(k)+'=\"'+str(props[k])+'\"')
    pString = " ".join(propString)
    gm = o['coordinates']
    yvec = [gm[1]*o['height'],gm[5]*o['height'],gm[9]*o['height']]
    planeorigin = [gm[3]+yvec[0],gm[7]+yvec[1],gm[11]+yvec[2]]
    planeremap = point(planeorigin,False)
    imgPlane = r.Geometry.Plane(r.Geometry.Point3d(gm[3],gm[7],gm[11]),r.Geometry.Vector3d(gm[0],gm[4],gm[8]),r.Geometry.Vector3d(gm[1],gm[5],gm[9]))
    worldPlane = r.Geometry.Plane(r.Geometry.Point3d(0,0,0),r.Geometry.Vector3d(1,0,0),r.Geometry.Vector3d(0,1,0))
    transform = r.Geometry.Transform.PlaneToPlane(lPlane,worldPlane)
    imgPlane.Transform(transform)
    npln = [imgPlane.XAxis.X,imgPlane.YAxis.X,imgPlane.ZAxis.X,imgPlane.OriginX,imgPlane.XAxis.Y,imgPlane.YAxis.Y,imgPlane.ZAxis.Y,imgPlane.OriginY,imgPlane.XAxis.Z,imgPlane.YAxis.Z,imgPlane.ZAxis.Z,imgPlane.OriginZ,0,0,0,1]
    matrix = [str(npln[0]), str(npln[1]),str(npln[4]),str(npln[5]), str(planeremap[0]), str(planeremap[1])]
    matrixtext = " ".join(matrix)
    text = '<image transform="matrix(%s)" width="%s" height="%s" xlink:href="%s"/>'%(matrixtext,o['width']/layout['scale'],o['height']/layout['scale'],o['image'])
    print text
    return text
function_mappings = {
        'FeatureCollection':featurecollection,
        'Feature': feature,
        'polyline': polyline,
        'line': line,
        'text': text,
        'image':image,
}
obarray = []
layout = json.loads(LAYOUT)
lPlane = layout['plane']
lOrigin = r.Geometry.Point3d(lPlane[0][0],lPlane[0][1],lPlane[0][2])
lXAx = r.Geometry.Vector3d(lPlane[1][0],lPlane[1][1],lPlane[1][2])
lYAx = r.Geometry.Vector3d(lPlane[2][0],lPlane[2][1],lPlane[2][2])
lPlane = r.Geometry.Plane(lOrigin,lXAx,lYAx)
for i in in1:
    if i["type"]:
        fCall = function_mappings[i['type']]
        fCall(i)
    else:
        fCall = function_mappings[i['geometry']['type']]
        obarray.append(fCall(i['geometry']))

#OUT = log
template =Template("""<?xml version="1.0" encoding="utf-8"?>
<!-- Generator: Grasshopper 1.0.0, Redback Plugin. SVG Version: 6.00 Build 0) Made by Andrew Butler at Cox Architecture -->
<!DOCTYPE svg PUBLIC "-//W3C//DTD SVG 1.1//EN" "http://www.w3.org/Graphics/SVG/1.1/DTD/svg11.dtd">
<svg version="1.1" xmlns="http://www.w3.org/2000/svg" xmlns:xlink="http://www.w3.org/1999/xlink" x="0px" y="0px"
width="${width}mm" height="${height}mm" viewBox="0 0 ${width} ${height}" xml:space="preserve">
<style type="text/css">
$css
</style>
$svg
</svg>""")
print(layout)
svgdict = {'svg':"\n".join(obarray),'width':layout['page'][0],'height':layout['page'][1],'css':"\n".join(CSS)}
svgfull = template.substitute(svgdict)
SVG = svgfull.split("\n")
# ---------- end python ----------
svg = ClusterOutput(python)  # SVG output

# ==== cluster Geo2ArchiJSON: Converts Geometry to ArchiJSON. Version 18.09.10
G = ClusterInput()
output_type = ClusterInput()  # Output Type: 0 = PythonDictionary; 1=JSON String
properties = ClusterInput()  # Properties as a JSON to sync with Geometry. Use JSON Component to build properties. Need to include 'zindex'
int = Integer(output_type)
G_2 = Data(G)
long = LongestList(ListA=G_2, ListB=properties, PaddingMode=2)  # -> ListA, ListB
python = PythonScript(G=long.ListA, P=long.ListB, T=int)  # -> O; inputs G: list, P: list
# ---------- python: Python ----------
import rhinoscriptsyntax as rs
import Rhino as r
import Grasshopper as g
import json
log = []
def Point(geom,prop=None):
    pt = rs.coerce3dpoint(geom)
    pt = [pt[0],pt[1],pt[2]]
    if prop:
        pt = {"type":"Feature","geometry":{'coordinates':pt, 'type': 'point'}}
        pt['properties'] = json.loads(prop)
        return pt
    else:
        return pt
def convertToRPT (geom):
    pt = r.Geometry.Point3d(geom[0],geom[1],geom[2])
    return pt
def PointCollection(geom,prop=None):
    t = geom
    pts = map(lambda g: Point(g), t)
    crv = {"type":"Feature","geometry":{'coordinates':pts, 'type': 'pointcollection'}}
    if prop:
        crv['properties'] = json.loads(prop)
    print(crv)
    return crv
def CurveCollection(geom,prop=None):
    pass
    t = rs.CurvePoints(geom)
    tc = rs.ClosedCurveOrientation(geom)
    if tc == 0: tc = False
    else: tc = True
    tdeg = rs.CurveDegree(geom)
    tcPo = len(t)
    print("tdeg: "+str(tdeg))
    print("tcPo: "+str(tcPo))
    pts = map(lambda g: Point(g), t)
    crv = {"type":"Feature","geometry":{'coordinates':pts, 'type': 'CurveCollection','closed':tc}}
    if tdeg == 1 and tc  : del crv['geometry']['coordinates'][-1]
    if tdeg == 1 and tcPo == 2  : crv['geometry']['type']='line'
    if tdeg >= 2                : crv['geometry']['type']='spline'
    if tdeg == 2 and tcPo == 5  :
        arc = rs.AddArc3Pt(pts[0],pts[4],pts[2])
        pt0 = convertToRPT(pts[0])
        pt2 = convertToRPT(pts[2])
        pt4 = convertToRPT(pts[4])
        arc = r.Geometry.Arc(startPoint = pt0, pointOnInterior = pt2, endPoint = pt4)
        crv['geometry']['type']='arc'
        print(crv['geometry']['coordinates'])
        del crv['geometry']['coordinates'][3]
        del crv['geometry']['coordinates'][1]
    if prop:
        crv['properties'] = json.loads(prop)
    print(crvcollection)
    return crvcollection
def Plane(geom,prop=None):
    pln = {"type":"Feature","geometry":{'coordinates':[geom.XAxis.X,geom.YAxis.X,geom.ZAxis.X,geom.OriginX,geom.XAxis.Y,geom.YAxis.Y,geom.ZAxis.Y,geom.OriginY,geom.XAxis.Z,geom.YAxis.Z,geom.ZAxis.Z,geom.OriginZ,0,0,0,1], 'type': 'xform'}}
    if prop:
        pln['properties'] = json.loads(prop)
    return pln
def Text(geom,prop=None):
    print("TEXT")
    text = Plane(geom.location,prop)
    text['geometry']['type']="text"
    text['geometry']['content']=geom.content
    return text
def Image(geom,prop=None):
    print("Image")
    print(dir(geom))
    image = Plane(geom.location,prop)
    image['geometry']['type']="image"
    image['geometry']['image']=geom.img
    image['geometry']['width']=geom.width
    image['geometry']['height']=geom.height
    return image
def Curve(geom,prop=None):
    t = rs.CurvePoints(geom)
    tc = rs.ClosedCurveOrientation(geom)
    if tc == 0: tc = False
    else: tc = True
    tdeg = rs.CurveDegree(geom)
    tcPo = len(t)
    print("tdeg: "+str(tdeg))
    print("tcPo: "+str(tcPo))
    pts = map(lambda g: Point(g), t)
    crv = {"type":"Feature","geometry":{'coordinates':pts, 'type': 'polyline','closed':tc}}
    if tdeg == 1 and tc  : del crv['geometry']['coordinates'][-1]
    if tdeg == 1 and tcPo == 2  : crv['geometry']['type']='line'
    if tdeg >= 2                : crv['geometry']['type']='spline'
    if tdeg == 2 and tcPo == 5  :
        arc = rs.AddArc3Pt(pts[0],pts[4],pts[2])
        pt0 = convertToRPT(pts[0])
        pt2 = convertToRPT(pts[2])
        pt4 = convertToRPT(pts[4])
        arc = r.Geometry.Arc(startPoint = pt0, pointOnInterior = pt2, endPoint = pt4)
        crv['geometry']['type']='arc'
        print(crv['geometry']['coordinates'])
        del crv['geometry']['coordinates'][3]
        del crv['geometry']['coordinates'][1]
    if prop:
        crv['properties'] = json.loads(prop)
    print(crv)
    return crv
otype = {"0": "Unknown object", "1": Point, "2": "PointCloud", "3":PointCollection, "4": Curve, "5":Plane, "6":Text, "7":CurveCollection, "8":"Surface", "9":Image, "16": "Polysurface", "32": "Mesh", "256": "Light", "512": "Annotation", "4096": "Instance reference", "8192": "Text dot", "16384": "Grip", "32768": "Detail", "65536": "Hatch", "131072": "Morph control", "134217728": "Cage", "268435456": "Phantom", "536870912": "Clipping plane", "1073741824": "Extrusion"}
def Convert(geom,prop):
    print("START CONVERT")
    print(geom)
    ot = otype["1"]
    try:
        ot = otype[str(rs.ObjectType(geom))]
    except:
        #ot = otype[type(geom)]
        othertype = str(type(geom))
        print(othertype)
        if othertype == "<type 'List[object]'>":
            innertype = str(type(geom[0]))
            if innertype=="<type 'PolylineCurve'>":
                print("PCrv")
                ot = otype["7"]
            if innertype=="<type 'Point3d'>":
                print("PT3D")
                ot = otype["3"]
        if othertype == "<type 'Plane'>":
            ot = otype["5"]
        if othertype == "<type 'instance'>":
            if geom.type == "text":
                ot = otype["6"]
            if geom.type == "image":
                ot = otype["9"]
    return(ot(geom,prop))
P = map(lambda g,p: Convert(g,p), G,P)
if T == 0:
    print(P)
    O = [{"type":"FeatureCollection", "features":P}]
if T == 1:
    O = json.dumps({"type":"FeatureCollection", "features":P})
L = log
# ---------- end python ----------
output = ClusterOutput(python)  # ArchiJSON Output

# ==== cluster WRITEFILE: Writes files, also checks for python objects and converts them to text before writing.
activate = ClusterInput()
content = ClusterInput()
filename = ClusterInput()
filepath = ClusterInput()
python = GhPythonScript(CONTENT=content, FILEPATH=filepath, FILENAME=filename, ACTIVATE=activate)  # inputs CONTENT: list
# ---------- python: Python ----------
__author__ = "s-abutler"
__version__ = "2018.09.10"

import rhinoscriptsyntax as rs
from json import dumps
def check(o):
#    print(str(type(o)))
#    return o
    if str(type(o)) == "<type 'dict'>":
        return dumps(o)
    else:
        return o
if ACTIVATE:
    con = list(map(lambda u: check(u), CONTENT))
    conwrite = "\n".join(con)
    dir = FILEPATH+"\\"+FILENAME
    write = True
    try:
        check = open(dir,'r')
        checktext = check.read()
        check.close()
        write = checktext != conwrite
    except:
        write = True
    if write:
        with open(dir,'w') as f:
            f.write(conwrite)
            print("SAVED")
# ---------- end python ----------

# ==== cluster Geo2ArchiJSON_2: Converts Geometry to ArchiJSON. Version 18.09.10
G = ClusterInput()
output_type = ClusterInput()  # Output Type: 0 = PythonDictionary; 1=JSON String
properties = ClusterInput()  # Properties as a JSON to sync with Geometry. Use JSON Component to build properties. Need to include 'zindex'
int = Integer(output_type)
G_2 = Data(G)
long = LongestList(ListA=G_2, ListB=properties, PaddingMode=2)  # -> ListA, ListB
python = PythonScript(G=long.ListA, P=long.ListB, T=int)  # -> O; inputs G: list, P: list
# ---------- python: Python ----------
import rhinoscriptsyntax as rs
import Rhino as r
import Grasshopper as g
import json
log = []
def Point(geom,prop=None):
    pt = rs.coerce3dpoint(geom)
    pt = [pt[0],pt[1],pt[2]]
    if prop:
        pt = {"type":"Feature","geometry":{'coordinates':pt, 'type': 'point'}}
        pt['properties'] = json.loads(prop)
        return pt
    else:
        return pt
def convertToRPT (geom):
    pt = r.Geometry.Point3d(geom[0],geom[1],geom[2])
    return pt
def PointCollection(geom,prop=None):
    t = geom
    pts = map(lambda g: Point(g), t)
    crv = {"type":"Feature","geometry":{'coordinates':pts, 'type': 'pointcollection'}}
    if prop:
        crv['properties'] = json.loads(prop)
    print(crv)
    return crv
def CurveCollection(geom,prop=None):
    pass
    t = rs.CurvePoints(geom)
    tc = rs.ClosedCurveOrientation(geom)
    if tc == 0: tc = False
    else: tc = True
    tdeg = rs.CurveDegree(geom)
    tcPo = len(t)
    print("tdeg: "+str(tdeg))
    print("tcPo: "+str(tcPo))
    pts = map(lambda g: Point(g), t)
    crv = {"type":"Feature","geometry":{'coordinates':pts, 'type': 'CurveCollection','closed':tc}}
    if tdeg == 1 and tc  : del crv['geometry']['coordinates'][-1]
    if tdeg == 1 and tcPo == 2  : crv['geometry']['type']='line'
    if tdeg >= 2                : crv['geometry']['type']='spline'
    if tdeg == 2 and tcPo == 5  :
        arc = rs.AddArc3Pt(pts[0],pts[4],pts[2])
        pt0 = convertToRPT(pts[0])
        pt2 = convertToRPT(pts[2])
        pt4 = convertToRPT(pts[4])
        arc = r.Geometry.Arc(startPoint = pt0, pointOnInterior = pt2, endPoint = pt4)
        crv['geometry']['type']='arc'
        print(crv['geometry']['coordinates'])
        del crv['geometry']['coordinates'][3]
        del crv['geometry']['coordinates'][1]
    if prop:
        crv['properties'] = json.loads(prop)
    print(crvcollection)
    return crvcollection
def Plane(geom,prop=None):
    pln = {"type":"Feature","geometry":{'coordinates':[geom.XAxis.X,geom.YAxis.X,geom.ZAxis.X,geom.OriginX,geom.XAxis.Y,geom.YAxis.Y,geom.ZAxis.Y,geom.OriginY,geom.XAxis.Z,geom.YAxis.Z,geom.ZAxis.Z,geom.OriginZ,0,0,0,1], 'type': 'xform'}}
    if prop:
        pln['properties'] = json.loads(prop)
    return pln
def Text(geom,prop=None):
    print("TEXT")
    text = Plane(geom.location,prop)
    text['geometry']['type']="text"
    text['geometry']['content']=geom.content
    return text
def Image(geom,prop=None):
    print("Image")
    print(dir(geom))
    image = Plane(geom.location,prop)
    image['geometry']['type']="image"
    image['geometry']['image']=geom.img
    image['geometry']['width']=geom.width
    image['geometry']['height']=geom.height
    return image
def Curve(geom,prop=None):
    t = rs.CurvePoints(geom)
    tc = rs.ClosedCurveOrientation(geom)
    if tc == 0: tc = False
    else: tc = True
    tdeg = rs.CurveDegree(geom)
    tcPo = len(t)
    print("tdeg: "+str(tdeg))
    print("tcPo: "+str(tcPo))
    pts = map(lambda g: Point(g), t)
    crv = {"type":"Feature","geometry":{'coordinates':pts, 'type': 'polyline','closed':tc}}
    if tdeg == 1 and tc  : del crv['geometry']['coordinates'][-1]
    if tdeg == 1 and tcPo == 2  : crv['geometry']['type']='line'
    if tdeg >= 2                : crv['geometry']['type']='spline'
    if tdeg == 2 and tcPo == 5  :
        arc = rs.AddArc3Pt(pts[0],pts[4],pts[2])
        pt0 = convertToRPT(pts[0])
        pt2 = convertToRPT(pts[2])
        pt4 = convertToRPT(pts[4])
        arc = r.Geometry.Arc(startPoint = pt0, pointOnInterior = pt2, endPoint = pt4)
        crv['geometry']['type']='arc'
        print(crv['geometry']['coordinates'])
        del crv['geometry']['coordinates'][3]
        del crv['geometry']['coordinates'][1]
    if prop:
        crv['properties'] = json.loads(prop)
    print(crv)
    return crv
otype = {"0": "Unknown object", "1": Point, "2": "PointCloud", "3":PointCollection, "4": Curve, "5":Plane, "6":Text, "7":CurveCollection, "8":"Surface", "9":Image, "16": "Polysurface", "32": "Mesh", "256": "Light", "512": "Annotation", "4096": "Instance reference", "8192": "Text dot", "16384": "Grip", "32768": "Detail", "65536": "Hatch", "131072": "Morph control", "134217728": "Cage", "268435456": "Phantom", "536870912": "Clipping plane", "1073741824": "Extrusion"}
def Convert(geom,prop):
    print("START CONVERT")
    print(geom)
    ot = otype["1"]
    try:
        ot = otype[str(rs.ObjectType(geom))]
    except:
        #ot = otype[type(geom)]
        othertype = str(type(geom))
        print(othertype)
        if othertype == "<type 'List[object]'>":
            innertype = type(geom[0])
            if innertype=="<type 'PolylineCurve'>":
                ot = otype["7"]
            if innertype=="<type 'Point3d'>":
                ot = otype["3"]
        if othertype == "<type 'Plane'>":
            ot = otype["5"]
        if othertype == "<type 'instance'>":
            if geom.type == "text":
                ot = otype["6"]
            if geom.type == "image":
                ot = otype["9"]
    return(ot(geom,prop))
P = map(lambda g,p: Convert(g,p), G,P)
if T == 0:
    print(P)
    O = [{"type":"FeatureCollection", "features":P}]
if T == 1:
    O = json.dumps({"type":"FeatureCollection", "features":P})
L = log
# ---------- end python ----------
output = ClusterOutput(python)  # ArchiJSON Output

# ==== cluster DrawSVG_2: Creates SVG output from ArchiJSON objects. Version 18.09.10
objects = ClusterInput()  # ArchiJSON obects
css = ClusterInput()  # CSS Text
layout = ClusterInput()  # Layout Object
python = PythonScript(OBJECTS=objects, LAYOUT=layout, CSS=css)  # -> SVG; inputs OBJECTS: list, CSS: list
# ---------- python: Python ----------
import rhinoscriptsyntax as rs
import sys
import json
import inspect
import Rhino as r
from string import Template

log = []
#The inputs to this node will be stored as a list in the IN variables.
in1 = OBJECTS
def checkRB(ob):
    if str(type(ob)) == "<type 'str'>":
        return json.loads(ob)
    else:
        return ob
in1 = list(map(lambda u: checkRB(u),in1))
array = []
def featurecollection(o):
    for i in o["features"]:
        fCall = function_mappings[i['geometry']['type']]
        props = {}
        try:
            props = i['properties']
        except:
            pass
        obarray.append(fCall(i['geometry'],props))
def feature(o):
    pass
def point(o,w=True):
    pt = r.Geometry.Point3d(o[0],o[1],o[2])
    remap = r.Geometry.Plane.RemapToPlaneSpace(lPlane, pt)
    rpt = remap[1]
    rpt = [rpt[0]/layout['scale'],-1*rpt[1]/layout['scale'],rpt[2]/layout['scale']]
    pt = str(remap[1][0]/layout['scale'])+","+str(remap[1][1]/layout['scale']*-1)
    if w:
        return pt
    else:
        return rpt


def line(o, props):
    #<polyline points="118.85,155.3 118.85,180.7" class="FOPActual" zindex="10"/>
    pts = map(lambda i: point(i,False), o['coordinates'])
    propString = []
    for k in props:
        print(k)
        print(props[k])
        propString.append(str(k)+'=\"'+str(props[k])+'\"')
    pString = " ".join(propString)
    pline = '<line x1="'+str(pts[0][0])+'" y1="'+str(pts[0][1])+'" x2="'+str(pts[1][0])+'" y2="'+str(pts[1][1])+'" '+pString+'/>'
    #pline = NurbsCurve.ByControlPoints(polarray,1,o['properties']['closed'])
    return pline


def polyline(o, props):
    #<polyline points="118.85,155.3 118.85,180.7" class="FOPActual" zindex="10"/>
    polarray = []
    for p in o['coordinates']:
        pt = point(p)
        polarray.append(pt)
    pts = " ".join(polarray)
    propString = []
    for k in props:

        propString.append(str(k)+'=\"'+str(props[k])+'\"')
    pString = " ".join(propString)
    if o['closed']:
        pline = '<polygon points=\"'+pts+'\" '+pString+'/>'
    else: 
        pline = '<polyline points=\"'+pts+'\" '+pString+'/>'
    #pline = NurbsCurve.ByControlPoints(polarray,1,o['properties']['closed'])
    return pline

def text(o, props):
    #<text class="CLASS" zindex="500" transform="matrix(1 0 0 1 210 148.5)">TEXT</text> 
    propString = []
    for k in props:
        propString.append(str(k)+'=\"'+str(props[k])+'\"')
    pString = " ".join(propString)
    gm = o['coordinates']
    planeorigin = [gm[3],gm[7],gm[11]]
    planeremap = point(planeorigin,False)
    matrix = [str(gm[0]), str(gm[1]),str(gm[4]),str(gm[5]), str(planeremap[0]), str(planeremap[1])]
    matrixtext = " ".join(matrix)
    text = '<text '+pString+' transform="matrix(%s)">%s</text>'%(matrixtext,o['content'])
    print text
    return text
def image(o, props):
    #<image width="132.543857" height="132.543857" transform="matrix(-0.173648 -0.984808 0.984808 -0.173648 28.869475 131.454367)" xlink:href="K:\Computational Design Group\20.png"'"/>
    propString = []
    for k in props:
        propString.append(str(k)+'=\"'+str(props[k])+'\"')
    pString = " ".join(propString)
    gm = o['coordinates']
    yvec = [gm[1]*o['height'],gm[5]*o['height'],gm[9]*o['height']]
    planeorigin = [gm[3]+yvec[0],gm[7]+yvec[1],gm[11]+yvec[2]]
    planeremap = point(planeorigin,False)
    imgPlane = r.Geometry.Plane(r.Geometry.Point3d(gm[3],gm[7],gm[11]),r.Geometry.Vector3d(gm[0],gm[4],gm[8]),r.Geometry.Vector3d(gm[1],gm[5],gm[9]))
    worldPlane = r.Geometry.Plane(r.Geometry.Point3d(0,0,0),r.Geometry.Vector3d(1,0,0),r.Geometry.Vector3d(0,1,0))
    transform = r.Geometry.Transform.PlaneToPlane(lPlane,worldPlane)
    imgPlane.Transform(transform)
    npln = [imgPlane.XAxis.X,imgPlane.YAxis.X,imgPlane.ZAxis.X,imgPlane.OriginX,imgPlane.XAxis.Y,imgPlane.YAxis.Y,imgPlane.ZAxis.Y,imgPlane.OriginY,imgPlane.XAxis.Z,imgPlane.YAxis.Z,imgPlane.ZAxis.Z,imgPlane.OriginZ,0,0,0,1]
    matrix = [str(npln[0]), str(npln[1]),str(npln[4]),str(npln[5]), str(planeremap[0]), str(planeremap[1])]
    matrixtext = " ".join(matrix)
    text = '<image transform="matrix(%s)" width="%s" height="%s" xlink:href="%s"/>'%(matrixtext,o['width']/layout['scale'],o['height']/layout['scale'],o['image'])
    print text
    return text
function_mappings = {
        'FeatureCollection':featurecollection,
        'Feature': feature,
        'polyline': polyline,
        'line': line,
        'text': text,
        'image':image,
}
obarray = []
layout = json.loads(LAYOUT)
lPlane = layout['plane']
lOrigin = r.Geometry.Point3d(lPlane[0][0],lPlane[0][1],lPlane[0][2])
lXAx = r.Geometry.Vector3d(lPlane[1][0],lPlane[1][1],lPlane[1][2])
lYAx = r.Geometry.Vector3d(lPlane[2][0],lPlane[2][1],lPlane[2][2])
lPlane = r.Geometry.Plane(lOrigin,lXAx,lYAx)
for i in in1:
    if i["type"]:
        fCall = function_mappings[i['type']]
        fCall(i)
    else:
        fCall = function_mappings[i['geometry']['type']]
        obarray.append(fCall(i['geometry']))

#OUT = log
template =Template("""<?xml version="1.0" encoding="utf-8"?>
<!-- Generator: Grasshopper 1.0.0, Redback Plugin. SVG Version: 6.00 Build 0)  -->
<!DOCTYPE svg PUBLIC "-//W3C//DTD SVG 1.1//EN" "http://www.w3.org/Graphics/SVG/1.1/DTD/svg11.dtd">
<svg version="1.1" xmlns="http://www.w3.org/2000/svg" xmlns:xlink="http://www.w3.org/1999/xlink" x="0px" y="0px"
width="${width}mm" height="${height}mm" viewBox="0 0 ${width} ${height}" xml:space="preserve">
<style type="text/css">
$css
</style>
$svg
</svg>""")
print(layout)
svgdict = {'svg':"\n".join(obarray),'width':layout['page'][0],'height':layout['page'][1],'css':"\n".join(CSS)}
svgfull = template.substitute(svgdict)
SVG = svgfull.split("\n")
# ---------- end python ----------
svg = ClusterOutput(python)  # SVG output

# ==== cluster ReplaceMultiText: Replaces multiple values in a string
T = ClusterInput()
F = ClusterInput()
R = ClusterInput()
python = PythonScript(T=T, F=F, R=R)  # -> O; inputs F: list, R: list
# ---------- python: Python ----------
import string
print F
print R

c=T
for s,r in zip(F,R):
    print s
    print r
    c=string.replace(c,s,str(r))
print(c)
O=c
# ---------- end python ----------
O = ClusterOutput(python)

# ==== cluster UberTrim: Better version of Trim
data = ClusterInput()
data_2 = Data(data)
trim = TrimTree(Tree=data_2, Depth=1)
null = NullItem(Item=trim)  # -> NullFlags, InvalidFlags, Description
bool = Boolean(invert(null.NullFlags))
trim_2 = TrimTree(Tree=data_2, Depth=bool)
data_3 = Data(trim_2)
data_4 = ClusterOutput(data_3)
