# Grasshopper definition Tower by Multiple Breps.ghx (Grasshopper 1.0.7)
# Copyright: Co-de-iT
# plug-ins: Redback, Human

# ----
# GEOMETERY INPUT
panel = Panel("BREPS::Brep4")
dpipeline = DynamicGeometryPipeline(
    LayerFilter=panel,
    TypeFilter="Brep",
    NameFilter="*",
    GroupByLayer=False,
    GroupByType=False,
    IncludeHidden=True,
    IncludeLocked=True,
    enableFullPath=True,
    listenToAttributes=True)

input = DataInput(Destination="C:\Users\bekjc\Documents\Hackaton\Hackathon2018\MultiBreps.ghdata")  # -> Multi_Breps, Properties
tower_by_multiple_breps_gh_input = TowerByMultipleBrepsGhInput(geometry=input.Multi_Breps, properties=input.Properties)  # -> rooftops_2, roof_properties_2, full_mass_2, full_mass_properties_2, sub_mass_2, sub_mass_properties_2, facade_3, facade_properties_2, floorplates_2, floorplate_properties_2
tower_by_multiple_breps = TowerByMultipleBreps(geometry=dpipeline)  # -> rooftops_2, roof_properties_2, full_mass_2, full_mass_properties_2, sub_mass_2, sub_mass_properties_2, facade_3, facade_properties_2, floorplates_2, floorplate_properties_2

# ---- group: FLOOR PLATES
read = ReadJSON(Object=tower_by_multiple_breps_gh_input.floorplate_properties_2, Key="Typology")
tmatch = MatchText(Text=read, Pattern="Residential", Case=True)
dispatch = Dispatch(List=tower_by_multiple_breps_gh_input.floorplates_2, DispatchPattern=tmatch)  # -> ListA, ListB
resi = Geometry(dispatch.ListB)
comm = Geometry(dispatch.ListA)

# ---- group: FACADE
read_2 = ReadJSON(Object=tower_by_multiple_breps_gh_input.facade_properties_2, Key="Typology")
tmatch_2 = MatchText(Text=read_2, Pattern="Residential", Case=True)
dispatch_2 = Dispatch(List=tower_by_multiple_breps_gh_input.facade_3, DispatchPattern=tmatch_2)  # -> ListA, ListB
comm_2 = Geometry(dispatch_2.ListA)
resi_2 = Geometry(dispatch_2.ListB)

# ---- group: SUBMASS
read_3 = ReadJSON(Object=tower_by_multiple_breps_gh_input.sub_mass_properties_2, Key="Typology")
tmatch_3 = MatchText(Text=read_3, Pattern="Residential", Case=True)
dispatch_3 = Dispatch(List=tower_by_multiple_breps_gh_input.sub_mass_2, DispatchPattern=tmatch_3)  # -> ListA, ListB
comm_3 = Geometry(dispatch_3.ListA)
resi_3 = Geometry(dispatch_3.ListB)

# ---- group: ROOFTOPS
read_4 = ReadJSON(Object=tower_by_multiple_breps_gh_input.roof_properties_2, Key="Typology")
tmatch_4 = MatchText(Text=read_4, Pattern="Residential", Case=True)
dispatch_4 = Dispatch(List=tower_by_multiple_breps_gh_input.rooftops_2, DispatchPattern=tmatch_4)  # -> ListA, ListB
resi_4 = Geometry(dispatch_4.ListB)
comm_4 = Geometry(dispatch_4.ListA)

# ----
output = DataOutput(
    Floorplate_Properties=tower_by_multiple_breps.floorplate_properties_2,
    Floorplates=tower_by_multiple_breps.floorplates_2,
    Full_Mass=tower_by_multiple_breps.full_mass_2,
    Full_Mass_Properties=tower_by_multiple_breps.full_mass_properties_2,
    Sub_Mass=tower_by_multiple_breps.sub_mass_properties_2,
    Sub_Mass_Properties=tower_by_multiple_breps.sub_mass_2,
    Facade=tower_by_multiple_breps.facade_3,
    Facade_Properties=tower_by_multiple_breps.facade_properties_2,
    Rooftops=tower_by_multiple_breps.roof_properties_2,
    Rooftop_Properties=tower_by_multiple_breps.rooftops_2,
    Destination="C:\Users\bekjc\Documents\Hackaton\Hackathon2018\Hackaton Multiple Mass.ghdata")

# ---- group: FACADE
read_5 = ReadJSON(Object=tower_by_multiple_breps.floorplate_properties_2, Key="Typology")
tmatch_5 = MatchText(Text=read_5, Pattern="Comm", Case=True)
dispatch_5 = Dispatch(List=tower_by_multiple_breps.floorplates_2, DispatchPattern=tmatch_5)  # -> ListA, ListB
comm_5 = Geometry(dispatch_5.ListA)
resi_5 = Geometry(dispatch_5.ListB)

read_6 = ReadJSON(Object=tower_by_multiple_breps.facade_properties_2, Key="Typology")
tmatch_6 = MatchText(Text=read_6, Pattern="Comm", Case=True)
dispatch_6 = Dispatch(List=tower_by_multiple_breps.facade_3, DispatchPattern=tmatch_6)  # -> ListA, ListB
comm_6 = Geometry(dispatch_6.ListA)
resi_6 = Geometry(dispatch_6.ListB)

# ---- group: SUBMASS
read_7 = ReadJSON(Object=tower_by_multiple_breps.sub_mass_properties_2, Key="Typology")
tmatch_7 = MatchText(Text=read_7, Pattern="Comm", Case=True)
dispatch_7 = Dispatch(List=tower_by_multiple_breps.sub_mass_2, DispatchPattern=tmatch_7)  # -> ListA, ListB
comm_7 = Geometry(dispatch_7.ListA)
resi_7 = Geometry(dispatch_7.ListB)

# ---- group: ROOFTOPS
read_8 = ReadJSON(Object=tower_by_multiple_breps.roof_properties_2, Key="Typology")
tmatch_8 = MatchText(Text=read_8, Pattern="Comm", Case=True)
dispatch_8 = Dispatch(List=tower_by_multiple_breps.rooftops_2, DispatchPattern=tmatch_8)  # -> ListA, ListB
comm_8 = Geometry(dispatch_8.ListA)
resi_8 = Geometry(dispatch_8.ListB)

# ----
input_2 = DataInput(Destination="C:\Users\bekjc\Documents\Hackaton\Hackathon2018\Hackaton Multiple Mass.ghdata")  # -> Floorplate_Properties, Floorplates, Full_Mass, Full_Mass_Properties, Sub_Mass, Sub_Mass_Properties, Facade, Facade_Properties, Rooftops, Rooftop_Properties
panel_2 = Panel(input_2.Floorplates)

# ==== cluster TowerByMultipleBreps
geometry = ClusterInput()
# SORT INTO BUILDINGS
geometry_2 = Data(geometry)

getuv = GetUserValue(Geometry=geometry_2, Key="BuildID")
cset = CreateSet(List=getuv)  # -> simplify(graft(Set)), Map
tmatch = MatchText(Text=getuv, Pattern=cset.Set, Case=True)
dispatch = Dispatch(List=geometry_2, DispatchPattern=tmatch)  # -> simplify(ListA), ListB

# ----
# GET LOWEST POINT ON EACH BREP
debrep = DeconstructBrep(Brep=dispatch.ListA)  # -> Faces, Edges, simplify(Vertices)
pdecon = Deconstruct(Point=debrep.Vertices)  # -> XComponent, YComponent, ZComponent
sort = SortList(Keys=pdecon.ZComponent, ValuesA=debrep.Vertices)  # -> reverse(Keys), reverse(ValuesA)
item = ListItem(List=sort.Keys, Index=-1, Wrap=True)  # -> simplify(Item)
utrim = UberTrim(data=item)

# ----
# CALCULATE HEIGHT OF EACH BREP
bbox = BoundingBox(Content=dispatch.ListA, Plane=PlaneXY(0, 0, 0))  # -> Box, Box_2
debox = DeconstructBox(Box=bbox.Box)  # -> Plane, X, Y, Z
dedomain = DeconstructDomain(Domain=debox.Z)  # -> Start, End
subtraction = Subtraction(A=dedomain.End, B=dedomain.Start)

area = Area(Geometry=debrep.Faces)  # -> Area, Centroid
pdecon_2 = Deconstruct(Point=area.Centroid)  # -> XComponent, YComponent, ZComponent
getuv_2 = GetUserValue(Geometry=dispatch.ListA, Key="F2F")
sort_2 = SortList(Keys=pdecon_2.ZComponent, ValuesA=debrep.Faces, ValuesB=area.Centroid)  # -> Keys, ValuesA, ValuesB
getuv_3 = GetUserValue(Geometry=dispatch.ListA, Key="SubBuildID")

# ----
# CREATE LEVEL NUMBERS
len = TextLength(Text=getuv_3)  # disabled
utrim_2 = UberTrim(data=len)  # disabled
cset_2 = CreateSet(List=utrim_2)  # -> Set, Map; disabled
sort_3 = SortList(Keys=cset_2.Set)  # -> Keys, ValuesA; disabled
num = Number(sort_3.Keys)  # disabled
num_2 = Number(utrim_2)  # disabled
mindex = MemberIndex(Set=num_2, Member=num)  # -> Index, Count; disabled
lng = ListLength(List=mindex.Index)  # disabled
trim = TrimTree(Tree=lng, Depth=1)  # disabled
panel = Panel("\t")  # disabled
join = TextJoin(Text=getuv_3, Join=panel)  # disabled
lng_2 = ListLength(List=trim)  # disabled
repeat = RepeatData(Data=join, Length=lng_2)  # disabled
split = TextSplit(Text=repeat, Separators=panel)  # disabled
item_2 = ListItem(List=split, Index=mindex.Index, Wrap=True)  # -> simplify(Item); disabled
panel_2 = Panel("^")  # disabled
lng_3 = ListLength(List=item_2)  # disabled
number_slider = Slider(1, range=0..1)  # disabled
panel_3 = Panel("^")  # disabled
join_2 = TextJoin(Text=item_2, Join=panel_2)  # disabled
join_3 = TextJoin(Text=lng_3, Join=panel_3)  # disabled
utrim_3 = UberTrim(data=join_3)  # disabled
utrim_4 = UberTrim(data=join_2)  # disabled
larger = LargerThan(FirstNumber=utrim_3, SecondNumber=number_slider)  # -> LargerThan, OrEqualTo; disabled
lng_4 = ListLength(List=larger.LargerThan)  # disabled
series = Series(Start=0, Step=1, Count=lng_4)  # disabled
dispatch_2 = Dispatch(List=utrim_4, DispatchPattern=larger.LargerThan)  # -> ListA, ListB; disabled
cull = CullPattern(List=series, CullPattern=larger.LargerThan)  # disabled
split_2 = SplitList(List=utrim_4, Index=cull)  # -> ListA, ListB; disabled
split_3 = TextSplit(Text=split_2.ListB, Separators=panel_2)  # -> simplify(Result); disabled
split_4 = TextSplit(Text=split_2.ListA, Separators=panel_2)  # -> simplify(Result); disabled
utrim_5 = UberTrim(data=split_3)  # disabled
item_3 = ListItem(List=utrim_5, Index=0, Wrap=True)  # disabled
len_2 = TextLength(Text=item_3)  # disabled
series_2 = Series(Start=0, Step=1, Count=len_2)  # disabled
chars = Characters(Text=getuv_3)  # -> Result, Unicode; disabled
item_4 = ListItem(List=chars.Result, Index=series_2, Wrap=True)  # -> Item, Item1, Item2; disabled
merge = Merge(Data1=item_4.Item)  # disabled
join_4 = TextJoin(Text=item_4.Item)  # disabled

getuv_4 = GetUserValue(Geometry=dispatch.ListA, Key="Typology")
getuv_5 = GetUserValue(Geometry=dispatch.ListA, Key="BuildID")

# ----
# NUMBER OF FLOORS
division = Division(A=subtraction, B=getuv_2)
round = Round(Number=division)  # -> simplify(Nearest), Floor, Ceiling

# ----
# PLANE PER LEVEL
series_3 = Series(Start=utrim, Step=getuv_2, Count=round.Nearest)
pt = ConstructPoint(XCoordinate=0, YCoordinate=0, ZCoordinate=series_3)  # -> simplify(Point)
xy = XYPlane(Origin=pt)

graft = GraftTree(Tree=dispatch.ListA, IncludeEmptyLists=True, IncludeNullItems=True)

debrep_2 = DeconstructBrep(Brep=dispatch.ListA)  # -> Faces, Edges, Vertices
evalsrf = EvaluateSurface(Surface=reparameterize(debrep_2.Faces), Point="0.5,0.5")  # -> Point, Normal, UDirection, VDirection, Frame
pdecon_3 = Deconstruct(Point=evalsrf.Point)  # -> XComponent, YComponent, ZComponent
sort_4 = SortList(Keys=pdecon_3.ZComponent, ValuesA=debrep_2.Faces)  # -> Keys, ValuesA
panel_4 = Panel("""-1
0""")

# ---- group: BUILD ID
# BUILD ID
# FACADE
dup = DuplicateData(Data=graft(getuv_5), Number=graft(round.Nearest), Order=True)  # -> simplify(Data)

# ---- group: SUB BUILD ID
# SUB BUILD ID
dup_2 = DuplicateData(Data=graft(getuv_3), Number=graft(round.Nearest), Order=True)  # -> simplify(Data)

# ---- group: TYPOLOGY
# TYPOLOGY
dup_3 = DuplicateData(Data=graft(getuv_4), Number=graft(round.Nearest), Order=True)  # -> simplify(Data)

# ----
# FLOOR PLATE CRVS
sec = BrepPlane(Brep=graft, Plane=xy)  # -> Curves, Points

# ---- group: all floorplates
boundary = BoundarySurfaces(Edges=sec.Curves)  # -> simplify(Surfaces)

# ----
utrim_6 = UberTrim(data=boundary)

# ---- group: sort by height to get tops
area_2 = Area(Geometry=utrim_6)  # -> Area, Centroid
pdecon_4 = Deconstruct(Point=area_2.Centroid)  # -> XComponent, YComponent, ZComponent
sort_5 = SortList(Keys=pdecon_4.ZComponent, ValuesFloorplate=utrim_6, ValuesTypology=dup_3, ValuesSubBuildID=dup_2, ValuesBuildID=dup)  # -> reverse(Keys), reverse(ValuesFloorplate), reverse(ValuesTypology), reverse(ValuesSubBuildID), reverse(ValuesBuildID)
item_5 = ListItem(List=sort_5.ValuesFloorplate, Index=0, Wrap=True)

# ---- group: facade
cull_i = CullIndex(List=sort_4.ValuesA, Indices=panel_4, Wrap=True)  # -> simplify(List)

# ----
cull_i_2 = CullIndex(List=sort_5.ValuesFloorplate, Indices=0, Wrap=True)  # -> simplify(List)

# ---- group: usable space above floor
area_3 = Area(Geometry=item_5)  # -> Area, Centroid
Z = UnitZ(Factor=1)
graft_2 = GraftTree(Tree=getuv_2, IncludeEmptyLists=True, IncludeNullItems=True)
line = LineSDL(Start=area_3.Centroid, Direction=Z, Length=graft_2)

# ----
graft_3 = GraftTree(Tree=dispatch.ListA, IncludeEmptyLists=True, IncludeNullItems=True)
bcx = BrepCurve(Brep=graft_3, Curve=line)  # -> Curves, simplify(Points)
null = NullItem(Item=bcx.Points)  # -> NullFlags, InvalidFlags, Description

# ---- group: Typology
item_6 = ListItem(List=sort_5.ValuesTypology, Index=0, Wrap=True)
cull_i_3 = CullIndex(List=sort_5.ValuesTypology, Indices=0, Wrap=True)  # -> simplify(List)
dispatch_3 = Dispatch(List=item_6, DispatchPattern=null.NullFlags)  # -> ListA, ListB
merge_2 = Merge(Data1=dispatch_3.ListA, Data2=cull_i_3)

# ---- group: SubBuildID
item_7 = ListItem(List=sort_5.ValuesSubBuildID, Index=0, Wrap=True)
cull_i_4 = CullIndex(List=sort_5.ValuesSubBuildID, Indices=0, Wrap=True)  # -> simplify(List)
dispatch_4 = Dispatch(List=item_7, DispatchPattern=null.NullFlags)  # -> ListA, ListB
merge_3 = Merge(Data1=dispatch_4.ListA, Data2=cull_i_4)

# ---- group: BuildID
item_8 = ListItem(List=sort_5.ValuesBuildID, Index=0, Wrap=True)
cull_i_5 = CullIndex(List=sort_5.ValuesBuildID, Indices=0, Wrap=True)  # -> simplify(List)
dispatch_5 = Dispatch(List=item_8, DispatchPattern=null.NullFlags)  # -> ListA, ListB
merge_4 = Merge(Data1=dispatch_5.ListA, Data2=cull_i_5)

# ----
dispatch_6 = Dispatch(List=item_5, DispatchPattern=null.NullFlags)  # -> ListA, ListB
merge_5 = Merge(Data1=dispatch_6.ListA, Data2=cull_i_2)
area_4 = Area(Geometry=merge_5)  # -> Area, Centroid
pdecon_5 = Deconstruct(Point=area_4.Centroid)  # -> XComponent, YComponent, ZComponent
sort_6 = SortList(
    Keys=pdecon_5.ZComponent,
    ValuesFloorPlate=merge_5,
    ValuesTypology=merge_2,
    ValuesSubBuildID=merge_3,
    ValuesBuildID=merge_4)  # -> Keys, ValuesFloorPlate, ValuesTypology, ValuesSubBuildID, ValuesBuildID

pt_2 = ConstructPoint(XCoordinate=0, YCoordinate=0, ZCoordinate=sort_6.Keys)
xy_2 = XYPlane(Origin=pt_2)
group = Group(Objects=xy_2)
geo = Geometry(cull_i)
long = LongestList(ListA=geo, ListB=group, PaddingMode=2)  # -> ListA, ListB
ungroup = Ungroup(Group=long.ListB)
sec_2 = BrepPlane(Brep=graft(long.ListA), Plane=ungroup)  # -> Curves, Points
shift = ShiftPaths(Data=sec_2.Curves, Offset=-1)  # -> simplify(Data)
srfsplit = SurfaceSplit(Surface=graft(long.ListA), Curves=shift)  # -> simplify(Fragments)

# ----
# CUT FACADE FLOORS
# EXPLODE FACADE FACES
facade = Data(srfsplit)
utrim_7 = UberTrim(data=facade)
area_5 = Area(Geometry=utrim_7)  # -> Area, Centroid
pdecon_6 = Deconstruct(Point=area_5.Centroid)  # -> XComponent, YComponent, ZComponent
lng_5 = ListLength(List=cull_i)
sort_7 = SortList(Keys=pdecon_6.ZComponent, ValuesA=utrim_7)  # -> Keys, ValuesA, ValuesC, ValuesD, ValuesE
partition = PartitionList(List=sort_7.ValuesA, Size=lng_5)
join_5 = BrepJoin(Breps=partition)  # -> Breps, Closed
utrim_8 = UberTrim(data=join_5.Breps)
panel_5 = Panel("""Typology
SubBuildID
BuildID""")
merge_6 = Merge(Data2=graft(sort_6.ValuesTypology), Data3=graft(sort_6.ValuesSubBuildID), Data4=graft(sort_6.ValuesBuildID))  # -> simplify(Result)
json = JSON(Key=panel_5, Value=merge_6)
utrim_9 = UberTrim(data=json)
utrim_10 = UberTrim(data=utrim_9)
utrim_11 = UberTrim(data=utrim_8)
facade_properties = Data(utrim_10)
facade_2 = Data(utrim_11)
facade_3 = ClusterOutput(facade_2)
facade_properties_2 = ClusterOutput(facade_properties)

merge_7 = Merge(
    Data1=graft(sort_6.Keys),
    Data2=graft(sort_6.ValuesTypology),
    Data3=graft(sort_6.ValuesSubBuildID),
    Data4=graft(sort_6.ValuesBuildID))  # -> simplify(Result)
panel_6 = Panel("""RL
Typology
SubBuildID
BuildID""")
json_2 = JSON(Key=panel_6, Value=merge_7)
utrim_12 = UberTrim(data=json_2)

# ----
# SUB MASS
panel_7 = Panel("""F2F
Typology
SubBuildID
BuildID""")
merge_8 = Merge(Data1=graft(getuv_2), Data2=graft(getuv_4), Data3=graft(getuv_3), Data4=graft(getuv_5))
sub_mass = Geometry(dispatch.ListA)
json_3 = JSON(Key=panel_7, Value=merge_8)
trim_2 = TrimTree(Tree=json_3, Depth=1)
sub_mass_2 = ClusterOutput(sub_mass)
sub_mass_properties = Data(trim_2)
sub_mass_properties_2 = ClusterOutput(sub_mass_properties)

utrim_13 = UberTrim(data=sort_6.ValuesFloorPlate)
utrim_14 = UberTrim(data=utrim_12)
floorplate_properties = Data(utrim_14)
floorplates = Data(simplify(utrim_13))
floorplate_properties_2 = ClusterOutput(floorplate_properties)
floorplates_2 = ClusterOutput(floorplates)

# ----
# ROOF
sunion = SolidUnion(Breps=dispatch.ListA)
data = Data(getuv_5)
panel_8 = Panel("""BuildID
SubBuildID
Typology""")

debrep_3 = DeconstructBrep(Brep=sunion)  # -> Faces, Edges, Vertices
evalsrf_2 = EvaluateSurface(Surface=reparameterize(debrep_3.Faces), Point="0.5,0.5")  # -> Point, Normal, UDirection, VDirection, Frame
devec = DeconstructVector(Vector=evalsrf_2.Normal)  # -> XComponent, YComponent, ZComponent
equals = Equality(FirstNumber=devec.ZComponent, SecondNumber=Slider(1, range=0..1))  # -> Equality, Inequality
dispatch_7 = Dispatch(List=debrep_3.Faces, DispatchPattern=equals.Equality)  # -> ListA, ListB
utrim_15 = UberTrim(data=dispatch_7.ListA)

# ---- group: TEST POINT FROM ROOFTOP
number_slider_2 = Slider(0.1, range=0..0.1)
data_2 = Data(utrim_15)
Z_2 = UnitZ(Factor=Slider(0.5, range=0..1))
area_6 = Area(Geometry=data_2)  # -> Area, Centroid
neg = Negative(Value=Z_2)
move = Move(Geometry=area_6.Centroid, Motion=neg)  # -> graft(Geometry), Transform

# ---- group: DUPLICATE BREPS
group_2 = Group(Objects=dispatch.ListA)
lng_6 = ListLength(List=area_6.Centroid)
dup_4 = DuplicateData(Data=group_2, Number=lng_6, Order=True)
ungroup_2 = Ungroup(Group=dup_4)  # -> simplify(Objects)

# ---- group: Sort rooftops per mass
brepinc = PointInBrep(Brep=ungroup_2, Point=move.Geometry, Strict=False)
dispatch_8 = Dispatch(List=ungroup_2, DispatchPattern=brepinc)  # -> ListA, ListB

# ----
geo_2 = Geometry(dispatch_8.ListA)
getuv_6 = GetUserValue(Geometry=geo_2, Key="BuildID")
getuv_7 = GetUserValue(Geometry=geo_2, Key="SubBuildID")
getuv_8 = GetUserValue(Geometry=geo_2, Key="Typology")
merge_9 = Merge(Data1=simplify(graft(getuv_6)), Data2=simplify(graft(getuv_7)), Data3=simplify(graft(getuv_8)))  # -> simplify(Result)
json_4 = JSON(Key=panel_8, Value=merge_9)
trim_3 = TrimTree(Tree=json_4, Depth=1)
rooftops = Geometry(data_2)
roof_properties = Data(trim_3)
rooftops_2 = ClusterOutput(rooftops)
roof_properties_2 = ClusterOutput(roof_properties)

# ----
# FULL MASS
panel_9 = Panel("BuildID")
cset_3 = CreateSet(List=data)  # -> Set, Map
utrim_16 = UberTrim(data=sunion)
json_5 = JSON(Key=panel_9, Value=cset_3.Set)
full_mass_properties = Data(json_5)
full_mass = Data(utrim_16)
full_mass_properties_2 = ClusterOutput(full_mass_properties)
full_mass_2 = ClusterOutput(full_mass)

# ==== cluster TowerByMultipleBrepsGhInput

# ----
# CREATE LEVEL NUMBERS
len = TextLength()  # disabled
utrim = UberTrim(data=len)  # disabled
cset = CreateSet(List=utrim)  # -> Set, Map; disabled
sort = SortList(Keys=cset.Set)  # -> Keys, ValuesA; disabled
num = Number(sort.Keys)  # disabled
num_2 = Number(utrim)  # disabled
mindex = MemberIndex(Set=num_2, Member=num)  # -> Index, Count; disabled
lng = ListLength(List=mindex.Index)  # disabled
trim = TrimTree(Tree=lng, Depth=1)  # disabled
panel = Panel("\t")  # disabled
join = TextJoin(Join=panel)  # disabled
lng_2 = ListLength(List=trim)  # disabled
repeat = RepeatData(Data=join, Length=lng_2)  # disabled
split = TextSplit(Text=repeat, Separators=panel)  # disabled
item = ListItem(List=split, Index=mindex.Index, Wrap=True)  # -> simplify(Item); disabled
panel_2 = Panel("^")  # disabled
lng_3 = ListLength(List=item)  # disabled
number_slider = Slider(1, range=0..1)  # disabled
panel_3 = Panel("^")  # disabled
join_2 = TextJoin(Text=item, Join=panel_2)  # disabled
join_3 = TextJoin(Text=lng_3, Join=panel_3)  # disabled
utrim_2 = UberTrim(data=join_3)  # disabled
utrim_3 = UberTrim(data=join_2)  # disabled
larger = LargerThan(FirstNumber=utrim_2, SecondNumber=number_slider)  # -> LargerThan, OrEqualTo; disabled
lng_4 = ListLength(List=larger.LargerThan)  # disabled
series = Series(Start=0, Step=1, Count=lng_4)  # disabled
dispatch = Dispatch(List=utrim_3, DispatchPattern=larger.LargerThan)  # -> ListA, ListB; disabled
cull = CullPattern(List=series, CullPattern=larger.LargerThan)  # disabled
split_2 = SplitList(List=utrim_3, Index=cull)  # -> ListA, ListB; disabled
split_3 = TextSplit(Text=split_2.ListB, Separators=panel_2)  # -> simplify(Result); disabled
split_4 = TextSplit(Text=split_2.ListA, Separators=panel_2)  # -> simplify(Result); disabled
utrim_4 = UberTrim(data=split_3)  # disabled
item_2 = ListItem(List=utrim_4, Index=0, Wrap=True)  # disabled
len_2 = TextLength(Text=item_2)  # disabled
series_2 = Series(Start=0, Step=1, Count=len_2)  # disabled
chars = Characters()  # -> Result, Unicode; disabled
item_3 = ListItem(List=chars.Result, Index=series_2, Wrap=True)  # -> Item, Item1, Item2; disabled
merge = Merge(Data1=item_3.Item)  # disabled
join_4 = TextJoin(Text=item_3.Item)  # disabled

properties = ClusterInput()
geometry = ClusterInput()
properties_2 = Data(properties)
read = ReadJSON(Object=properties_2, Key="F2F")  # -> graft(Value)
read_2 = ReadJSON(Object=properties_2, Key="Typology")  # -> graft(Value)
read_3 = ReadJSON(Object=properties_2, Key="BuildID")  # -> graft(Value)
# SORT INTO BUILDINGS
geometry_2 = Data(graft(geometry))

# ----
# CALCULATE HEIGHT OF EACH BREP
bbox = BoundingBox(Content=geometry_2, Plane=PlaneXY(0, 0, 0))  # -> Box, Box_2
debox = DeconstructBox(Box=bbox.Box)  # -> Plane, X, Y, Z
dedomain = DeconstructDomain(Domain=debox.Z)  # -> Start, End
subtraction = Subtraction(A=dedomain.End, B=dedomain.Start)

# ----
# GET LOWEST POINT ON EACH BREP
debrep = DeconstructBrep(Brep=geometry_2)  # -> Faces, Edges, simplify(Vertices)
pdecon = Deconstruct(Point=debrep.Vertices)  # -> XComponent, YComponent, ZComponent
sort_2 = SortList(Keys=pdecon.ZComponent, ValuesA=debrep.Vertices)  # -> reverse(Keys), reverse(ValuesA)
item_4 = ListItem(List=sort_2.Keys, Index=-1, Wrap=True)  # -> simplify(Item)
utrim_5 = UberTrim(data=item_4)

# ----
# NUMBER OF FLOORS
division = Division(A=subtraction, B=read)
round = Round(Number=division)  # -> simplify(Nearest), Floor, Ceiling

panel_4 = Panel(round.Nearest)

# ----
# PLANE PER LEVEL
series_3 = Series(Start=utrim_5, Step=read, Count=round.Nearest)
pt = ConstructPoint(XCoordinate=0, YCoordinate=0, ZCoordinate=series_3)  # -> simplify(Point)
xy = XYPlane(Origin=pt)

graft = GraftTree(Tree=geometry_2, IncludeEmptyLists=True, IncludeNullItems=True)

debrep_2 = DeconstructBrep(Brep=geometry_2)  # -> Faces, Edges, Vertices
evalsrf = EvaluateSurface(Surface=reparameterize(debrep_2.Faces), Point="0.5,0.5")  # -> Point, Normal, UDirection, VDirection, Frame
pdecon_2 = Deconstruct(Point=evalsrf.Point)  # -> XComponent, YComponent, ZComponent
sort_3 = SortList(Keys=pdecon_2.ZComponent, ValuesA=debrep_2.Faces)  # -> Keys, ValuesA
panel_5 = Panel("""-1
0""")

# ---- group: BUILD ID
# BUILD ID
# FACADE
dup = DuplicateData(Data=graft(read_3), Number=graft(round.Nearest), Order=True)  # -> simplify(Data)

# ---- group: TYPOLOGY
# TYPOLOGY
dup_2 = DuplicateData(Data=graft(read_2), Number=graft(round.Nearest), Order=True)  # -> simplify(Data)

# ----
# FLOOR PLATE CRVS
sec = BrepPlane(Brep=graft, Plane=xy)  # -> Curves, Points

# ---- group: all floorplates
boundary = BoundarySurfaces(Edges=sec.Curves)  # -> simplify(Surfaces)

# ----
utrim_6 = UberTrim(data=boundary)

# ---- group: sort by height to get tops
area = Area(Geometry=utrim_6)  # -> Area, Centroid
pdecon_3 = Deconstruct(Point=area.Centroid)  # -> XComponent, YComponent, ZComponent
sort_4 = SortList(Keys=pdecon_3.ZComponent, ValuesFloorplate=utrim_6, ValuesTypology=dup_2, ValuesBuildID=dup)  # -> reverse(Keys), reverse(ValuesFloorplate), reverse(ValuesTypology), reverse(ValuesSubBuildID), reverse(ValuesBuildID)
item_5 = ListItem(List=sort_4.ValuesFloorplate, Index=0, Wrap=True)

# ---- group: facade
cull_i = CullIndex(List=sort_3.ValuesA, Indices=panel_5, Wrap=True)  # -> simplify(List)

# ----
cull_i_2 = CullIndex(List=sort_4.ValuesFloorplate, Indices=0, Wrap=True)  # -> simplify(List)

# ---- group: usable space above floor
area_2 = Area(Geometry=item_5)  # -> Area, Centroid
Z = UnitZ(Factor=1)
graft_2 = GraftTree(Tree=read, IncludeEmptyLists=True, IncludeNullItems=True)
line = LineSDL(Start=area_2.Centroid, Direction=Z, Length=graft_2)

# ----
graft_3 = GraftTree(Tree=geometry_2, IncludeEmptyLists=True, IncludeNullItems=True)
bcx = BrepCurve(Brep=graft_3, Curve=line)  # -> Curves, simplify(Points)
null = NullItem(Item=bcx.Points)  # -> NullFlags, InvalidFlags, Description

# ---- group: Typology
item_6 = ListItem(List=sort_4.ValuesTypology, Index=0, Wrap=True)
cull_i_3 = CullIndex(List=sort_4.ValuesTypology, Indices=0, Wrap=True)  # -> simplify(List)
dispatch_2 = Dispatch(List=item_6, DispatchPattern=null.NullFlags)  # -> ListA, ListB
merge_2 = Merge(Data1=dispatch_2.ListA, Data2=cull_i_3)

# ---- group: SubBuildID
item_7 = ListItem(List=sort_4.ValuesSubBuildID, Index=0, Wrap=True)
cull_i_4 = CullIndex(List=sort_4.ValuesSubBuildID, Indices=0, Wrap=True)  # -> simplify(List)
dispatch_3 = Dispatch(List=item_7, DispatchPattern=null.NullFlags)  # -> ListA, ListB
merge_3 = Merge(Data1=dispatch_3.ListA, Data2=cull_i_4)

# ---- group: BuildID
item_8 = ListItem(List=sort_4.ValuesBuildID, Index=0, Wrap=True)
cull_i_5 = CullIndex(List=sort_4.ValuesBuildID, Indices=0, Wrap=True)  # -> simplify(List)
dispatch_4 = Dispatch(List=item_8, DispatchPattern=null.NullFlags)  # -> ListA, ListB
merge_4 = Merge(Data1=dispatch_4.ListA, Data2=cull_i_5)

# ----
dispatch_5 = Dispatch(List=item_5, DispatchPattern=null.NullFlags)  # -> ListA, ListB
merge_5 = Merge(Data1=dispatch_5.ListA, Data2=cull_i_2)
area_3 = Area(Geometry=merge_5)  # -> Area, Centroid
pdecon_4 = Deconstruct(Point=area_3.Centroid)  # -> XComponent, YComponent, ZComponent
sort_5 = SortList(
    Keys=pdecon_4.ZComponent,
    ValuesFloorPlate=merge_5,
    ValuesTypology=merge_2,
    ValuesSubBuildID=merge_3,
    ValuesBuildID=merge_4)  # -> Keys, ValuesFloorPlate, ValuesTypology, ValuesSubBuildID, ValuesBuildID

pt_2 = ConstructPoint(XCoordinate=0, YCoordinate=0, ZCoordinate=sort_5.Keys)
xy_2 = XYPlane(Origin=pt_2)
group = Group(Objects=xy_2)
geo = Geometry(cull_i)
long = LongestList(ListA=geo, ListB=group, PaddingMode=2)  # -> ListA, ListB
ungroup = Ungroup(Group=long.ListB)
sec_2 = BrepPlane(Brep=graft(long.ListA), Plane=ungroup)  # -> Curves, Points
shift = ShiftPaths(Data=sec_2.Curves, Offset=-1)  # -> simplify(Data)
srfsplit = SurfaceSplit(Surface=graft(long.ListA), Curves=shift)  # -> simplify(Fragments)

# ----
# CUT FACADE FLOORS
# EXPLODE FACADE FACES
facade = Data(srfsplit)
utrim_7 = UberTrim(data=facade)
area_4 = Area(Geometry=utrim_7)  # -> Area, Centroid
pdecon_5 = Deconstruct(Point=area_4.Centroid)  # -> XComponent, YComponent, ZComponent
lng_5 = ListLength(List=cull_i)
sort_6 = SortList(Keys=pdecon_5.ZComponent, ValuesA=utrim_7)  # -> Keys, ValuesA, ValuesC, ValuesD, ValuesE
partition = PartitionList(List=sort_6.ValuesA, Size=lng_5)
join_5 = BrepJoin(Breps=partition)  # -> Breps, Closed
utrim_8 = UberTrim(data=join_5.Breps)
panel_6 = Panel("""Typology
SubBuildID
BuildID""")
merge_6 = Merge(Data2=graft(sort_5.ValuesTypology), Data3=graft(sort_5.ValuesSubBuildID), Data4=graft(sort_5.ValuesBuildID))  # -> simplify(Result)
json = JSON(Key=panel_6, Value=merge_6)
utrim_9 = UberTrim(data=json)
utrim_10 = UberTrim(data=utrim_9)
utrim_11 = UberTrim(data=utrim_8)
facade_properties = Data(simplify(utrim_10))
facade_2 = Data(simplify(utrim_11))
facade_3 = ClusterOutput(facade_2)
facade_properties_2 = ClusterOutput(facade_properties)

merge_7 = Merge(
    Data1=graft(sort_5.Keys),
    Data2=graft(sort_5.ValuesTypology),
    Data3=graft(sort_5.ValuesSubBuildID),
    Data4=graft(sort_5.ValuesBuildID))  # -> simplify(Result)
panel_7 = Panel("""RL
Typology
SubBuildID
BuildID""")
json_2 = JSON(Key=panel_7, Value=merge_7)
utrim_12 = UberTrim(data=json_2)

# ----
# SUB MASS
panel_8 = Panel("""F2F
Typology
SubBuildID
BuildID""")
merge_8 = Merge(Data1=graft(read), Data2=graft(read_2), Data4=graft(read_3))
json_3 = JSON(Key=panel_8, Value=merge_8)
sub_mass = Geometry(simplify(geometry_2))
trim_2 = TrimTree(Tree=json_3, Depth=1)
sub_mass_2 = ClusterOutput(sub_mass)
sub_mass_properties = Data(simplify(trim_2))
sub_mass_properties_2 = ClusterOutput(sub_mass_properties)

utrim_13 = UberTrim(data=sort_5.ValuesFloorPlate)
utrim_14 = UberTrim(data=utrim_12)
floorplate_properties = Data(simplify(utrim_14))
floorplates = Data(simplify(utrim_13))
floorplate_properties_2 = ClusterOutput(floorplate_properties)
floorplates_2 = ClusterOutput(floorplates)

# ----
# ROOF
sunion = SolidUnion(Breps=geometry_2)
data = Data(read_3)
panel_9 = Panel("""BuildID
SubBuildID
Typology""")

debrep_3 = DeconstructBrep(Brep=sunion)  # -> Faces, Edges, Vertices
evalsrf_2 = EvaluateSurface(Surface=reparameterize(debrep_3.Faces), Point="0.5,0.5")  # -> Point, Normal, UDirection, VDirection, Frame
devec = DeconstructVector(Vector=evalsrf_2.Normal)  # -> XComponent, YComponent, ZComponent
equals = Equality(FirstNumber=devec.ZComponent, SecondNumber=Slider(1, range=0..1))  # -> Equality, Inequality
dispatch_6 = Dispatch(List=debrep_3.Faces, DispatchPattern=equals.Equality)  # -> ListA, ListB
utrim_15 = UberTrim(data=dispatch_6.ListA)

# ---- group: TEST POINT FROM ROOFTOP
number_slider_2 = Slider(0.1, range=0..0.1)
data_2 = Data(utrim_15)
Z_2 = UnitZ(Factor=Slider(0.5, range=0..1))
area_5 = Area(Geometry=data_2)  # -> Area, Centroid
neg = Negative(Value=Z_2)
move = Move(Geometry=area_5.Centroid, Motion=neg)  # -> graft(Geometry), Transform

# ---- group: DUPLICATE BREPS
group_2 = Group(Objects=geometry_2)
lng_6 = ListLength(List=area_5.Centroid)
dup_3 = DuplicateData(Data=group_2, Number=lng_6, Order=True)
ungroup_2 = Ungroup(Group=dup_3)  # -> simplify(Objects)

# ---- group: Sort rooftops per mass
brepinc = PointInBrep(Brep=ungroup_2, Point=move.Geometry, Strict=False)
dispatch_7 = Dispatch(List=ungroup_2, DispatchPattern=brepinc)  # -> ListA, ListB

# ----
# FULL MASS
panel_10 = Panel("BuildID")
cset_2 = CreateSet(List=data)  # -> Set, Map
json_4 = JSON(Key=panel_10, Value=cset_2.Set)
full_mass_properties = Data(simplify(json_4))
full_mass = Data(simplify(sunion))
full_mass_properties_2 = ClusterOutput(full_mass_properties)
full_mass_2 = ClusterOutput(full_mass)

geo_2 = Geometry(dispatch_7.ListA)
dispatch_8 = Dispatch(List=read, DispatchPattern=brepinc)  # -> ListA, ListB
dispatch_9 = Dispatch(List=read_2, DispatchPattern=brepinc)  # -> ListA, ListB
dispatch_10 = Dispatch(List=read_3, DispatchPattern=brepinc)  # -> ListA, ListB
merge_9 = Merge(
    Data1=simplify(graft(dispatch_10.ListA)),
    Data2=simplify(graft(dispatch_8.ListA)),
    Data3=simplify(graft(dispatch_9.ListA)))  # -> simplify(Result)
json_5 = JSON(Key=panel_9, Value=merge_9)
rooftops = Geometry(simplify(data_2))
rooftops_2 = ClusterOutput(rooftops)

utrim_16 = UberTrim(data=json_5)

roof_properties = Data(simplify(utrim_16))
roof_properties_2 = ClusterOutput(roof_properties)

# ==== cluster UberTrim: Better version of Trim
data = ClusterInput()
data_2 = Data(data)
trim = TrimTree(Tree=data_2, Depth=1)
null = NullItem(Item=trim)  # -> NullFlags, InvalidFlags, Description
bool = Boolean(invert(null.NullFlags))
trim_2 = TrimTree(Tree=data_2, Depth=bool)
data_3 = Data(trim_2)
data_4 = ClusterOutput(data_3)
