# Grasshopper definition ViewAnalysis.gh (Grasshopper 1.0.7)
# plug-ins: MeshEdit Components, treesloth01, Redback, Human, EleFront, Weaverbird, Kangaroo2 Components

input = DataInput(Destination="C:\Users\p-tmorgan\Documents\ViewAnalysis\Hackaton Multiple Mass.ghdata")  # -> flatten(Floorplate_Properties), Floorplates, Full_Mass, Facade, Rooftops
input_2 = DataInput(Destination="C:\Users\p-tmorgan\Documents\ViewAnalysis\Hackaton Multiple Mass.ghdata")  # -> flatten(Floorplate_Properties), Floorplates, Full_Mass, Facade, Rooftops; disabled
brep = Brep(flatten(input.Facade))
brep_2 = Brep(input_2.Facade)  # disabled
edges = BrepEdges(Brep=brep_2)  # -> Naked, Interior, NonManifold; disabled
join = JoinCurves(Curves=edges.Naked, Preserve=False)  # disabled
item = ListItem(List=join, Index=0, Wrap=True)  # -> Item, Item1; disabled
explode = Explode(Curve=item.Item, Recursive=True)  # -> Segments, Vertices; disabled
explode_2 = Explode(Curve=item.Item1, Recursive=True)  # -> Segments, Vertices; disabled
eval = EvaluateLength(Curve=explode.Segments, Length=0.5, Normalized=True)  # -> Point, Tangent, Parameter; disabled
eval_2 = EvaluateLength(Curve=explode_2.Segments, Length=0.5, Normalized=True)  # -> Point, Tangent, Parameter; disabled
cp = ClosestPoint(Point=eval.Point, Cloud=eval_2.Point)  # -> ClosestPoint, CPIndex, Distance; disabled
edges_2 = BrepEdges(Brep=brep)  # -> Naked, Interior, NonManifold
item_2 = ListItem(List=explode_2.Segments, Index=cp.CPIndex, Wrap=True)  # disabled
crv = Curve(explode.Segments)  # disabled
join_2 = JoinCurves(Curves=edges_2.Naked, Preserve=False)
graft = GraftTree(Tree=item_2, IncludeEmptyLists=True, IncludeNullItems=True)  # disabled
graft_2 = GraftTree(Tree=crv, IncludeEmptyLists=True, IncludeNullItems=True)  # disabled
item_3 = ListItem(List=join_2, Index=0, Wrap=True)
merge = Merge(Data1=graft_2, Data2=graft)  # disabled
clockcrv = ClockwiseCurve(crv=join_2)
number_slider = Slider(4, range=0..10)  # disabled
len = Length(Curve=merge)  # disabled
crv_2 = Curve(clockcrv)
crv_3 = Curve(crv_2)
division = Division(A=len, B=number_slider)  # disabled
item_4 = ListItem(List=crv_2, Index=0, Wrap=True)  # -> Item, Item1
avr = Average(Input=division)  # disabled
explode_3 = Explode(Curve=item_4.Item, Recursive=True)  # -> Segments, Vertices
explode_4 = Explode(Curve=item_4.Item1, Recursive=True)  # -> Segments, Vertices
int = Integer(avr)  # disabled
dispatch = Dispatch(List=crv_2, DispatchPattern=[True, False])  # -> ListA, ListB
eval_3 = EvaluateLength(Curve=explode_3.Segments, Length=0.5, Normalized=True)  # -> Point, Tangent, Parameter
eval_4 = EvaluateLength(Curve=explode_4.Segments, Length=0.5, Normalized=True)  # -> Point, Tangent, Parameter
divide = DivideCurve(Curve=merge, Count=int, Kinks=False)  # -> simplify(Points), Tangents, Parameters; disabled
flip = FlipCurve(Curve=dispatch.ListB)  # -> Curve, Flag
series = Series(Start=0, Step=1, Count=expr("x+1", int))  # disabled
cp_2 = ClosestPoint(Point=eval_3.Point, Cloud=eval_4.Point)  # -> ClosestPoint, CPIndex, Distance
eval_5 = EvaluateCurve(Curve=crv_2, Parameter="0.5")  # -> Point, Tangent, Angle
weave = Weave(Pattern=[0, 1], Stream0=flip.Curve, Stream1=dispatch.ListA, NullGaps=False)
explode_5 = Explode(Curve=weave, Recursive=True)  # -> Segments, Vertices
shift = ShiftPaths(Data=divide.Points, Offset=-1)  # -> simplify(Data); disabled
flip_last = FlipLast(Data=explode_5.Segments)
pdecon = Deconstruct(Point=eval_5.Point)  # -> XComponent, YComponent, ZComponent
shift_2 = ShiftList(List=series, Shift=1, Wrap=False)  # -> simplify(List); disabled
shift_3 = ShiftList(List=series, Shift=-1, Wrap=False)  # -> simplify(List); disabled
item_5 = ListItem(List=explode_4.Segments, Index=cp_2.CPIndex, Wrap=True)
expression = Expression(x=shift_2, y=int, Expression="x+y+1")  # disabled
expression_2 = Expression(x=shift_3, y=int, Expression="x+y+1")  # disabled
crv_4 = Curve(explode_3.Segments)
sort = SortList(Keys=pdecon.ZComponent, ValuesA=crv_2)  # -> Keys, ValuesA
graft_3 = GraftTree(Tree=item_5, IncludeEmptyLists=True, IncludeNullItems=True)
graft_4 = GraftTree(Tree=crv_4, IncludeEmptyLists=True, IncludeNullItems=True)
quad = MeshQuad(CornerA=shift_3, CornerB=shift_2, CornerC=expression, CornerD=expression_2)  # -> simplify(Face); disabled
merge_2 = Merge(Data1=graft_4, Data2=graft_3)
len_2 = Length(Curve=merge_2)
division_2 = Division(A=len_2, B=Slider(4, range=0..10))
avr_2 = Average(Input=division_2)
int_2 = Integer(avr_2)
conmesh = ConstructMesh(Vertices=shift, Faces=quad)  # disabled
divide_2 = DivideCurve(Curve=merge_2, Count=int_2, Kinks=False)  # -> simplify(Points), Tangents, Parameters
series_2 = Series(Start=0, Step=1, Count=expr("x+1", int_2))
item_6 = ListItem(List=merge_2, Index=0, Wrap=True)
wbstellate = WeaverbirdsStellateCumulation(MeshPolylines=conmesh, Distance=0)  # disabled
shift_4 = ShiftList(List=series_2, Shift=1, Wrap=False)  # -> simplify(List)
shift_5 = ShiftList(List=series_2, Shift=-1, Wrap=False)  # -> simplify(List)
item_7 = ListItem(List=flatten(wbstellate), Index=0, Wrap=True)  # disabled
demesh = DeconstructMesh(Mesh=item_7)  # -> Vertices, Faces, Colours, Normals; disabled
expression_3 = Expression(x=shift_4, y=int_2, Expression="x+y+1")
expression_4 = Expression(x=shift_5, y=int_2, Expression="x+y+1")
wheel = ColourWheel(
    demesh.Vertices,
    ColourGrips_Style=31,
    ColourGrips_Grip=[0.4268228698, 2.521217972, 4.615613075, 3.141592654],
    ColourGrips_Lum=[0.570755349, 0.5603316288],
    ColourGrips_Range=[1.032255284, 1.032255284, 1.032255284, 1.032255284],
    ColourGrips_Sat=[0.8452843022, 1])  # disabled
panel = Panel("{1}[1]")
panel_2 = Panel("{1}[0]")
panel_3 = Panel("{0}[1]")
divide_3 = DivideCurve(Curve=item_6, Count=int_2, Kinks=False)  # -> simplify(Points), Tangents, Parameters
mcol = MeshColours(Mesh=item_7, Colours=wheel)  # disabled
item_8 = ListItem(List=sort.ValuesA, Index=0, Wrap=True)
trim = TrimTree(Tree=item_8, Depth=2)
shift_6 = ShiftPaths(Data=divide_2.Points, Offset=-1)  # -> simplify(Data)
quad_2 = MeshQuad(CornerA=shift_5, CornerB=shift_4, CornerC=expression_3, CornerD=expression_4)  # -> simplify(Face)
conmesh_2 = ConstructMesh(Vertices=shift_6, Faces=quad_2)
trim_2 = TrimTree(Tree=conmesh_2, Depth=1)
area = MeshArea(Mesh=trim_2)  # -> Area, Centroid
meshcp = MeshClosestPoint(Point=area.Centroid, Mesh=trim_2)  # -> Point, Index, Parameter
meval = MeshEval(Mesh=trim_2, Parameter=meshcp.Parameter)  # -> Point, Normal, Colour
line = LineSDL(Start=meshcp.Point, Direction=meval.Normal, Length=Slider(200, range=0..1000))
end = EndPoints(Curve=line)  # -> Start, End
area_2 = Area(Geometry=item_8)  # -> Area, Centroid
pt = Point(end.End)
dist = Distance(PointA=pt, PointB=area_2.Centroid)
expression_5 = Expression(x=dist, y=Slider(200, range=0..1000), Expression="x<y")
dispatch_2 = Dispatch(List=trim_2, DispatchPattern=expression_5)  # -> ListA, ListB
demesh_2 = DeconstructMesh(Mesh=dispatch_2.ListB)  # -> Vertices, Faces, Colours, Normals
deface = DeconstructFace(Face=demesh_2.Faces)  # -> CornerA, CornerB, CornerC, CornerD
quad_3 = MeshQuad(CornerA=deface.CornerD, CornerB=deface.CornerC, CornerC=deface.CornerB, CornerD=deface.CornerA)
conmesh_3 = ConstructMesh(Vertices=demesh_2.Vertices, Faces=quad_3)
trim_3 = TrimTree(Tree=conmesh_3, Depth=1)
weave_2 = Weave(Pattern=expression_5, Stream0=trim_3, Stream1=dispatch_2.ListA, NullGaps=False)
mesh = Mesh(weave_2)
explode_6 = MeshExplode(Mesh=mesh, Interpolate=False)
facen = FaceNormals(Mesh=explode_6)  # -> Centers, Normals
subtraction = Subtraction(A=Slider(135, range=0..1000), B=Slider(0, range=0..10))
dom = ConstructDomain(DomainStart=Slider(45, range=0..100), DomainEnd=subtraction)
range = Range(Domain=dom, Steps=10)
Z = UnitZ(Factor=1)
rad = Radians(Degrees=range)
xprod = CrossProduct(VectorA=Z, VectorB=facen.Normals, Unitize=False)  # -> Vector, Length
vrot = Rotate(Vector=graft(xprod.Vector), Axis=Z, Angle=rad)  # -> simplify(Vector)
vdis = VectorDisplay(Anchor=graft(facen.Centers), Vector=vrot)
dpipeline = DynamicGeometryPipeline(
    LayerFilter="Context",
    TypeFilter="All",
    NameFilter="*",
    GroupByLayer=False,
    GroupByType=False,
    IncludeHidden=True,
    IncludeLocked=True,
    enableFullPath=True,
    listenToAttributes=True)
dpipeline_2 = DynamicGeometryPipeline(
    LayerFilter="POI",
    TypeFilter="All",
    NameFilter="*",
    GroupByLayer=False,
    GroupByType=False,
    IncludeHidden=True,
    IncludeLocked=True,
    enableFullPath=True,
    listenToAttributes=True)
mesh_2 = Mesh(dpipeline)
mesh_3 = Mesh(dpipeline_2)
mjoin = MeshJoin(Meshes=mesh_2)
mjoin_2 = MeshJoin(Meshes=mesh_3)
clean = CombineClean(Meshes=flatten(mesh))
merge_3 = Merge(Data1=clean, Data2=mjoin)
meshray = MeshRay(Mesh=mjoin_2, Point=graft(facen.Centers), Direction=vrot)  # -> Point, Hit
meshray_2 = MeshRay(Mesh=merge_3, Point=graft(facen.Centers), Direction=vrot)  # -> Point, Hit
lng = ListLength(List=rad)
ma = MassAddition(Input=simplify(meshray_2.Hit))  # -> Result, PartialResults
ma_2 = MassAddition(Input=simplify(meshray.Hit))  # -> Result, PartialResults
subtraction_2 = Subtraction(A=lng, B=ma.Result)
multiplication = Multiplication(A=ma_2.Result, B=Slider(0.18, range=0..10))
max = Maximum(A=multiplication, B=Slider(1, range=0..1))
multiplication_2 = Multiplication(A=subtraction_2, B=max)
python = GhPythonScript(x=input.Floorplate_Properties)  # -> out, a
# ---------- python: Python ----------
__author__ = "p-tmorgan"
__version__ = "2018.10.25"

import rhinoscriptsyntax as rs
import json

a = json.loads(x)
# ---------- end python ----------
bnd = Bounds(Numbers=flatten(multiplication_2))
remap = RemapNumbers(Value=multiplication_2, Source=bnd, Target=Domain(0, 1))  # -> Mapped, Clipped
trim_4 = TrimTree(Tree=remap.Mapped, Depth=2)
avr_3 = Average(Input=trim_4)  # -> flatten(ArithmeticMean)
dup = DuplicateDataMatch(SourceDataTree=python.a, SecondaryData1="AverageView")  # -> SourceData, SecondaryData1
dedomain = DeconstructDomain(Domain=bnd)  # -> Start, End
read = ReadJSON(Object=input.Floorplate_Properties, Key=flatten(python.a))
item_9 = ListItem(List=dup.SecondaryData1, Index=0, Wrap=True)
gradient = Gradient(
    LowerLimit=0,
    UpperLimit=dedomain.End,
    Parameter=multiplication_2,
    stops=[0: RGB(234, 38, 0), 0.25: RGB(234, 126, 0), 0.5: RGB(254, 244, 84), 0.75: RGB(173, 203, 249), 1: RGB(75, 107, 169)])
graph = QuickGraph(avr_3, SortOrder=0)
lng_2 = ListLength(List=python.a)  # -> flatten(Length)
merge_4 = Merge(Data1=python.a, Data2=item_9)
partition = PartitionList(List=read, Size=lng_2)
mcol_2 = MeshColours(Mesh=simplify(graft(explode_6)), Colours=gradient)
merge_5 = Merge(Data1=simplify(partition), Data2=simplify(graft(avr_3)))
preview = CustomPreview(Geometry=simplify(graft(explode_6)), Material=gradient)
trim_5 = TrimTree(Tree=mcol_2, Depth=2)
json = JSON(Key=merge_4, Value=merge_5)
output = DataOutput(
    Floorplate_Properties=json,
    Floorplates=input.Floorplates,
    Full_Mass=input.Full_Mass,
    Facade=input.Facade,
    Rooftops=input.Rooftops,
    Analysis_Mesh=trim_5,
    Destination="C:\Users\p-tmorgan\Documents\ViewAnalysis\Hackathon View Analysis.ghdata")
panel_4 = Panel(json)

# ==== cluster ClockwiseCurve: Reorders controlpoints of curve to clockwise
crv = ClusterInput()
crv_2 = Curve(crv)
cp = ControlPoints(Curve=crv_2)  # -> simplify(Points), Weights, Knots
shift = ShiftList(List=cp.Points, Shift=1, Wrap=True)
pdecon = Deconstruct(Point=cp.Points)  # -> XComponent, YComponent, ZComponent
pdecon_2 = Deconstruct(Point=shift)  # -> XComponent, YComponent, ZComponent
expression = Expression(x=pdecon.XComponent, y=pdecon_2.XComponent, z=pdecon.YComponent, u=pdecon_2.YComponent, Expression="(y-x)*(u+z)")
ma = MassAddition(Input=expression)  # -> Result, PartialResults
larger = LargerThan(FirstNumber=ma.Result, SecondNumber=0)  # -> simplify(LargerThan), OrEqualTo
dispatch = Dispatch(List=simplify(graft(crv_2)), DispatchPattern=larger.LargerThan)  # -> ListA, ListB
flip = FlipCurve(Curve=dispatch.ListB)  # -> Curve, Flag
merge = Merge(Data1=dispatch.ListA, Data2=flip.Curve)  # -> simplify(flatten(Result))
unflatten = UnflattenTree(Tree=merge, Guide=crv_2)
crv_3 = Curve(unflatten)
crv_4 = ClusterOutput(crv_3)
